# Grasshopper definition quad_from_brep.ghx (Grasshopper 1.0.7)

reload = Button()
py = PythonScript(reload=reload)
# ---------- py: Python ----------
from compas_rhino.utilities.misc import get_tolerance
from compas_rhino.utilities.misc import unload_modules

from compas_ghpython import unload_modules

unload_modules("compas")
unload_modules("compas_fab")
unload_modules("roslibpy")
unload_modules("fabrication_control")
unload_modules("assembly_information_model")
unload_modules("am_information_model")
unload_modules("ur_fabrication_control")
unload_modules("workshop_aaec_revamp")
unload_modules("add_on_am")
unload_modules("mobile_part_based_am")
# ---------- end py ----------
py_2 = PythonScript()  # -> HERE, DATA
# ---------- py_2: Python ----------
import os

HERE = os.path.dirname(ghdoc.Path)
DATA = os.path.abspath(os.path.join(HERE, "..", "data"))

#print(HERE)
print(DATA)
# ---------- end py_2 ----------

panel = Panel("""0.011
0.015345
0.006176
0.011328
0.012437""")

number_slider = Slider(2, range=0..10)
number_slider_2 = Slider(5, range=0..10)

crvs = GhPythonScript(
    width=number_slider_2,
    height=number_slider,
    up_a=Slider(0.1, range=0.1..0.3),
    up_f=Slider(1.15, range=0.6..1.2),
    up_ro=Slider(0.93, range=0..1),
    down_a=Slider(0.49, range=0.3..0.6),
    down_f=Slider(0.59, range=0.4..0.6),
    down_ro=Slider(0.73, range=0..1))  # -> base, base_crv, top, top_crv
# ---------- crvs: Python ----------
__author__ = "timda"
__version__ = "2023.07.15"

import rhinoscriptsyntax as rs
import math
from Rhino.Geometry import Point3d, Vector3d, Curve
from Rhino.Collections import Point3dList

class CrvParams:
    def __init__(self, amp, freq, ro):
        self.amp = amp
        self.freq = freq
        self.ro = ro*math.pi
    def crv(self, width, height):
        points = []
        iterator = [i*0.1 for i in range(int(width/0.1 +1.999))]
        for x in iterator:
            points.append(Point3d(x, -self.amp*math.sin(2.0 * math.pi * self.freq*x + self.ro), height))
        
        points = Point3dList(points)
        start_tangent = Vector3d(iterator[0], self.amp * 2.0 * math.pi * self.freq * math.cos(2.0 * math.pi * self.freq*iterator[0] + self.ro), 0)
        end_tangent = Vector3d(iterator[0], self.amp * 2.0 * math.pi * self.freq * math.cos(2.0 * math.pi * self.freq*iterator[-1] + self.ro), 0)
        self.curve = Curve.CreateInterpolatedCurve(points, 3)
        return self.curve


base = CrvParams(down_a, down_f, down_ro)
base_crv = base.crv(width, 0)
top = CrvParams(up_a, up_f, up_ro)
top_crv = top.crv(width, height)
# ---------- end crvs ----------

crv = Curve(crvs.base_crv)
crv_2 = Curve(crvs.top_crv)
rulesrf = RuledSurface(CurveA=crv, CurveB=crv_2)

number_slider_3 = Slider(0.006, range=0..0.5)
brep = Brep(rulesrf)
brep_to_mesh = GhPythonScript(
    brep=brep,
    w=number_slider_2,
    h=number_slider,
    elsize=number_slider_3,
    max_size=number_slider_3,
    min_size=number_slider_3,
    base=crvs.base,
    top=crvs.top)  # -> rmesh, wall; inputs brep: Brep
# ---------- brep_to_mesh: Python ----------
__author__ = "timda"
__version__ = "2023.07.14"

import rhinoscriptsyntax as rs
from compas_ghpython.artists import MeshArtist
from add_on_am import NewWall

wall = NewWall(w, h, elsize)
wall.undulate(top, base)
mesh = wall.from_brep(brep, max_size, min_size)
mesh_art = MeshArtist(mesh)
rmesh = mesh_art.draw_mesh()

wall
# ---------- end brep_to_mesh ----------
swatch = ColourSwatch(SwatchColor=RGB(82, 82, 82))  # disabled
mcol = MeshColours(Mesh=brep_to_mesh.rmesh, Colours=swatch)  # disabled

python = GhPythonScript(wall=brep_to_mesh.wall, size=number_slider_3)  # -> max_d, min_d, mean_d, median_d, abs_err, max_err, min_err, per_abs, per_max, per_min
# ---------- python: Python ----------
__author__ = "timda"
__version__ = "2023.08.04"

import rhinoscriptsyntax as rs
from statistics import mean, median, stdev


def erro_mean(lst):
    st = stdev(lst)
    n = len(lst)
    return st/pow(n, 0.5)

def mean_abs_error(lst, desired):
    return sum([abs(desired - k) for k in lst])/len(lst)


per_abs, per_max, per_min, d = wall.distances(size)

max_d = max(d)
min_d = min(d)
mean_d = mean(d)
median_d = median(d)
#
#
#abs_err = mean_abs_error(d, size)
#
#max_err = abs(max_d-size)
#min_err = abs(min_d-size)
#
#per_abs = 100*abs_err / size
#per_max = 100*max_err / size
#per_min = 100*min_err / size
# ---------- end python ----------
panel_2 = Panel([python.max_d, python.min_d, python.mean_d, python.median_d])
panel_3 = Panel([python.abs_err, python.max_err, python.min_err])
panel_4 = Panel([python.per_abs, python.per_max, python.per_min])
demesh = DeconstructMesh(Mesh=mcol)  # -> Vertices, Faces, Colours, Normals; disabled

number_slider_4 = Slider(0.02, range=0..0.1)  # disabled
swatch_2 = ColourSwatch(SwatchColor=RGB(255, 0, 0))  # disabled
dots = DotDisplay(Point=demesh.Vertices, Colour=swatch_2, Size=number_slider_4)  # disabled
