# Grasshopper definition 01_mobile_robot_moveit_simulation_direct_control.ghx (Grasshopper 1.0.7)

mesh = Mesh(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)

# ----
# Robot Model
reload = Button()
panel = Panel("Unload libraries")
py = PythonScript(reload=reload)
# ---------- py: Python ----------
from compas_ghpython import unload_modules

if reload:
    unload_modules("roslibpy")
    unload_modules("fabrication_manager")
    unload_modules("assembly_information_model")
    unload_modules("am_information_model")
    unload_modules("ur_fabrication_control")
    unload_modules("mobile_robot_control")
    unload_modules("extruder_control")
    unload_modules("mobile_part_based_am")
# ---------- end py ----------

pt = Point(Point(1.4, 0.8938926261, 0))
mesh_2 = Mesh(mesh)
line = Line([Line((1.107827653, -0.1367265176, 0.2248912162), (1.139959676, -0.1063575375, 0.2248826637)), Line((1.13996004, -0.1130401864, 0.1748824696), (1.171631484, -0.0808564138, 0.1748761113)), Line((1.139959676, -0.1063575375, 0.2248826637), (1.13996004, -0.1130401864, 0.1748824696)), Line((1.171631754, -0.0856911824, 0.124876432), (1.203127196, -0.05142167635, 0.1248722018)), Line((1.171631484, -0.0808564138, 0.1748761113), (1.171631754, -0.0856911824, 0.124876432)), Line((1.171631197, -0.07602158818, 0.2248762015), (1.203126844, -0.04557726035, 0.2248717818))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])
pln = Plane([Plane(origin=(1.107827653, -0.1367265176, 0.2248912162), x=(-0.7294046801, -0.6840824604, 0), y=(0.083692719, -0.08923757656, -0.9924878759)), Plane(origin=(1.139959676, -0.1063575375, 0.2248826637), x=(-0.7241251205, -0.6896686232, 0), y=(0.06643640668, -0.06975563246, -0.9953493636)), Plane(origin=(1.13996004, -0.1130401864, 0.1748824696), x=(-0.703810395, -0.7103878715, 0), y=(0.06652950495, -0.06591350871, -0.995604959)), Plane(origin=(1.171631484, -0.0808564138, 0.1748761113), x=(-0.6990909065, -0.7150327995, 0), y=(0.04822577407, -0.04715056446, -0.997722957)), Plane(origin=(1.171631754, -0.0856911824, 0.124876432), x=(-0.6785376062, -0.7345656656, 0), y=(0.04809293795, -0.04442471043, -0.9978544555)), Plane(origin=(1.203127196, -0.05142167635, 0.1248722018), x=(-0.6749066961, -0.7379030773, 0), y=(0.02908365001, -0.02660071593, -0.9992229697))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])
pt_2 = Point([Point(1.107827653, -0.1367265176, 0.2248912162), Point(1.139959676, -0.1063575375, 0.2248826637), Point(1.13996004, -0.1130401864, 0.1748824696), Point(1.171631484, -0.0808564138, 0.1748761113), Point(1.171631754, -0.0856911824, 0.124876432), Point(1.203127196, -0.05142167635, 0.1248722018)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])
crv = Curve(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)
crv_2 = Curve(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)

# ----
# ROS client
panel_2 = Panel("9090")
list = ValueList({"local": "127.0.0.1", "linux computer": "192.168.0.42", "linux eduroam": "10.181.95.254", "linux vmware": "192.168.199.36", "robot": "192.168.0.200", "robotAA_wifi": "192.168.0.111", "robotAB_wifi": "192.168.0.112", "robotAB_eduroam": "10.181.67.95"}, selected="local")
connect = BooleanToggle(True)
ros = ROSConnect(ip=list, port=panel_2, connect=connect)  # -> ros_client, is_connected; inputs port: Int32, connect: Boolean
#   port ip: The ip address ROS. Defaults to 127.0.0.1.
#   port port: The port of ROS. Defaults to 9090.
#   port connect: If True, connects to ROS. If False, disconnects from ROS. Defaults to False.
#   port ros_client: The ROS client.
#   port is_connected: True if connection established.
# ---------- ros: Python ----------
"""
Connect or disconnect to ROS.

COMPAS FAB v0.27.0
"""
from ghpythonlib.componentbase import executingcomponent as component
from scriptcontext import sticky as st

from compas_fab.backends import RosClient
from compas_fab.ghpython.components import create_id


class ROSConnect(component):
    def RunScript(self, ip, port, connect):
        ros_client = None

        ip = ip or '127.0.0.1'
        port = port or 9090

        key = create_id(self, 'ros_client')
        ros_client = st.get(key, None)

        if ros_client:
            st[key].close()
        if connect:
            st[key] = RosClient(ip, port)
            st[key].run(5)

        ros_client = st.get(key, None)
        is_connected = ros_client.is_connected if ros_client else False
        return (ros_client, is_connected)
# ---------- end ros ----------
panel_3 = Panel(ros.is_connected)

# ----
# IP Settings
# --> Set your IP address
# --> Set robot IP address
server_ip = ValueList({"192.168.10.44", "192.168.10.12", "192.168.10.11", "192.168.10.10", "192.168.10.2", "127.0.0.1", "192.168.10.111", "192.168.0.250", "192.168.0.30", "10.42.0.212", "10.42.0.133"}, selected="192.168.0.250")
server_port = ValueList({"50002", "50003", "50005", "50006", "50007", "50008", "50009", "50010", "50011", "50012", "50013", "50014", "50015", "50016", "50017", "50018", "50019", "50020", "50021", "50022", "50023", "50024", "50025", "50026", "50027", "50028"}, selected="50013")
ur_ip = ValueList({"192.168.10.10", "192.168.10.20", "192.168.10.11", "192.168.10.12", "127.0.0.1", "192.168.10.111", "192.168.0.210", "192.168.0.211", "192.168.0.30"}, selected="192.168.0.210")
ur_port = ValueList({"30002"}, selected="30002")
globals = PythonScript(server_ip=server_ip, server_port=server_port, ur_ip=ur_ip, ur_port=ur_port, clear=Button())  # inputs server_port: Int32
# ---------- globals: Python ----------
from scriptcontext import sticky as st

st["server_ip"] = server_ip
st["server_port"] = server_port

st["ur_ip"] = ur_ip
st["ur_port"] = ur_port


if clear:
    st.clear()
# ---------- end globals ----------

# ----
# Check if UR robot
#  is available
ping = Button()
py_2 = PythonScript(ip=ur_ip, ping=ping)  # -> out, trigger
# ---------- py_2: Python ----------
from scriptcontext import sticky as st
from ur_fabrication_control.direct_control.utilities import is_available

guid = str(ghenv.Component.InstanceGuid)
txt_key = "txt_" + guid
if txt_key not in st:
    st[txt_key] = ""

if ping:
    
    available = is_available(ip)
    
    if available:
        st[txt_key] = "%s is up!" % ip
        trigger = True
    else:
        st[txt_key] = "%s is down!" % ip
        trigger = False

print(st[txt_key])
# ---------- end py_2 ----------
panel_4 = Panel(py_2.out)

# ----
# Load robot from ROS
# Load robot from ROS
load = Button()
robot = ROSRobot(ros_client=ros.ros_client, load=load)  # -> mobile_robot; inputs load: Boolean
#   port ros_client: The ROS client.
#   port load: If True, loads the robot from ROS. Defaults to False.
# ---------- robot: Python ----------
"""
Load robot directly from ROS.

COMPAS FAB v0.27.0
"""
from mobile_robot_control.mobile_robot import MobileRobot
from mobile_robot_control.mobile_robot_client import MobileRobotClient

from compas_ghpython.artists import RobotModelArtist
from ghpythonlib.componentbase import executingcomponent as component
from scriptcontext import sticky as st

from compas_fab.ghpython.components import create_id


class ROSRobot(component):
    def RunScript(self, ros_client, prefix, load):
        key = create_id(self, 'robot')

        if ros_client and ros_client.is_connected and load:
            # Load URDF from ROS
            robot = ros_client.load_robot(
                    load_geometry=True, 
                    urdf_param_name= '{}/robot_description'.format(prefix),
                    srdf_param_name= '{}/robot_description_semantic'.format(prefix),
                    precision='12f')
            robot.artist = RobotModelArtist(robot.model)
            mobile_robot = MobileRobot(robot.model, robot.artist, robot.semantics, client=None)
            st[key] = mobile_robot

        mobile_robot = st.get(key, None)
        if mobile_robot:  # client sometimes need to be restarted, without needing to reload geometry
            mobile_robot.mobile_client = MobileRobotClient(ros_client)
            mobile_robot.client = ros_client
        return mobile_robot
# ---------- end robot ----------

set_to_origin = BooleanToggle(True)

list_2 = ValueList({"20", "50", "100", "500", "1000", "5000"}, selected="20")
back = Button()
reset = Button()
start = Button()
stop = Button()
step = Button()
full = Button()

robot_2 = Data(robot)
info = PythonScript(robot=robot_2)  # -> out, main_group_name
# ---------- info: Python ----------
if robot:
    robot.info()
    main_group_name = robot.main_group_name
# ---------- end info ----------
panel_5 = Panel(info.out)

# ----
# Planning scene
scene = PlanningScene(robot=robot_2)  # -> scene
#   port scene: A planning scene.
# ---------- scene: Python ----------
"""
Create a planning scene.

COMPAS FAB v0.27.0
"""
from ghpythonlib.componentbase import executingcomponent as component
from scriptcontext import sticky as st

from compas_fab.ghpython.components import create_id
from compas_fab.robots import PlanningScene


class PlanningSceneComponent(component):
    def RunScript(self, robot):
        key = create_id(self, 'planning_scene')
        if robot:
            st[key] = PlanningScene(robot)
        return st.get(key, None)
# ---------- end scene ----------

# ----
# Attach tool
list_3 = ValueList({"measurement_tool": 0, "earth_extruder_v1": 1, "earth_extruder_v1_10mm_15deg": 3}, selected="earth_extruder_v1")
show = BooleanToggle(True)
py_3 = PythonScript()  # -> DATA
# ---------- py_3: Python ----------
import os

#package_path = os.path.dirname(mobile_fabrication_control.__file__)
#DATA = os.path.abspath(os.path.join(package_path,"../../data"))

package_path = ghdoc.Path
# package_path = os.path.dirname(ur_fabrication_control.__file__)
#DATA = os.path.abspath(os.path.join(package_path,"../../data"))

# .stl files not stored in am_hackathon repo. but in mobile_fabrication_control
DATA = os.path.abspath(os.path.join(package_path,"../../../../../mobile_part_based_am/data"))

print(package_path)
print(DATA)
# ---------- end py_3 ----------
tool = PythonScript(data_path=py_3, tool=list_3, show=show)  # -> tool, M, ee_plane
# ---------- tool: Python ----------
import os, math
from compas.geometry import Frame, Rotation, Vector
from compas.datastructures import Mesh
from compas_ghpython.artists import MeshArtist
from compas_fab.robots import Tool
from compas_ghpython.utilities import draw_frame

tolerance = 0

if tool == 0:
    filename = 'measurement_tool.stl'
    ee_frame = Frame([0, 0, 0.109], [1, 0, 0], [0, 1, 0])

elif tool == 1:
    filename = 'earth_extruder_v1.stl'
    ee_frame = Frame([0.0, -0.419208, 0.131956,], [1, 0, 0], [0, 0, 1])
    
elif tool == 3:
    filename = 'earth_extruder_v1_10mm_15deg.stl'
    vec = Vector.from_start_end([6.09775e-10,-0.418261,0.121892], [6.09777e-10,-0.419581,0.126818])
    ee_frame = Frame([6.09775e-10,-0.418261,0.121892], [1, 0, 0], vec)

data_path = os.path.join(data_path, "tool_geometry")
fullfilename = os.path.join(data_path, filename)
print fullfilename

ee_mesh = Mesh.from_stl(fullfilename)

if show:
    artist = MeshArtist(ee_mesh)
    M = artist.draw()

tool = Tool(ee_mesh, ee_frame)
#ee_plane = draw_frame(ee_frame)
#print(ee_frame.quaternion.xyzw)
#ee_framek = Frame([0.0110607,0.00809854,0.41498], [0,1,0], [1,0,0])
#print(ee_framek.quaternion.xyzw)
# ---------- end tool ----------
panel_6 = Panel("Attach a custom tool")
remove = Button()
add = Button()
attach_remove = PythonScript(robot=robot_2, tool=tool.tool, attach=add, remove=remove)  # -> out, bang
# ---------- attach_remove: Python ----------
if attach:
    robot.attach_tool(tool)
if remove:
    robot.detach_tool()
# ---------- end attach_remove ----------

# ----
# Move mobile robot base
base_origin = Point(Point(-0.001141447913, -1.19564634, 0))
angle = Slider(90, range=0..360)
base_plane = GhPythonScript(origin=base_origin, angle=angle)  # -> base_plane; inputs origin: Point3d
# ---------- base_plane: Python ----------
import Rhino.Geometry as rg
import math

base_plane = rg.Plane(origin, rg.Vector3d.XAxis, rg.Vector3d.YAxis)
base_plane.Rotate(math.radians(angle), rg.Vector3d.ZAxis)
# ---------- end base_plane ----------
set_base_frame = PythonScript(robot=robot_2, set_to_origin=set_to_origin, base_plane=base_plane)  # -> bang
# ---------- set_base_frame: Python ----------
from compas_ghpython import draw_frame
from compas.geometry import Frame, Point, Vector, Transformation
from compas.datastructures import Mesh
from compas_rhino.geometry import RhinoMesh
from compas_fab.robots import CollisionMesh

if set_to_origin:
    base_frame = Frame.worldXY()
else:
    base_frame = Frame(base_plane.Origin, base_plane.XAxis, base_plane.YAxis)


# Base_frame is BCF in WCF
if robot:
    robot.BCF = base_frame
    print(robot.BCF)
# ---------- end set_base_frame ----------

# ----
# Attach to scene
add_2 = Button()
remove_2 = Button()
mesh_3 = Mesh(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)
cm = CollisionMesh(scene=scene, mesh=mesh_3, identifier="scene_elem", add=add_2, append=set_base_frame, remove=remove_2)  # -> ok, bang; inputs mesh: Mesh, add: Boolean, append: Boolean, remove: Boolean
#   port scene: The planning scene.
#   port mesh: A collision mesh.
#   port identifier: The identifier of the collision mesh.
#   port add: If True, adds the collision mesh to the planning scene.
#   port append: If True, appends the collision mesh to the planning scene.
#   port remove: If True, removes the collision mesh from the planning scene.
#   port ok: True if the operation was successfully performed.
# ---------- cm: Python ----------
"""
Add or remove a collision mesh from the planning scene.

COMPAS FAB v0.27.0
"""
from compas_rhino.geometry import RhinoMesh
from ghpythonlib.componentbase import executingcomponent as component

from compas_fab.robots import CollisionMesh


class CollisionMeshComponent(component):
    def RunScript(self, scene, M, name, add, append, remove):
        ok = False
        self.Message = ""

        if (add and append) or (append and remove) or (add and remove):
            self.Message = "Use only one operation at a time\n(add, append or remove)"
            raise Exception(self.Message)

        if scene and M and name:
            mesh_WCS = RhinoMesh.from_geometry(M).to_compas()
            # transform to mobile robot base coordinate system
            mesh = mesh_WCS.transformed(scene.robot.transformation_WCF_BCF())
            collision_mesh = CollisionMesh(mesh, name)
            if add:
                scene.add_collision_mesh(collision_mesh)
                self.Message = "Added"
                ok = True
            if append:
                scene.append_collision_mesh(collision_mesh)
                self.Message = "Appended"
                ok = True
            if remove:
                scene.remove_collision_mesh(name)
                self.Message = "Removed"
                ok = True
        return ok
# ---------- end cm ----------
panel_7 = Panel(cm.ok)

# ----
# Attach to robot
remove_3 = Button()
add_3 = Button()
mesh_4 = Mesh(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)
acm = AttachedCollisionMesh(
    scene=scene,
    mesh=mesh_4,
    identifier="elem",
    link_name="robot_arm_tool0",
    touch_links="robot_arm_tool0",
    add=add_3,
    remove=remove_3)  # -> attached_collision_mesh, bang; inputs mesh: Mesh, touch_links: list, add: Boolean, remove: Boolean
#   port scene: The planning scene.
#   port mesh: A collision mesh.
#   port identifier: The identifier of the collision mesh.
#   port link_name: The robot's link name to attach the mesh to.
#   port touch_links: Names of links that the robot is allowed to touch.
#   port add: If True, adds the collision mesh to the planning scene.
#   port remove: If True, removes the collision mesh from the planning scene.
#   port attached_collision_mesh: A collision mesh that is attached to a robot's link.
# ---------- acm: Python ----------
"""
Add an attached collision mesh to the robot.

COMPAS FAB v0.27.0
"""
from ghpythonlib.componentbase import executingcomponent as component

from compas_rhino.geometry import RhinoMesh
from compas_fab.robots import AttachedCollisionMesh
from compas_fab.robots import CollisionMesh

class AttachedCollisionMeshComponent(component):
    def RunScript(self, scene, mesh, identifier, link_name, touch_links, add, remove):
        attached_collision_mesh = None
        if scene and mesh and identifier and link_name:
            compas_mesh = RhinoMesh.from_geometry(mesh).to_compas()
            collision_mesh = CollisionMesh(compas_mesh, identifier)
            attached_collision_mesh = AttachedCollisionMesh(collision_mesh, link_name, touch_links)
            if add:
                scene.add_attached_collision_mesh(attached_collision_mesh)
            if remove:
                scene.remove_attached_collision_mesh(identifier)
                scene.remove_collision_mesh(identifier)
        return attached_collision_mesh
# ---------- end acm ----------

list_4 = ValueList({"value": 0, "Iterator": 1}, selected="value")
list_5 = ValueList({"ur10e", "ur10e_and_liftkit"}, selected="ur10e_and_liftkit")

# ---- group: zero configuration
zero_config = ZeroConfig(robot=robot_2, group=list_5)  # -> config
#   port group: If assigned, it will return the zero configuration for the given group, otherwise a full zero configuration.
#   port config: The zero configuration.
# ---------- zero_config: Python ----------
"""
Get a zero configuration for a robot.

COMPAS FAB v0.27.0
"""
from ghpythonlib.componentbase import executingcomponent as component


class ConfigZero(component):
    def RunScript(self, robot, group):

        if robot:
            return robot.zero_configuration(group)

        return None
# ---------- end zero_config ----------

# ----
# Configuration
l = Slider(0, range=0..0.72)

# ---- group: forward kinematics
a1 = Slider(45, range=-360..360)
a2 = Slider(-120, range=-360..360)
a3 = Slider(165, range=-360..360)
a4 = Slider(-135, range=-360..360)
a6 = Slider(0, range=-360..360)
a5 = Slider(-90, range=-360..360)
jp = GhPythonScript()  # -> joint_positions
# ---------- jp: Python ----------
import math

joint_positions = [0,0,-90,90,0,90,0]
joint_positions = [math.radians(a) for a in joint_positions]
#joint_positions = [-3.136, -0.328, -1.218, 3.129, 0.852, 0.008]
#joint_positions = [0] * 6



#joint_positions = [1.6239667567485938, 0.25439606475392273, 4.409424838594969-2*3.14, 3.1901607306255908, 1.5707963267948954, 0.053170429953696939]
#joint_positions = [1.598543436748912, 0.23021224965157744, 4.712232135219824-2*3.14, 6.0531299026928744, 4.7123889803846915, 0.027747109954015234]
#joint_positions = [-1.1373533430447322, 4.0117247163121572, 5.4083762087596021-2*3.14, 1.5754733624925168, 4.7123889803846879, 3.5750356373399574]
print joint_positions
# ---------- end jp ----------
forward_kinematics = PythonScript(robot=robot_2, set_joint_positions=Button(), joint_positions=jp, lift=l, a1=a1, a2=a2, a3=a3, a4=a4, a5=a5, a6=a6)  # -> full_configuration; inputs joint_positions: list
# ---------- forward_kinematics: Python ----------
import math
import Grasshopper
from compas.robots import Joint
from compas_fab.robots import Configuration

if set_joint_positions:
    j = 0
    for i in range(ghenv.Component.Params.Input.Count):
        nslider = ghenv.Component.Params.Input[i].Sources[0]
        if nslider.GetType() == Grasshopper.Kernel.Special.GH_NumberSlider:
            nslider.TrySetSliderValue(math.degrees(joint_positions[j]))
            j += 1

if robot:
    joints = robot.get_configurable_joints()
    joint_types = [joint.type for joint in joints]
    joint_names = [joint.name for joint in joints]
    
    joint_positions = [a1, a2, a3, a4, a5, a6]
    joint_positions = [math.radians(position) for position in joint_positions]
    
    if len(joints) == 7:
        joint_positions = [lift] + joint_positions
    
    print joint_types, joint_names, joint_positions
    full_configuration = Configuration(joint_positions, joint_types, joint_names)
    
print(full_configuration)
# ---------- end forward_kinematics ----------

# ----
list_6 = ValueList({"analytics inverse": 0, "inverse kinematics": 1}, selected="analytics inverse")
show_cm = BooleanToggle(False)

# ----
# Stop
stop_2 = Button()  # disabled
stop_3 = PythonScript(stop=stop_2)  # disabled
# ---------- stop_3: Python ----------
from scriptcontext import sticky as st
from ur_fabrication_control.direct_control.common import send_stop

ur_ip = st["ur_ip"]
ur_port = st["ur_port"]

if stop:
    send_stop(ur_ip, ur_port)
# ---------- end stop_3 ----------

# ----
# Area Gripper Switch
suction = BooleanToggle(False)  # disabled
blow_off = BooleanToggle(False)  # disabled
digital_out = PythonScript(suction=suction, blow_off=blow_off)  # -> urscript; disabled
# ---------- digital_out: Python ----------
from ur_fabrication_control.direct_control import URScript
from ur_fabrication_control.direct_control.mixins import AreaGripMixins

class URScript_AreaGrip(URScript, AreaGripMixins):
    pass

urscript = URScript_AreaGrip()
urscript.start()

if suction == True and blow_off == False:
    urscript.areagrip_on()
elif blow_off == True:
    urscript.areagrip_blowoff()
elif suction == False and blow_off == False:
    urscript.areagrip_off()

urscript.end()
urscript = urscript.generate()
print(urscript)
# ---------- end digital_out ----------
send = Button()  # disabled
send_2 = GhPythonScript(urscript=digital_out, send=send)  # -> out; inputs send: Boolean; disabled
# ---------- send_2: Python ----------
from scriptcontext import sticky as st
from ur_fabrication_control.direct_control import send_script

ur_ip = st["ur_ip"]
ur_port = st["ur_port"]

if send:
    send_script(urscript, ur_ip, ur_port)
# ---------- end send_2 ----------

# ----
# Get Pose Joint
get = Button()  # disabled
pose = PythonScript(robot=robot_2, get=get)  # -> out, configuration, pose_joints; disabled
# ---------- pose: Python ----------
from scriptcontext import sticky as st
from ur_fabrication_control.direct_control.common import get_current_pose_joints
from compas_fab.robots import Configuration


robot = st["robot"]

server_ip= st["server_ip"]
server_port = st["server_port"]
ur_port = st["ur_port"]
ur_ip = st["ur_ip"]
print ur_ip

guid = str(ghenv.Component.InstanceGuid)
pose_joints_key = "pose_joints" + guid

# retrieve the current tool frame in axis angle format
if robot.attached_tool:
    tool_angle_axis = list(robot.attached_tool.frame.point) + list(robot.attached_tool.frame.axis_angle_vector)
else:
    tool0_frame = Frame([0, 0, 0], [1, 0, 0], [0, 1, 0])
    tool_angle_axis = list(tool0_frame.point) + list(tool0_frame.axis_angle_vector)

print(tool_angle_axis)

# send script to the robot to receive the current joint configuration
if get:
    st[pose_joints_key] = get_current_pose_joints(server_ip, server_port, ur_ip, ur_port, tool_angle_axis)

print(st[pose_joints_key])
configuration = Configuration.from_revolute_values(st[pose_joints_key])
pose_joints = configuration.joint_values
"""
if pose_joints_key not in st:
    configuration = Configuration.from_revolute_values([0,0,0,0,0,0])
else:
    configuration = Configuration.from_revolute_values(st[pose_joints_key])

pose_joints = configuration.values
"""
# ---------- end pose ----------
panel_8 = Panel(pose.pose_joints)  # disabled

angle_2 = Slider(90, range=0..360)
rad = Radians(Degrees=angle_2)
python = GhPythonScript(
    calculate=set_base_frame,
    robot=robot_2,
    pos=pt,
    mesh=mesh_2,
    path=line,
    planes=pln,
    crv_top=crv_2,
    crv_bottom=crv,
    angle=angle_2)  # -> mesh, new_path, new_planes, v, center, crv_top, crv_bottom; inputs pos: Point3d, mesh: Mesh, path: list of Curve, planes: list, crv_top: Curve, crv_bottom: Curve
# ---------- python: Python ----------
__author__ = "timda"
__version__ = "2023.06.22"

import rhinoscriptsyntax as rs
from compas_rhino.conversions import point_to_rhino
from Rhino.Geometry import Point3d, Vector3d, Plane, Transform
from math import pi


radians = angle * pi/180
v = Point3d(robot.RCF.point.x-robot.BCF.point.x, robot.RCF.point.y - robot.BCF.point.y, 0) - pos

new_path = []
for crv in path:
    crv.Translate(v)
    crv.Rotate(radians, Vector3d.ZAxis, point_to_rhino(robot.RCF.point))
    new_path.append(crv)

mesh.Translate(v)
mesh.Rotate(radians, Vector3d.ZAxis, point_to_rhino(robot.RCF.point))

crv_top.Translate(v)
crv_top.Rotate(radians, Vector3d.ZAxis, point_to_rhino(robot.RCF.point))
crv_bottom.Translate(v)
crv_bottom.Rotate(radians, Vector3d.ZAxis, point_to_rhino(robot.RCF.point))

new_planes = []
for plane in planes:
    plane.Translate(v)
    plane.Rotate(radians, Vector3d.ZAxis, point_to_rhino(robot.RCF.point))
    new_planes.append(plane)

center = point_to_rhino(robot.RCF.point)
# ---------- end python ----------
move = Move(Geometry=pt_2, Motion=python.v)  # -> Geometry, Transform
rot3d = Rotate3D(Geometry=move.Geometry, Angle=rad, Center=python.center, Axis=Vector(0, 0, 1))  # -> Geometry, Transform
mesh_5 = Mesh(python.mesh)
crv_3 = Curve(python.new_path)
counter = CountThroughList(planes=python.new_planes, start=start, stop=stop, step=step, step_back=back, reset=reset, full=full, interval=list_2)  # -> item, counter; inputs planes: list, start: Boolean, stop: Boolean, step_back: Boolean
# ---------- counter: Python ----------
from scriptcontext import sticky as st
from compas_ghpython import update_component


L = planes
# store data in component
guid = str(ghenv.Component.InstanceGuid)
counter_key = "counter_" + guid
running_key = "running_" + guid

if counter_key not in st:
    st[counter_key] = 0

if running_key not in st:
    st[running_key] = False
    

if st[running_key]:
    if st[counter_key] < len(L) - 1:
        st[counter_key] += 1
        update_component(ghenv, interval)
    else:
        st[counter_key] = 0
        st[running_key] = False
    
    
if start:
    st[running_key] = True

if stop:
    st[running_key] = False

if step:
    if st[counter_key] < len(L) - 1:
        st[counter_key] += 1

if step_back:
    if st[counter_key] > 0:
        st[counter_key] -= 1

if reset:
    st[counter_key] = 0

if full:
    st[counter_key] = len(L)-1

if len(L):
    item = L[st[counter_key]]
#    item = L[st[counter_key]+500]



st["visualisation_counter"] = st[counter_key]
counter = st[counter_key]
# ---------- end counter ----------
preview = CustomPreview(
    Geometry=crv_3,
    Material={diffuse=RGB(221, 160, 221), emission=RGB(66, 48, 66), shine=0.5, specular=RGB(255, 255, 255), transparency=0})
panel_9 = Panel(counter.item)
panel_10 = Panel(counter.counter)

crv_4 = Curve(python.crv_top)
crv_5 = Curve(python.crv_bottom)
filter = StreamFilter(Gate=list_4, Stream0=Slider(600, range=0..5280), Stream1=counter.counter)
item = ListItem(List=python.new_planes, Index=filter, Wrap=True)

python_2 = GhPythonScript(counter=filter, points=rot3d.Geometry)  # -> pts; inputs counter: Int32, points: list
# ---------- python_2: Python ----------
__author__ = "timda"
__version__ = "2023.06.27"

import rhinoscriptsyntax as rs
pts = points[:counter+1]
# ---------- end python_2 ----------
python_3 = GhPythonScript(plane=item, robot=robot_2)  # -> new_plane; inputs plane: Plane
# ---------- python_3: Python ----------
__author__ = "timda"
__version__ = "2023.06.21"

import rhinoscriptsyntax as rs
from compas.geometry import Transformation, Frame
from compas_ghpython.utilities import draw_frame

frame = Frame(plane.Origin, plane.XAxis, plane.YAxis)
T = Transformation.from_change_of_basis(robot.BCF, Frame.worldXY())
new_frame = frame.transformed(T)
new_plane = draw_frame(new_frame)
# ---------- end python_3 ----------
dots = DotDisplay(Point=python_2, Colour=ColourSwatch(SwatchColor=RGB(255, 0, 0)), Size=Slider(0.02, range=0..0.1))

# ---- group: inverse kinematics
select_configuration = Slider(0, range=0..7)
plane = Plane(python_3)

# ----
gate = StreamGate(Stream=plane, Gate=list_6)  # -> Target0, Target1
ik = InverseKinematics(robot=robot_2, plane=gate.Target1, start_configuration=zero_config, group=list_5)  # -> configuration
#   port plane: The plane or frame to calculate the inverse kinematic for.
#   port start_configuration: If passed, calculates the inverse such that the joint positions differ the least from the start_configuration. Defaults to the zero configuration.
#   port group: The planning group used for calculation. Defaults to the robot's main planning group.
#   port configuration: The planning group's configuration.
# ---------- ik: Python ----------
"""
Calculate the robot's inverse kinematic for a given plane.

COMPAS FAB v0.28.0
"""
from compas_rhino.conversions import RhinoPlane
from ghpythonlib.componentbase import executingcomponent as component


class InverseKinematics(component):
    def RunScript(self, robot, plane, start_configuration, group):
        configuration = None
        if robot and robot.client and robot.client.is_connected and plane:
            frame = RhinoPlane.from_geometry(plane).to_compas_frame()
            configuration = robot.inverse_kinematics(frame, start_configuration, group)
        return configuration
# ---------- end ik ----------

# ---- group: inverse kinematics (continued)
analytic_inverse = PythonScript(robot=robot_2, lift=l, plane_WCS=gate.Target0, idx=select_configuration, bang=Button())  # -> out, configuration, plane_tool0_RCS, plane_RCS; inputs plane_WCS: Plane, idx: Int32, bang: list
# ---------- analytic_inverse: Python ----------
import Rhino.Geometry as rg
import math
from compas.geometry import Frame, Transformation, Rotation
from compas_fab.robots import Configuration
from ur_fabrication_control.kinematics.ur_kinematics import inverse_kinematics
from ur_fabrication_control.kinematics.ur_params import ur_params
from compas_ghpython import draw_frame

robot.lift_height = lift

frame_WCS = Frame(plane_WCS.Origin, plane_WCS.XAxis, plane_WCS.YAxis)

# transform frame to robot coordinate system
frame_BCS = frame_WCS.transformed(robot.transformation_WCF_BCF())
frame_RCS = frame_BCS.transformed(robot.transformation_BCF_RCF())

print(frame_WCS, frame_BCS, frame_RCS)
if robot.attached_tool:
    tool0_RCS = robot.from_tcf_to_t0cf([frame_RCS])[0]
else:
    tool0_RCS = frame_RCS

plane_tool0_RCS = draw_frame(tool0_RCS)
plane_RCS = draw_frame(frame_RCS)

# calculate solutions to frame
ur_params = ur_params["ur10e"] # get the parameters according to the robot model
print ur_params
solutions = inverse_kinematics(tool0_RCS, ur_params)
print solutions

if not len(solutions):
    joint_values = [0, 0, 0, 0, 0, 0]
    configuration = Configuration.from_prismatic_and_revolute_values([0], joint_values)
else:
    joint_values = solutions[idx]
    configuration = [Configuration.from_prismatic_and_revolute_values([lift], joint_values)]

print(configuration)
# ---------- end analytic_inverse ----------

# ----
pln_2 = Plane(analytic_inverse.plane_tool0_RCS)
pln_3 = Plane(analytic_inverse.plane_RCS)

# ----
# Plan motion
list_7 = ValueList({"ur10e", "ur10e_and_liftkit"}, selected="ur10e_and_liftkit")  # disabled
constraints_from_plane = ConstraintsFromPlane(robot=robot_2, plane=plane, group=list_7)  # -> constraints; disabled
#   port plane: The plane or frame from which we create position and orientation constraints.
#   port group: The planning group for which we specify the constraint. Defaults to the robot's main planning group.
#   port tolerance_position: The allowed tolerance to the frame's position (defined in the robot's units). Defaults to 0.001
#   port tolerance_xaxis: The allowed tolerance of the frame's X-axis in degrees.
#   port tolerance_yaxis: The allowed tolerance of the frame's Y-axis in degrees.
#   port tolerance_zaxis: The allowed tolerance of the frame's Z-axis in degrees.
#   port constraints: A list containing a position and an orientation constraint.
# ---------- constraints_from_plane: Python ----------
"""
Create a position and an orientation constraint from a plane calculated for the group's end-effector link.

COMPAS FAB v0.27.0
"""
import math
from compas_rhino.conversions import RhinoPlane
from ghpythonlib.componentbase import executingcomponent as component

class ConstraintsFromPlane(component):
    def RunScript(self, robot, plane, group, tolerance_position, tolerance_xaxis, tolerance_yaxis, tolerance_zaxis):
        goal_constraints = None
        if robot and plane:
            tolerance_position = tolerance_position or 0.001
            tolerance_xaxis = tolerance_xaxis or 1.
            tolerance_yaxis = tolerance_yaxis or 1.
            tolerance_zaxis = tolerance_zaxis or 1.
            
            frame_WCS = RhinoPlane.from_geometry(plane).to_compas_frame()
            # transform frame to mobile robot base coordinate system
            frame_BCS = frame_WCS.transformed(robot.transformation_WCF_BCF())
            frame = frame_BCS
            # Test the bottom:
#            if group == 'ur10e':
#                frame = frame_BCS.transformed(robot.transformation_BCF_RCF())
#            else:
#                frame = frame_BCS
            
            if robot.attached_tool:
                tool0_frame = robot.from_tcf_to_t0cf([frame])[0]
            else:
                tool0_frame = frame
            
            tolerances_axes = [math.radians(tolerance_xaxis), math.radians(tolerance_yaxis), math.radians(tolerance_zaxis)]
            goal_constraints = robot.constraints_from_frame(tool0_frame, tolerance_position, tolerances_axes, group)

        return goal_constraints
# ---------- end constraints_from_plane ----------
button = Button()  # disabled
plan_motion = PlanMotion(
    robot=robot_2,
    goal_constraints=constraints_from_plane,
    start_configuration=forward_kinematics,
    group=list_7,
    compute=button)  # -> trajectory; inputs goal_constraints: list, attached_collision_meshes: list, path_constraints: list, compute: Boolean; disabled
#   port goal_constraints: The goal to be achieved, defined in a set of constraints. Constraints can be very specific, for example defining value domains for each joint, such that the goal configuration is included, or defining a volume in space, to which a specific robot link (e.g. the end-effector) is required to move to.
#   port start_configuration: The robot's full configuration, i.e. values for all configurable joints of the entire robot, at the starting position. Defaults to the all-zero configuration.
#   port group: The planning group used for calculation. Defaults to the robot's main planning group.
#   port attached_collision_meshes: A list of attached collision meshes to be included for planning.
#   port path_constraints: Optional constraints that can be imposed along the solution path. Note that path calculation won't work if the start_configuration violates these constraints. Defaults to None.
#   port planner_id: The name of the algorithm used for path planning. Defaults to 'RRTConnect'
#   port compute: If True, calculates a trajectory.
#   port trajectory: The calculated trajectory.
# ---------- plan_motion: Python ----------
"""
Calculate a motion path.

COMPAS FAB v0.27.0
"""
from ghpythonlib.componentbase import executingcomponent as component
from scriptcontext import sticky as st

from compas_fab.ghpython.components import create_id


class PlanMotion(component):
    def RunScript(self, robot, goal_constraints, start_configuration, group, attached_collision_meshes, path_constraints, planner_id, compute):

        key = create_id(self, 'trajectory')

        path_constraints = list(path_constraints) if path_constraints else None
        attached_collision_meshes = list(attached_collision_meshes) if attached_collision_meshes else None
        planner_id = str(planner_id) if planner_id else 'RRTConnect'

        if robot and robot.client and robot.client.is_connected and start_configuration and goal_constraints and compute:
            st[key] = robot.plan_motion(goal_constraints,
                                        start_configuration=start_configuration,
                                        group=group,
                                        options=dict(
                                            attached_collision_meshes=attached_collision_meshes,
                                            path_constraints=path_constraints,
                                            planner_id=planner_id,
                                        ))

        trajectory = st.get(key, None)
        return trajectory
# ---------- end plan_motion ----------
trajectory_visualize = TrajectoryVisualize(robot=robot_2, group=list_7, trajectory=plan_motion)  # -> start_configuration, configurations, fraction, time, planes, P, V, A; disabled
#   port group: The planning group for which this trajectory was planned.
#   port trajectory: The calculated trajectory.
#   port start_configuration: The start configuration of the trajectory.
#   port configurations: The full configurations along the trajectory.
#   port fraction: Indicates the fraction of requested trajectory that was calculated, e.g. 1 means the full trajectory was found.
#   port time: The time which is needed to execute that trajectory at full speed.
#   port planes: The planes of the robot's end-effector.
#   port P: The positions along the trajectory
#   port V: The velocities along the trajectory
#   port A: The accelerations along the trajectory
# ---------- trajectory_visualize: Python ----------
"""
Visualizes a trajectory.

COMPAS FAB v0.27.0
"""
from compas_ghpython import draw_frame
from compas_ghpython import list_to_ghtree
from compas_fab.robots import Configuration
from ghpythonlib.componentbase import executingcomponent as component

class TrajectoryVisualize(component):
    def RunScript(self, robot, group, trajectory):
        start_configuration = None
        configurations = []
        fraction = 0.
        time = 0.

        planes = []
        positions = []
        velocities = []
        accelerations = []

        if robot and trajectory:
            group = group or robot.main_group_name

            for c in trajectory.points:
                config = robot.merge_group_with_full_configuration(c, trajectory.start_configuration, group)
                joint_names_ordered = ['robot_ewellix_lift_top_joint', 'robot_arm_shoulder_pan_joint', 'robot_arm_shoulder_lift_joint', 'robot_arm_elbow_joint', 'robot_arm_wrist_1_joint', 'robot_arm_wrist_2_joint', 'robot_arm_wrist_3_joint']
                joint_values_ordered = [config.joint_values[config.joint_names.index(joint_name)] for joint_name in joint_names_ordered]
                joint_types_ordered = [config.joint_types[config.joint_names.index(joint_name)] for joint_name in joint_names_ordered]
                mobile_robot_config = Configuration(joint_values_ordered, joint_types_ordered, joint_names_ordered)
                configurations.append(mobile_robot_config)
                frame = robot.forward_kinematics(c, group, options=dict(solver='model'))
                
                # transform the planes to mobile robot base
                planes.append(draw_frame(frame.transformed(robot.transformation_BCF_WCF())))
                positions.append(c.positions)
                velocities.append(c.velocities)
                accelerations.append(c.accelerations)

            start_configuration = trajectory.start_configuration
            fraction = trajectory.fraction
            time = trajectory.time_from_start

        P = list_to_ghtree(list(zip(*positions)))
        V = list_to_ghtree(list(zip(*velocities)))
        A = list_to_ghtree(list(zip(*accelerations)))

        # return outputs if you have them; here I try it for you:
        return (start_configuration, configurations, fraction, time, planes, P, V, A)
# ---------- end trajectory_visualize ----------
planes = Plane(trajectory_visualize.planes)  # disabled

# ----
# Move Cartesian
list_8 = ValueList({"send one cartesian position": 0, "send all cartesian positions": 1}, selected="send one cartesian position")  # disabled
number_slider = Slider(0.05, range=0..0.5)  # disabled
radius = Slider(0.003, range=0..0.5)  # disabled
filter_2 = StreamFilter(Gate=list_8, Stream0=plane, Stream1=plane)  # disabled
movel = PythonScript(robot=robot_2, lift=l, velocity=number_slider, radius=radius)  # -> urscript, lift; inputs planes_WCS: list; disabled
# ---------- movel: Python ----------
import Rhino.Geometry as rg
from compas.geometry import Frame
from compas.geometry import Transformation, Rotation
from compas_ghpython import draw_frame
from ur_fabrication_control import direct_control 
import math

from scriptcontext import sticky as st
from ur_fabrication_control.direct_control import URScript

# retrieve the current tool frame in axis angle format
if robot.attached_tool:
    tool_angle_axis = list(robot.attached_tool.frame.point) + list(robot.attached_tool.frame.axis_angle_vector)
else:
    tool0_frame = Frame([0, 0, 0], [1, 0, 0], [0, 1, 0])
    tool_angle_axis = list(tool0_frame.point) + list(tool0_frame.axis_angle_vector)

frames_RCS = []
for plane_WCS in planes_WCS:
    frame_WCS = Frame(plane_WCS.Origin, plane_WCS.XAxis, plane_WCS.YAxis)
    # transform frame to robot coordinate system
    frame_BCS = frame_WCS.transformed(robot.transformation_WCF_BCF())
    frame_RCS = frame_BCS.transformed(robot.transformation_BCF_RCF())
    frames_RCS.append(frame_RCS)

urscript = URScript()
urscript.start()
urscript.set_tcp(tool_angle_axis)
for frame_RCS in frames_RCS:
    urscript.move_process(frame_RCS, velocity, radius)
urscript.end()

urscript = urscript.generate()

print(urscript)

lift = lift
# ---------- end movel ----------
send_3 = Button()  # disabled
ur_send = GhPythonScript(urscript=movel.urscript, send=send_3)  # -> out; inputs send: Boolean; disabled; same code as send_2

filter_3 = StreamFilter(Gate=list_6, Stream0=analytic_inverse.configuration, Stream1=ik)

# ----
# Select
# Config
configuration = Slider(19, range=0..100)  # disabled
item_2 = ListItem(List=trajectory_visualize.configurations, Index=configuration, Wrap=True)  # disabled

# ----
# Plan cartesian motion
list_9 = ValueList({"ur10e", "ur10e_and_liftkit"}, selected="ur10e")  # disabled
button_2 = Button()  # disabled
toggle = BooleanToggle(False)  # disabled
plan_cartesian_motion = PlanCartesianMotion(robot=robot_2, start_configuration=analytic_inverse.configuration, group=list_9, compute=toggle)  # -> trajectory; inputs planes: list, attached_collision_meshes: list, path_constraints: list, compute: Boolean; disabled
#   port planes: The planes or frames through which the path is defined.
#   port start_configuration: The robot's full configuration, i.e. values for all configurable joints of the entire robot, at the starting position. Defaults to the all-zero configuration.
#   port group: The planning group used for calculation. Defaults to the robot's main planning group.
#   port attached_collision_meshes: A list of attached collision meshes to be included for planning.
#   port path_constraints: Optional constraints that can be imposed along the solution path. Note that path calculation won't work if the start_configuration violates these constraints. Defaults to None.
#   port max_step: The approximate distance between the calculated points. (Defined in the robot's units.) Defaults to 0.01.
#   port compute: If True, calculates a trajectory.
#   port trajectory: The calculated trajectory.
# ---------- plan_cartesian_motion: Python ----------
"""
Calculate a cartesian motion path (linear in tool space).

COMPAS FAB v0.27.0
"""
from compas_rhino.conversions import RhinoPlane
from ghpythonlib.componentbase import executingcomponent as component
from scriptcontext import sticky as st

from compas_fab.ghpython.components import create_id


class PlanCartesianMotion(component):
    def RunScript(self, robot, planes, start_configuration, group, attached_collision_meshes, path_constraints, max_step, compute):

        key = create_id(self, 'trajectory')

        max_step = float(max_step) if max_step else 0.01
        path_constraints = list(path_constraints) if path_constraints else None
        attached_collision_meshes = list(attached_collision_meshes) if attached_collision_meshes else None

        if robot and robot.client and robot.client.is_connected and start_configuration and planes and compute:
            # transform frame to robot coordinate system
            frames = []
            for plane in planes:
                frame_BCS = RhinoPlane.from_geometry(plane).to_compas_frame().transformed(robot.transformation_WCF_BCF())
                print frame_BCS
#                if robot.attached_tool:
#                    tool0_BCS = robot.from_tcf_to_t0cf([frame_BCS])[0]
#                else:
                tool0_BCS = frame_BCS
                frames.append(tool0_BCS)
                
            st[key] = robot.plan_cartesian_motion(frames,
                                                  start_configuration=start_configuration,
                                                  group=group,
                                                  options=dict(
                                                      max_step=max_step,
                                                      path_constraints=path_constraints,
                                                      attached_collision_meshes=attached_collision_meshes
                                                  ))

        trajectory = st.get(key, None)
        return trajectory
# ---------- end plan_cartesian_motion ----------
trajectory_visualize_2 = TrajectoryVisualize(robot=robot_2, group=list_9, trajectory=plan_cartesian_motion)  # -> start_configuration, configurations, fraction, time, planes, P, V, A; disabled
#   port group: The planning group for which this trajectory was planned.
#   port trajectory: The calculated trajectory.
#   port start_configuration: The start configuration of the trajectory.
#   port configurations: The full configurations along the trajectory.
#   port fraction: Indicates the fraction of requested trajectory that was calculated, e.g. 1 means the full trajectory was found.
#   port time: The time which is needed to execute that trajectory at full speed.
#   port planes: The planes of the robot's end-effector.
#   port P: The positions along the trajectory
#   port V: The velocities along the trajectory
#   port A: The accelerations along the trajectory
# ---------- trajectory_visualize_2: Python ----------
"""
Visualizes a trajectory.

COMPAS FAB v0.27.0
"""
from compas_ghpython import draw_frame
from compas_ghpython import list_to_ghtree
from compas_fab.robots import Configuration
from ghpythonlib.componentbase import executingcomponent as component


class TrajectoryVisualize(component):
    def RunScript(self, robot, group, trajectory):
        start_configuration = None
        configurations = []
        fraction = 0.
        time = 0.

        planes = []
        positions = []
        velocities = []
        accelerations = []

        if robot and trajectory:
            group = group or robot.main_group_name

            for c in trajectory.points:
                config = robot.merge_group_with_full_configuration(c, trajectory.start_configuration, group)
                joint_names_ordered = ['robot_ewellix_lift_top_joint', 'robot_arm_shoulder_pan_joint', 'robot_arm_shoulder_lift_joint', 'robot_arm_elbow_joint', 'robot_arm_wrist_1_joint', 'robot_arm_wrist_2_joint', 'robot_arm_wrist_3_joint']
                joint_values_ordered = [config.joint_values[config.joint_names.index(joint_name)] for joint_name in joint_names_ordered]
                joint_types_ordered = [config.joint_types[config.joint_names.index(joint_name)] for joint_name in joint_names_ordered]
                mobile_robot_config = Configuration(joint_values_ordered, joint_types_ordered, joint_names_ordered)
                configurations.append(mobile_robot_config)
                frame = robot.forward_kinematics(c, group, options=dict(solver='model'))
                
                # transform the planes to mobile robot base
                planes.append(draw_frame(frame.transformed(robot.transformation_BCF_WCF())))
                positions.append(c.positions)
                velocities.append(c.velocities)
                accelerations.append(c.accelerations)

            start_configuration = trajectory.start_configuration
            fraction = trajectory.fraction
            time = trajectory.time_from_start

        P = list_to_ghtree(list(zip(*positions)))
        V = list_to_ghtree(list(zip(*velocities)))
        A = list_to_ghtree(list(zip(*accelerations)))

        # return outputs if you have them; here I try it for you:
        return (start_configuration, configurations, fraction, time, planes, P, V, A)
# ---------- end trajectory_visualize_2 ----------
planes_2 = Plane(trajectory_visualize_2.planes)  # disabled

# ----
# Select
# Config
configuration_2 = Slider(71, range=0..100)  # disabled
item_3 = ListItem(List=trajectory_visualize_2.configurations, Index=configuration_2, Wrap=True)  # disabled

list_10 = ValueList({"0 zero_configuration": 0, "1 forward_kinematics": 1, "2 inverse_kinematics": 2, "3 motion_planning": 3, "4 cartesian_motion_planning": 4}, selected="1 forward_kinematics")
filter_4 = StreamFilter(Gate=list_10, Stream0=zero_config, Stream1=forward_kinematics, Stream2=filter_3, Stream3=item_2, Stream4=item_3)

# ----
# Visualisation
show_end_effector_frame = BooleanToggle(True)
show_base_frame = BooleanToggle(True)
show_collision = BooleanToggle(False)
show_frames = BooleanToggle(True)
show_visual = BooleanToggle(True)
show_acm = BooleanToggle(False)

robot_visualize = RobotVisualize(
    robot=robot_2,
    group=info.main_group_name,
    configuration=filter_4,
    show_visual=show_visual,
    show_collision=show_collision,
    show_frames=show_frames,
    show_base_frame=show_base_frame,
    show_end_effector_frame=show_end_effector_frame,
    show_cm=show_cm,
    show_acm=show_acm,
    redraw=[set_base_frame, attach_remove.bang, acm.bang, cm.bang])  # -> visual, collision, collision_meshes, attached_meshes, all_frames, base_frame, ee_frame; inputs show_visual: Boolean, show_collision: Boolean, show_frames: Boolean, show_base_frame: Boolean, show_end_effector_frame: Boolean, show_cm: Boolean, show_acm: Boolean, redraw: list
#   port group: The planning group used for end-effector and base visualization.
#   port configuration: The robot's full configuration.
#   port show_visual: Whether or not to show the robot's visual meshes.
#   port show_collision: Whether or not to show the robot's collision meshes.
#   port show_frames: Whether or not to show the robot's joint frames.
#   port show_base_frame: Whether or not to show the robot's base frame.
#   port show_end_effector_frame: Whether or not to show the robot's end-effector frame.
#   port show_cm: Whether or not to show the collision meshes (if any).
#   port show_acm: Whether or not to show the attached collision meshes (if any).
#   port visual: Rhino meshes of the robot's visual geometry (if any).
#   port collision: Rhino meshes of the robot's collision geometry (if any).
#   port collision_meshes: Rhino meshes of the scene's collision meshes (if any).
#   port attached_meshes: Rhino meshes of the scene's attached collision meshes (if any).
#   port all_frames: The robot's joint frames as Rhino planes (if any).
#   port base_frame: The robot's base frame as a Rhino plane (if any).
#   port ee_frame: The robot's end-effector frame as a Rhino plane (if any).
# ---------- robot_visualize: Python ----------
"""
Visualizes the robot.

COMPAS FAB v0.27.0
"""
import Rhino.Geometry as rg
import ghpythonlib.components as ghcomp
from compas.artists import Artist
from compas.geometry import Frame
from compas.geometry import Transformation
from compas_fab.robots import PlanningScene
from compas_ghpython.utilities import draw_frame
from ghpythonlib.componentbase import executingcomponent as component

class RobotVisualize(component):
    def RunScript(
        self,
        robot,
        group,
        configuration,
        show_visual,
        show_collision,
        show_frames,
        show_base_frame,
        show_end_effector_frame,
        show_cm,
        show_acm,
        redraw
    ):

        visual = None
        collision = None
        collision_meshes = None
        attached_meshes = None
        frames = None
        base_frame = None
        ee_frame = None
        all_frames = None

        if robot:
            show_visual = True if show_visual is None else show_visual
            show_cm = True if show_cm is None else show_cm
            show_acm = True if show_acm is None else show_acm
            configuration = configuration or robot.zero_configuration()

            robot.update(configuration, visual=show_visual, collision=show_collision)
            frames = robot.transformed_frames(configuration, group)

            if show_visual:
                visual = robot.artist.draw_visual()
                # orient the robot to its base plane:
                robot_BCF = draw_frame(robot.BCF) 
                init_robot_plane = rg.Plane.WorldXY
                visual = ghcomp.Orient(visual, init_robot_plane, robot_BCF)[0]

            if show_collision:
                collision = robot.artist.draw_collision()

            if show_base_frame:
                base_frame = robot.BCF

            if show_end_effector_frame:
                ee_frame = robot.forward_kinematics(
                    configuration, group, options=dict(solver="model")
                )
                ee_frame = robot.to_world_coordinates(ee_frame)

            if show_frames:
                all_frames = [robot.to_world_coordinates(frame) for frame in frames]

            if show_cm or show_acm:
                scene = PlanningScene(robot)
                scene = robot.client.get_planning_scene()

                collision_meshes = []
                attached_meshes = []

                if show_cm:
                    for co in scene.world.collision_objects:
                        header = co.header
                        frame_id = header.frame_id
                        cms = co.to_collision_meshes()

                        for cm in cms:
                            if cm.frame != Frame.worldXY():
                                t = Transformation.from_frame(cm.frame)
                                mesh = cm.mesh.transformed(t)
                            else:
                                mesh = cm.mesh
                            
                            mesh_t = mesh.transformed(robot.transformation_BCF_WCF())
                            collision_meshes.append(Artist(mesh_t).draw())

                if show_acm:
                    for aco in scene.robot_state.attached_collision_objects:
                        for acm in aco.to_attached_collision_meshes():
                            frame_id = aco.object["header"]["frame_id"]
                            frame = robot.forward_kinematics(
                                configuration, options=dict(link=frame_id)
                            )
                            t = Transformation.from_frame(frame)

                            # Local CM frame
                            if (
                                acm.collision_mesh.frame
                                and acm.collision_mesh.frame != Frame.worldXY()
                            ):
                                t = t * Transformation.from_frame(
                                    acm.collision_mesh.frame
                                )

                            mesh = acm.collision_mesh.mesh.transformed(t)
                            # transform to mobile robot base
                            mesh_t = mesh.transformed(robot.transformation_BCF_WCF())

                            attached_meshes.append(Artist(mesh_t).draw())

        return (
            visual,
            collision,
            collision_meshes,
            attached_meshes,
            all_frames,
            base_frame,
            ee_frame,
        )
# ---------- end robot_visualize ----------
geo = Geometry(robot_visualize.collision_meshes)
geo_2 = Geometry(robot_visualize.attached_meshes)

geo_3 = Geometry(robot_visualize.visual)
geo_4 = Geometry(robot_visualize.collision)
draw = GhPythonScript(frames=flatten([robot_visualize.all_frames, robot_visualize.ee_frame]), scale=Slider(0.2, range=0..1))  # -> P, V, C, W; inputs frames: list
# ---------- draw: Python ----------
from System.Drawing import Color
from compas_ghpython.utilities import draw_frame

red = Color.FromArgb(255, 0, 0)
green = Color.FromArgb(0, 255, 0)
blue = Color.FromArgb(0, 0, 255)

P = []
V = []
C = []

scale = float(scale)

for frame in frames:
    if not frame:
        continue
    plane = draw_frame(frame)
    P += [plane.Origin] * 3
    V.append(plane.XAxis * scale)
    V.append(plane.YAxis * scale)
    V.append(plane.ZAxis * scale)
    C += [red, green, blue]

W = 3
# ---------- end draw ----------
preview_2 = CustomPreview(Geometry=geo_3, Shader=ColourSwatch(SwatchColor=RGB(105, 105, 105)))
preview_3 = CustomPreview(Geometry=[geo, geo_2, geo_4], Shader=ColourSwatch(SwatchColor=RGB(255, 255, 255)))
vdisex = VectorDisplayEx(Point=draw.P, Vector=draw.V, Colour=draw.C, Width=draw.W)

# ----
# Move Joints
list_11 = ValueList({"send ik configuration": 0, "send one motion configuration": 1, "send all motion configurations": 2}, selected="send all motion configurations")  # disabled
number_slider_2 = Slider(0.158, range=0..0.5)  # disabled
filter_5 = StreamFilter(Gate=list_11, Stream0=analytic_inverse.configuration, Stream1=item_2, Stream2=trajectory_visualize.configurations)  # disabled
movej = PythonScript(configurations=forward_kinematics, velocity=number_slider_2)  # -> urscript, lift, values; inputs configurations: list; disabled
# ---------- movej: Python ----------
from ur_fabrication_control.direct_control import URScript
from compas_fab.robots import Configuration
import math

urscript = URScript()
urscript.start()
for configuration in configurations:
    joint_configuration = Configuration.from_revolute_values(configuration.revolute_values)
    print joint_configuration
    lift = configuration
    urscript.move_joint(joint_configuration, velocity)
urscript.end()

urscript = urscript.generate()

print(urscript)
# ---------- end movej ----------
send_4 = Button()  # disabled
ur_send_2 = GhPythonScript(urscript=movej.urscript, send=send_4)  # -> out; inputs send: Boolean; disabled
# ---------- ur_send_2: Python ----------
from scriptcontext import sticky as st
from ur_fabrication_control.direct_control import send_script

ur_ip = st["ur_ip"]
ur_port = st["ur_port"]

print urscript

if send:
    send_script(urscript, ur_ip, ur_port)
# ---------- end ur_send_2 ----------

# ----
# Direct UR control + Lift control
send_5 = Button()  # disabled
send_6 = Button()  # disabled

lift_send = GhPythonScript(robot=robot_2, lift=movel.lift, send=send_6)  # -> out; disabled
# ---------- lift_send: Python ----------
if send:
    robot.mobile_client.set_lift_height(lift)
# ---------- end lift_send ----------

lift_send_2 = GhPythonScript(robot=robot_2, lift=movej.lift, send=send_5)  # -> out; disabled
# ---------- lift_send_2: Python ----------
if send:
    robot.mobile_client.set_lift_height(0.2)
# ---------- end lift_send_2 ----------

# ----
# Get Pose Cartesian
get_2 = Button()  # disabled
pose_2 = PythonScript(robot=robot_2, get=get_2)  # -> out, pose_cartesian_meter; disabled
# ---------- pose_2: Python ----------
from scriptcontext import sticky as st
#from ur_fabrication_control.online_control.ur_direct import get_current_pose_cartesian

from ur_fabrication_control.direct_control.common import get_current_pose_cartesian
from compas.geometry import Frame
from compas_ghpython import draw_frame


server_ip = st["server_ip"]
server_port = st["server_port"]
ur_port = st["ur_port"]
ur_ip = st["ur_ip"]
pose_cartesian_meter = []
print ur_ip

# retrieve the current tool frame in axis angle format
if robot.attached_tool:
    print ("attached")
    tool_angle_axis = list(robot.attached_tool.frame.point) + list(robot.attached_tool.frame.axis_angle_vector)
    
else:
    tool0_frame = Frame([0, 0, 0], [1, 0, 0], [0, 1, 0])
    tool_angle_axis = list(tool0_frame.point) + list(tool0_frame.axis_angle_vector)

print(tool_angle_axis)

guid = str(ghenv.Component.InstanceGuid)
pose_cartesian_key = "pose_cartesian" + guid


if get:
    print ("getting pose")
    st[pose_cartesian_key] = get_current_pose_cartesian(tool_angle_axis, server_ip, server_port, ur_ip, ur_port, send=True)
#    st[pose_cartesian_key] = get_current_pose_cartesian(server_ip, server_port, ur_ip, tool_angle_axis)
    

if pose_cartesian_key not in st:
    pose_cartesian_mm = []
    pose_cartesian_meter = []
else:
    pose_cartesian = st[pose_cartesian_key]

for i in pose_cartesian:
    new_c = i / 1000
    pose_cartesian_meter.append(new_c)

print (pose_cartesian_meter)
# ---------- end pose_2 ----------

rec = DataRecorder(pose_2.out, DataLimit=-10, RecordData=True)  # disabled

panel_11 = Panel(rec)  # disabled
