# Grasshopper definition stability_analysis.ghx (Grasshopper 1.0.7)
# plug-ins: Karamba3D, Kiwi3d

panel = Panel("""0.2 0.1
0.48 1.15
1.05 0.93
110.405

0.55 0.49
0.50 0.59
1.0 0.73
110.8337""")
brep_10 = Brep(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)
brep_5 = Brep(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)
brep_1 = Brep(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)
brep = Brep(brep_10)
wires = BrepWireframe(Brep=brep, Density=-1)
item = ListItem(List=wires, Index=0, Wrap=True)
item_2 = ListItem(List=wires, Index=2, Wrap=True)
panel_2 = Panel("""Galapagos Species Record
------------------------
Created on: Tuesday, 01 August 2023  (17:10:50)


Generation 1
{
  Bio-Diversity: 0.984
  Genome[0], Fitness=110.74, Genes [0% · 0%]
  Genome[1], Fitness=109.25, Genes [53% · 56%]
  Genome[2], Fitness=108.88, Genes [53% · 53%]
  Genome[3], Fitness=99.89, Genes [98% · 8%]
  Genome[4], Fitness=98.44, Genes [97% · 95%]
  Genome[5], Fitness=97.33, Genes [47% · 58%]
  Genome[6], Fitness=95.66, Genes [6% · 11%]
  Genome[7], Fitness=93.81, Genes [97% · 92%]
  Genome[8], Fitness=93.43, Genes [52% · 40%]
  Genome[9], Fitness=92.45, Genes [48% · 39%]
  Genome[10], Fitness=91.62, Genes [3% · 94%]
  Genome[11], Fitness=90.46, Genes [95% · 5%]
  Genome[12], Fitness=90.20, Genes [53% · 69%]
  Genome[13], Fitness=87.92, Genes [95% · 89%]
  Genome[14], Fitness=84.08, Genes [58% · 50%]
  Genome[15], Fitness=84.06, Genes [50% · 34%]
  Genome[16], Fitness=83.13, Genes [90% · 92%]
  Genome[17], Fitness=79.83, Genes [52% · 32%]
  Genome[18], Fitness=79.62, Genes [97% · 18%]
  Genome[19], Fitness=78.03, Genes [48% · 27%]
  Genome[20], Fitness=77.04, Genes [94% · 81%]
  Genome[21], Fitness=76.60, Genes [35% · 37%]
  Genome[22], Fitness=75.14, Genes [61% · 53%]
  Genome[23], Fitness=73.41, Genes [18% · 23%]
  Genome[24], Fitness=72.94, Genes [95% · 69%]
  Genome[25], Fitness=72.90, Genes [60% · 82%]
  Genome[26], Fitness=72.88, Genes [44% · 19%]
  Genome[27], Fitness=72.69, Genes [10% · 31%]
  Genome[28], Fitness=72.57, Genes [31% · 34%]
  Genome[29], Fitness=72.18, Genes [31% · 32%]
  Genome[30], Fitness=72.07, Genes [82% · 82%]
  Genome[31], Fitness=72.03, Genes [16% · 13%]
  Genome[32], Fitness=71.73, Genes [40% · 24%]
  Genome[33], Fitness=71.47, Genes [40% · 58%]
  Genome[34], Fitness=71.30, Genes [3% · 81%]
  Genome[35], Fitness=70.97, Genes [61% · 84%]
  Genome[36], Fitness=70.66, Genes [40% · 13%]
  Genome[37], Fitness=70.52, Genes [94% · 16%]
  Genome[38], Fitness=70.30, Genes [26% · 26%]
  Genome[39], Fitness=70.24, Genes [34% · 0%]
  Genome[40], Fitness=70.24, Genes [77% · 77%]
  Genome[41], Fitness=69.89, Genes [34% · 2%]
  Genome[42], Fitness=69.83, Genes [13% · 55%]
  Genome[43], Fitness=69.46, Genes [27% · 26%]
  Genome[44], Fitness=68.95, Genes [76% · 73%]
  Genome[45], Fitness=68.74, Genes [35% · 98%]
  Genome[46], Fitness=68.67, Genes [77% · 74%]
  Genome[47], Fitness=68.64, Genes [71% · 81%]
  Genome[48], Fitness=68.64, Genes [27% · 24%]
  Genome[49], Fitness=68.62, Genes [58% · 97%]
  Genome[50], Fitness=68.13, Genes [34% · 23%]
  Genome[51], Fitness=68.08, Genes [47% · 15%]
  Genome[52], Fitness=68.06, Genes [23% · 16%]
  Genome[53], Fitness=68.04, Genes [71% · 5%]
  Genome[54], Fitness=68.01, Genes [66% · 90%]
  Genome[55], Fitness=67.35, Genes [35% · 97%]
  Genome[56], Fitness=66.59, Genes [35% · 16%]
  Genome[57], Fitness=66.42, Genes [68% · 97%]
  Genome[58], Fitness=65.89, Genes [24% · 68%]
  Genome[59], Fitness=65.63, Genes [76% · 65%]
  Genome[60], Fitness=65.35, Genes [81% · 65%]
  Genome[61], Fitness=65.21, Genes [24% · 60%]
  Genome[62], Fitness=65.14, Genes [0% · 37%]
  Genome[63], Fitness=65.14, Genes [29% · 44%]
  Genome[64], Fitness=64.80, Genes [76% · 35%]
  Genome[65], Fitness=64.69, Genes [27% · 3%]
  Genome[66], Fitness=64.42, Genes [50% · 87%]
  Genome[67], Fitness=64.06, Genes [76% · 8%]
  Genome[68], Fitness=64.03, Genes [73% · 98%]
  Genome[69], Fitness=63.84, Genes [29% · 10%]
  Genome[70], Fitness=63.82, Genes [77% · 95%]
  Genome[71], Fitness=63.65, Genes [71% · 32%]
  Genome[72], Fitness=63.51, Genes [89% · 44%]
  Genome[73], Fitness=63.44, Genes [98% · 34%]
  Genome[74], Fitness=63.30, Genes [66% · 19%]
  Genome[75], Fitness=63.10, Genes [21% · 6%]
  Genome[76], Fitness=63.02, Genes [50% · 89%]
  Genome[77], Fitness=63.01, Genes [65% · 19%]
  Genome[78], Fitness=62.86, Genes [15% · 73%]
  Genome[79], Fitness=62.79, Genes [32% · 77%]
  Genome[80], Fitness=62.39, Genes [11% · 66%]
  Genome[81], Fitness=62.20, Genes [34% · 81%]
  Genome[82], Fitness=61.83, Genes [81% · 8%]
  Genome[83], Fitness=61.65, Genes [71% · 21%]
  Genome[84], Fitness=61.62, Genes [71% · 47%]
  Genome[85], Fitness=61.62, Genes [2% · 45%]
  Genome[86], Fitness=61.36, Genes [73% · 47%]
  Genome[87], Fitness=61.02, Genes [5% · 74%]
  Genome[88], Fitness=60.63, Genes [90% · 37%]
  Genome[89], Fitness=60.32, Genes [10% · 85%]
  Genome[90], Fitness=59.71, Genes [85% · 11%]
  Genome[91], Fitness=59.64, Genes [37% · 65%]
  Genome[92], Fitness=59.54, Genes [32% · 66%]
  Genome[93], Fitness=59.01, Genes [56% · 23%]
  Genome[94], Fitness=58.85, Genes [0% · 47%]
  Genome[95], Fitness=58.73, Genes [87% · 16%]
  Genome[96], Fitness=58.25, Genes [89% · 27%]
  Genome[97], Fitness=57.97, Genes [16% · 89%]
  Genome[98], Fitness=57.84, Genes [45% · 89%]
  Genome[99], Fitness=57.40, Genes [58% · 21%]
}

Generation 2
{
  Bio-Diversity: 0.944
  Genome[0], Fitness=110.74, Genes [0% · 0%]
  Genome[1], Fitness=109.25, Genes [53% · 56%]
  {
    Record: Point Mutation at index 1: 0.1452 -> 0.1461
    Record: Point Mutation at index 0: 0.8226 -> 0.8509
  }
  Genome[2], Fitness=93.94, Genes [95% · 2%]
  Genome[3], Fitness=92.28, Genes [95% · 3%]
  Genome[4], Fitness=91.48, Genes [44% · 42%]
  {
    Record: Point Mutation at index 1: 0.0161 -> 0.0161
  }
  Genome[5], Fitness=83.44, Genes [3% · 23%]
  Genome[6], Fitness=79.60, Genes [13% · 18%]
  Genome[7], Fitness=77.79, Genes [58% · 76%]
  {
    Record: Point Mutation at index 0: 0.6452 -> 0.5897
  }
  Genome[8], Fitness=77.03, Genes [44% · 29%]
  Genome[9], Fitness=73.33, Genes [44% · 21%]
  {
    Record: Point Mutation at index 1: 0.6774 -> 0.784
  }
  Genome[10], Fitness=72.53, Genes [8% · 35%]
  {
    Record: Point Mutation at index 0: 0.6774 -> 0.6753
  }
  Genome[11], Fitness=71.36, Genes [29% · 31%]
  Genome[12], Fitness=71.11, Genes [23% · 26%]
  Genome[13], Fitness=71.03, Genes [81% · 81%]
  Genome[14], Fitness=71.00, Genes [27% · 32%]
  Genome[15], Fitness=70.57, Genes [23% · 21%]
  {
    Record: Genome was mutated to avoid collision
    Record: Genome was mutated to avoid collision
    Record: Genome was mutated to avoid collision
  }
  Genome[16], Fitness=70.12, Genes [81% · 79%]
  {
    Record: Point Mutation at index 1: 0.0968 -> 0.1001
  }
  Genome[17], Fitness=69.59, Genes [26% · 24%]
  {
    Record: Point Mutation at index 0: 0.3065 -> 0.3054
    Record: Genome was mutated to avoid collision
  }
  Genome[18], Fitness=69.47, Genes [55% · 31%]
  {
    Record: Point Mutation at index 0: 0.7903 -> 0.7893
  }
  Genome[19], Fitness=69.44, Genes [77% · 85%]
  {
    Record: Point Mutation at index 1: 0.0806 -> 0.0797
  }
  Genome[20], Fitness=69.23, Genes [21% · 29%]
  Genome[21], Fitness=68.72, Genes [34% · 24%]
  {
    Record: Point Mutation at index 0: 0.3065 -> 0.3088
  }
  Genome[22], Fitness=68.68, Genes [53% · 89%]
  Genome[23], Fitness=68.65, Genes [13% · 56%]
  Genome[24], Fitness=67.62, Genes [19% · 11%]
  Genome[25], Fitness=66.73, Genes [76% · 68%]
  Genome[26], Fitness=66.53, Genes [53% · 24%]
  {
    Record: Genome was mutated to avoid collision
  }
  Genome[27], Fitness=65.82, Genes [31% · 11%]
  Genome[28], Fitness=65.56, Genes [31% · 15%]
  Genome[29], Fitness=65.07, Genes [73% · 94%]
  Genome[30], Fitness=64.98, Genes [76% · 6%]
  Genome[31], Fitness=64.28, Genes [77% · 94%]
  Genome[32], Fitness=63.43, Genes [27% · 10%]
  {
    Record: Genome was mutated to avoid collision
    Record: Genome was mutated to avoid collision
  }
  Genome[33], Fitness=62.88, Genes [89% · 10%]
  Genome[34], Fitness=62.76, Genes [77% · 8%]
  Genome[35], Fitness=62.47, Genes [42% · 71%]
  Genome[36], Fitness=62.32, Genes [29% · 53%]
  {
    Record: Genome was mutated to avoid collision
  }
  Genome[37], Fitness=62.25, Genes [5% · 76%]
  Genome[38], Fitness=62.15, Genes [85% · 5%]
  Genome[39], Fitness=61.89, Genes [66% · 23%]
  {
    Record: Point Mutation at index 0: 0.0968 -> 0.0947
  }
  Genome[40], Fitness=61.40, Genes [24% · 77%]
  Genome[41], Fitness=61.25, Genes [90% · 16%]
  Genome[42], Fitness=60.76, Genes [58% · 8%]
  Genome[43], Fitness=60.76, Genes [53% · 19%]
  Genome[44], Fitness=59.74, Genes [68% · 42%]
  Genome[45], Fitness=58.96, Genes [52% · 2%]
  Genome[46], Fitness=58.92, Genes [37% · 77%]
  {
    Record: Point Mutation at index 1: 0.0484 -> 0.0495
    Record: Genome was mutated to avoid collision
  }
  Genome[47], Fitness=58.69, Genes [40% · 85%]
  {
    Record: Point Mutation at index 1: 0.0484 -> 0.046
    Record: Genome was mutated to avoid collision
  }
  Genome[48], Fitness=58.65, Genes [84% · 15%]
  {
    Record: Genome carried over from previous generation.
  }
  Genome[49], Fitness=58.56, Genes [58% · 26%]
  {
    Record: Genome carried over from previous generation.
  }
}

Generation 3
{
  Bio-Diversity: 0.855
  Genome[0], Fitness=110.74, Genes [0% · 0%]
  Genome[1], Fitness=109.25, Genes [53% · 56%]
  Genome[2], Fitness=100.45, Genes [45% · 48%]
  Genome[3], Fitness=87.20, Genes [55% · 71%]
  Genome[4], Fitness=85.54, Genes [56% · 71%]
  Genome[5], Fitness=84.05, Genes [61% · 66%]
  Genome[6], Fitness=82.30, Genes [10% · 19%]
  {
    Record: Genome was mutated to avoid collision
  }
  Genome[7], Fitness=78.40, Genes [5% · 27%]
  {
    Record: Point Mutation at index 1: 0.1613 -> 0.1612
  }
  Genome[8], Fitness=76.76, Genes [8% · 26%]
  Genome[9], Fitness=75.77, Genes [52% · 29%]
  Genome[10], Fitness=75.59, Genes [11% · 26%]
  Genome[11], Fitness=75.53, Genes [42% · 29%]
  Genome[12], Fitness=75.39, Genes [53% · 82%]
  {
    Record: Genome was mutated to avoid collision
  }
  Genome[13], Fitness=73.96, Genes [53% · 31%]
  Genome[14], Fitness=72.73, Genes [19% · 23%]
  {
    Record: Point Mutation at index 0: 0.7742 -> 0.7434
  }
  Genome[15], Fitness=71.85, Genes [21% · 21%]
  Genome[16], Fitness=71.75, Genes [29% · 32%]
  Genome[17], Fitness=71.48, Genes [79% · 82%]
  {
    Record: Genome was mutated to avoid collision
  }
  Genome[18], Fitness=71.45, Genes [18% · 26%]
  {
    Record: Point Mutation at index 1: 0.5 -> 0.5003
  }
  Genome[19], Fitness=71.41, Genes [31% · 31%]
  {
    Record: Genome was mutated to avoid collision
  }
  Genome[20], Fitness=71.38, Genes [23% · 24%]
  Genome[21], Fitness=71.11, Genes [79% · 81%]
  {
    Record: Point Mutation at index 1: 0.2742 -> 0.2765
  }
  Genome[22], Fitness=71.02, Genes [21% · 26%]
  {
    Record: Genome was mutated to avoid collision
  }
  Genome[23], Fitness=70.79, Genes [26% · 27%]
  {
    Record: Genome was mutated to avoid collision
  }
  Genome[24], Fitness=70.46, Genes [71% · 77%]
  Genome[25], Fitness=70.46, Genes [40% · 15%]
  {
    Record: Point Mutation at index 0: 0.7097 -> 0.7216
  }
  Genome[26], Fitness=69.85, Genes [15% · 56%]
  {
    Record: Genome was mutated to avoid collision
  }
  Genome[27], Fitness=69.78, Genes [23% · 19%]
  {
    Record: Genome was mutated to avoid collision
  }
  Genome[28], Fitness=69.75, Genes [29% · 27%]
  {
    Record: Genome was mutated to avoid collision
  }
  Genome[29], Fitness=69.25, Genes [60% · 42%]
  Genome[30], Fitness=69.24, Genes [24% · 21%]
  Genome[31], Fitness=68.69, Genes [16% · 50%]
  {
    Record: Point Mutation at index 0: 0.2258 -> 0.1905
  }
  Genome[32], Fitness=68.43, Genes [24% · 19%]
  Genome[33], Fitness=68.13, Genes [32% · 24%]
  {
    Record: Point Mutation at index 1: 0.3226 -> 0.3236
    Record: Genome was mutated to avoid collision
  }
  Genome[34], Fitness=67.27, Genes [26% · 19%]
  {
    Record: Genome was mutated to avoid collision
  }
  Genome[35], Fitness=67.23, Genes [74% · 85%]
  Genome[36], Fitness=66.21, Genes [69% · 89%]
  {
    Record: Genome was mutated to avoid collision
  }
  Genome[37], Fitness=66.08, Genes [52% · 89%]
  {
    Record: Point Mutation at index 0: 0.5323 -> 0.5339
  }
  Genome[38], Fitness=65.67, Genes [29% · 18%]
  {
    Record: Genome was mutated to avoid collision
  }
  Genome[39], Fitness=65.59, Genes [74% · 90%]
  Genome[40], Fitness=65.57, Genes [26% · 15%]
  Genome[41], Fitness=65.36, Genes [23% · 53%]
  {
    Record: Point Mutation at index 1: 0.2258 -> 0.2598
  }
  Genome[42], Fitness=65.19, Genes [27% · 15%]
  Genome[43], Fitness=65.17, Genes [73% · 92%]
  Genome[44], Fitness=63.51, Genes [53% · 21%]
  {
    Record: Point Mutation at index 1: 0.6129 -> 0.6686
  }
  Genome[45], Fitness=63.43, Genes [26% · 11%]
  Genome[46], Fitness=63.00, Genes [31% · 50%]
  Genome[47], Fitness=61.42, Genes [45% · 81%]
  {
    Record: Point Mutation at index 0: 0.4516 -> 0.4535
  }
  Genome[48], Fitness=59.76, Genes [61% · 19%]
  {
    Record: Genome carried over from previous generation.
    Record: Genome carried over from previous generation.
  }
  Genome[49], Fitness=59.54, Genes [53% · 2%]
  {
    Record: Genome carried over from previous generation.
    Record: Genome carried over from previous generation.
  }
}

Generation 4
{
  Bio-Diversity: 0.831
  Genome[0], Fitness=110.74, Genes [0% · 0%]
  Genome[1], Fitness=110.03, Genes [52% · 56%]
  Genome[2], Fitness=109.25, Genes [53% · 56%]
  Genome[3], Fitness=106.71, Genes [53% · 58%]
  Genome[4], Fitness=106.21, Genes [52% · 48%]
  Genome[5], Fitness=88.56, Genes [52% · 37%]
  Genome[6], Fitness=86.89, Genes [60% · 66%]
  {
    Record: Point Mutation at index 0: 0.2742 -> 0.2765
  }
  Genome[7], Fitness=86.17, Genes [53% · 71%]
  Genome[8], Fitness=85.68, Genes [42% · 39%]
  {
    Record: Genome was mutated to avoid collision
  }
  Genome[9], Fitness=80.42, Genes [52% · 76%]
  {
    Record: Point Mutation at index 1: 0.1935 -> 0.1931
  }
  Genome[10], Fitness=79.76, Genes [8% · 24%]
  Genome[11], Fitness=78.11, Genes [44% · 31%]
  Genome[12], Fitness=77.71, Genes [13% · 21%]
  Genome[13], Fitness=77.04, Genes [10% · 26%]
  Genome[14], Fitness=76.05, Genes [53% · 32%]
  {
    Record: Genome was mutated to avoid collision
  }
  Genome[15], Fitness=75.86, Genes [55% · 82%]
  Genome[16], Fitness=74.24, Genes [60% · 47%]
  Genome[17], Fitness=74.24, Genes [58% · 82%]
  {
    Record: Point Mutation at index 1: 0.3226 -> 0.3267
    Record: Genome was mutated to avoid collision
    Record: Genome was mutated to avoid collision
    Record: Genome was mutated to avoid collision
    Record: Genome was mutated to avoid collision
  }
  Genome[18], Fitness=74.08, Genes [18% · 19%]
  {
    Record: Point Mutation at index 0: 0.5323 -> 0.5297
  }
  Genome[19], Fitness=74.04, Genes [18% · 21%]
  Genome[20], Fitness=73.56, Genes [60% · 81%]
  Genome[21], Fitness=73.18, Genes [16% · 24%]
  {
    Record: Genome was mutated to avoid collision
    Record: Genome was mutated to avoid collision
  }
  Genome[22], Fitness=72.98, Genes [19% · 21%]
  Genome[23], Fitness=72.01, Genes [52% · 26%]
  {
    Record: Point Mutation at index 0: 0.3065 -> 0.3064
    Record: Genome was mutated to avoid collision
  }
  Genome[24], Fitness=71.86, Genes [42% · 19%]
  {
    Record: Genome was mutated to avoid collision
    Record: Genome was mutated to avoid collision
    Record: Genome was mutated to avoid collision
    Record: Genome was mutated to avoid collision
    Record: Genome was mutated to avoid collision
    Record: Genome was mutated to avoid collision
  }
  Genome[25], Fitness=71.18, Genes [23% · 23%]
  Genome[26], Fitness=71.18, Genes [27% · 31%]
  {
    Record: Point Mutation at index 0: 0.5161 -> 0.5168
    Record: Point Mutation at index 1: 0.2903 -> 0.2661
  }
  Genome[27], Fitness=71.07, Genes [19% · 26%]
  {
    Record: Genome was mutated to avoid collision
  }
  Genome[28], Fitness=70.98, Genes [24% · 26%]
  Genome[29], Fitness=70.96, Genes [66% · 79%]
  Genome[30], Fitness=70.64, Genes [73% · 77%]
  Genome[31], Fitness=70.60, Genes [52% · 85%]
  Genome[32], Fitness=70.43, Genes [27% · 34%]
  {
    Record: Point Mutation at index 0: 0.7903 -> 0.594
  }
  Genome[33], Fitness=70.21, Genes [37% · 23%]
  Genome[34], Fitness=70.11, Genes [19% · 27%]
  Genome[35], Fitness=69.61, Genes [63% · 84%]
  {
    Record: Point Mutation at index 1: 0.3065 -> 0.3033
    Record: Point Mutation at index 1: 0.2903 -> 0.3195
    Record: Genome was mutated to avoid collision
  }
  Genome[36], Fitness=69.59, Genes [74% · 81%]
  {
    Record: Point Mutation at index 0: 0.0968 -> 0.0973
  }
  Genome[37], Fitness=69.32, Genes [29% · 39%]
  {
    Record: Point Mutation at index 1: 0.2258 -> 0.2254
  }
  Genome[38], Fitness=69.00, Genes [63% · 87%]
  {
    Record: Point Mutation at index 0: 0.4516 -> 0.4482
    Record: Genome was mutated to avoid collision
  }
  Genome[39], Fitness=68.92, Genes [73% · 81%]
  {
    Record: Genome was mutated to avoid collision
  }
  Genome[40], Fitness=68.90, Genes [23% · 18%]
  {
    Record: Point Mutation at index 0: 0.5323 -> 0.5301
  }
  Genome[41], Fitness=68.72, Genes [15% · 58%]
  Genome[42], Fitness=67.97, Genes [74% · 84%]
  {
    Record: Point Mutation at index 0: 0.5323 -> 0.534
    Record: Point Mutation at index 1: 0.6613 -> 0.6939
    Record: Genome was mutated to avoid collision
  }
  Genome[43], Fitness=67.84, Genes [27% · 23%]
  Genome[44], Fitness=67.24, Genes [23% · 15%]
  {
    Record: Point Mutation at index 1: 0.2903 -> 0.3767
  }
  Genome[45], Fitness=67.17, Genes [31% · 23%]
  {
    Record: Point Mutation at index 0: 0.5323 -> 0.5316
  }
  Genome[46], Fitness=66.52, Genes [79% · 71%]
  {
    Record: Point Mutation at index 0: 0.5323 -> 0.5339
    Record: Genome was mutated to avoid collision
  }
  Genome[47], Fitness=66.51, Genes [23% · 13%]
  {
    Record: Genome carried over from previous generation.
    Record: Genome carried over from previous generation.
    Record: Genome carried over from previous generation.
  }
  Genome[48], Fitness=66.29, Genes [24% · 15%]
  {
    Record: Point Mutation at index 0: 0.5323 -> 0.531
  }
  Genome[49], Fitness=66.03, Genes [26% · 16%]
  {
    Record: Genome carried over from previous generation.
    Record: Genome carried over from previous generation.
    Record: Genome carried over from previous generation.
  }
}

Generation 5
{
  Bio-Diversity: 0.798
  Genome[0], Fitness=110.74, Genes [0% · 0%]
  Genome[1], Fitness=110.38, Genes [53% · 55%]
  Genome[2], Fitness=110.03, Genes [52% · 56%]
  {
    Record: Genome was mutated to avoid collision
    Record: Genome was mutated to avoid collision
    Record: Genome was mutated to avoid collision
    Record: Genome was mutated to avoid collision
    Record: Genome was mutated to avoid collision
    Record: Genome was mutated to avoid collision
    Record: Genome was mutated to avoid collision
    Record: Genome was mutated to avoid collision
  }
  Genome[3], Fitness=109.01, Genes [50% · 56%]
  {
    Record: Genome was mutated to avoid collision
  }
  Genome[4], Fitness=104.90, Genes [52% · 60%]
  Genome[5], Fitness=103.97, Genes [50% · 60%]
  Genome[6], Fitness=102.29, Genes [53% · 48%]
  Genome[7], Fitness=99.85, Genes [53% · 47%]
  {
    Record: Point Mutation at index 0: 0.3387 -> 0.3396
    Record: Genome was mutated to avoid collision
  }
  Genome[8], Fitness=99.08, Genes [53% · 63%]
  Genome[9], Fitness=98.49, Genes [52% · 44%]
  {
    Record: Point Mutation at index 1: 0.2419 -> 0.2583
    Record: Genome was mutated to avoid collision
  }
  Genome[10], Fitness=94.93, Genes [50% · 40%]
  {
    Record: Genome was mutated to avoid collision
  }
  Genome[11], Fitness=92.62, Genes [52% · 68%]
  {
    Record: Genome was mutated to avoid collision
  }
  Genome[12], Fitness=90.97, Genes [52% · 39%]
  Genome[13], Fitness=90.35, Genes [50% · 37%]
  {
    Record: Point Mutation at index 1: 0.7742 -> 0.7737
  }
  Genome[14], Fitness=89.24, Genes [56% · 48%]
  {
    Record: Genome was mutated to avoid collision
  }
  Genome[15], Fitness=89.01, Genes [55% · 69%]
  Genome[16], Fitness=88.09, Genes [60% · 65%]
  {
    Record: Point Mutation at index 0: 0.2258 -> 0.2239
  }
  Genome[17], Fitness=82.66, Genes [44% · 34%]
  Genome[18], Fitness=82.27, Genes [52% · 74%]
  Genome[19], Fitness=81.07, Genes [53% · 76%]
  Genome[20], Fitness=80.85, Genes [10% · 21%]
  Genome[21], Fitness=80.80, Genes [63% · 68%]
  {
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""")
multiplication = Multiplication(A=Slider(1, range=0..1000), B=Slider(1000, range=0..10000))
galapagos = Galapagos(fitness=emodes, gene=[number_slider_3, number_slider_4, number_slider_2])
visopt = VisualizeOptions(
    ScaleCrossSections=1,
    ScaleSupports=Slider(0.2, range=-0.5..0.5),
    ScaleLoads=Slider(0.0005, range=0..0.001),
    ScaleCouplingPoints=1,
    ScaleConnectingPoints=1,
    ScaleRefinedControlPoints=1,
    ColourBeam=RGB(211, 211, 211),
    ColourCable=RGB(255, 255, 255),
    ColourSupports=RGB(232, 65, 119),
    ColourLoads=RGB(232, 65, 119),
    ColourConnects=RGB(255, 255, 255),
    ColourRefinedPatches=RGB(139, 0, 0),
    ColourSliding=RGB(135, 16, 55))

number_slider = Slider(11, range=0..100)
series = Series(Start=Slider(0, range=0..1000), Step=Slider(2, range=0..5), Count=number_slider)
series_2 = Series(Start=0, Step=1, Count=number_slider)
panel_3 = Panel(series)
ldc = LoadDisplCurve(TimeStepList=series_2, ValueList=series)
list = ValueList({"Displacements": 1, "Stresses": 2, "SupportForces": 3}, selected="Displacements")
nonlina = NonLinearAnalysis(
    Name="Non_Linear_10",
    Iterations=Slider(100, range=0..1000),
    EquilibriumAccurancy=0.001,
    OutputSetting=list,
    GlobalLDCurve=ldc,
    AdaptiveForceControl=Slider(3, range=0..10),
    OutputFrequency=1)

list_2 = ValueList({"STEEL": 1, "WOOD": 2, "GFRP": 3, "ETFE (Membrane)": 4, "CONCRETE": 5, "ALUMINIUM": 6}, selected="CONCRETE")
matdef = MaterialDefaults(Type=list_2, IsNmm2=False, IskNcm2=False, IskNm2=True, mUnit=1)  # -> Material, YoungsModulus, AlphaT, Nue, Density, Strength
srfref = SurfaceRefinement(PDeg=3, QDeg=5, ElementRefU=1, ElementRefV=5, IsKnotApproxElementSize=False, IsKnotSubdivision=True)
list_3 = ValueList({"DEAD": 1, "SNOW": 2, "PRES": 3, "PRES_FL": 4, "MOMENT": 5}, selected="DEAD")
supcrv = SupportCurve(Crv=item, DispX=True, DispY=True, DispZ=True, Rot=False)
shell = ShellElement(Brep=brep, Material=matdef.Material, Thickness=0.1, Refinement=srfref, HingeCoupling=False)
crvload = CurveLoad(Crv=item_2, Loadtype=list_3, Direction=Vector(0, 0, -1), Value=multiplication, LoadCase=2)
amodel = AnalysisModel(
    Analysis=nonlina,
    StructuralElements=shell,
    Supports=supcrv,
    Loads=crvload,
    Visualizer=visopt,
    IntersectionTolerance=0.001,
    IsCarat=True,
    IsKratos=False,
    PenaltyFac=10000000,
    ShowCouplingIDs=False,
    ShowEdgeIDs=False,
    ShowGeo=True,
    ShowPatchIDs=False,
    ShowPrePro=True,
    ShowRef=False)

lina = LinearAnalysis(Name="Linear", OutputSetting=list)

demodel = DeconstructModel(Model=amodel)  # -> StructuralElements, RefinedGeometries, GaussPoints, InputText

panel_4 = Panel("C:\Users\timda\Documents\Uni-Programming\revamp\workspace\add_on_am\nlin_analysis")
run_analysis = IGASolver(AnalysisModel=amodel, Path=panel_4, Run=Button(), antiFreeze=False, showWindow=True)  # -> ResultModel, ErrorReport
defmod = DeformedModel(
    Model=run_analysis.ResultModel,
    LoadCase=Slider(10, range=0..20),
    ScaleFactor=Slider(1, range=-10..10),
    FlyingNodeLimit=100000)  # -> Model, Geo, DeformedStructuralElements

matselect = MaterialSelectionKaramba3D(menu=[dropdown(7), dropdown(1)])  # disabled
Z = UnitZ(Factor=-1)
cross_section = CrossSectionKaramba3D(
    FamilyNameOfCrossSection="DefaultCroSec",
    Height_cm=10,
    ReinforcementAreas_cm2_m=[0, 0, 0, 0],
    ReinforcementConcreteCovers_cm=[3.5, 4.5, -4.5, -3.5],
    PrincipalReinforcementDirection_deg=0,
    mode="Shell RC Standard - Const.")
list_4 = ValueList({"X Displacement": 1, "Y Displacement": 2, "Z Displacement": 3, "Displacement Length": 4, "P_N1": 5, "P_N2": 6, "N1": 7, "N2": 8, "N12": 9, "P_M1 (Shell)": 10, "P_M2 (Shell)": 11, "M1 (Shell)": 12, "M2 (Shell)": 13, "M12 (Shell)": 14, "von_Mises (Shell)": 15}, selected="von_Mises (Shell)")
_2drescolplot = _2DElementResultColourPlot(Model=defmod.Model, Type=list_4, VisMeshCoarse=True, VisMeshSmooth=False)  # -> Model, Mesh, ValueDomain, LegendC, LegendT
preview = CustomPreview(Geometry=defmod.Geo, Material=ColourSwatch(SwatchColor=RGBA(255, 0, 0, 150)))
mesh = MeshBrep(
    Brep=defmod.Geo,
    Settings={GridMaxCount=0, GridMinCount=16, JaggedSeams=False, MaxEdgeLength=0, MinEdgeLength=0.0001, MinTolerance=0, Refine=True, RefineAngle=0, RelativeTolerance=0.65, SimplePlanes=True, Tolerance=0})
demesh = DeconstructMesh(Mesh=mesh)  # -> Vertices, Faces, Colours, Normals
list_5 = ValueList({"EigenMode_#0": 0, "EigenMode_#1": 1, "EigenMode_#2": 2}, selected="EigenMode_#0")
item_3 = ListItem(List=demesh.Vertices, Index=Slider(5795, range=0..10000), Wrap=True)
swatch = ColourSwatch(SwatchColor=RGB(0, 54, 214))

number_slider_2 = Slider(0.93, range=0..1)
number_slider_3 = Slider(0.1, range=0.1..0.3)
number_slider_4 = Slider(1.15, range=0.6..1.2)
number_slider_5 = Slider(2, range=0..10)
number_slider_6 = Slider(5, range=0..10)

crvs = GhPythonScript(
    width=number_slider_6,
    height=number_slider_5,
    up_a=number_slider_3,
    up_f=number_slider_4,
    up_ro=number_slider_2,
    down_a=Slider(0.49, range=0.3..0.6),
    down_f=Slider(0.59, range=0.4..0.6),
    down_ro=Slider(0.73, range=0..1))  # -> base, base_crv, top, top_crv
# ---------- crvs: Python ----------
__author__ = "timda"
__version__ = "2023.07.15"

import rhinoscriptsyntax as rs
import math
from Rhino.Geometry import Point3d, Vector3d, Curve
from Rhino.Collections import Point3dList

class CrvParams:
    def __init__(self, amp, freq, ro):
        self.amp = amp
        self.freq = freq
        self.ro = ro*math.pi
    def crv(self, width, height):
        points = []
        iterator = [i*0.1 for i in range(int(width/0.1 +1.999))]
        for x in iterator:
            points.append(Point3d(x, -self.amp*math.sin(2.0 * math.pi * self.freq*x + self.ro), height))
        
        points = Point3dList(points)
        start_tangent = Vector3d(iterator[0], self.amp * 2.0 * math.pi * self.freq * math.cos(2.0 * math.pi * self.freq*iterator[0] + self.ro), 0)
        end_tangent = Vector3d(iterator[0], self.amp * 2.0 * math.pi * self.freq * math.cos(2.0 * math.pi * self.freq*iterator[-1] + self.ro), 0)
        self.curve = Curve.CreateInterpolatedCurve(points, 3)
        return self.curve


base = CrvParams(down_a, down_f, down_ro)
base_crv = base.crv(width, 0)
top = CrvParams(up_a, up_f, up_ro)
top_crv = top.crv(width, height)
# ---------- end crvs ----------

crv = Curve(crvs.base_crv)
crv_2 = Curve(crvs.top_crv)
rulesrf = RuledSurface(CurveA=crv, CurveB=crv_2)

number_slider_7 = Slider(0.05, range=0..0.1)
brep_2 = Brep(rulesrf)
brep_to_mesh = GhPythonScript(
    brep=brep_2,
    w=number_slider_6,
    h=number_slider_5,
    elsize=number_slider_7,
    max_size=number_slider_7,
    min_size=number_slider_7,
    base=crvs.base,
    top=crvs.top)  # -> rmesh, wall; inputs brep: Brep
# ---------- brep_to_mesh: Python ----------
__author__ = "timda"
__version__ = "2023.07.14"

import rhinoscriptsyntax as rs
from compas_ghpython.artists import MeshArtist
from add_on_am import NewWall

wall = NewWall(w, h, elsize)
wall.undulate(top, base)
mesh = wall.from_brep(brep, max_size, min_size)
mesh_art = MeshArtist(mesh)
rmesh = mesh_art.draw_mesh()
# ---------- end brep_to_mesh ----------
swatch_2 = ColourSwatch(SwatchColor=RGB(194, 194, 194))
mcol = MeshColours(Mesh=brep_to_mesh.rmesh, Colours=swatch_2)

python = GhPythonScript(mesh=brep_to_mesh.rmesh)  # -> supports; inputs mesh: Mesh
# ---------- python: Python ----------
__author__ = "timda"
__version__ = "2023.07.31"

import rhinoscriptsyntax as rs
supports = []
for v in mesh.Vertices:
    if v.Z == 0:
        supports.append(v)
# ---------- end python ----------
preview_2 = CustomPreview(Geometry=mcol, Material=swatch_2)
supp = SupportKaramba3D(PosInd=python, menu=[buttons(on, on, on, off, off, off)])
loads = LoadsKaramba3D(Vector=Z, Mesh=mcol, LCase="0", mode="MeshLoad -Const.", menu=[buttons(off, on, off), buttons(on, on)])
meshtoshell = MeshToShellKaramba3D(Mesh=mcol, CrossSection=cross_section, LimitDistance_m=0.005)  # -> Element, Points, Info
panel_5 = Panel(loads)  # disabled
assemble = AssembleModelKaramba3D(Elem=meshtoshell.Element, Support=supp, Load=loads, LimitDistance_m=0.005)  # -> Model, Info, Mass_kg, CenterOfGravity, LoadCaseNames
emodes = EigenModesKaramba3D(Model=assemble.Model, FromIndex=1, NumberOfModes=3, MaximumNumberOfIterations=300, Epsilon=1e-07)  # -> ModelWithEigenModesAsLoadCaseResults, Eigenvalues
bmodes = BucklingModesKaramba3D(Model=assemble.Model, FromIndex=1, NumberOfModes=1, MaximumNumberOfIterations=300, Epsilon=1e-07)  # -> ModelWithBucklingModesAsLoadCaseResults, BucklingLoadFactors
panel_6 = Panel(bmodes.BucklingLoadFactors)
mesh_2 = MeshBrep(
    Brep=rulesrf,
    Settings={GridMaxCount=0, GridMinCount=16, JaggedSeams=False, MaxEdgeLength=0, MinEdgeLength=0.0001, MinTolerance=0, Refine=True, RefineAngle=0, RelativeTolerance=0.65, SimplePlanes=True, Tolerance=0})
demesh_2 = DeconstructMesh(Mesh=mesh_2)  # -> Vertices, Faces, Colours, Normals
python_2 = GhPythonScript(V=demesh_2.Vertices)  # -> a; inputs V: list of Point3d
# ---------- python_2: Python ----------
__author__ = "timda"
__version__ = "2023.08.13"

import rhinoscriptsyntax as rs

for vertex in V:
    if vertex.X > 4.97 and vertex.Z > 1.97:
        print(vertex, V.index(vertex))
# ---------- end python_2 ----------
repeat = RepeatData(Data=swatch_2, Length=4)
item_4 = ListItem(List=demesh_2.Vertices, Index=Slider(424, range=0..966), Wrap=True)
dots = DotDisplay(Point=[item_4, item_3], Colour=swatch, Size=Slider(0.02, range=0..0.1))
modelview = ModelViewKaramba3D(Model=bmodes.ModelWithBucklingModesAsLoadCaseResults, ResultFactors=1, ResultCase=list_5, Colors=repeat)  # -> Model, DeformedMesh, DeformedAxes, DeformedModel
vec2pt = Vector2Pt(PointA=item_4, PointB=item_3, Unitize=False)  # -> Vector, Length
preview_3 = CustomPreview(Geometry=modelview.DeformedMesh, Material=swatch_2)
vdisex = VectorDisplayEx(Point=item_4, Vector=vec2pt.Vector, Colour=swatch, Width=Slider(10, range=0..10))
