# Grasshopper definition wall.ghx (Grasshopper 1.0.7)

number_slider = Slider(2, range=0..10)
number_slider_2 = Slider(5, range=0..10)
crvs = GhPythonScript(
    width=number_slider_2,
    height=number_slider,
    up_a=Slider(0.1, range=0.1..0.3),
    up_f=Slider(1.15, range=0.6..1.2),
    up_ro=Slider(0.93, range=0..1),
    down_a=Slider(0.49, range=0.3..0.6),
    down_f=Slider(0.59, range=0.4..0.6),
    down_ro=Slider(0.73, range=0..1))  # -> base, base_crv, top, top_crv
# ---------- crvs: Python ----------
__author__ = "timda"
__version__ = "2023.07.15"

import rhinoscriptsyntax as rs
import math
from Rhino.Geometry import Point3d, Vector3d, Curve
from Rhino.Collections import Point3dList

class CrvParams:
    def __init__(self, amp, freq, ro):
        self.amp = amp
        self.freq = freq
        self.ro = ro*math.pi
    def crv(self, width, height):
        points = []
        iterator = [i*0.1 for i in range(int(width/0.1 +1.999))]
        for x in iterator:
            points.append(Point3d(x, -self.amp*math.sin(2.0 * math.pi * self.freq*x + self.ro), height))
        
        points = Point3dList(points)
        start_tangent = Vector3d(iterator[0], self.amp * 2.0 * math.pi * self.freq * math.cos(2.0 * math.pi * self.freq*iterator[0] + self.ro), 0)
        end_tangent = Vector3d(iterator[0], self.amp * 2.0 * math.pi * self.freq * math.cos(2.0 * math.pi * self.freq*iterator[-1] + self.ro), 0)
        self.curve = Curve.CreateInterpolatedCurve(points, 3)
        return self.curve


base = CrvParams(down_a, down_f, down_ro)
base_crv = base.crv(width, 0)
top = CrvParams(up_a, up_f, up_ro)
top_crv = top.crv(width, height)
# ---------- end crvs ----------
crv = Curve(crvs.base_crv)
crv_2 = Curve(crvs.top_crv)
rulesrf = RuledSurface(CurveA=crv, CurveB=crv_2)

number_slider_3 = Slider(0.05, range=0..0.1)
brep = Brep(rulesrf)
brep_to_mesh = GhPythonScript(
    brep=brep,
    w=number_slider_2,
    h=number_slider,
    elsize=number_slider_3,
    max_size=number_slider_3,
    min_size=number_slider_3,
    base=crvs.base,
    top=crvs.top)  # -> rmesh, wall; inputs brep: Brep
# ---------- brep_to_mesh: Python ----------
__author__ = "timda"
__version__ = "2023.07.14"

import rhinoscriptsyntax as rs
from compas_ghpython.artists import MeshArtist
from add_on_am import NewWall

wall = NewWall(w, h, elsize)
wall.undulate(top, base)
mesh = wall.from_brep(brep, max_size, min_size)
mesh_art = MeshArtist(mesh)
rmesh = mesh_art.draw_mesh()
# ---------- end brep_to_mesh ----------

flipm = FlipMesh(Mesh=brep_to_mesh.rmesh, VertexNormals=True, FaceNormals=True, FaceOrientation=True)

mcol = MeshColours(Mesh=flipm, Colours=ColourSwatch(SwatchColor=RGB(173, 172, 172)))
