# Grasshopper definition old_path_heat_method.ghx (Grasshopper 1.0.7)
# plug-ins: Kangaroo2 Components

number_slider = Slider(0.73, range=0..1)
number_slider_2 = Slider(0.49, range=0.3..0.6)
number_slider_3 = Slider(0.59, range=0.4..0.6)
number_slider_4 = Slider(2, range=0..10)
number_slider_5 = Slider(5, range=0..10)
crvs = GhPythonScript(
    width=number_slider_5,
    height=number_slider_4,
    up_a=Slider(0.1, range=0.1..0.3),
    up_f=Slider(1.15, range=0.6..1.2),
    up_ro=Slider(0.93, range=0..1),
    down_a=number_slider_2,
    down_f=number_slider_3,
    down_ro=number_slider)  # -> base, base_crv, top, top_crv
# ---------- crvs: Python ----------
__author__ = "timda"
__version__ = "2023.07.15"

import rhinoscriptsyntax as rs
import math
from Rhino.Geometry import Point3d, Vector3d, Curve
from Rhino.Collections import Point3dList

class CrvParams:
    def __init__(self, amp, freq, ro):
        self.amp = amp
        self.freq = freq
        self.ro = ro*math.pi
    def crv(self, width, height):
        points = []
        iterator = [i*0.1 for i in range(int(width/0.1 +1.999))]
        for x in iterator:
            points.append(Point3d(x, -self.amp*math.sin(2.0 * math.pi * self.freq*x + self.ro), height))
        
        points = Point3dList(points)
        start_tangent = Vector3d(iterator[0], self.amp * 2.0 * math.pi * self.freq * math.cos(2.0 * math.pi * self.freq*iterator[0] + self.ro), 0)
        end_tangent = Vector3d(iterator[0], self.amp * 2.0 * math.pi * self.freq * math.cos(2.0 * math.pi * self.freq*iterator[-1] + self.ro), 0)
        self.curve = Curve.CreateInterpolatedCurve(points, 3)
        return self.curve


base = CrvParams(down_a, down_f, down_ro)
base_crv = base.crv(width, 0)
top = CrvParams(up_a, up_f, up_ro)
top_crv = top.crv(width, height)
# ---------- end crvs ----------
crv = Curve(crvs.base_crv)
crv_2 = Curve(crvs.top_crv)
rulesrf = RuledSurface(CurveA=crv, CurveB=crv_2)

# ---- group: UNDULATION
base_sine_crv = GhPythonScript(width=number_slider_5, a=number_slider_2, f=number_slider_3, ro=number_slider)  # -> c_curve, curve, L
# ---------- base_sine_crv: Python ----------
import Rhino.Geometry as rg
from Rhino.Collections import Point3dList
from compas.geometry import NurbsCurve 
import math

points = []
iterator = [i*0.1 for i in range(int(width/0.1 +1.999))]
for x in iterator:
    points.append(rg.Point3d(x, -a*math.sin(2.0 * math.pi * f*x + ro), 0))

points = Point3dList(points)
start_tangent = rg.Vector3d(iterator[0], a * 2.0 * math.pi * f * math.cos(2.0 * math.pi * f*iterator[0] + ro), 0)
end_tangent = rg.Vector3d(iterator[0], a * 2.0 * math.pi * f * math.cos(2.0 * math.pi * f*iterator[-1] + ro), 0)
curve = rg.Curve.CreateInterpolatedCurve(points, 3)


c_curve = NurbsCurve().from_interpolation(points)
L = curve.GetLength()
# ---------- end base_sine_crv ----------

# ----
number_slider_6 = Slider(0.025, range=0..0.1)
brep = Brep(rulesrf)
brep_to_mesh = GhPythonScript(
    brep=brep,
    w=number_slider_5,
    h=number_slider_4,
    elsize=number_slider_6,
    max_size=number_slider_6,
    min_size=number_slider_6,
    base=crvs.base,
    top=crvs.top)  # -> rmesh, wall; inputs brep: Brep
# ---------- brep_to_mesh: Python ----------
__author__ = "timda"
__version__ = "2023.07.14"

import rhinoscriptsyntax as rs
from compas_ghpython.artists import MeshArtist
from add_on_am import NewWall

wall = NewWall(w, h, elsize)
wall.undulate(top, base)
mesh = wall.from_brep(brep, max_size, min_size)
mesh_art = MeshArtist(mesh)
rmesh = mesh_art.draw_mesh()
# ---------- end brep_to_mesh ----------
mcol = MeshColours(Mesh=brep_to_mesh.rmesh, Colours=ColourSwatch(SwatchColor=RGB(163, 163, 163)))

triremesh = TriRemesh(Geometry=brep_to_mesh.rmesh, Iterations=25)  # -> Triangulation, Dual, Creases
demesh = DeconstructMesh(Mesh=triremesh.Triangulation)  # -> Vertices, Faces, Colours, Normals
python = GhPythonScript(vertices=demesh.Vertices, x=Slider(4.975, range=0..5))  # -> points, indices; inputs vertices: list of Point3d
# ---------- python: Python ----------
__author__ = "timda"
__version__ = "2023.08.11"

import rhinoscriptsyntax as rs
points = []
indices = []
for vertice in vertices:
    if vertice.X > x:
        points.append(vertice)
        indices.append(vertices.index(vertice))
        
points = [points[0]]
indices = [vertices.index(points[0])]
# ---------- end python ----------
python_2 = GhPythonScript(vertices=demesh.Vertices, x=Slider(0.025, range=0..0.1))  # -> points, indices; inputs vertices: list of Point3d
# ---------- python_2: Python ----------
__author__ = "timda"
__version__ = "2023.08.11"

import rhinoscriptsyntax as rs
points = []
indices = []
for vertice in vertices:
    if vertice.X < x:
        points.append(vertice)
        indices.append(vertices.index(vertice))
points = [points[0]]
indices = [vertices.index(points[0])]
# ---------- end python_2 ----------

# ----
# Path planner
path_type = ValueList({"Lowest Axis Path": 1, "Heat Method": 2}, selected="Heat Method")
orientation = ValueList({"X-axis": "x", "Y-axis": "y", "Z-axis": "z"}, selected="X-axis")
tool_path_planning = GhPythonScript(
    compute=Button(),
    path_type=path_type,
    orientation=orientation,
    mesh=triremesh.Triangulation,
    L=base_sine_crv.L,
    start=python_2.indices,
    end=python.indices)  # -> planner, points, edges, heat, zero_crossings, v; inputs start: list, end: list
# ---------- tool_path_planning: Python ----------
import compas
from compas_rhino.geometry import RhinoMesh
from add_on_am import HeatPathPlanner
from compas_ghpython.utilities import draw_network

rmesh = RhinoMesh.from_guid(mesh)
planner = HeatPathPlanner()
planner.set_quad_mesh_from_rhinomesh(rmesh)

v, heat, network = planner.heat_method(5.0, 2.0, L, start, end)

points, edges = draw_network(network)
# ---------- end tool_path_planning ----------
pt = Point(tool_path_planning.points)
path = Curve(tool_path_planning.edges)

reload = Button()
py = PythonScript(reload=reload)
# ---------- py: Python ----------
from compas_rhino.utilities.misc import get_tolerance
from compas_rhino.utilities.misc import unload_modules

from compas_ghpython import unload_modules

unload_modules("compas")
unload_modules("compas_fab")
unload_modules("roslibpy")
unload_modules("fabrication_control")
unload_modules("assembly_information_model")
unload_modules("am_information_model")
unload_modules("ur_fabrication_control")
unload_modules("workshop_aaec_revamp")
unload_modules("add_on_am")
unload_modules("mobile_part_based_am")
# ---------- end py ----------
py_2 = PythonScript()  # -> HERE, DATA
# ---------- py_2: Python ----------
import os

HERE = os.path.dirname(ghdoc.Path)
DATA = os.path.abspath(os.path.join(HERE, "..", "data"))

#print(HERE)
print(DATA)
# ---------- end py_2 ----------

list = ValueList({"weighted heat": 0, "distances start": 1, "distances end": 2}, selected="weighted heat")
Y = UnitY(Factor=-0.1)
python_3 = GhPythonScript(
    heat_list=tool_path_planning.heat,
    zero_crossings=tool_path_planning.zero_crossings,
    index=list,
    weight_index=Slider(100, range=0..199))  # -> min_h, max_h, heat, zero_points; inputs heat_list: list, zero_crossings: list, index: Int32, weight_index: Int32
# ---------- python_3: Python ----------
__author__ = "timda"
__version__ = "2023.06.02"

import rhinoscriptsyntax as rs
from compas_rhino.conversions import point_to_rhino

heat = heat_list[index]

print(len(heat))
if index == 0:
    heat = heat[weight_index]
#    heat_weight = [0 for i in range(len(heat[0]))]
#    for weight in heat:
#        for i in range(len(heat)):
#            heat_weight[i] += weight[i]
#    heat = heat_weight
    

#
#isolines = zero_crossings[weight_index]
#zero_points = []
#for p in isolines:
#    zero_points.append(point_to_rhino(p))

max_h = max(heat)
min_h = min(heat)
# ---------- end python_3 ----------
move = Move(Geometry=path, Motion=Y)  # -> Geometry, Transform
gradient = Gradient(
    LowerLimit=python_3.min_h,
    UpperLimit=python_3.max_h,
    Parameter=python_3.heat,
    stops=[0: RGB(203, 37, 215), 0: RGB(90, 100, 156), 0: RGB(234, 38, 0), 0: RGB(228, 231, 162), 0: RGB(116, 38, 103), 0.239: RGB(234, 126, 0), 0.543: RGB(254, 244, 84), 0.992: RGB(173, 203, 249), 1: RGB(75, 107, 169)])
pt_2 = Point(python_3.zero_points)
preview = CustomPreview(Geometry=move.Geometry, Material=ColourSwatch(SwatchColor=RGB(0, 0, 0)))
mcol_2 = MeshColours(Mesh=triremesh.Triangulation, Colours=gradient)
