# Grasshopper definition reachability_map.ghx (Grasshopper 1.0.7)

list = ValueList({"ur10e_map.json"}, selected="ur10e_map.json")
py = PythonScript()  # -> DATA
# ---------- py: Python ----------
import os

#package_path = os.path.dirname(mobile_fabrication_control.__file__)
#DATA = os.path.abspath(os.path.join(package_path,"../../data"))

package_path = ghdoc.Path
# package_path = os.path.dirname(ur_fabrication_control.__file__)
#DATA = os.path.abspath(os.path.join(package_path,"../../data"))

# .stl files not stored in am_hackathon repo. but in mobile_fabrication_control
DATA = os.path.abspath(os.path.join(package_path,"../../../../../mobile_part_based_am/data/reachabilitymaps"))

print(package_path)
print(DATA)
# ---------- end py ----------

reload = Button()
py_2 = PythonScript(reload=reload)
# ---------- py_2: Python ----------
from compas_rhino.utilities.misc import get_tolerance
from compas_rhino.utilities.misc import unload_modules

from compas_ghpython import unload_modules

unload_modules("compas")
unload_modules("compas_fab")
unload_modules("roslibpy")
unload_modules("fabrication_control")
unload_modules("assembly_information_model")
unload_modules("am_information_model")
unload_modules("ur_fabrication_control")
unload_modules("workshop_aaec_revamp")
unload_modules("add_on_am")
unload_modules("mobile_part_based_am")
# ---------- end py_2 ----------
py_3 = PythonScript()  # -> HERE, DATA
# ---------- py_3: Python ----------
import os

HERE = os.path.dirname(ghdoc.Path)
DATA = os.path.abspath(os.path.join(HERE, "..", "data"))

#print(HERE)
print(DATA)
# ---------- end py_3 ----------

file = GhPythonScript(DATA=py, file=list)  # -> filepath
# ---------- file: Python ----------
__author__ = "Gido"
__version__ = "2023.04.18"

import os
import rhinoscriptsyntax as rs

filepath = os.path.join(DATA, file)
# ---------- end file ----------

# ----
# Reachabilitymap to JSON
toggle = BooleanToggle(True)
from_json = GhPythonScript(filepath=file, load=toggle, h=Slider(1.1, range=0..2))  # -> out, reachabilitymap, r
# ---------- from_json: Python ----------
__author__ = "Gido"
__version__ = "2023.04.18"

import rhinoscriptsyntax as rs
from add_on_am import ReachabilityMap

if load:
    reachabilitymap = ReachabilityMap.from_json(filepath)
    r = reachabilitymap.calc_radius()
# ---------- end from_json ----------

visualize_map = GhPythonScript(reachabilitymap=from_json.reachabilitymap)  # -> out, reachabilitymap, sphere_points, resolution, reachability_index
# ---------- visualize_map: Python ----------
__author__ = "Gido"
__version__ = "2023.04.17"

import rhinoscriptsyntax as rs

from compas.geometry import Frame
from compas_ghpython.utilities import draw_frame


sphere_points = []
reachability_index = []
for data in reachabilitymap.spheres_data():
    sphere_points.append(draw_frame(Frame(data[0], [1,0,0], [0,1,0])))
    reachability_index.append(data[1])
#sphere_points = draw_frames(sphere_frames)
resolution = reachabilitymap.resolution
# ---------- end visualize_map ----------
sph = Sphere(Base=visualize_map.sphere_points, Radius=expr("x/10", visualize_map.resolution))
gradient = Gradient(
    LowerLimit=0,
    UpperLimit=100,
    Parameter=visualize_map.reachability_index,
    stops=[0: RGB(234, 38, 0), 0.25: RGB(234, 126, 0), 0.5: RGB(254, 244, 84), 0.75: RGB(173, 203, 249), 1: RGB(75, 107, 169)])
python = GhPythonScript(reachabilitymap=from_json.reachabilitymap, index=Slider(5000, range=0..5000), show=Toggle(True))  # -> center; inputs index: Int32
# ---------- python: Python ----------
__author__ = "timda"
__version__ = "2023.05.23"

import rhinoscriptsyntax as rs
from Rhino.Geometry import Point3d
from math import sqrt

points = reachabilitymap.points
r_points = []
x_p, y_p, z_p = [data[0].x for data in reachabilitymap.spheres_data()], [data[0].y for data in reachabilitymap.spheres_data()], [data[0].z for data in reachabilitymap.spheres_data()]
#for p in points:
#    x_p.append(p.x)
#    y_p.append(p.y)
#    z_p.append(p.z)

center = Point3d(sum(x_p)/len(points), sum(y_p)/len(points), sum(z_p)/len(points))
print(center)

dist = []
reachability_index = []
for data in reachabilitymap.spheres_data():
    dist = sqrt(pow(data[0].x-center.X, 2)+pow(data[0].y-center.Y, 2)+pow(data[0].z-center.Z, 2))
    reachability_index.append([dist, data[1]])

print(sorted(reachability_index))
# ---------- end python ----------
pt = Point(python)
preview = CustomPreview(Geometry=sph, Material=gradient)
