# Grasshopper definition 25dgeometries.gh (Grasshopper 1.0.7)
# plug-ins: NGon

reload = Button()
py = PythonScript(reload=reload)
# ---------- py: Python ----------
from compas_rhino.utilities.misc import get_tolerance
from compas_rhino.utilities.misc import unload_modules

from compas_ghpython import unload_modules

unload_modules("compas")
unload_modules("compas_fab")
unload_modules("roslibpy")
unload_modules("fabrication_control")
unload_modules("assembly_information_model")
unload_modules("am_information_model")
unload_modules("ur_fabrication_control")
unload_modules("workshop_aaec_revamp")
unload_modules("add_on_am")
unload_modules("mobile_part_based_am")
# ---------- end py ----------
py_2 = PythonScript()  # -> HERE, DATA
# ---------- py_2: Python ----------
import os

HERE = os.path.dirname(ghdoc.Path)
DATA = os.path.abspath(os.path.join(HERE, "..", "data"))

#print(HERE)
print(DATA)
# ---------- end py_2 ----------

# ---- group: DESIGN / Shape Initialization
number_slider = Slider(0, range=0..360)  # disabled
number_slider_2 = Slider(2, range=0..10)  # disabled
number_slider_3 = Slider(0, range=0..10)  # disabled
number_slider_4 = Slider(0.05, range=0..0.1)  # disabled
number_slider_5 = Slider(0, range=0..10)  # disabled
number_slider_6 = Slider(5, range=0..10)  # disabled
toggle = BooleanToggle(False)  # disabled

# ---- group: DESIGN
button = Button()  # disabled
create_wall = GhPythonScript(
    init=button,
    width=number_slider_6,
    height=number_slider_2,
    elsize=number_slider_4,
    x=number_slider_5,
    y=number_slider_3,
    rotation=number_slider,
    double_layer=toggle)  # -> wall; disabled
# ---------- create_wall: Python ----------
from add_on_am import Wall

import random
# create wall
wall = Wall(width, height, elsize, x, y, rotation)

print(wall.x_size, wall.z_size)
# ---------- end create_wall ----------

# ----
number_slider_7 = Slider(0.36, range=-5..5)  # disabled
number_slider_8 = Slider(4.29, range=0..5)  # disabled
number_slider_9 = Slider(0.87, range=0..5)  # disabled
number_slider_10 = Slider(2.07, range=0..5)  # disabled
number_slider_11 = Slider(3.49, range=0..5)  # disabled
num = Number([number_slider_8, number_slider_9, number_slider_10, number_slider_11])  # disabled
number_slider_12 = Slider(4, range=0..10)  # disabled
number_slider_13 = Slider(0.6, range=0..10)  # disabled
number_slider_14 = Slider(0, range=0..6.2)  # disabled
number_slider_15 = Slider(0.25, range=0..5)  # disabled
number_slider_16 = Slider(0.8, range=0..10)  # disabled

# ---- group: UNDULATION
number_slider_17 = Slider(0, range=0..6.2)  # disabled
number_slider_18 = Slider(0.5, range=0..5)  # disabled
number_slider_19 = Slider(0.4, range=0..10)  # disabled
base_sine_crv = GhPythonScript(width=number_slider_6, a=number_slider_18, f=number_slider_19, ro=number_slider_17)  # -> curve; disabled
# ---------- base_sine_crv: Python ----------
import Rhino.Geometry as rg
import Rhino as rc
import math

points = []
iterator = [i*0.1 for i in range(int(width/0.1 +1.999))]
for x in iterator:
    points.append(rg.Point3d(x, -a*math.sin(2.0 * math.pi * f*x + ro), 0))

points = rc.Collections.Point3dList(points)
start_tangent = rg.Vector3d(iterator[0], a * 2.0 * math.pi * f * math.cos(2.0 * math.pi * f*iterator[0] + ro), 0)
end_tangent = rg.Vector3d(iterator[0], a * 2.0 * math.pi * f * math.cos(2.0 * math.pi * f*iterator[-1] + ro), 0)
curve = rg.Curve.CreateInterpolatedCurve(points, 3)
# ---------- end base_sine_crv ----------
undulate = GhPythonScript(
    wall=create_wall,
    up_amp=number_slider_18,
    up_freq=number_slider_19,
    up_phase=number_slider_17,
    down_amp=number_slider_18,
    down_freq=number_slider_19,
    down_phase=number_slider_17)  # -> wall; disabled
# ---------- undulate: Python ----------
wall.undulate(up_amp, up_freq, up_phase ,down_amp, down_freq, down_phase)
# ---------- end undulate ----------

# ----
Z = UnitZ(Factor=number_slider_2)  # disabled
move = Move(Geometry=base_sine_crv, Motion=Z)  # -> Geometry, Transform; disabled
swatch = ColourSwatch(SwatchColor=RGB(255, 0, 0))  # disabled
toggle_2 = BooleanToggle(True)  # disabled
toggle_3 = BooleanToggle(True)  # disabled

# ---- group: VISUALIZATION
toggle_4 = BooleanToggle(True)  # disabled
visualize = GhPythonScript(wall=undulate, show_mesh=toggle_4, show_window=toggle_3, delete_window=toggle_2)  # -> rhmesh, vertices_window, vertices_support; disabled
# ---------- visualize: Python ----------
from compas_ghpython.artists import MeshArtist
import Rhino.Geometry as rg

rh_mesh = []
vertices_gate = []
vertices_all = []
disp_vectors = []

if delete_window:
    for vertex in wall.window_vertices:
        wall.mesh.delete_vertex(vertex)
        print("test")



if show_mesh:
    # Mesh Artist for visualization
    artist = MeshArtist(wall.mesh)
    rhmesh = artist.draw_mesh()


if show_window:
    k = []
    for vertex in wall.mesh.vertices():
        gp = wall.mesh.vertex_attribute(vertex, name='window')
        if gp: k.append(vertex)
    
    print k
    if len(k): vertices_window = artist.draw_vertices(vertices=k)

for vertex in wall.mesh.vertices():
    if wall.mesh.vertex_attribute(vertex, name='z') < 0.025:
        k.append(vertex)
if len(k): vertices_support = artist.draw_vertices(vertices=k)
# ---------- end visualize ----------
swatch_2 = ColourSwatch(SwatchColor=RGB(54, 45, 35))  # disabled

# ----
galapagos = Galapagos(fitness=subtraction, gene=[number_slider_9, number_slider_8, number_slider_10, number_slider_11])
pt = Point(visualize.vertices_window)  # disabled
mcol = MeshColours(Mesh=visualize.rhmesh, Colours=swatch_2)  # disabled
Z_2 = UnitZ(Factor=0.8)
number_slider_20 = Slider(2, range=0..10)
list = ValueList({"ur10e_map.json"}, selected="ur10e_map.json")  # disabled
py_3 = PythonScript()  # -> DATA; disabled
# ---------- py_3: Python ----------
import os

#package_path = os.path.dirname(mobile_fabrication_control.__file__)
#DATA = os.path.abspath(os.path.join(package_path,"../../data"))

package_path = ghdoc.Path
# package_path = os.path.dirname(ur_fabrication_control.__file__)
#DATA = os.path.abspath(os.path.join(package_path,"../../data"))

# .stl files not stored in am_hackathon repo. but in mobile_fabrication_control
DATA = os.path.abspath(os.path.join(package_path,"../../../mobile_part_based_am/data/reachabilitymaps"))

print(package_path)
print(DATA)
# ---------- end py_3 ----------
file = GhPythonScript(DATA=py_3, file=list)  # -> filepath; disabled
# ---------- file: Python ----------
__author__ = "Gido"
__version__ = "2023.04.18"

import os
import rhinoscriptsyntax as rs

filepath = os.path.join(DATA, file)
# ---------- end file ----------

# ----
# Reachabilitymap to JSON
toggle_5 = BooleanToggle(True)  # disabled
from_json = GhPythonScript(filepath=file, load=toggle_5)  # -> out, reachabilitymap, r; disabled
# ---------- from_json: Python ----------
__author__ = "Gido"
__version__ = "2023.04.18"

import rhinoscriptsyntax as rs
from add_on_am import ReachabilityMap

if load:
    reachabilitymap = ReachabilityMap.from_json(filepath)
    r = reachabilitymap.calc_radius()
    # r_two = reachabilitymap.calc_radius_two()
    # print(r, r_two) (0.845576756927508, 0.8261355951360555)
# ---------- end from_json ----------

# ---- group: plan motion
start = Button()  # disabled
stop = Button()  # disabled
reset = Button()  # disabled
step = Button()  # disabled

# ----
number_slider_21 = Slider(0, range=0..6.2)
number_slider_22 = Slider(0, range=0..6.2)
number_slider_23 = Slider(0.25, range=0..5)
number_slider_24 = Slider(0.8, range=0..10)
number_slider_25 = Slider(0.5, range=0..5)
number_slider_26 = Slider(0.4, range=0..10)
number_slider_27 = Slider(2, range=0..10)
number_slider_28 = Slider(5, range=0..10)

crvs = GhPythonScript(
    width=number_slider_28,
    height=number_slider_27,
    up_a=number_slider_25,
    up_f=number_slider_26,
    up_ro=number_slider_22,
    down_a=number_slider_25,
    down_f=number_slider_26,
    down_ro=number_slider_22)  # -> base, base_crv, top, top_crv
# ---------- crvs: Python ----------
__author__ = "timda"
__version__ = "2023.07.15"

import rhinoscriptsyntax as rs
import math
from Rhino.Geometry import Point3d, Vector3d, Curve
from Rhino.Collections import Point3dList

class CrvParams:
    def __init__(self, amp, freq, ro):
        self.amp = amp
        self.freq = freq
        self.ro = ro
    def crv(self, width, height):
        points = []
        iterator = [i*0.1 for i in range(int(width/0.1 +1.999))]
        for x in iterator:
            points.append(Point3d(x, -self.amp*math.sin(2.0 * math.pi * self.freq*x + self.ro), height))
        
        points = Point3dList(points)
        start_tangent = Vector3d(iterator[0], self.amp * 2.0 * math.pi * self.freq * math.cos(2.0 * math.pi * self.freq*iterator[0] + self.ro), 0)
        end_tangent = Vector3d(iterator[0], self.amp * 2.0 * math.pi * self.freq * math.cos(2.0 * math.pi * self.freq*iterator[-1] + self.ro), 0)
        self.curve = Curve.CreateInterpolatedCurve(points, 3)
        return self.curve


base = CrvParams(down_a, down_f, down_ro)
base_crv = base.crv(width, 0)
top = CrvParams(up_a, up_f, up_ro)
top_crv = top.crv(width, height)
# ---------- end crvs ----------

crv = Curve(crvs.base_crv)
crv_2 = Curve(crvs.top_crv)
rulesrf = RuledSurface(CurveA=crv, CurveB=crv_2)

number_slider_29 = Slider(0.05, range=0..0.1)
brep = Brep(rulesrf)
brep_to_mesh = GhPythonScript(
    brep=brep,
    w=number_slider_28,
    h=number_slider_27,
    elsize=number_slider_29,
    max_size=number_slider_29,
    min_size=number_slider_29,
    base=crvs.base,
    top=crvs.top)  # -> rmesh, wall; inputs brep: Brep
# ---------- brep_to_mesh: Python ----------
__author__ = "timda"
__version__ = "2023.07.14"

import rhinoscriptsyntax as rs
from compas_ghpython.artists import MeshArtist
from add_on_am import NewWall

wall = NewWall(w, h, elsize)
wall.undulate(top, base)
mesh = wall.from_brep(brep, max_size, min_size)
mesh_art = MeshArtist(mesh)
rmesh = mesh_art.draw_mesh()
# ---------- end brep_to_mesh ----------
mcol_2 = MeshColours(Mesh=brep_to_mesh.rmesh, Colours=ColourSwatch(SwatchColor=RGB(82, 82, 82)))

envelope = GhPythonScript(
    wall=mcol_2,
    r_out=Slider(1.7, range=0..10),
    h_out=Slider(0.72, range=0..3),
    r_in=Slider(0.4, range=0..1),
    h_in=Slider(1.32, range=0..2),
    z_offset=Slider(-0.7, range=-1..1))  # -> envelope, wall; inputs wall: Mesh
# ---------- envelope: Python ----------
import Rhino.Geometry as rg
import Rhino as rc

#class Envelope:
#    def __init__(self, r_out, h_out, r_in, h_in, z_offset):
#        self.reach = self.create_sphere_cylinder(r_out, h_out)
#        self.deadzone = self.create_sphere_cylinder(r_in, h_in)
#        self.deadzone.Translate(0, 0, z_offset)
#        self.envelope = rg.Mesh()
#        self.envelope.Append([self.reach, self.deadzone])
#        self.envelope.Translate(1, 0, 0)
#    
#    def create_sphere_cylinder(self, r, h):
#        sphere = rg.Sphere(rg.Point3d(0, 0, 0,), r)
#        sph_cyl = rg.Mesh.CreateFromSphere(sphere, 16, 32)
#        
#        to_delete = []
#        sph_cyl.FaceNormals.ComputeFaceNormals()
#        for i, normal in enumerate(sph_cyl.FaceNormals):
#            if normal.Z > 0:
#                to_delete.append(i)
#        top_sphere = sph_cyl.Faces.ExtractFaces(to_delete)
#        top_sphere.Translate(0, 0, h)
#        
#        cylinder = rg.Cylinder(rg.Circle(rg.Point3d(0, 0, 0), r), h)
#        cylinder = rg.Mesh.CreateFromCylinder(cylinder, 10, 16, False, False)
#        
#        sph_cyl.Append([cylinder, top_sphere])
#        return sph_cyl
#
#e = Envelope(r_out, h_out, r_in, h_in, z_offset)
#meshes = []
#meshes.append(wall)
#meshes.append(e.envelope)
#intersections = rg.Intersect.Intersection.MeshMesh(meshes, 1.0e-10, False, False, None, None, None)
#
#reach = e.reach
#deadzone = e.deadzone
#envelope = e.envelope


class Envelope:
    def __init__(self, wall, r_out, h_out, r_in, h_in, z_offset, z):
        self.mesh = wall
        self.r_out = r_out
        self.r_in = r_in
        self.h_out = h_out
        self.h_in = h_in
        self.z_offset = z_offset
        self.x = 0
        self.y = 0
        self.z = z
        
    def get_intersection(self, x=0, y=0, z=0, p=None):
        if p != None:
            self.x = p.X
            self.y = p.Y
            self.z = p.Z
        inside = []
        for i, vertex in enumerate(self.mesh.Vertices):
            condition1 = [vertex.Z > self.h_out+self.z, vertex.Z < self.z]
            condition2 = {
            "cylinder": (vertex.X-self.x)**2 + (vertex.Y-self.y)**2 < self.r_out**2,
            "upper circle": (vertex.X-self.x)**2 + (vertex.Y-self.y)**2 + (vertex.Z-self.h_out-self.z)**2 < self.r_out**2,
            "lower circle": (vertex.X-self.x)**2 + (vertex.Y-self.y)**2 + (vertex.Z-self.z)**2 < self.r_out**2
            }
            outside_condition = ((not (condition1[0] or condition1[1])) and condition2["cylinder"]) or (condition1[0] and condition2["upper circle"]) or (condition1[1] and condition2["lower circle"])
            
            condition1 = [vertex.Z-self.z_offset > self.h_in+self.z, vertex.Z-self.z_offset < self.z]
            condition2 = {
            "cylinder": (vertex.X-self.x)**2 + (vertex.Y-self.y)**2 > self.r_in**2,
            "upper circle": (vertex.X-self.x)**2 + (vertex.Y-self.y)**2 + (vertex.Z-(self.h_in+self.z_offset)-self.z)**2 > self.r_in**2,
            "lower circle": (vertex.X-self.x)**2 + (vertex.Y-self.y)**2 + (vertex.Z-self.z_offset-self.z)**2 > self.r_in**2
            }
            # inside_condition = ((not (condition1[0] or condition1[1])) and condition2["cylinder"]) or (condition1[0] and condition2["upper circle"]) or (condition1[1] and condition2["lower circle"])
            if not (condition1[0] or condition1[1]):
                inside_condition = condition2["cylinder"]
            elif condition1[0]:
                inside_condition = condition2["upper circle"]
            elif condition1[1]:
                inside_condition = condition2["lower circle"]
            else:
                inside_condition = False
            
            if inside_condition and outside_condition:
                inside += wall.Vertices.GetVertexFaces(i)
        return self.mesh.DuplicateMesh().Faces.ExtractFaces(inside)
        
    def create_mesh(self):
        reach = self.create_sphere_cylinder(self.r_out, self.h_out)
        deadzone = self.create_sphere_cylinder(self.r_in, self.h_in)
        deadzone.Translate(0, 0, self.z_offset)
        e = rg.Mesh()
        e.Append([reach, deadzone])
        e.Translate(self.x, self.y, self.z)
        return e
    
    def create_sphere_cylinder(self, r, h):
        sphere = rg.Sphere(rg.Point3d(0, 0, 0), r)
        sph_cyl = rg.Mesh.CreateFromSphere(sphere, 16, 32)
        
        to_delete = []
        sph_cyl.FaceNormals.ComputeFaceNormals()
        for i, normal in enumerate(sph_cyl.FaceNormals):
            if normal.Z > 0:
                to_delete.append(i)
        top_sphere = sph_cyl.Faces.ExtractFaces(to_delete)
        top_sphere.Translate(0, 0, h)
        
        cylinder = rg.Cylinder(rg.Circle(rg.Point3d(0, 0, 0), r), h)
        cylinder = rg.Mesh.CreateFromCylinder(cylinder, 10, 16, False, False)
        
        sph_cyl.Append([cylinder, top_sphere])
        return sph_cyl
        
envelope = Envelope(wall, r_out, h_out, r_in, h_in, z_offset, 1.15)
in_mesh = envelope.get_intersection(1.1, r_in, 0)
# ---------- end envelope ----------
seperation = GhPythonScript(crv=crv, z=Slider(1.2, range=0..10), envelope=envelope.envelope, wall=brep_to_mesh.wall, switch_sides=Toggle(True))  # -> total_mesh, meshes, meshes_envelope, points, p_dist, int_p; inputs crv: Curve
# ---------- seperation: Python ----------
import Rhino.Geometry as rg
import math
from Rhino.Geometry import Brep, Intersect


whole_mesh = rg.Mesh()
meshes = []
meshes_envelope = [] # rg.Mesh()
if 0 < z < envelope.r_out:
    dist_bottom = math.sqrt((envelope.r_out)**2 - (z)**2 - envelope.r_in**2)
elif z < 0:
    dist_bottom = math.sqrt((envelope.r_out)**2 - envelope.r_in**2)
else:
    dist_bottom = 0
    
if wall.height-envelope.h_out-envelope.r_out < z < wall.height-envelope.h_out:
    dist_top = math.sqrt((envelope.r_out)**2 - (z+envelope.h_out-wall.height)**2 - envelope.r_in**2)
elif z > wall.height-envelope.h_out:
    dist_top = math.sqrt((envelope.r_out)**2 - envelope.r_in**2)
else:
    dist_top = 0

dist = min([dist_top, dist_bottom])


crv.Translate(0, 0, z)

# divide the wall with points that are equally spaced, the first point must not be at zero but at distance dist from 0
temp = crv.Split(crv.ClosestPoint(crv.DivideEquidistant(dist)[1])[1])[1]
points_t = temp.DivideEquidistant(dist*2)
points = points_t
if crv.PointAtEnd.DistanceTo(points_t[-1]) > dist:
    points = [point for point in points_t]
    points.append(crv.PointAtEnd)

p_dist = points_t

for i, point in enumerate(points):
    normal = crv.TangentAt(crv.ClosestPoint(point)[1])
    if switch_sides:
        curvature = crv.CurvatureAt(crv.ClosestPoint(point)[1]).Y
        crv_sign = curvature/abs(curvature)
    else:
        crv_sign = 1.0
    normal.Rotate(crv_sign*math.pi/2, rg.Vector3d(0, 0, 1.0))
    normal.Unitize()
    
    point += (envelope.r_in*normal)
    points[i] = point
    mesh = envelope.get_intersection(p=point)
    if mesh != None:
        meshes.append(envelope.get_intersection(p=point))
        whole_mesh.Append(envelope.get_intersection(p=point))
    meshes_envelope.append(envelope.create_mesh())

overlap = whole_mesh.Faces.ExtractDuplicateFaces()


# checking each face that appears twice for its second closest point and then removing it from the mesh that is associated with that point
# the points are the robots positions
for i, face in enumerate(overlap.Faces):
    center = overlap.Faces.GetFaceCenter(i)
    distance = []
    for point in points:
        distance.append(center.DistanceTo(point))
    for d in sorted(set(distance))[1:]:
        i_mesh_to_delete_from = distance.index(d)
        duplicate_face = meshes[i_mesh_to_delete_from].ClosestMeshPoint(center,0.05)
        if duplicate_face:
            i_face_to_delete = duplicate_face.FaceIndex
            meshes[i_mesh_to_delete_from].Faces.DeleteFaces([i_face_to_delete])

total_mesh = rg.Mesh()
total_mesh.Append(meshes)

#
#points = []
#whole_mesh = rg.Mesh()
#meshes_envelope = rg.Mesh()
#dist = math.sqrt((envelope.r_out)**2 - (z+envelope.h_out-wall.height)**2 - envelope.r_in**2)
#crv.Translate(0, 0, z)
#k = crv.LengthParameter(dist)[1]
#t = k
#while t < crv.LengthParameter(crv.GetLength())[1]+k:
#    normal = crv.TangentAt(t)
#    if switch_sides:
#        curvature = crv.CurvatureAt(t).Y
#        crv_sign = curvature/abs(curvature)
#    else:
#        crv_sign = 1.0
#    normal.Rotate(crv_sign*math.pi/2, rg.Vector3d(0, 0, 1.0))
#    normal.Unitize()
#    point = crv.PointAt(t)
#    
#    point += (envelope.r_in*normal)
#    points.append(point)
#    mesh = envelope.get_intersection(p=point)
#    if mesh != None:
#        whole_mesh.Append(envelope.get_intersection(p=point))
#    meshes_envelope.Append(envelope.create_mesh())
#    t_old = t
#    t += 2*k


#top_edges = []
#for mesh in meshes:
#    edges = mesh.GetNakedEdges()[0].BreakAtAngles(math.pi/2)
#    for i, edge in enumerate(edges):
#        edge = edge.ToPolylineCurve()
#        if edge.PointAtStart.Z == wall.height and edge.PointAtEnd.Z == wall.height:
#            top_edges.append(edge)
#
#for edge in enumerate(top_edges[1:]):
#    split = 

crv.Translate(0, 0, -z)
crv_top = crv.Duplicate()
crv_top.Translate(0, 0, wall.height)
int_p = []
for mesh in meshes_envelope:
    b = Brep.CreateFromMesh(mesh, True)
    intersect = Intersect.Intersection.CurveBrep(crv, b, 0.001)[2]
    for p in intersect:
        int_p.append(p)
    
    intersect = Intersect.Intersection.CurveBrep(crv_top, b, 0.001)[2]
    for p in intersect:
        int_p.append(p)
# ---------- end seperation ----------
mesh = Mesh(seperation.total_mesh)
mesh_2 = Mesh(seperation.meshes_envelope)
pt_2 = Point(seperation.points)

python = GhPythonScript(
    width=number_slider_6,
    a=number_slider_18,
    f=number_slider_19,
    ro=number_slider_17,
    crv=base_sine_crv,
    x=num,
    y=number_slider_7,
    z=number_slider_13,
    duplications=number_slider_12,
    envelope=envelope.envelope,
    wall=envelope.wall)  # -> print_meshes, points; inputs x: list, duplications: Int32; disabled
# ---------- python: Python ----------
import Rhino.Geometry as rg
import math

print_meshes = rg.Mesh()
points = []
for i in range(duplications):
    y_temp = a*math.sin(2.0 * math.pi * f*x[i] + ro) - y
    points.append(rg.Point3d(x[i], -y_temp, z))
    print_meshes.Append(envelope.get_intersection(x[i], y_temp, z))
print_meshes.Faces.ExtractDuplicateFaces()
# ---------- end python ----------
pt_3 = Point(python.points)  # disabled
mcol_3 = MeshColours(Mesh=python.print_meshes, Colours=swatch)  # disabled
mesh_3 = Mesh(envelope.wall)  # disabled
area = Area(Geometry=mcol_3)  # -> Area, Centroid; disabled
area_2 = Area(Geometry=mesh_3)  # -> Area, Centroid; disabled
subtraction = Subtraction(A=area_2.Area, B=area.Area)  # disabled
mesh_4 = Mesh(seperation.meshes)
pt_4 = Point(seperation.p_dist)
move_2 = Move(Geometry=pt_4, Motion=Z_2)  # -> Geometry, Transform
pt_5 = Point(seperation.int_p)
item = ListItem(List=mesh_4, Index=number_slider_20, Wrap=True)
item_2 = ListItem(List=pt_2, Index=number_slider_20, Wrap=True)
mcol_4 = MeshColours(Mesh=item, Colours=ColourSwatch(SwatchColor=RGB(255, 0, 0)))

# ----
# Path planner
path_type = ValueList({"Lowest Axis Path": 1, "Lowest Axis Path Combined": 2, "Lowest Axis Path Priority": 3, "Lowest Axis Path Adjusted": 4, "Centroid Path": 5, "Boundary Path": 6, "Corners Path": 7, "Random Path Adjusted": 8, "Lowest Neighbors Path": 9}, selected="Lowest Axis Path")  # disabled
orientation = ValueList({"X-axis": "x", "Y-axis": "y", "Z-axis": "z"}, selected="Z-axis")  # disabled
button_2 = Button()  # disabled
tool_path_planning = GhPythonScript(
    compute=button_2,
    path_type=path_type,
    orientation=orientation,
    mesh=mcol_4,
    reachabilitymap=from_json.reachabilitymap,
    center=item_2)  # -> planner, points, edges, n; inputs center: Point3d; disabled
# ---------- tool_path_planning: Python ----------
import compas
from compas_rhino.geometry import RhinoMesh
from add_on_am import SurfacePathPlanner
from compas_ghpython.utilities import draw_network, draw_frame
from compas.colors import Color

rmesh = RhinoMesh.from_guid(mesh)
planner = SurfacePathPlanner()
planner.set_quad_mesh_from_rhinomesh(rmesh)
planner.set_network_nodes()
#planner.set_color_map([
#    Color.from_rgb255(128,255,255),
#    Color.from_rgb255(255,255,0),
#    Color.from_rgb255(255,0,0)])
#planner.set_thickness_map([
#    0.008,
#    0.010,
#    0.012])

planner.map_reachability(reachabilitymap, center)


if path_type == 1:
    [network, n] = planner.lowest_axis_path(orientation)

#planner.calculate_fabrication_parameters()

points, edges = draw_network(network)   
planes = []
tool_planes = []
cylinders = []
colors = []
for k in planner.network.path:
    frame = planner.network.node_attribute(key=k, name='frame')
    plane = draw_frame(frame)
    planes.append(plane)

# print(planner.network.node_attributes(key=0))
# ---------- end tool_path_planning ----------
pt_6 = Point(tool_path_planning.points)  # disabled
panel = Panel(tool_path_planning.n)  # disabled
path = Curve(tool_path_planning.edges)  # disabled

counter = CountThroughList(L=pt_6, start=start, stop=stop, step=step, reset=reset)  # -> item, index; inputs L: list, start: Boolean; disabled
# ---------- counter: Python ----------
from scriptcontext import sticky as st
from compas_ghpython.utilities import update_component


interval = 1

# store data in component
guid = str(ghenv.Component.InstanceGuid)
counter_key = "counter_" + guid
running_key = "running_" + guid

if counter_key not in st or reset:
    st[counter_key] = 0

if running_key not in st:
    st[running_key] = False

if start:
    st[running_key] = True

if stop:
    st[running_key] = False

if step:
    if st[counter_key] < len(L) - 1:
        st[counter_key] += 1
    
if len(L):
    index = st[counter_key]
    item = L[index]

if st[running_key]:
    if st[counter_key] < len(L) - 1:
        st[counter_key] += 1
        update_component(ghenv, interval)
    else:
        st[counter_key] = 0
        st[running_key] = False
# ---------- end counter ----------

visualization = GhPythonScript(mesh=mcol_4, planner=tool_path_planning.planner, i=counter.index, position=item_2)  # -> ri, mesh, plane, point; inputs mesh: Mesh, i: Int32, position: Point3d; disabled
# ---------- visualization: Python ----------
__author__ = "timda"
__version__ = "2023.04.30"

import rhinoscriptsyntax as rs
from Rhino.Geometry import Vector3d

from compas.geometry import Frame, Point
from compas_ghpython.utilities import draw_frame, draw_points
from compas_rhino.conversions import point_to_rhino

index = planner.network.path[i]
frame = planner.network.node_attribute(index, name="frame")
plane = draw_frame(frame)
p = Point.from_data(planner.network.node_coordinates(index))
point = point_to_rhino(p)

ri = []
for k in planner.mesh.faces():
    ri.append(planner.network.node_attribute(k, name="sphere").ri)



x = -position.X
y = -position.Y
z = -position.Z
trans = Vector3d(x, y, z)

mesh.Translate(x, y, z)
plane.Translate(trans)
point += trans
# ---------- end visualization ----------
pt_7 = Point(visualization.point)  # disabled
toggle_6 = BooleanToggle(True)  # disabled
deplane = DeconstructPlane(Plane=visualization.plane)  # -> Origin, XAxis, YAxis, ZAxis; disabled
explodemesh = ExplodeMesh(Mesh=visualization.mesh, Explode=toggle_6)  # disabled
gradient = Gradient(
    LowerLimit=0,
    UpperLimit=100,
    Parameter=visualization.ri,
    stops=[0: RGB(234, 38, 0), 0.25: RGB(234, 126, 0), 0.5: RGB(254, 244, 84), 0.75: RGB(173, 203, 249), 1: RGB(75, 107, 169)])  # disabled
vdis = VectorDisplay(Anchor=deplane.Origin, Vector=deplane.ZAxis)  # disabled
subdmesh = SubDFromMesh(Mesh=explodemesh, Creases=1, Corners=1, Interpolate=False)  # disabled
preview = CustomPreview(Geometry=subdmesh, Shader=gradient)  # disabled
