# Grasshopper definition combi_segmentation_path_finding.ghx (Grasshopper 1.0.7)

reload = Button()
py = PythonScript(reload=reload)
# ---------- py: Python ----------
from compas_rhino.utilities.misc import get_tolerance
from compas_rhino.utilities.misc import unload_modules

from compas_ghpython import unload_modules

unload_modules("compas")
unload_modules("compas_fab")
unload_modules("roslibpy")
unload_modules("fabrication_control")
unload_modules("assembly_information_model")
unload_modules("am_information_model")
unload_modules("ur_fabrication_control")
unload_modules("workshop_aaec_revamp")
unload_modules("add_on_am")
unload_modules("mobile_part_based_am")
# ---------- end py ----------
py_2 = PythonScript()  # -> HERE, DATA
# ---------- py_2: Python ----------
import os

HERE = os.path.dirname(ghdoc.Path)
DATA = os.path.abspath(os.path.join(HERE, "..", "data"))

#print(HERE)
print(DATA)
# ---------- end py_2 ----------

# ----
# Wall
number_slider = Slider(0.93, range=0..1)
number_slider_2 = Slider(2, range=0..10)
number_slider_3 = Slider(5, range=0..10)
crvs = GhPythonScript(
    width=number_slider_3,
    height=number_slider_2,
    up_a=Slider(0, range=0..0.3),
    up_f=Slider(1.15, range=0.6..1.2),
    up_ro=number_slider,
    down_a=Slider(0.3, range=0..0.6),
    down_f=Slider(0.59, range=0.4..0.6),
    down_ro=Slider(0.73, range=0..1))  # -> base, base_crv, top, top_crv
# ---------- crvs: Python ----------
__author__ = "timda"
__version__ = "2023.07.15"

import rhinoscriptsyntax as rs
import math
from Rhino.Geometry import Point3d, Vector3d, Curve
from Rhino.Collections import Point3dList

class CrvParams:
    def __init__(self, amp, freq, ro):
        self.amp = amp
        self.freq = freq
        self.ro = ro*math.pi
    def crv(self, width, height):
        points = []
        iterator = [i*0.1 for i in range(int(width/0.1 +1.999))]
        for x in iterator:
            points.append(Point3d(x, -self.amp*math.sin(2.0 * math.pi * self.freq*x + self.ro), height))
        
        points = Point3dList(points)
        start_tangent = Vector3d(iterator[0], self.amp * 2.0 * math.pi * self.freq * math.cos(2.0 * math.pi * self.freq*iterator[0] + self.ro), 0)
        end_tangent = Vector3d(iterator[0], self.amp * 2.0 * math.pi * self.freq * math.cos(2.0 * math.pi * self.freq*iterator[-1] + self.ro), 0)
        self.curve = Curve.CreateInterpolatedCurve(points, 3)
        return self.curve


base = CrvParams(down_a, down_f, down_ro)
base_crv = base.crv(width, 0)
top = CrvParams(up_a, up_f, up_ro)
top_crv = top.crv(width, height)
# ---------- end crvs ----------
crv = Curve(crvs.base_crv)
crv_2 = Curve(crvs.top_crv)
rulesrf = RuledSurface(CurveA=crv, CurveB=crv_2)

# ----
# Planar Wall
X = UnitX(Factor=number_slider_3)
Z = UnitZ(Factor=number_slider_2)
addition = Addition(A=Z, B=X)
pt = ConstructPoint(XCoordinate=0, YCoordinate=0, ZCoordinate=0)
move = Move(Geometry=pt, Motion=X)  # -> Geometry, Transform
move_2 = Move(Geometry=pt, Motion=addition)  # -> Geometry, Transform
move_3 = Move(Geometry=pt, Motion=Z)  # -> Geometry, Transform
srf4pt = _4PointSurface(CornerA=pt, CornerB=move_3.Geometry, CornerC=move_2.Geometry, CornerD=move.Geometry)

# ----
# Brep to Mesh
number_slider_4 = Slider(0.05, range=0..0.1)
brep = Brep(srf4pt)
brep_to_mesh = GhPythonScript(
    brep=brep,
    w=number_slider_3,
    h=number_slider_2,
    elsize=number_slider_4,
    max_size=number_slider_4,
    min_size=number_slider_4,
    base=crvs.base,
    top=crvs.top)  # -> rmesh, wall; inputs brep: Brep
# ---------- brep_to_mesh: Python ----------
__author__ = "timda"
__version__ = "2023.07.14"

import rhinoscriptsyntax as rs
from compas_ghpython.artists import MeshArtist
from add_on_am import NewWall

wall = NewWall(w, h, elsize)
wall.undulate(top, base)
mesh = wall.from_brep(brep, max_size, min_size)
mesh_art = MeshArtist(mesh)
rmesh = mesh_art.draw_mesh()
# ---------- end brep_to_mesh ----------
mcol = MeshColours(Mesh=brep_to_mesh.rmesh, Colours=ColourSwatch(SwatchColor=RGBA(194, 194, 194, 130)))

# ----
# Envelope
number_slider_5 = Slider(0, range=0..1)
envelope = GhPythonScript(
    r_out=Slider(1.3, range=0..10),
    h_out=Slider(0.72, range=0..3),
    r_in=Slider(0.55, range=0..1),
    h_in=Slider(0.3, range=0..1),
    z_offset=number_slider_5)  # -> mesh, points, crvs_in, crvs_out, envelope; inputs crvs: list of Curve
# ---------- envelope: Python ----------
from Rhino.Geometry.Intersect.Intersection import MeshPolyline
from add_on_am import Envelope
# from compas.artists import MeshArtist
from compas_rhino.conversions import polyline_to_compas
import math

z = 1.049
c_crvs = []
for i, crv in enumerate(crvs):
    c_crvs.append(polyline_to_compas(crv.ToPolyline()))

envelope = Envelope(r_out, h_out, r_in, h_in, z_offset, 0, 0, z)

def intersections(intersection_mesh, curves):
    inter_points = []
    for curve in curves:
        inter = MeshPolyline(intersection_mesh, curve)
        if inter[1]:
            inter_points += inter[0]
    return inter_points

#c, max_in = envelope.iterate(c_crvs, base_crv)
#print(c, max_in)
#
## takes 3sek???
#i_in, i_out = envelope.crvs_inside(c_crvs, True, True)
#crvs_in = [[], []]
#crvs_out = []
#for i, crv in enumerate(crvs):
#    if i in i_in:
#        crvs_in[0].append(crv)
#    elif i in i_out:
#        crvs_out.append(crv)


i_out = range(len(c_crvs))
crvs_in = []

for k in range(5):
    if len(i_out)==0:
        break 
    crvs_in.append([])
    c, max_in = envelope.iterate([c_crvs[i] for i in i_out], base_crv)
    print(c, max_in)
    
    # takes 3sek???
    i_in, i_out = envelope.crvs_inside(c_crvs, True, True)
    crvs_out = []
    for i, crv in enumerate(crvs):
        if i in i_in:
            crvs_in[k].append(crv)
        elif i in i_out:
            crvs_out.append(crv)
# ---------- end envelope ----------
pt_2 = Point(envelope.points)
crv_3 = Curve(envelope.crvs_out)
mesh = Mesh(envelope.mesh)

# ----
# Path planner
orientation = ValueList({"X-axis": "x", "Y-axis": "y", "Z-axis": "z"}, selected="Z-axis")
tool_path_planning = GhPythonScript(
    compute=Button(),
    orientation=orientation,
    min_ri=Slider(20, range=0..100),
    wall=brep_to_mesh.wall,
    envelope=envelope.envelope)  # -> planner, points, edges, n, pos
# ---------- tool_path_planning: Python ----------
import compas
from compas_rhino.geometry import RhinoMesh
from Rhino.Geometry import Point3d
from add_on_am import PathPosPlanner
from compas_ghpython.utilities import draw_network, draw_frame
from compas.colors import Color

planner = PathPosPlanner(wall, 0.2, envelope)
planner.set_network_nodes()
planner.create_pos_network()

[network, position] = planner.section_path(min_ri=min_ri)

points, edges = draw_network(network)
print(position)

# check if positions is list
if isinstance(position, list):
    pos = []
    for node in position:
        [x, y, z] = planner.pos_network.node_coordinates(node)
        pos.append(Point3d(x, y, z))
else:
    [x, y, z] = planner.pos_network.node_coordinates(position)
    pos = Point3d(x, y, z)
# ---------- end tool_path_planning ----------
pt_3 = Point(tool_path_planning.points)
line = Line(tool_path_planning.edges)

# ----
# Visualize
number_slider_6 = Slider(0.02, range=0..0.1)
swatch = ColourSwatch(SwatchColor=RGB(255, 0, 0))
Y = UnitY(Factor=-0.005)
move_4 = Move(Geometry=line, Motion=Y)  # -> Geometry, Transform
dots = DotDisplay(Point=tool_path_planning.pos, Colour=swatch, Size=number_slider_6)
python = GhPythonScript(planner=tool_path_planning.planner, index=Slider(812, range=0..2000))  # -> point; inputs index: Int32
# ---------- python: Python ----------
__author__ = "timda"
__version__ = "2023.09.08"

import rhinoscriptsyntax as rs
from Rhino.Geometry import Point3d

[x, y, z] = planner.path_network.node_coordinates(index)
point = Point3d(x, y, z)
# ---------- end python ----------
show_envelope = GhPythonScript(envelope=envelope.envelope, pos=tool_path_planning.pos, index=Slider(0, range=0..10))  # -> mesh; inputs pos: list of Point3d, index: Int32
# ---------- show_envelope: Python ----------
__author__ = "timda"
__version__ = "2023.09.08"

import rhinoscriptsyntax as rs

from compas.artists import MeshArtist

envelope.x, envelope.y = pos[index].X, pos[index].Y

envelope.draw_mesh()
artist = MeshArtist(envelope.mesh_out)
mesh = artist.draw()
# ---------- end show_envelope ----------
preview = CustomPreview(Geometry=move_4.Geometry, Material=swatch)
