# Grasshopper definition generative.ghx (Grasshopper 1.0.7)
# plug-ins: NGon, Karamba3D

reload = Button()
py = PythonScript(reload=reload)
# ---------- py: Python ----------
from compas_rhino.utilities.misc import get_tolerance
from compas_rhino.utilities.misc import unload_modules

from compas_ghpython import unload_modules

unload_modules("compas")
unload_modules("compas_fab")
unload_modules("roslibpy")
unload_modules("fabrication_control")
unload_modules("assembly_information_model")
unload_modules("am_information_model")
unload_modules("ur_fabrication_control")
unload_modules("workshop_aaec_revamp")
unload_modules("add_on_am")
unload_modules("mobile_part_based_am")
# ---------- end py ----------
py_2 = PythonScript()  # -> HERE, DATA
# ---------- py_2: Python ----------
import os

HERE = os.path.dirname(ghdoc.Path)
DATA = os.path.abspath(os.path.join(HERE, "..", "data"))

#print(HERE)
print(DATA)
# ---------- end py_2 ----------

# ---- group: DESIGN / Shape Initialization
number_slider = Slider(0, range=0..360)
number_slider_2 = Slider(2, range=0..10)
number_slider_3 = Slider(0, range=0..10)
number_slider_4 = Slider(0.05, range=0..0.1)
number_slider_5 = Slider(0, range=0..10)
number_slider_6 = Slider(5, range=0..10)
toggle = BooleanToggle(False)

# ----
number_slider_7 = Slider(0.36, range=-5..5)  # disabled
number_slider_8 = Slider(4.29, range=0..5)  # disabled
number_slider_9 = Slider(0.87, range=0..5)  # disabled
number_slider_10 = Slider(2.07, range=0..5)  # disabled
number_slider_11 = Slider(3.49, range=0..5)  # disabled

# ---- group: DESIGN
create_wall = GhPythonScript(
    init=Button(),
    width=number_slider_6,
    height=number_slider_2,
    elsize=number_slider_4,
    x=number_slider_5,
    y=number_slider_3,
    rotation=number_slider,
    double_layer=toggle)  # -> wall
# ---------- create_wall: Python ----------
from add_on_am import Wall

import random
# create wall
wall = Wall(width, height, elsize, x, y, rotation)

print(wall.x_size, wall.z_size)
# ---------- end create_wall ----------

# ----
num = Number([number_slider_8, number_slider_9, number_slider_10, number_slider_11])  # disabled
number_slider_12 = Slider(4, range=0..10)  # disabled
number_slider_13 = Slider(0.6, range=0..10)  # disabled
number_slider_14 = Slider(1.3, range=0..10)  # disabled

# ---- group: UNDULATION
number_slider_15 = Slider(0, range=0..6.2)
number_slider_16 = Slider(0.5, range=0..5)
number_slider_17 = Slider(0.4, range=0..10)
base_sine_crv = GhPythonScript(width=number_slider_6, a=number_slider_16, f=number_slider_17, ro=number_slider_15)  # -> c_curve, curve
# ---------- base_sine_crv: Python ----------
import Rhino.Geometry as rg
from Rhino.Collections import Point3dList
from compas.geometry import NurbsCurve 
import math

points = []
iterator = [i*0.1 for i in range(int(width/0.1 +1.999))]
for x in iterator:
    points.append(rg.Point3d(x, -a*math.sin(2.0 * math.pi * f*x + ro), 0))

points = Point3dList(points)
start_tangent = rg.Vector3d(iterator[0], a * 2.0 * math.pi * f * math.cos(2.0 * math.pi * f*iterator[0] + ro), 0)
end_tangent = rg.Vector3d(iterator[0], a * 2.0 * math.pi * f * math.cos(2.0 * math.pi * f*iterator[-1] + ro), 0)
curve = rg.Curve.CreateInterpolatedCurve(points, 3)


c_curve = NurbsCurve().from_interpolation(points)
print(c_curve)
# ---------- end base_sine_crv ----------
undulate = GhPythonScript(
    wall=create_wall,
    up_amp=Slider(0.25, range=0..5),
    up_freq=Slider(0.8, range=0..10),
    up_phase=Slider(0, range=0..6.2),
    down_amp=number_slider_16,
    down_freq=number_slider_17,
    down_phase=number_slider_15)  # -> wall
# ---------- undulate: Python ----------
wall.undulate(up_amp, up_freq, up_phase ,down_amp, down_freq, down_phase)
# ---------- end undulate ----------

# ----
swatch = ColourSwatch(SwatchColor=RGB(255, 0, 0))  # disabled

# ---- group: VISUALIZATION
visualize = GhPythonScript(wall=undulate, show_mesh=Toggle(True), show_window=Toggle(True), delete_window=Toggle(True))  # -> rhmesh, vertices_window, vertices_support
# ---------- visualize: Python ----------
from compas_ghpython.artists import MeshArtist
import Rhino.Geometry as rg

rh_mesh = []
vertices_gate = []
vertices_all = []
disp_vectors = []
#
#if delete_window:
#    for vertex in wall.window_vertices:
#        wall.mesh.delete_vertex(vertex)
#        print("test")



if show_mesh:
    # Mesh Artist for visualization
    artist = MeshArtist(wall.mesh)
    rhmesh = artist.draw_mesh()

#
#if show_window:
    k = []
#    for vertex in wall.mesh.vertices():
#        gp = wall.mesh.vertex_attribute(vertex, name='window')
#        if gp: k.append(vertex)
#    
#    print k
#    if len(k): vertices_window = artist.draw_vertices(vertices=k)

for vertex in wall.mesh.vertices():
    if wall.mesh.vertex_attribute(vertex, name='z') < 0.025:
        k.append(vertex)
if len(k): vertices_support = artist.draw_vertices(vertices=k)
# ---------- end visualize ----------
swatch_2 = ColourSwatch(SwatchColor=RGB(54, 45, 35))

# ----
toggle_2 = BooleanToggle(False)  # disabled

number_slider_18 = Slider(0.2, range=0..1)  # disabled
number_slider_19 = Slider(2, range=0..3)  # disabled
number_slider_20 = Slider(0.3, range=0..1)  # disabled
number_slider_21 = Slider(0.2, range=0..1)  # disabled
envelope = GhPythonScript(
    wall=visualize.rhmesh,
    r_out=number_slider_14,
    h_out=number_slider_19,
    r_in=number_slider_20,
    h_in=number_slider_21,
    z_offset=number_slider_18)  # -> envelope, wall; inputs wall: Mesh; disabled
# ---------- envelope: Python ----------
import Rhino.Geometry as rg
import Rhino as rc

#class Envelope:
#    def __init__(self, r_out, h_out, r_in, h_in, z_offset):
#        self.reach = self.create_sphere_cylinder(r_out, h_out)
#        self.deadzone = self.create_sphere_cylinder(r_in, h_in)
#        self.deadzone.Translate(0, 0, z_offset)
#        self.envelope = rg.Mesh()
#        self.envelope.Append([self.reach, self.deadzone])
#        self.envelope.Translate(1, 0, 0)
#    
#    def create_sphere_cylinder(self, r, h):
#        sphere = rg.Sphere(rg.Point3d(0, 0, 0,), r)
#        sph_cyl = rg.Mesh.CreateFromSphere(sphere, 16, 32)
#        
#        to_delete = []
#        sph_cyl.FaceNormals.ComputeFaceNormals()
#        for i, normal in enumerate(sph_cyl.FaceNormals):
#            if normal.Z > 0:
#                to_delete.append(i)
#        top_sphere = sph_cyl.Faces.ExtractFaces(to_delete)
#        top_sphere.Translate(0, 0, h)
#        
#        cylinder = rg.Cylinder(rg.Circle(rg.Point3d(0, 0, 0), r), h)
#        cylinder = rg.Mesh.CreateFromCylinder(cylinder, 10, 16, False, False)
#        
#        sph_cyl.Append([cylinder, top_sphere])
#        return sph_cyl
#
#e = Envelope(r_out, h_out, r_in, h_in, z_offset)
#meshes = []
#meshes.append(wall)
#meshes.append(e.envelope)
#intersections = rg.Intersect.Intersection.MeshMesh(meshes, 1.0e-10, False, False, None, None, None)
#
#reach = e.reach
#deadzone = e.deadzone
#envelope = e.envelope


class Envelope:
    def __init__(self, wall, r_out, h_out, r_in, h_in, z_offset):
        self.mesh = wall
        self.r_out = r_out
        self.r_in = r_in
        self.h_out = h_out
        self.h_in = h_in
        self.z_offset = z_offset
        self.x = 0
        self.y = 0
        self.z = 0
        
    def get_intersection(self, x=0, y=0, z=0, p=None):
        if p != None:
            self.x = p.X
            self.y = p.Y
            self.z = p.Z
        inside = []
        for i, vertex in enumerate(self.mesh.Vertices):
            condition1 = [vertex.Z > self.h_out+self.z, vertex.Z < self.z]
            condition2 = {
            "cylinder": (vertex.X-self.x)**2 + (vertex.Y-self.y)**2 < self.r_out**2,
            "upper circle": (vertex.X-self.x)**2 + (vertex.Y-self.y)**2 + (vertex.Z-self.h_out-self.z)**2 < self.r_out**2,
            "lower circle": (vertex.X-self.x)**2 + (vertex.Y-self.y)**2 + (vertex.Z-self.z)**2 < self.r_out**2
            }
            outside_condition = ((not (condition1[0] or condition1[1])) and condition2["cylinder"]) or (condition1[0] and condition2["upper circle"]) or (condition1[1] and condition2["lower circle"])
            
            condition1 = [vertex.Z-self.z_offset > self.h_in+self.z, vertex.Z-self.z_offset < self.z]
            condition2 = {
            "cylinder": (vertex.X-self.x)**2 + (vertex.Y-self.y)**2 > self.r_in**2,
            "upper circle": (vertex.X-self.x)**2 + (vertex.Y-self.y)**2 + (vertex.Z-(self.h_in+self.z_offset)-self.z)**2 > self.r_in**2,
            "lower circle": (vertex.X-self.x)**2 + (vertex.Y-self.y)**2 + (vertex.Z-self.z_offset-self.z)**2 > self.r_in**2
            }
            # inside_condition = ((not (condition1[0] or condition1[1])) and condition2["cylinder"]) or (condition1[0] and condition2["upper circle"]) or (condition1[1] and condition2["lower circle"])
            if not (condition1[0] or condition1[1]):
                inside_condition = condition2["cylinder"]
            elif condition1[0]:
                inside_condition = condition2["upper circle"]
            elif condition1[1]:
                inside_condition = condition2["lower circle"]
            else:
                inside_condition = False
            
            if inside_condition and outside_condition:
                inside += wall.Vertices.GetVertexFaces(i)
        return self.mesh.DuplicateMesh().Faces.ExtractFaces(inside)
        
    def create_mesh(self):
        reach = self.create_sphere_cylinder(self.r_out, self.h_out)
        deadzone = self.create_sphere_cylinder(self.r_in, self.h_in)
        deadzone.Translate(0, 0, self.z_offset)
        e = rg.Mesh()
        e.Append([reach, deadzone])
        e.Translate(self.x, self.y, self.z)
        return e
    
    def create_sphere_cylinder(self, r, h):
        sphere = rg.Sphere(rg.Point3d(0, 0, 0,), r)
        sph_cyl = rg.Mesh.CreateFromSphere(sphere, 16, 32)
        
        to_delete = []
        sph_cyl.FaceNormals.ComputeFaceNormals()
        for i, normal in enumerate(sph_cyl.FaceNormals):
            if normal.Z > 0:
                to_delete.append(i)
        top_sphere = sph_cyl.Faces.ExtractFaces(to_delete)
        top_sphere.Translate(0, 0, h)
        
        cylinder = rg.Cylinder(rg.Circle(rg.Point3d(0, 0, 0), r), h)
        cylinder = rg.Mesh.CreateFromCylinder(cylinder, 10, 16, False, False)
        
        sph_cyl.Append([cylinder, top_sphere])
        return sph_cyl
        
envelope = Envelope(wall, r_out, h_out, r_in, h_in, z_offset)
in_mesh = envelope.get_intersection(1.1, r_in, 0)
# ---------- end envelope ----------
number_slider_22 = Slider(0, range=0..10)  # disabled
seperation = GhPythonScript(crv=base_sine_crv.curve, z=number_slider_22, envelope=envelope.envelope, wall=create_wall, switch_sides=toggle_2)  # -> total_mesh, meshes, meshes_envelope, points; inputs crv: Curve; disabled
# ---------- seperation: Python ----------
import Rhino.Geometry as rg
import math


whole_mesh = rg.Mesh()
meshes = []
meshes_envelope = rg.Mesh()
dist = math.sqrt((envelope.r_out)**2 - (z+envelope.h_out-wall.height)**2 - envelope.r_in**2)
crv.Translate(0, 0, z)
# divide the wall with points that are equally spaced, the first point must not be at zero but at distance dist from 0
temp = crv.Split(crv.ClosestPoint(crv.DivideEquidistant(dist)[1])[1])[1]
points_t = temp.DivideEquidistant(dist*2)
points = points_t
if crv.PointAtEnd.DistanceTo(points_t[-1]) > dist:
    points = [point for point in points_t]
    points.append(crv.PointAtEnd)

for i, point in enumerate(points):
    normal = crv.TangentAt(crv.ClosestPoint(point)[1])
    if switch_sides:
        curvature = crv.CurvatureAt(crv.ClosestPoint(point)[1]).Y
        crv_sign = curvature/abs(curvature)
    else:
        crv_sign = 1.0
    normal.Rotate(crv_sign*math.pi/2, rg.Vector3d(0, 0, 1.0))
    normal.Unitize()
    
    point += (envelope.r_in*normal)
    points[i] = point
    mesh = envelope.get_intersection(p=point)
    if mesh != None:
        meshes.append(envelope.get_intersection(p=point))
        whole_mesh.Append(envelope.get_intersection(p=point))
    meshes_envelope.Append(envelope.create_mesh())

overlap = whole_mesh.Faces.ExtractDuplicateFaces()


# checking each face that appears twice for its second closest point and then removing it from the mesh that is associated with that point
# the points are the robots positions
for i, face in enumerate(overlap.Faces):
    center = overlap.Faces.GetFaceCenter(i)
    distance = []
    for point in points:
        distance.append(center.DistanceTo(point))
    for d in sorted(set(distance))[1:]:
        i_mesh_to_delete_from = distance.index(d)
        duplicate_face = meshes[i_mesh_to_delete_from].ClosestMeshPoint(center,0.05)
        if duplicate_face:
            i_face_to_delete = duplicate_face.FaceIndex
            meshes[i_mesh_to_delete_from].Faces.DeleteFaces([i_face_to_delete])

total_mesh = rg.Mesh()
total_mesh.Append(meshes)

#
#points = []
#whole_mesh = rg.Mesh()
#meshes_envelope = rg.Mesh()
#dist = math.sqrt((envelope.r_out)**2 - (z+envelope.h_out-wall.height)**2 - envelope.r_in**2)
#crv.Translate(0, 0, z)
#k = crv.LengthParameter(dist)[1]
#t = k
#while t < crv.LengthParameter(crv.GetLength())[1]+k:
#    normal = crv.TangentAt(t)
#    if switch_sides:
#        curvature = crv.CurvatureAt(t).Y
#        crv_sign = curvature/abs(curvature)
#    else:
#        crv_sign = 1.0
#    normal.Rotate(crv_sign*math.pi/2, rg.Vector3d(0, 0, 1.0))
#    normal.Unitize()
#    point = crv.PointAt(t)
#    
#    point += (envelope.r_in*normal)
#    points.append(point)
#    mesh = envelope.get_intersection(p=point)
#    if mesh != None:
#        whole_mesh.Append(envelope.get_intersection(p=point))
#    meshes_envelope.Append(envelope.create_mesh())
#    t_old = t
#    t += 2*k


#top_edges = []
#for mesh in meshes:
#    edges = mesh.GetNakedEdges()[0].BreakAtAngles(math.pi/2)
#    for i, edge in enumerate(edges):
#        edge = edge.ToPolylineCurve()
#        if edge.PointAtStart.Z == wall.height and edge.PointAtEnd.Z == wall.height:
#            top_edges.append(edge)
#
#for edge in enumerate(top_edges[1:]):
#    split =
# ---------- end seperation ----------
pt = Point(seperation.points)  # disabled
mesh = Mesh(seperation.total_mesh)  # disabled
mesh_2 = Mesh(seperation.meshes_envelope)  # disabled

python = GhPythonScript(
    width=number_slider_6,
    a=number_slider_16,
    f=number_slider_17,
    ro=number_slider_15,
    crv=base_sine_crv.curve,
    x=num,
    y=number_slider_7,
    z=number_slider_13,
    duplications=number_slider_12,
    envelope=envelope.envelope,
    wall=envelope.wall)  # -> print_meshes, points; inputs x: list, duplications: Int32; disabled
# ---------- python: Python ----------
import Rhino.Geometry as rg
import math

print_meshes = rg.Mesh()
points = []
for i in range(duplications):
    y_temp = a*math.sin(2.0 * math.pi * f*x[i] + ro) - y
    points.append(rg.Point3d(x[i], -y_temp, z))
    print_meshes.Append(envelope.get_intersection(x[i], y_temp, z))
print_meshes.Faces.ExtractDuplicateFaces()
# ---------- end python ----------
pt_2 = Point(python.points)  # disabled
mcol = MeshColours(Mesh=python.print_meshes, Colours=swatch)  # disabled
mesh_3 = Mesh(envelope.wall)  # disabled
area = Area(Geometry=mcol)  # -> Area, Centroid; disabled
area_2 = Area(Geometry=mesh_3)  # -> Area, Centroid; disabled
galapagos = Galapagos(fitness=subtraction, gene=[number_slider_9, number_slider_8, number_slider_10, number_slider_11])
subtraction = Subtraction(A=area_2.Area, B=area.Area)  # disabled
number_slider_23 = Slider(0, range=0..10)  # disabled

# ----
# Forces
number_slider_24 = Slider(10, range=0..10)  # disabled
cross_section = CrossSectionKaramba3D(
    FamilyNameOfCrossSection="DefaultCroSec",
    Height_cm=number_slider_24,
    ReinforcementAreas_cm2_m=[0, 0, 0, 0],
    ReinforcementConcreteCovers_cm=[3.5, 4.5, -4.5, -3.5],
    PrincipalReinforcementDirection_deg=0,
    mode="Shell RC Standard - Const.")  # disabled
panel = Panel("Mesh")  # disabled
pt_3 = Point(visualize.vertices_support)  # disabled
loads = LoadsKaramba3D(Vector=Vector(0, 0, -1), LCase="0", mode="Gravity")  # disabled
meshtoshell = MeshToShellKaramba3D(Mesh=mesh, Identifier=panel, CrossSection=cross_section, LimitDistance_m=0.005)  # -> Element, Points, Info; disabled
supp = SupportKaramba3D(PosInd=pt_3, menu=[buttons(on, on, on, off, off, off)])  # disabled
assemble = AssembleModelKaramba3D(Elem=meshtoshell.Element, Support=supp, Load=loads, LimitDistance_m=0.005)  # -> Model, Info, Mass_kg, CenterOfGravity, LoadCaseNames; disabled
analyze = AnalyzeKaramba3D(Model=assemble.Model)  # -> CalculatedModel, MaximumDisplacement_cm, ResultingForceOfGravity_kN, ElasticEnergyChange_kNm; disabled
s_forces = ShellForcesKaramba3D(AnalyzedModel=analyze.CalculatedModel, mode="Local")  # -> AnalyzedModel, Nxx_kN_m, Nyy_kN_m, Nxy_kN_m, Mxx_kNm_m, Myy_kNm_m, Mxy_kNm_m, Vx_kN_m, Vy_kN_m; disabled

mesh_4 = Mesh(seperation.meshes)  # disabled
pt_4 = Point(visualize.vertices_window)
mcol_2 = MeshColours(Mesh=visualize.rhmesh, Colours=swatch_2)
curves_on_mesh = GhPythonScript(wall=undulate)  # -> crvs
# ---------- curves_on_mesh: Python ----------
__author__ = "timda"
__version__ = "2023.05.05"

import rhinoscriptsyntax as rs
from System.Collections.Generic import List
from Rhino.Geometry.Curve import ProjectToMesh, CreateControlPointCurve, CreateTweenCurvesWithSampling
from Rhino.Geometry import Point3d, Vector3d, LineCurve, Line, Curve, Mesh, BlendContinuity

crvs = []
for i in range(wall.x_size):
    x = i*wall.elsize
    crvs.append(Line(Point3d(x, 0, 0), Point3d(x, 0, wall.height)))
# ---------- end curves_on_mesh ----------
Y = UnitY(Factor=1)
item = ListItem(List=mesh_4, Index=number_slider_23, Wrap=True)  # disabled
item_2 = ListItem(List=pt, Index=number_slider_23, Wrap=True)  # disabled
projecttomesh = CSharpScript(Curve=curves_on_mesh, Mesh=visualize.rhmesh, Direction=Y)  # -> out, A; inputs Curve: Curve, Mesh: Mesh, Direction: Vector3d
# ---------- projecttomesh: C# usings ----------
using System.IO;
using System.Linq;
using System.Data;
using System.Drawing;
using System.Reflection;
using System.Windows.Forms;
using System.Xml;
using System.Xml.Linq;
using System.Runtime.InteropServices;

using Rhino.DocObjects;
using Rhino.Collections;
using GH_IO;
using GH_IO.Serialization;
# ---------- projecttomesh: C# ----------
    if (null != Curve && null != Mesh && Direction.IsValid)
    {
      var tol = RhinoDoc.ActiveDoc.ModelAbsoluteTolerance;
      A = Curve.ProjectToMesh(Curve, Mesh, Direction, tol);
    }
# ---------- end projecttomesh ----------
swatch_3 = ColourSwatch(SwatchColor=RGB(255, 0, 0))  # disabled
curves_on_mesh_2 = GhPythonScript(mesh=visualize.rhmesh, wall=undulate)  # -> crvs; inputs mesh: Mesh
# ---------- curves_on_mesh_2: Python ----------
__author__ = "timda"
__version__ = "2023.05.05"

import rhinoscriptsyntax as rs
from System.Collections.Generic import List
from Rhino.Geometry.Curve import ProjectToMesh, CreateControlPointCurve, CreateTweenCurvesWithSampling
from Rhino.Geometry import Point3d, Vector3d, LineCurve, Line, Curve, Mesh, BlendContinuity

def inter_lines(lines):
    cp = []
    for line in lines:
        cp.append(line.PointAtStart)
        cp.append(line.PointAtEnd)
    crv = CreateControlPointCurve(List[Point3d](cp))
    return crv

line = []
crvs = []
for i in range(wall.x_size):
    x = i*wall.elsize
    line = CreateControlPointCurve(List[Point3d]([Point3d(x, 0, 0), Point3d(x, 0, wall.height)]))
    segments = ProjectToMesh(line, mesh, Vector3d(0, 1, 0), 0.001)
    if len(segments) > 1:
        segments = [inter_lines(segments)]
    crvs.append(segments[0])
# ---------- end curves_on_mesh_2 ----------
python_2 = GhPythonScript(mesh=visualize.rhmesh)  # -> edges, lines, line_p
# ---------- python_2: Python ----------
__author__ = "timda"
__version__ = "2023.05.07"

import rhinoscriptsyntax as rs
from add_on_am import SurfacePathPlanner
from compas_rhino.geometry import RhinoMesh
from System.Collections.Generic import List
from Rhino.Geometry.Curve import CreateControlPointCurve
from Rhino.Geometry import Point3d

from compas_ghpython.utilities import draw_network, draw_polylines

rmesh = RhinoMesh.from_guid(mesh)
planner = SurfacePathPlanner()
planner.set_quad_mesh_from_rhinomesh(rmesh)
planner.set_network_nodes()
[network, n, line_p] = planner.vertical_lines("x")
points, edges = draw_network(network) 
lines = []
for polyline in line_p:
    point = []
    for p in polyline:
        point.append(Point3d(p[0], p[1], p[2]))
    lines.append(CreateControlPointCurve(List[Point3d](point)))
# ---------- end python_2 ----------
python_3 = GhPythonScript(crvs=projecttomesh.A)  # -> a; inputs crvs: tree of Curve
# ---------- python_3: Python ----------
__author__ = "timda"
__version__ = "2023.05.07"

import rhinoscriptsyntax as rs
from Rhino.Geometry.Curve import JoinCurves
a = []
for i in range(crvs.BranchCount):
    branchList = crvs.Branch(i)
    crv = JoinCurves(branchList, 0.1, True)[0]
    print(crv)
    a.append(crv)
# ---------- end python_3 ----------
mcol_3 = MeshColours(Mesh=item, Colours=swatch_3)  # disabled
item_3 = ListItem(List=curves_on_mesh_2, Index=Slider(84, range=0..110), Wrap=True)
envelope_2 = GhPythonScript(
    crvs=python_3,
    r_out=Slider(1.3, range=0..10),
    h_out=Slider(1, range=0..3),
    r_in=Slider(0.3, range=0..1),
    h_in=Slider(0.2, range=0..1),
    z_offset=Slider(0.2, range=0..1),
    base_crv=base_sine_crv.c_curve)  # -> mesh, points, crvs_in, crvs_out, envelope; inputs crvs: list of Curve
# ---------- envelope_2: Python ----------
from Rhino.Geometry.Intersect.Intersection import MeshPolyline
from add_on_am import Envelope
from compas.artists import MeshArtist
from compas_rhino.conversions import polyline_to_compas
import math

z = 0.5
c_crvs = []
for i, crv in enumerate(crvs):
    c_crvs.append(polyline_to_compas(crv.ToPolyline()))

envelope = Envelope(r_out, h_out, r_in, h_in, z_offset, 0, 0, z)

def intersections(intersection_mesh, curves):
    inter_points = []
    for curve in curves:
        inter = MeshPolyline(intersection_mesh, curve)
        if inter[1]:
            inter_points += inter[0]
    return inter_points

#c, max_in = envelope.iterate(c_crvs, base_crv)
#print(c, max_in)
#
## takes 3sek???
#i_in, i_out = envelope.crvs_inside(c_crvs, True, True)
#crvs_in = [[], []]
#crvs_out = []
#for i, crv in enumerate(crvs):
#    if i in i_in:
#        crvs_in[0].append(crv)
#    elif i in i_out:
#        crvs_out.append(crv)


i_out = range(len(c_crvs))
crvs_in = []

for k in range(5):
    if len(i_out)==0:
        break 
    crvs_in.append([])
    c, max_in = envelope.iterate([c_crvs[i] for i in i_out], base_crv)
    print(c, max_in)
    
    # takes 3sek???
    i_in, i_out = envelope.crvs_inside(c_crvs, True, True)
    crvs_out = []
    for i, crv in enumerate(crvs):
        if i in i_in:
            crvs_in[k].append(crv)
        elif i in i_out:
            crvs_out.append(crv)

envelope.draw_mesh()
artist = MeshArtist(envelope.mesh_out)
mesh = artist.draw()
# ---------- end envelope_2 ----------
list = ValueList({"ur10e_map.json"}, selected="ur10e_map.json")
py_3 = PythonScript()  # -> DATA
# ---------- py_3: Python ----------
import os

#package_path = os.path.dirname(mobile_fabrication_control.__file__)
#DATA = os.path.abspath(os.path.join(package_path,"../../data"))

package_path = ghdoc.Path
# package_path = os.path.dirname(ur_fabrication_control.__file__)
#DATA = os.path.abspath(os.path.join(package_path,"../../data"))

# .stl files not stored in am_hackathon repo. but in mobile_fabrication_control
DATA = os.path.abspath(os.path.join(package_path,"../../../mobile_part_based_am/data/reachabilitymaps"))

print(package_path)
print(DATA)
# ---------- end py_3 ----------
pt_5 = Point(envelope_2.points)
mesh_5 = Mesh(envelope_2.mesh)
crv = Curve(envelope_2.crvs_out)
i = Slider(0, range=0..5)
file = GhPythonScript(DATA=py_3, file=list)  # -> filepath
# ---------- file: Python ----------
__author__ = "Gido"
__version__ = "2023.04.18"

import os
import rhinoscriptsyntax as rs

filepath = os.path.join(DATA, file)
# ---------- end file ----------
python_4 = GhPythonScript(wall=undulate, envelope=envelope_2.envelope)  # -> points, ri, pos, vertices, mesh
# ---------- python_4: Python ----------
__author__ = "timda"
__version__ = "2023.05.11"

import rhinoscriptsyntax as rs
from add_on_am import Map2d
from compas_ghpython.utilities import draw_network
from Rhino.Geometry import Point3d
from compas.artists import MeshArtist

map = Map2d(wall, 0.25)
network = map.create_network(envelope)
map.assign_reach(envelope)
points, edges = draw_network(network)
ri = {}
for node in map.network.nodes():
    ri[node] = map.network.node_attribute(node, "ri")

max_i = max(ri, key=ri.get)
pos = points[max_i]

vertices_i = map.network.node_attribute(max_i, "vertices")
vertices = []
for i in vertices_i:
    [x, y, z] = wall.mesh.vertex_coordinates(i)
    vertices.append(Point3d(x, y, z))

#pos = []
#for k in range(3):
#    max_i = max(ri, key=ri.get)
#    pos.append(points[max_i])
#    ri[max_i] = 0


envelope.x = pos.X
envelope.y = pos.Y
envelope.draw_mesh()
artist = MeshArtist(envelope.mesh_out)
mesh = artist.draw()
# ---------- end python_4 ----------
python_5 = GhPythonScript(list=envelope_2.crvs_in, i=i)  # -> out, item; inputs list: list, i: Int32
# ---------- python_5: Python ----------
__author__ = "timda"
__version__ = "2023.05.09"

import rhinoscriptsyntax as rs
item = list[i]
# ---------- end python_5 ----------

# ----
# Reachabilitymap to JSON
toggle_3 = BooleanToggle(True)
from_json = GhPythonScript(filepath=file, load=toggle_3)  # -> out, reachabilitymap, r
# ---------- from_json: Python ----------
__author__ = "Gido"
__version__ = "2023.04.18"

import rhinoscriptsyntax as rs
from add_on_am import ReachabilityMap

if load:
    reachabilitymap = ReachabilityMap.from_json(filepath)
    r = reachabilitymap.calc_radius()
    # r_two = reachabilitymap.calc_radius_two()
    # print(r, r_two) (0.845576756927508, 0.8261355951360555)
# ---------- end from_json ----------

mesh_6 = Mesh(python_4.mesh)
crv_2 = Curve(python_5.item)
pt_6 = Point(python_4.points)
pt_7 = Point(python_4.vertices)
pt_8 = Point(python_4.pos)
panel_2 = Panel(python_4.ri)

# ----
# Path planner
path_type = ValueList({"Lowest Axis Path": 1, "Lowest Axis Path Combined": 2, "Lowest Axis Path Priority": 3, "Lowest Axis Path Adjusted": 4, "Centroid Path": 5, "Boundary Path": 6, "Corners Path": 7, "Random Path Adjusted": 8, "Lowest Neighbors Path": 9}, selected="Lowest Axis Path")
orientation = ValueList({"X-axis": "x", "Y-axis": "y", "Z-axis": "z"}, selected="Z-axis")
tool_path_planning = GhPythonScript(
    compute=Button(),
    path_type=path_type,
    orientation=orientation,
    mesh=visualize.rhmesh,
    reachabilitymap=from_json.reachabilitymap,
    center=item_2)  # -> planner, points, edges, n; inputs center: Point3d
# ---------- tool_path_planning: Python ----------
import compas
from compas_rhino.geometry import RhinoMesh
from Rhino.Geometry import Point3d
from add_on_am import SurfacePathPlanner
from compas_ghpython.utilities import draw_network, draw_frame
from compas.colors import Color

rmesh = RhinoMesh.from_guid(mesh)
planner = SurfacePathPlanner()
planner.set_quad_mesh_from_rhinomesh(rmesh)
planner.set_network_nodes()
#planner.set_color_map([
#    Color.from_rgb255(128,255,255),
#    Color.from_rgb255(255,255,0),
#    Color.from_rgb255(255,0,0)])
#planner.set_thickness_map([
#    0.008,
#    0.010,
#    0.012])
center = Point3d(0, 0, 0)
print(orientation)
planner.map_reachability(reachabilitymap, center)


if path_type == 1:
    [network, n] = planner.lowest_axis_path(orientation)

#planner.calculate_fabrication_parameters()

points, edges = draw_network(network)   
planes = []
tool_planes = []
cylinders = []
colors = []
for k in planner.network.path:
    frame = planner.network.node_attribute(key=k, name='frame')
    plane = draw_frame(frame)
    planes.append(plane)

# print(planner.network.node_attributes(key=0))
# ---------- end tool_path_planning ----------
pt_9 = Point(tool_path_planning.points)
panel_3 = Panel(tool_path_planning.n)
path = Curve(tool_path_planning.edges)

list_2 = ValueList({"Nxx": 0, "Nyy": 1}, selected="Nxx")  # disabled
filter = StreamFilter(Gate=list_2, Stream0=s_forces.Nxx_kN_m, Stream1=s_forces.Nyy_kN_m)  # disabled
addforces = GhPythonScript(planner=tool_path_planning.planner, meshes=mesh_4, i=number_slider_23, n=filter)  # -> force, L0, L1; inputs meshes: list of Mesh, i: Int32, n: list; disabled
# ---------- addforces: Python ----------
__author__ = "timda"
__version__ = "2023.04.30"

import rhinoscriptsyntax as rs

mesh_lengths = [0] + [len(mesh.Faces) for mesh in meshes]

start = sum(mesh_lengths[0:i+1])
end = sum(mesh_lengths[0:i+2])
n = [n[start:end], n[sum(mesh_lengths)+start:sum(mesh_lengths)+end]]
planner.add_force(n)

force = []
for node in planner.mesh.faces():
    force.append(planner.network.node_attribute(key=node, name='force'))

L1 = max(force)
L0 = min(force)
# ---------- end addforces ----------

toggle_4 = BooleanToggle(True)  # disabled
explodemesh = ExplodeMesh(Mesh=item, Explode=toggle_4)  # disabled
gradient = Gradient(
    LowerLimit=addforces.L0,
    UpperLimit=addforces.L1,
    Parameter=addforces.force,
    stops=[0: RGB(75, 107, 169), 0.54: RGB(173, 203, 249), 0.54: RGB(254, 244, 84), 0.54: RGB(234, 126, 0), 1: RGB(234, 38, 0)])  # disabled
subdmesh = SubDFromMesh(Mesh=explodemesh, Creases=1, Corners=1, Interpolate=False)  # disabled
shelllineresults = LineResultsOnShellsKaramba3D(
    AnalyzedModel=analyze.CalculatedModel,
    LayerPosition=0,
    ListOfSourcesOfPrincipalStressLinesLinesPoints=pt_9,
    SegmentLength_m=0.5,
    DA_deg=5,
    mode="PrincStress")  # -> AnalyzedModel, Lines1, Lines2; disabled
number_slider_25 = Slider(0, range=0..100)  # disabled
item_4 = ListItem(List=shelllineresults.Lines1, Index=number_slider_25, Wrap=True)  # disabled
# Use stress lines for QuadRemeshAsync => should result in thicker path in certain parts, print thickness adjusted from facearea
preview = CustomPreview(Geometry=subdmesh, Shader=gradient)  # disabled
line = Line(item_4)  # disabled

# ---- group: plan motion
start = Button()  # disabled
stop = Button()  # disabled
reset = Button()  # disabled
step = Button()  # disabled

# ----
counter = CountThroughList(L=pt_9, start=start, stop=stop, step=step, reset=reset)  # -> item, index; inputs L: list, start: Boolean; disabled
# ---------- counter: Python ----------
from scriptcontext import sticky as st
from compas_ghpython.utilities import update_component


interval = 1

# store data in component
guid = str(ghenv.Component.InstanceGuid)
counter_key = "counter_" + guid
running_key = "running_" + guid

if counter_key not in st or reset:
    st[counter_key] = 0

if running_key not in st:
    st[running_key] = False

if start:
    st[running_key] = True

if stop:
    st[running_key] = False

if step:
    if st[counter_key] < len(L) - 1:
        st[counter_key] += 1
    
if len(L):
    index = st[counter_key]
    item = L[index]

if st[running_key]:
    if st[counter_key] < len(L) - 1:
        st[counter_key] += 1
        update_component(ghenv, interval)
    else:
        st[counter_key] = 0
        st[running_key] = False
# ---------- end counter ----------

visualization = GhPythonScript(mesh=mcol_3, planner=tool_path_planning.planner, i=counter.index, position=item_2)  # -> ri, mesh, plane, point; inputs mesh: Mesh, i: Int32, position: Point3d; disabled
# ---------- visualization: Python ----------
__author__ = "timda"
__version__ = "2023.04.30"

import rhinoscriptsyntax as rs
from Rhino.Geometry import Vector3d

from compas.geometry import Frame, Point
from compas_ghpython.utilities import draw_frame, draw_points
from compas_rhino.conversions import point_to_rhino

index = planner.network.path[i]
frame = planner.network.node_attribute(index, name="frame")
plane = draw_frame(frame)
p = Point.from_data(planner.network.node_coordinates(index))
point = point_to_rhino(p)

ri = []
for k in planner.mesh.faces():
    ri.append(planner.network.node_attribute(k, name="sphere").ri)



x = -position.X
y = -position.Y
z = -position.Z
trans = Vector3d(x, y, z)

mesh.Translate(x, y, z)
plane.Translate(trans)
point += trans
# ---------- end visualization ----------
pt_10 = Point(visualization.point)  # disabled
toggle_5 = BooleanToggle(True)  # disabled
deplane = DeconstructPlane(Plane=visualization.plane)  # -> Origin, XAxis, YAxis, ZAxis; disabled
explodemesh_2 = ExplodeMesh(Mesh=visualization.mesh, Explode=toggle_5)  # disabled
gradient_2 = Gradient(
    LowerLimit=0,
    UpperLimit=100,
    Parameter=visualization.ri,
    stops=[0: RGB(234, 38, 0), 0.25: RGB(234, 126, 0), 0.5: RGB(254, 244, 84), 0.75: RGB(173, 203, 249), 1: RGB(75, 107, 169)])  # disabled
vdis = VectorDisplay(Anchor=deplane.Origin, Vector=deplane.ZAxis)  # disabled
subdmesh_2 = SubDFromMesh(Mesh=explodemesh_2, Creases=1, Corners=1, Interpolate=False)  # disabled
preview_2 = CustomPreview(Geometry=subdmesh_2, Shader=gradient_2)  # disabled

py_4 = PythonScript()  # -> DATA; disabled
# ---------- py_4: Python ----------
import os
import getpass

username = getpass.getuser()
USER_FOLDER = os.path.abspath("C:/Users/timda/Documents/Uni-Programming/revamp")
DATA = os.path.abspath(os.path.join(USER_FOLDER,"workspace/ur_fabrication_control/data"))

print(USER_FOLDER)
print(DATA)
# ---------- end py_4 ----------

# ----
# Robot Model
# Load Model
list_3 = ValueList({"ur_description", "ur_e_description", "ur_setups"}, selected="ur_e_description")  # disabled
list_4 = ValueList({"ur3.urdf", "ur3_rot.urdf", "ur5.urdf", "ur10.urdf", "ur3e.urdf", "ur5e.urdf", "ur10e.urdf", "ur10e_rot.urdf"}, selected="ur10e_rot.urdf")  # disabled
list_5 = ValueList({"ur3.srdf", "ur5.srdf", "ur10.srdf", "ur3e.srdf", "ur5e.srdf", "ur10e.srdf"}, selected="ur10e.srdf")  # disabled
py_5 = PythonScript(data_path=py_4, package=list_3, urdf_name=list_4, srdf_name=list_5)  # -> loaders, urdf_filename, srdf_filename; disabled
# ---------- py_5: Python ----------
import os
from compas.robots import LocalPackageMeshLoader

path = os.path.join(data_path, "robot_description")

#loaders
packages = ["ur_description", "ur_e_description", "ur_end_effectors", "ur_setups"]
loaders = [LocalPackageMeshLoader(path, pck) for pck in packages]

#files
package_path = os.path.join(path, package)
print package_path

urdf_filename = os.path.join(package_path, "urdf", urdf_name)
srdf_filename = os.path.join(package_path, srdf_name)

assert os.path.isfile(urdf_filename)
assert os.path.isfile(srdf_filename)
# ---------- end py_5 ----------
load = Button()  # disabled
units = ValueList({"m": 1, "cm": 100, "mm": 1000}, selected="m")  # disabled
create = PythonScript(load=load, loaders=py_5.loaders, urdf_filename=py_5.urdf_filename, srdf_filename=py_5.srdf_filename, scale_factor=units)  # -> out, robot; inputs load: Boolean, loaders: list; disabled
# ---------- create: Python ----------
import os
from scriptcontext import sticky as st

import compas

from compas.robots import RobotModel
from compas.robots import LocalPackageMeshLoader

from compas_fab.robots import Robot
from compas_fab.robots import RobotSemantics

from compas_fab.ghpython import RobotArtist

compas.PRECISION = '12f'

# store robot in component
guid = str(ghenv.Component.InstanceGuid)
robot_key = "robot_" + guid

if robot_key not in st:
    st[robot_key] = None

print loaders
if load:
    model = RobotModel.from_urdf_file(urdf_filename)
    
    model.load_geometry(*loaders)
    artist = RobotArtist(model)
    semantics = RobotSemantics.from_srdf_file(srdf_filename, model)
    robot = Robot(model, artist, semantics, client=None)

    
    st[robot_key] = robot

robot = st[robot_key]


if robot:
    robot.scale(scale_factor)
# ---------- end create ----------
robot = Data(create.robot)  # disabled

# ----
# Tool
list_6 = ValueList({"measurement_tool": 0, "airpick_15mm": 1, "airpick_40mm": 2, "area_gripper": 3, "parallel_gripper": 4}, selected="measurement_tool")  # disabled
panel_4 = Panel("Attach a custom tool")  # disabled
remove = Button()  # disabled
show = BooleanToggle(True)  # disabled
add = Button()  # disabled
tool = PythonScript(data_path=py_4, tool=list_6, show=show)  # -> tool, M; disabled
# ---------- tool: Python ----------
import os, math
from compas.geometry import Frame, Rotation
from compas.datastructures import Mesh
from compas_ghpython.artists import MeshArtist
from compas_fab.robots import Tool

tolerance = 0

if tool == 0:
    filename = 'measurement_tool_zaxis.stl'
    ee_frame = Frame([0, 0, 0.109], [1, 0, 0], [0, 1, 0])

elif tool == 1:
    filename = 'airpick_15.stl'
    ee_frame = Frame([0, 0, 0.158 + tolerance], [1, 0, 0], [0, 1, 0])
    
elif tool == 2:
    filename = 'airpick_40.stl'
    ee_frame = Frame([0, 0, 0.158 + tolerance], [1, 0, 0], [0, 1, 0])

elif tool == 3:
    filename = 'area_gripper_zaxis.stl'
    ee_frame = Frame([0, 0, 0.10219 + tolerance], [1, 0, 0], [0, 1, 0])

elif tool == 4:
    filename = 'parallel_gripper_zaxis.stl'
    ee_frame = Frame([0, 0, 0.176 + tolerance], [1, 0, 0], [0, 1, 0])

data_path = os.path.join(data_path, "tool_geometry")
fullfilename = os.path.join(data_path, filename)
print fullfilename

ee_mesh = Mesh.from_stl(fullfilename)

#R = Rotation.from_axis_and_angle(ee_frame.zaxis, math.radians(180), point=ee_frame.point)
#ee_frame.transform(R)

if show:
    artist = MeshArtist(ee_mesh)
    M = artist.draw()

tool = Tool(ee_mesh, ee_frame)
# ---------- end tool ----------
attach_remove = PythonScript(robot=robot, tool=tool.tool, attach=add, remove=remove)  # -> out, bang; disabled
# ---------- attach_remove: Python ----------
if attach:
    robot.attach_tool(tool)
if remove:
    robot.detach_tool()
# ---------- end attach_remove ----------

panel_5 = Panel(py_4)  # disabled

# ----
# Info
info = PythonScript(robot=robot)  # -> out, main_group_name; disabled
# ---------- info: Python ----------
if robot:
    robot.info()
    main_group_name = robot.main_group_name
# ---------- end info ----------
panel_6 = Panel(info.out)  # disabled

# ---- group: forward kinematics
# Configuration
a1 = Slider(0, range=-360..360)  # disabled
a2 = Slider(-90, range=-360..360)  # disabled
a3 = Slider(90, range=-360..360)  # disabled
a5 = Slider(-90, range=-360..360)  # disabled
a6 = Slider(90, range=-360..360)  # disabled
a4 = Slider(-90, range=-360..360)  # disabled
jp = GhPythonScript()  # -> joint_positions; disabled
# ---------- jp: Python ----------
import math

joint_positions = [0,-90,90,-90,-90,90]
joint_positions = [math.radians(a) for a in joint_positions]
#joint_positions = [-3.136, -0.328, -1.218, 3.129, 0.852, 0.008]
#joint_positions = [0] * 6



#joint_positions = [1.6239667567485938, 0.25439606475392273, 4.409424838594969-2*3.14, 3.1901607306255908, 1.5707963267948954, 0.053170429953696939]
#joint_positions = [1.598543436748912, 0.23021224965157744, 4.712232135219824-2*3.14, 6.0531299026928744, 4.7123889803846915, 0.027747109954015234]
#joint_positions = [-1.1373533430447322, 4.0117247163121572, 5.4083762087596021-2*3.14, 1.5754733624925168, 4.7123889803846879, 3.5750356373399574]
print joint_positions
# ---------- end jp ----------
button = Button()  # disabled
forward_kinematics = PythonScript(robot=robot, set_joint_positions=button, joint_positions=jp, a1=a1, a2=a2, a3=a3, a4=a4, a5=a5, a6=a6)  # -> full_configuration; inputs joint_positions: list; disabled
# ---------- forward_kinematics: Python ----------
import math
import Grasshopper
from compas.robots import Joint
from compas_fab.robots import Configuration

if set_joint_positions:

    j = 0
    for i in range(ghenv.Component.Params.Input.Count):
        nslider = ghenv.Component.Params.Input[i].Sources[0]
        if nslider.GetType() == Grasshopper.Kernel.Special.GH_NumberSlider:
            nslider.TrySetSliderValue(math.degrees(joint_positions[j]))
            j += 1

if robot:
    joint_positions = [a1, a2, a3, a4, a5, a6]
    joint_types = robot.get_configurable_joint_types()
    for i, joint_type in enumerate(joint_types):
        if joint_type == Joint.REVOLUTE:
            joint_positions[i] = math.radians(joint_positions[i])
    full_configuration = Configuration(joint_positions, joint_types)
    
print(full_configuration)
# ---------- end forward_kinematics ----------

# ---- group: inverse kinematics
number = Number(-1)  # disabled
select_configuration = Slider(0, range=0..7)  # disabled
Y_2 = UnitY(Factor=number)  # disabled
pt_11 = Point(Point(-0.2872771489, -0.02480203338, 0.1593326121))  # disabled
pl = ConstructPlane(Origin=pt_11, XAxis=Vector(1, 0, 0), YAxis=Y_2)  # disabled
inverse_kinematics = PythonScript(robot=robot, plane_WCS=visualization.plane, idx=select_configuration)  # -> out, configuration, configuration_2; inputs plane_WCS: Plane, idx: Int32; disabled
# ---------- inverse_kinematics: Python ----------
import Rhino.Geometry as rg
import math
from compas.geometry import Frame, Transformation, Rotation
from compas_fab.robots import Configuration
from ur_fabrication_control.kinematics.ur_kinematics import inverse_kinematics
from ur_fabrication_control.kinematics.ur_params import ur_params
from compas_ghpython import draw_frame


tcp_WCS = Frame(plane_WCS.Origin, plane_WCS.XAxis, plane_WCS.YAxis)

# transform frame to robot coordinate system
tcp_RCS = robot.to_local_coordinates(tcp_WCS)
tool0_RCS = robot.from_tcf_to_t0cf([tcp_RCS])[0]

# calculate solutions to frame
ur_params = ur_params[robot.name] # get the parameters according to the robot model
solutions = inverse_kinematics(tool0_RCS, ur_params)

if not len(solutions):
    joint_values = [0,0,0,0,0,0]
    configuration = Configuration.from_revolute_values(joint_values)
else:
    joint_values = solutions[idx]
    #print joint_values
    
    ### ***** HACK ***** ##### TODO: CHECK!!!
    for i, v in enumerate(joint_values):
        if v > math.pi:
            v -= 2*math.pi
        if v < -math.pi:
            v += 2*math.pi
        joint_values[i] = v
    ### ***** HACK ***** ##### TODO: CHECK!!!
    
    configuration = [Configuration.from_revolute_values(joint_values)]

print(configuration)
# ---------- end inverse_kinematics ----------

# ----
list_7 = ValueList({"0 forward_kinematics": 0, "1 inverse_kinematics": 1}, selected="1 inverse_kinematics")  # disabled
filter_2 = StreamFilter(Gate=list_7, Stream0=forward_kinematics, Stream1=inverse_kinematics.configuration)  # disabled

# ----
# Visualisation
show_end_effector_frame = BooleanToggle(True)  # disabled
show_base_frame = BooleanToggle(False)  # disabled
show_collision = BooleanToggle(False)  # disabled
show_frames = BooleanToggle(False)  # disabled
show_visual = BooleanToggle(True)  # disabled
show_acm = BooleanToggle(False)  # disabled
visualize_2 = PythonScript(
    robot=robot,
    group=info.main_group_name,
    configuration=filter_2,
    redraw=attach_remove.bang,
    show_visual=show_visual,
    show_collision=show_collision,
    show_end_effector_frame=show_end_effector_frame,
    show_frames=show_frames,
    show_base_frame=show_base_frame,
    show_acm=show_acm)  # -> out, robot, visual, collision, attached_meshes, frames, ee_frame, base_frame; inputs redraw: list, attached_collision_meshes: list; disabled
# ---------- visualize_2: Python ----------
from compas.geometry import Vector
from compas.geometry import Point
from compas.geometry import Transformation
from compas.geometry import Frame
from compas_ghpython.artists import MeshArtist
from compas_fab.robots import Configuration

print(configuration)

if robot and configuration:
    
    robot.update(configuration, visual=show_visual, collision=show_collision)

    if show_visual:
        visual = robot.artist.draw_visual()

    if show_collision:
        collision = robot.artist.draw_collision()
    
    frames = robot.transformed_frames(configuration, group)

    if show_base_frame:
        base_frame = frames[0]

    if show_end_effector_frame:
        ee_frame = robot.forward_kinematics(configuration, group)
        print("End-effector", ee_frame)
    
    if not show_frames:
        frames = None
    
    #frame = robot.forward_kinematics(configuration, options=dict(solver='model', link_name=robot.attached_tool.link_name))
    #robot.artist.update_tool(visual=visual, collision=collision, transformation=Transformation.from_frame_to_frame(Frame.worldXY(), frame))
    
    if show_acm:
        M = []
        for acm in attached_collision_meshes:
            frame = robot.forward_kinematics(configuration, options=dict(solver='model', link_name=acm.link_name))
            T = Transformation.from_frame_to_frame(Frame.worldXY(), frame)
            mesh = acm.collision_mesh.mesh.transformed(T)
            M.append(MeshArtist(mesh).draw())
        attached_meshes = M
# ---------- end visualize_2 ----------
geo = Geometry(visualize_2.visual)  # disabled
geo_2 = Geometry(visualize_2.collision)  # disabled
number_slider_26 = Slider(0.1, range=0..1)  # disabled
draw = GhPythonScript(frames=[visualize_2.frames, visualize_2.ee_frame, visualize_2.base_frame], scale=number_slider_26)  # -> P, V, C, W; inputs frames: list; disabled
# ---------- draw: Python ----------
from System.Drawing import Color
from compas_ghpython.utilities import draw_frame

red = Color.FromArgb(255, 0, 0)
green = Color.FromArgb(0, 255, 0)
blue = Color.FromArgb(0, 0, 255)

P = []
V = []
C = []

scale = float(scale)

for frame in frames:
    if not frame:
        continue
    plane = draw_frame(frame)
    P += [plane.Origin] * 3
    V.append(plane.XAxis * scale)
    V.append(plane.YAxis * scale)
    V.append(plane.ZAxis * scale)
    C += [red, green, blue]

W = 3
# ---------- end draw ----------
colour_swatch = ColourSwatch(SwatchColor=RGB(255, 255, 255))  # disabled
preview_3 = CustomPreview(Geometry=visualize_2.attached_meshes, Shader=colour_swatch)  # disabled
colour_swatch_2 = ColourSwatch(SwatchColor=RGB(105, 105, 105))  # disabled
preview_4 = CustomPreview(Geometry=geo, Shader=colour_swatch_2)  # disabled
vdisex = VectorDisplayEx(Point=draw.P, Vector=draw.V, Colour=draw.C, Width=draw.W)  # disabled

panel_7 = Panel(inverse_kinematics.configuration_2)  # disabled
