# Grasshopper definition heat_method.gh (Grasshopper 1.0.7)

number_slider = Slider(2, range=0..10)
number_slider_2 = Slider(5, range=0..10)
crvs = GhPythonScript(
    width=number_slider_2,
    height=number_slider,
    up_a=Slider(0.1, range=0.1..0.3),
    up_f=Slider(1.15, range=0.6..1.2),
    up_ro=Slider(0.93, range=0..1),
    down_a=Slider(0.49, range=0.3..0.6),
    down_f=Slider(0.59, range=0.4..0.6),
    down_ro=Slider(0.73, range=0..1))  # -> base, base_crv, top, top_crv
# ---------- crvs: Python ----------
__author__ = "timda"
__version__ = "2023.07.15"

import rhinoscriptsyntax as rs
import math
from Rhino.Geometry import Point3d, Vector3d, Curve
from Rhino.Collections import Point3dList

class CrvParams:
    def __init__(self, amp, freq, ro):
        self.amp = amp
        self.freq = freq
        self.ro = ro*math.pi
    def crv(self, width, height):
        points = []
        iterator = [i*0.1 for i in range(int(width/0.1 +1.999))]
        for x in iterator:
            points.append(Point3d(x, -self.amp*math.sin(2.0 * math.pi * self.freq*x + self.ro), height))
        
        points = Point3dList(points)
        start_tangent = Vector3d(iterator[0], self.amp * 2.0 * math.pi * self.freq * math.cos(2.0 * math.pi * self.freq*iterator[0] + self.ro), 0)
        end_tangent = Vector3d(iterator[0], self.amp * 2.0 * math.pi * self.freq * math.cos(2.0 * math.pi * self.freq*iterator[-1] + self.ro), 0)
        self.curve = Curve.CreateInterpolatedCurve(points, 3)
        return self.curve


base = CrvParams(down_a, down_f, down_ro)
base_crv = base.crv(width, 0)
top = CrvParams(up_a, up_f, up_ro)
top_crv = top.crv(width, height)
# ---------- end crvs ----------
crv = Curve(crvs.base_crv)
crv_2 = Curve(crvs.top_crv)
rulesrf = RuledSurface(CurveA=crv, CurveB=crv_2)

number_slider_3 = Slider(0.05, range=0..0.1)
brep = Brep(rulesrf)
brep_to_mesh = GhPythonScript(
    brep=brep,
    w=number_slider_2,
    h=number_slider,
    elsize=number_slider_3,
    max_size=number_slider_3,
    min_size=number_slider_3,
    base=crvs.base,
    top=crvs.top)  # -> rmesh, wall; inputs brep: Brep
# ---------- brep_to_mesh: Python ----------
__author__ = "timda"
__version__ = "2023.07.14"

import rhinoscriptsyntax as rs
from compas_ghpython.artists import MeshArtist
from add_on_am import NewWall

wall = NewWall(w, h, elsize)
wall.undulate(top, base)
mesh = wall.from_brep(brep, max_size, min_size)
mesh_art = MeshArtist(mesh)
rmesh = mesh_art.draw_mesh()
# ---------- end brep_to_mesh ----------
mcol = MeshColours(Mesh=brep_to_mesh.rmesh, Colours=ColourSwatch(SwatchColor=RGB(82, 82, 82)))

python = GhPythonScript(m=mcol, compute=Toggle(True))  # -> mesh, heat, cold; inputs m: Mesh
# ---------- python: Python ----------
__author__ = "timda"
__version__ = "2023.06.27"

import rhinoscriptsyntax as rs

heat = []
cold = []
if compute:
    mesh = m
    for vertice in mesh.Vertices:
        if vertice.X < 0.02:
            heat.append(vertice)
        elif vertice.X > 4.98:
            cold.append(vertice)
# ---------- end python ----------
number_slider_4 = Slider(0.01, range=0..0.1)  # disabled
swatch = ColourSwatch(SwatchColor=RGB(201, 201, 201))  # disabled

pt = Point(python.cold)
mesh = Mesh(python.mesh)
pt_2 = Point(python.heat)

line = Line()
c_script = CSharpScript(
    P=mesh,
    heatPoints=flatten(pt_2),
    coldPoints=flatten(pt),
    isoFix=line,
    Ratio_target=Slider(1, range=0..10),
    Max_iterations=Slider(3000, range=0..10000),
    Reference=["C:\USERS\TIMDA\APPDATA\ROAMING\GRASSHOPPER\LIBRARIES\Plankton.dll", "C:\USERS\TIMDA\APPDATA\ROAMING\GRASSHOPPER\LIBRARIES\Plankton.gha"])  # -> out, Mesh, Values, Gradient, Ratio, Ratio_achieved, iterations; inputs P: Mesh, heatPoints: list of Point3d, coldPoints: list of Point3d, isoFix: list of Polyline, Ratio_target: Double, Max_iterations: Int32
# ---------- c_script: C# usings ----------
using Plankton;
using PlanktonGh;
using System.Linq;
using System.Threading.Tasks;
# ---------- c_script: C# ----------
    /*
    This skript is based on a script by Daniel Piker 03/07/2020
    updated 27/07/2020 Link: https://discourse.mcneel.com/t/heat-method/105135/30
    Afterwards it´s changed by Masterstudent Jonas Michl @ BMW (01/04/2022 - 30/09/2022) to generate printing paths for WAAM
    */

    // Some global variables are defined and the mesh is converted to a triangle mesh
    double global_max = 0;
    double global_min = 10000;
    int iter = 0;
    P.Faces.ConvertQuadsToTriangles();
    pm = P.ToPlanktonMesh();
    int vc = pm.Vertices.Count;
    double[] conduction = new double[pm.Vertices.Count];

    // Compute average edge length
    double avg_edge = 0;
    for(int i = 0;i < pm.Halfedges.Count / 2;i++)
    {
      int start = pm.Halfedges[2 * i].StartVertex; // Start point
      int end = pm.Halfedges[(2 * i) + 1].StartVertex; // End point
      avg_edge += Math.Sqrt(pm.Vertices[start].ToPoint3d().DistanceToSquared(pm.Vertices[end].ToPoint3d())) / (0.5 * pm.Halfedges.Count);
    }

    // Initilisation ####################################################################################################
    { // Here is the initial process where all weights of the vertices are computed and boundarise vertices are detected.
      storedweights = new double[vc][];
      storedneighbours = new int[vc][];
      values = new double[vc];
      fix = new int[vc];
      equalize = new int[isoFix.Count][];

      // Boundary conditions ###########################################################################################
      for(int i = 0;i < vc;i++) // For all vertices
      {
        storedweights[i] = cotanWeights(pm, i); // Get weigths of vertex
        storedneighbours[i] = pm.Vertices.GetVertexNeighbours(i); // Get neighbour of vertex
        for(int j = 0;j < heatPoints.Count;j++) // Define hot points
        {
          if(pm.Vertices[i].ToPoint3d().DistanceToSquared(heatPoints[j]) < 0.5 * avg_edge * avg_edge) // Better use 0.5*average edge length
          {
            values[i] = 1; // Define hot Neumann BC (Boundary Conditions)
            fix[i] = 1;
          }
        }
        for(int j = 0;j < coldPoints.Count;j++) // Define cold points BC
        {
          if(pm.Vertices[i].ToPoint3d().DistanceToSquared(coldPoints[j]) < 0.5 * avg_edge * avg_edge) // Define cold Neumann BC
          {
            values[i] = -1; // Test with low temperature is -1 to get faster convergence
            fix[i] = 2;
          }
        }
      }

      for(int i = 0;i < isoFix.Count;i++) // Define isocontours
      {
        Polyline thisPoly = isoFix[i];
        int polyCount = thisPoly.Count;
        if(thisPoly[thisPoly.Count - 1].Equals(thisPoly[0])) polyCount--;//don't count first point twice for closed curves
        equalize[i] = new int[polyCount];
        for(int j = 0;j < polyCount;j++)
        {
          for(int k = 0;k < vc;k++)
          {
            if(pm.Vertices[k].ToPoint3d().DistanceToSquared(thisPoly[j]) < 0.5 * avg_edge * avg_edge)
            {
              equalize[i][j] = k;
              break;
            }
          }
        }
      }

      gradient = new Vector3d[vc];
      meshOut = P.DuplicateMesh();
      edgeGradient = null;
    }
    // Thermal Simulation ################################################################################
    { // Here the thermal simulation takes place to recieve a corse view of the temperature distribution
      // Afterwards this directionfield of the distribution is used
      {// Heat simulation (possible to iterate till no 0-values are left (because then the  and then a bit longer)
        for(int k = 0;k < Max_iterations;k++) // Heuristic defined 5000 iter
        {
          double[] newValues = new double[values.Length];
          Parallel.For(0, pm.Vertices.Count, // Parallelism is possible due to update sceme similiar to Jacobi
            i => {

            if(fix[i] == 0) // Node is not included to BC
            {
              int[] neighbours = storedneighbours[i]; // initialize variables
              double[] weights = storedweights[i];
              double newValue = 0;
              for(int j = 0;j < neighbours.Length;j++)
              {
                newValue += weights[j] * values[neighbours[j]]; // Compute new temperature values according to poisson equation
              }
              newValues[i] = newValue;
            }
            else newValues[i] = values[i]; // Keep boundary temperatures constant
            });

          for(int i = 0;i < equalize.Length;i++) // Compute the isocontours values
          {
            double avg = 0;
            for(int j = 0;j < equalize[i].Length;j++)avg += newValues[equalize[i][j]];
            avg /= equalize[i].Length;
            for(int j = 0;j < equalize[i].Length;j++) newValues[equalize[i][j]] = avg;
          }
          values = newValues; // Assign new values back to the old
        } //end


        double min = values.Min(); // Rerange temperature values
        double max = values.Max();
        double mult = 1.0 / (max - min);
        for(int i = 0;i < values.Length;i++) values[i] = mult * (values[i] - min);

        edgeGradient = null;
      }

      { // Compute edge gradient values ############################################################
        double avgGradientLength = 0;
        if(edgeGradient == null) // Compute initial edge gradients
        {
          gradient = gradients(pm, values); // Compute temperature gradients
          avgGradientLength = 0;
          for(int i = 0;i < gradient.Length;i++) // Compute average gradient
          {
            avgGradientLength += gradient[i].Length;
          }
          avgGradientLength /= gradient.Length;

          edgeGradient = new Vector3d[pm.Halfedges.Count / 2]; // Computation of the edge gradients
          for(int i = 0;i < pm.Halfedges.Count / 2;i++)
          {
            int start = pm.Halfedges[2 * i].StartVertex; // Start point
            int end = pm.Halfedges[(2 * i) + 1].StartVertex; // End point
            Vector3d sv = gradient[start];
            Vector3d ev = gradient[end];
            Vector3d thisEdgeGradient = sv + ev; // Calculation of the averaged normalised edge gradient
            thisEdgeGradient.Unitize();
            thisEdgeGradient *= avgGradientLength;
            edgeGradient[i] = thisEdgeGradient;
          }
        }

        double avg = 1;
        double avg_old = 0;
        double ratio = 1000;
        int k = 0;
        double avg_grad_new = avgGradientLength;
        // Poisson equation on temperature gradient ##########################################################################
        while(k < Max_iterations && ratio > 0.97 * Ratio_target || k < 0.1 * Max_iterations) // Applying Poisson equation on the Gradient values
          // other approach: iterate as long as the values are not changing much || (avg_old - avg) * (avg_old - avg) > 0.00001
        {
          k++;
          double[] heChange = new double[pm.Halfedges.Count];
          // Compute gradient on each edge
          Parallel.For(0, pm.Halfedges.Count / 2,
            i => {
            int start = pm.Halfedges[2 * i].StartVertex;
            int end = pm.Halfedges[(2 * i) + 1].StartVertex;
            Vector3d edgeVector = pm.Vertices[end].ToPoint3d() - pm.Vertices[start].ToPoint3d();
            double projected = edgeVector * edgeGradient[i];
            double currentDifference = values[end] - values[start];
            double change = currentDifference - projected;
            heChange[2 * i] = 1 * change;
            heChange[(2 * i) + 1] = -1 * change;
            });

          // Apply poisson equation on all vertices
          Parallel.For(0, pm.Vertices.Count,
            i => {
            {
              {
                double[] weights = storedweights[i];
                int[] halfedges = pm.Vertices.GetHalfedges(i);
                for(int j = 0;j < halfedges.Length;j++)
                {
                  values[i] += heChange[halfedges[j]] * weights[j];
                }
              }
            }
            });

          avg_old = avg;
          avg = 0;
          for(int i = 0; i < equalize.Length; i++) // Compute average gradient
          {
            for(int j = 0;j < equalize[i].Length;j++)avg += values[equalize[i][j]];
            avg /= equalize[i].Length;
            for(int j = 0;j < equalize[i].Length;j++) values[equalize[i][j]] = avg;
          }


          // Analyse of the global max and min of the gradient, it´s equivalent to the min and max distance of the isolines
          global_max = 0;
          global_min = 10000;
          gradient = gradients(pm, values);
          double gradient_length = 0;
          for(int i = 0;i < meshOut.Vertices.Count;i++) // Global min max gradient
          {
            gradient_length = gradient[i].Length;
            avg_grad_new += gradient_length / meshOut.Vertices.Count;
            if((gradient_length) < global_min)
            {
              global_min = gradient_length;
            }

            if(gradient_length > global_max)
            {
              global_max = gradient_length;
            }
          }
          ratio = global_max / global_min;
          avgGradientLength = avg_grad_new;
          avg_grad_new = 0;
          iter = k;
        }
      }
    }
    // End of iterative poisson
    Max_iterations = iter; // Output the real number of iterations

    // Compute output of the mesh values ##########################################################
    gradient = gradients(pm, values);
    for(int i = 0;i < meshOut.Vertices.Count;i++) // Compute output of the mesh values
    {
      meshOut.TextureCoordinates.SetTextureCoordinate(i, new Point2f(0, (float) (values[i])));
    }



    // Output####################################################################################
    {
      bool target_ratio = false;
      if(Ratio_target > Math.Sqrt(global_max / global_min))
      {
        target_ratio = true;
      }

      Mesh = meshOut;
      Values = values;
      Gradient = gradient;
      Ratio = Math.Sqrt(global_max / global_min);
      Ratio_achieved = target_ratio;
      iterations = Max_iterations;
    }
# ---------- c_script: C# additional code ----------
  PlanktonMesh pm;
  double[] values;
  double[][] storedweights;
  int[][] storedneighbours;
  Vector3d[] gradient;
  Vector3d[] edgeGradient;
  int[] fix;
  int[][] equalize;
  Mesh meshOut;

  // Compute gradients ##################################################################################
  static Vector3d[] gradients(PlanktonMesh P, double[] values)
  {
    Vector3d[] halfedgeGradients = new Vector3d[P.Halfedges.Count];
    for(int i = 0;i < P.Halfedges.Count / 2;i++)
    {
      int start = P.Halfedges[2 * i].StartVertex;
      int end = P.Halfedges[2 * i + 1].StartVertex;
      Vector3d v = P.Vertices[end].ToPoint3d() - P.Vertices[start].ToPoint3d();
      double lengthSquared = v.SquareLength;
      double diff = values[end] - values[start];
      Vector3d edgeGradient = v * (diff / lengthSquared);
      halfedgeGradients[2 * i] = halfedgeGradients[2 * i + 1] = edgeGradient;
    }
    Vector3d[] vertexGradients = new Vector3d[P.Vertices.Count];
    for(int i = 0;i < P.Vertices.Count;i++)
    {
      double[] weights = cotanWeights(P, i);
      Vector3d gradient = new Vector3d();
      int[] halfedges = P.Vertices.GetHalfedges(i);
      for(int j = 0;j < halfedges.Length;j++)
      {
        gradient += halfedgeGradients[halfedges[j]] * weights[j];
      }
      vertexGradients[i] = gradient;
    }
    return vertexGradients;
  }

  // Compute cotan weights for the finite difference method on a triangle mesh ################################
  static double[] cotanWeights(PlanktonMesh P, int i)
  {
    int[] Neighbours = P.Vertices.GetVertexNeighbours(i);
    Point3d Vertex = P.Vertices[i].ToPoint3d();
    int valence = P.Vertices.GetValence(i);
    Point3d[] NeighbourPts = new Point3d[valence];
    Vector3d[] Radial = new Vector3d[valence];
    Vector3d[] Around = new Vector3d[valence];
    double[] CotWeight = new double[valence];
    double WeightSum = 0;
    for (int j = 0; j < valence; j++)
    {
      NeighbourPts[j] = P.Vertices[Neighbours[j]].ToPoint3d();
      Radial[j] = NeighbourPts[j] - Vertex;
    }
    for (int j = 0; j < valence; j++)
    {
      Around[j] = NeighbourPts[(j + 1) % valence] - NeighbourPts[j];
    }
    int[] halfEdges = P.Vertices.GetHalfedges(i);
    for (int j = 0; j < Neighbours.Length; j++)
    {
      int previous = (j + valence - 1) % valence;
      int next = (j + 1) % valence;

      Vector3d Cross1 = Vector3d.CrossProduct(Radial[previous], Around[previous]);
      double Dot1 = Radial[previous] * Around[previous];
      double cwa = Math.Abs(Dot1 / Cross1.Length);

      Vector3d Cross2 = Vector3d.CrossProduct(Radial[next], Around[j]);
      double Dot2 = Radial[next] * Around[j];
      double cwb = Math.Abs(Dot2 / Cross2.Length);

      if(P.Halfedges[halfEdges[j]].AdjacentFace == -1){cwa = 0;}
      if(P.Halfedges[P.Halfedges.GetPairHalfedge(halfEdges[j])].AdjacentFace == -1){cwb = 0;}
      CotWeight[j] = cwa + cwb;
      WeightSum += CotWeight[j];
    }
    for (int j = 0; j < CotWeight.Length; j++) CotWeight[j] /= WeightSum;
    return CotWeight;
  }
# ---------- end c_script ----------

dots = DotDisplay(Point=pt_2, Colour=swatch, Size=number_slider_4)  # disabled
swatch_2 = ColourSwatch(SwatchColor=RGB(84, 84, 84))  # disabled

panel = Panel("Generate temperature field")
panel_2 = Panel("Generate Contour lines")
panel_3 = Panel("Analysis")

dots_2 = DotDisplay(Point=pt, Colour=swatch_2, Size=number_slider_4)  # disabled

mesh_2 = Mesh(c_script.Mesh)
c_script_2 = CSharpScript(
    M=mesh_2,
    contourCount=Slider(100, range=0..300),
    iterations=Slider(1, range=1..100),
    damping=Slider(0.9, range=0..1),
    smoothing_interval=Slider(1, range=1..10))  # -> out, Contours, Ratio; inputs M: Mesh, contourCount: Int32, iterations: Int32, damping: Double, smoothing_interval: Int32
# ---------- c_script_2: C# usings ----------
using System.Linq;
using System.Threading.Tasks;
# ---------- c_script_2: C# ----------
    // Initialize variables ##########################################################################
    List<Line>[] contours = new List<Line>[contourCount];
    List<Curve>[] curves = new List<Curve>[contourCount];
    List<Point3d>[] points = new List<Point3d>[contourCount];
    List<Vector3d>[] vectors = new List<Vector3d>[contourCount];
    double[] values = new double[M.Vertices.Count];
    for(int i = 0;i < M.Vertices.Count;i++) values[i] = M.TextureCoordinates[i].Y;
    double lower = values.Min();
    double upper = values.Max();
    double unit_stepsize = (upper - lower) / (contourCount + 1.0);
    double[] iso = new double[contourCount + 1];
    double[] iso_old = new double[contourCount + 1];
    for(int i = 0; i < contourCount; i++) iso[i] = lower + ((i + 1) * unit_stepsize); // Compute iso values for first iteration
    iso_old = iso;
    double[] stepsize_correction = new double[contourCount + 1];
    for(int i = 0; i <= contourCount; i++) stepsize_correction[i] = 1;
    double[] stepsize = new double[contourCount + 1];
    for(int i = 0; i < contourCount; i++) {stepsize[i] = unit_stepsize;} // Compute stepsize for first iteration

    //  Start iterative isoliones generation ###################################################
    for(int iter = 0; iter < iterations; iter++)
    {
      if(iter > 0)
      {
        for(int i = 0; i < contourCount; i++) // Clear all lists
        {
          vectors[i].Clear();
          contours[i].Clear();
          points[i].Clear();
        }
      }

      Parallel.For(0, contourCount, // Compute intersection point for all contour iso values
        j => {
        List<Line> lines = new List<Line>();
        List<Point3d> points_contour = new List<Point3d>();
        List<Vector3d> vecs = new List<Vector3d>();
        for(int i = 0;i < M.Faces.Count;i++) // Check all faces of the mesh if there is a intersection
        {
          int va = M.Faces[i].A;
          int vb = M.Faces[i].B;
          int vc = M.Faces[i].C;
          double a = M.TextureCoordinates[va].Y - iso[j];
          double b = M.TextureCoordinates[vb].Y - iso[j];
          double c = M.TextureCoordinates[vc].Y - iso[j];
          Point3d pa = M.Vertices.Point3dAt(va);
          Point3d pb = M.Vertices.Point3dAt(vb);
          Point3d pc = M.Vertices.Point3dAt(vc);

          List<Point3d> ends = new List<Point3d>();
          if(a < 0 != b < 0)
          {
            double wa = b / (b - a);
            double wb = 1 - wa;
            ends.Add(wa * pa + wb * pb);
          }
          if(a < 0 != c < 0)
          {
            double wa = c / (c - a);
            double wc = 1 - wa;
            ends.Add(wa * pa + wc * pc);
          }
          if(c < 0 != b < 0)
          {
            double wb = c / (c - b);
            double wc = 1 - wb;
            ends.Add(wb * pb + wc * pc);
          }
          if(ends.Count == 2) // if there is a intersection, the line is added to the contour
          {
            lines.Add(new Line(ends[0], ends[1]));
            points_contour.Add(ends[0]);
            points_contour.Add(ends[1]);
            Vector3d vec = new Vector3d((ends[0].X - ends[1].X), (ends[0].Y - ends[1].Y), (ends[0].Z - ends[1].Z));
            vecs.Add(vec);
          }
        }
        contours[j] = lines;
        points[j] = points_contour;
        vectors[j] = vecs;
        });

      // Compute changes in the iso values ###############################################################
      double normalize_factor = 0;
      Rhino.Geometry.Polyline poly;
      double[] distance = new double[contourCount + 1];
      // First the distance to the isoline above and below is computed to know how to change the iso values
      for(int i = 1; i < contourCount - 2; i++){

        poly = new Rhino.Geometry.Polyline(points[i]);
        distance[i] = 0;
        double dist2 = 0;
        for(int j = 0; j < points[i + 1].Count; j++) //distance to isoline above
        {
          distance[i] += Math.Sqrt(points[i + 1][j].DistanceToSquared(poly.ClosestPoint(points[i + 1][j])));
        }
        if(points[i + 1].Count > 0) // Check if isoline (i+1) exists
        {
          stepsize_correction[i] = distance[i] / (points[i + 1].Count);
        }
        poly = new Rhino.Geometry.Polyline(points[i + 1]);
        for(int j = 0; j < points[i].Count; j++) // distance from line below
        {
          dist2 += Math.Sqrt(points[i][j].DistanceToSquared(poly.ClosestPoint(points[i][j])));
        }
        if(points[i].Count > 0 && stepsize_correction[i] > dist2 / (points[i].Count)) // Always choose the smaller one
        {
          stepsize_correction[i] = dist2 / (points[i].Count);
          distance[i] = dist2;
        }
        stepsize_correction[i] = 1 / stepsize_correction[i];
        normalize_factor += stepsize_correction[i]; // Sum up normalize corrections factor
      }

      //For last row - spzial treetment
      distance[contourCount - 1] = 0;
      poly = new Rhino.Geometry.Polyline(points[contourCount - 1]);
      for(int j = 0; j < points[contourCount - 2].Count; j++)
      {
        distance[contourCount - 1] += Math.Sqrt(points[contourCount - 2][j].DistanceToSquared(poly.ClosestPoint(points[contourCount - 2][j]))); //Math.Sqrt
      }
      if(points[contourCount - 1].Count > 0)
      {
        stepsize_correction[contourCount - 1] = distance[contourCount - 1] / points[contourCount - 1].Count;
        stepsize_correction[contourCount - 1] = 1 / stepsize_correction[contourCount - 1];
        normalize_factor += stepsize_correction[contourCount - 1];
      }

      //For first row - spezial treetment
      distance[0] = 0;
      poly = new Rhino.Geometry.Polyline(points[1]);
      for(int j = 0; j < points[0].Count; j++)
      {
        distance[0] += Math.Sqrt(points[0][j].DistanceToSquared(poly.ClosestPoint(points[0][j]))); //Math.Sqrt
      }
      if(points[0].Count > 0)
      {
        stepsize_correction[0] = distance[0] / points[0].Count;
        stepsize_correction[0] = 1 / stepsize_correction[0];
        normalize_factor += stepsize_correction[0];
      }

      normalize_factor = normalize_factor / contourCount;


      for(int i = 0; i < contourCount; i++) // Keep correction value in boundaries
      {
        stepsize_correction[i] = stepsize_correction[i] / normalize_factor;
        if(stepsize_correction[i] > 1.5){stepsize_correction[i] = 1.5;}
        if(stepsize_correction[i] < 0.5){stepsize_correction[i] = 0.5;}
      }
      normalize_factor = normalize_factor / contourCount;

      double sum_steps = 0;

      // Compute correction factors ###########################################################
      for(int i = 0; i < contourCount; i++)
      {
        if(i == 0) // Compute first correction factor
        {
          stepsize[0] = stepsize[0] * stepsize_correction[0];
          iso[0] = lower + stepsize[0];
        }
        else // Compute the other correction factors
          // This process is highly unstable therefore it´s damped
        {
          stepsize_correction[i] = 0.5 * stepsize_correction[i] + 0.5 * stepsize_correction[i - 1];
          stepsize[i] = (1 - damping) * (stepsize[i] * stepsize_correction[i]) + damping * stepsize[i];
        }

        if(iso[i] > upper || iso[i] < lower) // If iso value goes out of range it´s being pushed back to the start value
        {
          iso[i] = lower + ((i + 1) * unit_stepsize);
        }
        sum_steps += stepsize[i];
      }

      // Compute new adapted iso values ######################################################
      double step_correction = unit_stepsize / (sum_steps / (contourCount - 1));

      for(int i = 1; i < contourCount; i++)
      {
        iso[i] = iso[i - 1] + stepsize[i] * step_correction;
      }

      if(iso[0] < lower || iso[0] > lower + unit_stepsize)
      {
        iso[0] = lower + 0.5 * unit_stepsize;
      }
      if(iso[contourCount - 1] > upper || iso[contourCount - 1] < upper - 0.5 * unit_stepsize)
      {
        iso[contourCount - 1] = upper - 0.5 * unit_stepsize;
      }
      iso_old = iso;

      // Depending on the smooting_interval a post smooting is done with a 2 point stencil
      if(iter % smoothing_interval == 0)
      {
        for(int i = 1; i < contourCount - 1 ; i++)
        {
          iso[i] = (iso_old[i + 1] + iso_old[i - 1]) / 2;
        }
      }
    }
    // End iteration ###########################################################################################
    // Analyse output ##########################################################################################
    for(int i = 0; i < contourCount; i++) // Difference of original iso values and adapted isovalues is computed for analysis
    {
      iso[i] = iso[i] - (lower + ((i + 1) * unit_stepsize));
    }
    // analyse = iso;

    double global_max = 0;
    double global_min = 10000;
    List<Point3d> gmax = new List<Point3d>();
    Parallel.For(1, contourCount,
      i => {
      /*
      - Compute minimal distance between all previous points (List) to the lines (List)
      - Local Extremas are the minimum and maximum of the minimal distance values
      - Global Extremas are the Extremas of the local extremas
      */
      double contour_max = 0;
      double contour_min = 10000;
      List<Point3d> max_points = new List<Point3d>();
      for (int j = 0; j < points[i].Count;j++) // Lopp over all points on a contour
      {
        double dist = 10000;
        List<Point3d> lmax_points = new List<Point3d>();
        for (int k = 0; k < points[i - 1].Count; k++) // Compute distance to all points below
        {
          if (dist > Math.Sqrt(points[i][j].DistanceToSquared(points[i - 1][k]))) // choose min as dist
          {
            dist = points[i][j].DistanceToSquared(points[i - 1][k]);
            dist = Math.Sqrt(dist);
            lmax_points.Clear();
            lmax_points.Add(points[i][j]);
            lmax_points.Add(points[i - 1][k]);
          }
        }

        if(contour_max < dist) // Check for Contour min/max
        {
          contour_max = dist;
          max_points.Clear();
          max_points = lmax_points;
        }
        if(contour_min > dist)
        {
          contour_min = dist;
        }
      }

      if(global_max < contour_max) // Check for Global min/max
      {
        global_max = contour_max;
        gmax.Clear();
        gmax = max_points;
      }
      if(global_min > contour_min)
      {
        global_min = contour_min;
      }
      });


    for(int i = 0; i < contourCount; i++)
    {
      List<Line > contour_lines = new List<Line>();
      contour_lines = contours[i];
    }

    // Output ####################################################################

    Ratio = global_max / global_min;
    DataTree<Line> contoursTree = new DataTree<Line>();
    for(int i = 0; i < contourCount;i++)
    {
      GH_Path path = new GH_Path(i);
      for (int j = 0; j < contours[i].Count;j++)
      {
        contoursTree.Add(contours[i][j], path);
      }
    }
    Contours = contoursTree;
# ---------- end c_script_2 ----------

panel_4 = Panel("Analyse meshing")
medges = MeshEdges(Mesh=c_script.Mesh)  # -> NakedEdges, InteriorEdges, NonManifoldEdges

# ----
# Ratio of max and min gradient
# Analyse temperature  gradient field
panel_5 = Panel("Analyse temperature field")

mesh_3 = Mesh(c_script.Mesh)
num = Number(c_script.Values)
sort = SortList(Keys=num, ValuesA=num)  # -> Keys, ValuesA
number_slider_5 = Slider(0, range=0..1)
rev = ReverseList(List=sort.Keys)
item = ListItem(List=rev, Index=number_slider_5, Wrap=True)
item_2 = ListItem(List=sort.Keys, Index=number_slider_5, Wrap=True)
panel_6 = Panel([item, item_2])
gradient = Gradient(
    LowerLimit=item,
    UpperLimit=item_2,
    Parameter=num,
    stops=[0: RGB(248, 11, 57), 0: RGB(244, 180, 250), 0: RGB(102, 118, 54), 0.00106: RGB(234, 38, 0), 0.378: RGB(254, 244, 84), 0.692: RGB(173, 203, 249), 1: RGB(75, 107, 169)])
mcol_2 = MeshColours(Mesh=mesh_3, Colours=gradient)

mesh_4 = Mesh(c_script.Mesh)
num_2 = Number(c_script.Gradient)
sort_2 = SortList(Keys=num_2, ValuesA=num_2)  # -> Keys, ValuesA
number_slider_6 = Slider(0, range=0..1)
rev_2 = ReverseList(List=sort_2.Keys)
item_3 = ListItem(List=rev_2, Index=number_slider_6, Wrap=True)
item_4 = ListItem(List=sort_2.Keys, Index=number_slider_6, Wrap=True)
gradient_2 = Gradient(
    LowerLimit=item_3,
    UpperLimit=item_4,
    Parameter=num_2,
    stops=[0: RGB(248, 11, 57), 0: RGB(244, 180, 250), 0: RGB(102, 118, 54), 0.00339: RGB(234, 38, 0), 0.495: RGB(254, 244, 84), 0.749: RGB(173, 203, 249), 1: RGB(75, 107, 169)])
division = Division(A=item_3, B=item_4)
panel_7 = Panel(division)
mcol_3 = MeshColours(Mesh=mesh_4, Colours=gradient_2)

envelope = GhPythonScript(
    r_out=Slider(1.65, range=0..10),
    h_out=Slider(0.72, range=0..3),
    r_in=Slider(0.7, range=0..1),
    h_in=Slider(1.32, range=0..2),
    z_offset=Slider(-0.7, range=-2..1))  # -> mesh, points, crvs_in, crvs_out, envelope; inputs crvs: list of Curve
# ---------- envelope: Python ----------
from Rhino.Geometry.Intersect.Intersection import MeshPolyline
from add_on_am import Envelope
from compas.artists import MeshArtist
from compas_rhino.conversions import polyline_to_compas
import math

z = 1.15
c_crvs = []
for i, crv in enumerate(crvs):
    c_crvs.append(polyline_to_compas(crv.ToPolyline()))

envelope = Envelope(r_out, h_out, r_in, h_in, z_offset, 0, 0, z)

def intersections(intersection_mesh, curves):
    inter_points = []
    for curve in curves:
        inter = MeshPolyline(intersection_mesh, curve)
        if inter[1]:
            inter_points += inter[0]
    return inter_points

#c, max_in = envelope.iterate(c_crvs, base_crv)
#print(c, max_in)
#
## takes 3sek???
#i_in, i_out = envelope.crvs_inside(c_crvs, True, True)
#crvs_in = [[], []]
#crvs_out = []
#for i, crv in enumerate(crvs):
#    if i in i_in:
#        crvs_in[0].append(crv)
#    elif i in i_out:
#        crvs_out.append(crv)


i_out = range(len(c_crvs))
crvs_in = []

for k in range(5):
    if len(i_out)==0:
        break 
    crvs_in.append([])
    c, max_in = envelope.iterate([c_crvs[i] for i in i_out], base_crv)
    print(c, max_in)
    
    # takes 3sek???
    i_in, i_out = envelope.crvs_inside(c_crvs, True, True)
    crvs_out = []
    for i, crv in enumerate(crvs):
        if i in i_in:
            crvs_in[k].append(crv)
        elif i in i_out:
            crvs_out.append(crv)

envelope.draw_mesh()
artist = MeshArtist(envelope.mesh_out)
mesh = artist.draw()
# ---------- end envelope ----------
crv_3 = Curve(envelope.crvs_out)
pt_3 = Point(envelope.points)
mesh_5 = Mesh(envelope.mesh)

number_slider_7 = Slider(6, range=0..10)  # disabled

list = ValueList({"20", "50", "100", "500", "1000", "5000"}, selected="20")  # disabled
back = Button()  # disabled
reset = Button()  # disabled
start = Button()  # disabled
stop = Button()  # disabled
step = Button()  # disabled
full = Button()  # disabled

reload = Button()
py = PythonScript(reload=reload)
# ---------- py: Python ----------
from compas_rhino.utilities.misc import get_tolerance
from compas_rhino.utilities.misc import unload_modules

from compas_ghpython import unload_modules

unload_modules("compas")
unload_modules("compas_fab")
unload_modules("add_on_am")
# ---------- end py ----------
py_2 = PythonScript()  # -> HERE, DATA
# ---------- py_2: Python ----------
import os

HERE = os.path.dirname(ghdoc.Path)
DATA = os.path.abspath(os.path.join(HERE, "..", "data"))

#print(HERE)
print(DATA)
# ---------- end py_2 ----------

list_2 = ValueList({"20", "50", "100", "500", "1000", "5000"}, selected="20")  # disabled
back_2 = Button()  # disabled
reset_2 = Button()  # disabled
start_2 = Button()  # disabled
stop_2 = Button()  # disabled
step_2 = Button()  # disabled
full_2 = Button()  # disabled

swatch_3 = ColourSwatch(SwatchColor=RGB(255, 0, 0))  # disabled
number_slider_8 = Slider(0.005, range=0..0.01)  # disabled
pln = Plane([Plane(origin=(0.02500000042, -0.03133029503, 0.02499951061), x=(-9.619315255e-05, 0, -0.9999999954), y=(0.6237173628, -0.7816499522, -5.999733971e-05)), Plane(origin=(0.02500000042, -0.03132426937, 0.07499951163), x=(-9.615219332e-05, 0, -0.9999999954), y=(0.62379066, -0.7815914591, -5.99788404e-05)), Plane(origin=(0.02500000042, -0.03131824371, 0.1249995139), x=(-9.623016067e-05, 0, -0.9999999954), y=(0.6238639689, -0.7815329454, -6.003453024e-05)), Plane(origin=(0.02500000042, -0.03131221619, 0.1749995146), x=(-9.624869907e-05, 0, -0.9999999954), y=(0.6239373122, -0.781474393, -6.005315487e-05)), Plane(origin=(0.02500000042, -0.03130619053, 0.2249995119), x=(-9.620772687e-05, 0, -0.9999999954), y=(0.6240106446, -0.781415838, -6.003464593e-05)), Plane(origin=(0.02500000042, -0.03130016488, 0.2749995161), x=(-9.628572843e-05, 0, -0.9999999954), y=(0.6240839887, -0.7813572624, -6.009038173e-05))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])  # disabled
swatch_4 = ColourSwatch(SwatchColor=RGB(255, 0, 0))  # disabled
Y = UnitY(Factor=-0.005)  # disabled
swatch_5 = ColourSwatch(SwatchColor=RGB(0, 81, 255))  # disabled
number_slider_9 = Slider(0.02, range=0..0.1)  # disabled
swatch_6 = ColourSwatch(SwatchColor=RGB(255, 0, 0))  # disabled
number_slider_10 = Slider(0, range=0..10)  # disabled
number_slider_11 = Slider(1, range=0..10)  # disabled
number_slider_12 = Slider(2, range=0..10)  # disabled
number_slider_13 = Slider(5, range=0..10)  # disabled
number_slider_14 = Slider(3, range=0..10)  # disabled
number_slider_15 = Slider(4, range=0..10)  # disabled
swatch_7 = ColourSwatch(SwatchColor=RGB(255, 0, 0))  # disabled
swatch_8 = ColourSwatch(SwatchColor=RGB(255, 255, 0))  # disabled
swatch_9 = ColourSwatch(SwatchColor=RGB(0, 255, 0))  # disabled
swatch_10 = ColourSwatch(SwatchColor=RGB(255, 0, 170))  # disabled
swatch_11 = ColourSwatch(SwatchColor=RGB(0, 255, 255))  # disabled
swatch_12 = ColourSwatch(SwatchColor=RGB(0, 0, 255))  # disabled
number_slider_16 = Slider(0.02, range=0..0.1)  # disabled
number_slider_17 = Slider(0.01, range=0..0.1)  # disabled

# ----
# Vector to sort along
number_slider_18 = Slider(0, range=-10..10)

vec = VectorXYZ(XComponent=number_slider_18, YComponent=Slider(0, range=-10..10), ZComponent=Slider(1, range=-10..10))  # -> Vector, Length
python_2 = GhPythonScript(tree=c_script_2.Contours, compute=Toggle(True))  # -> points, lines; inputs tree: tree of Line
# ---------- python_2: Python ----------
__author__ = "timda"
__version__ = "2023.06.28"

import rhinoscriptsyntax as rs
from ghpythonlib.treehelpers import list_to_tree

l_tree = []
p_tree = []
if compute:
    for i in range(tree.BranchCount):
        branchList = tree.Branch(i)
        points = []
        for line in branchList:
            start = line.PointAt(0.00)
            end = line.PointAt(1.00)
            if start not in points:
                points.append(start)
            if end not in points:
                points.append(end)
        lines = [line for line in branchList]
        p_tree.append(points)
        l_tree.append(branchList)

lines = list_to_tree(l_tree, source=[0,0])
points = list_to_tree(p_tree, source=[0,0])
# ---------- end python_2 ----------
c_script_3 = CSharpScript(pts=python_2.points, vector=vec.Vector)  # -> out, sortPtsByY, sortPtsByZ, sortPtsAlongVector; inputs pts: list of Point3d, vector: Vector3d
# ---------- c_script_3: C# ----------
    //sort by Y
    var ptsArray = pts.ToArray();
    Array.Sort(ptsArray, SortPtByY());
    sortPtsByY = ptsArray;
    //sort by Z
    var ptsArray2 = pts.ToArray();
    Array.Sort(ptsArray2, SortPtByZ());
    sortPtsByZ = ptsArray2;
    //sort along vector
    var ptsArray3 = pts.ToArray();
    Array.Sort(ptsArray3, SortPtsAlongVector(vector));
    sortPtsAlongVector = ptsArray3;
# ---------- c_script_3: C# additional code ----------
  private class SortPtByY_Helper : IComparer
  {
    int IComparer.Compare(object a, object b)
    {
      double y1 = ((Point3d) a).Y;
      double y2 = ((Point3d) b).Y;
      if (y1 > y2)
        return 1;

      if (y1 < y2)
        return -1;
      else
        return 0;
    }
  }

  private class SortPtByZ_Helper : IComparer
  {
    int IComparer.Compare(object a, object b)
    {
      double z1 = ((Point3d) a).Z;
      double z2 = ((Point3d) b).Z;
      if (z1 > z2)
        return 1;

      if (z1 < z2)
        return -1;
      else
        return 0;
    }
  }

  private class SortPtsAlongVector_Helper : IComparer
  {
    private Vector3d Vector;

    public SortPtsAlongVector_Helper()
    {
      Vector = Vector3d.XAxis;
    }

    public SortPtsAlongVector_Helper(Vector3d vector0)
    {
      Vector = vector0;
      Vector.Unitize();
    }

    int IComparer.Compare(object a, object b)
    {
      int retval = 0;
      Vector3d vA = new Vector3d((Point3d) a);
      Vector3d vB = new Vector3d((Point3d) b);
      var vAprojectV = vA * Vector;
      var vBprojectV = vB * Vector;
      if (vAprojectV < vBprojectV)
      {
        retval = -1;
      }
      if (vAprojectV > vBprojectV)
      {
        retval = 1;
      }
      return retval;
    }
  }

  public static IComparer SortPtByY()
  {
    return (IComparer) new SortPtByY_Helper();
  }

  public static IComparer SortPtByZ()
  {
    return (IComparer) new SortPtByZ_Helper();
  }

  public static IComparer SortPtsAlongVector(Vector3d vector)
  {
    return (IComparer) new SortPtsAlongVector_Helper(vector);
  }
# ---------- end c_script_3 ----------
list_3 = ValueList({"Sort By Y": 0, "Sort By Z": 1, "Along Vector": 2}, selected="Sort By Z")
filter = StreamFilter(Gate=list_3, Stream0=c_script_3.sortPtsByY, Stream1=c_script_3.sortPtsByZ, Stream2=c_script_3.sortPtsAlongVector)
pline = PolyLine(Vertices=filter, Closed=False)  # -> flatten(Polyline)

vdis = VectorDisplay(Vector=vec.Vector)

python_3 = GhPythonScript(lines=pline)  # -> path, points; inputs lines: list of Curve
# ---------- python_3: Python ----------
__author__ = "timda"
__version__ = "2023.06.28"

import rhinoscriptsyntax as rs
from Rhino.Geometry import LineCurve
from Rhino.Geometry.Curve import JoinCurves

curves = []
for line in lines:
    param = line.LengthParameter(0.025)[1]
    l = line.Split(param)[1]
    param_neg = l.LengthParameter(l.GetLength() - 0.025)[1]
    l = l.Split(param_neg)[0]
    curves.append(l)

segments = [curves[0]]
for i, curve in enumerate(curves):
    if i % 2 == 0:
        curve.Reverse()
    if i == 0:
        continue
    connector = LineCurve(curves[i-1].PointAtEnd, curve.PointAtStart)
    segments.append(connector)
    segments.append(curve)
    # new_path = JoinCurves([path, connector], 0.00001, True)
path = JoinCurves(segments, 0.0001, True)[0]

print(path)
points = path.DivideEquidistant(0.05)
# ---------- end python_3 ----------
pt_4 = Point(python_3.points)
crv_4 = Curve(python_3.path)
simplify = SimplifyCurve(Curve=crv_4)  # -> Curve, Simplified

# ----
# Path planner
button = Button()
tool_path_planning = GhPythonScript(compute=button, mesh=mcol, nodes=pt_4)  # -> planner, points, edges, n; inputs nodes: list of Point3d, center: Point3d
# ---------- tool_path_planning: Python ----------
from compas_rhino.geometry import RhinoMesh
from add_on_am import SurfacePathPlanner
from compas_ghpython.utilities import draw_network

rmesh = RhinoMesh.from_guid(mesh)
planner = SurfacePathPlanner()
planner.set_quad_mesh_from_rhinomesh(rmesh)
if nodes[0].X > nodes[-1].X:
    nodes.reverse()
network = planner.from_heat_method(nodes)

points, edges = draw_network(network)
# ---------- end tool_path_planning ----------
panel_8 = Panel(tool_path_planning.n)  # disabled
pt_5 = Point(tool_path_planning.points)
line_2 = Line(tool_path_planning.edges)

sectioning = GhPythonScript(wall=brep_to_mesh.wall, envelope=envelope.envelope, planner=tool_path_planning.planner)  # -> network, planner, map, pos_i, last_i, positions
# ---------- sectioning: Python ----------
__author__ = "timda"
__version__ = "2023.05.11"

import rhinoscriptsyntax as rs
from add_on_am import Map2d_optimized

#map = Map2d_optimized(wall, 0.3)
#network = map.create_network(envelope)
#pos_i, last_i, positions_list = map.pos_by_path(planner, envelope, reachability_map)
#
#pos_i = [pos_i]
#last_i = [last_i]
#
#

map = Map2d_optimized(wall, 0.3)
network = map.create_network(envelope)
pos_i, last_i, positions = map.pos_by_path(planner, envelope, reachability_map)

print(list(pos_i.keys()))
for values in pos_i.values():
    print(values[0], values[-1])

pos_i = [pos_i]
last_i = [last_i]
positions = [positions]
# ---------- end sectioning ----------

visualization = GhPythonScript(
    pos_i=sectioning.pos_i,
    last_i=sectioning.last_i,
    network=sectioning.network,
    map=sectioning.map,
    planner=sectioning.planner,
    envelope=envelope.envelope,
    index=number_slider_7,
    positions_list=sectioning.positions)  # -> points, ri, pos, vertices, nodes, mesh, poses, positions; inputs pos_i: list, last_i: list, index: Int32, positions_list: list; disabled
# ---------- visualization: Python ----------
__author__ = "timda"
__version__ = "2023.05.23"

import rhinoscriptsyntax as rs
from Rhino.Geometry import Point3d
from compas.artists import MeshArtist
from compas_ghpython.utilities import draw_network, draw_frame

points, edges = draw_network(network)

pos_i = pos_i[0]
last_i = last_i[0]
positions_list = positions_list[0]
pos = []
for i in pos_i.keys():
    [x, y, z] = network.node_attributes(i, ["x", "y", "z"])
    pos.append(Point3d(x, y, z))
#for i in last_i:
#    pos.append(points[i])

nodes = pos_i.values()[index]
vertices = []
positions = []
for node in nodes:
    [x, y, z] = planner.network.node_attributes(node, ["x", "y", "z"])
    vertices.append(Point3d(x, y, z))
    try:
        positions.append(positions_list[node])
    except:
        print("fail", node)

envelope.x = pos[index].X
envelope.y = pos[index].Y

#envelope.draw_mesh()
#artist = MeshArtist(envelope.mesh_out)
#mesh = artist.draw()
# ---------- end visualization ----------
pt_6 = Point(visualization.points)  # disabled
python_4 = GhPythonScript(network=sectioning.network)  # -> points; disabled
# ---------- python_4: Python ----------
__author__ = "timda"
__version__ = "2023.06.29"

import rhinoscriptsyntax as rs
from compas_ghpython.utilities import draw_network

points, edges = draw_network(network)
# ---------- end python_4 ----------
panel_9 = Panel(visualization.ri)  # disabled
pt_7 = Point(visualization.vertices)  # disabled
counter = CountThroughList(
    points=pt_7,
    planes=visualization.poses,
    positions=visualization.positions,
    start=start,
    stop=stop,
    step=step,
    step_back=back,
    reset=reset,
    full=full,
    interval=list)  # -> plane, point, pos, counter; inputs points: list, planes: list, positions: list, start: Boolean, stop: Boolean, step_back: Boolean; disabled
# ---------- counter: Python ----------
from scriptcontext import sticky as st
from compas_ghpython import update_component


L = points
# store data in component
guid = str(ghenv.Component.InstanceGuid)
counter_key = "counter_" + guid
running_key = "running_" + guid

if counter_key not in st:
    st[counter_key] = 0

if running_key not in st:
    st[running_key] = False
    

if st[running_key]:
    if st[counter_key] < len(L) - 2:
        st[counter_key] += 1
        update_component(ghenv, interval)
    else:
        st[counter_key] = 0
        st[running_key] = False
    
    
if start:
    st[running_key] = True

if stop:
    st[running_key] = False

if step:
    if st[counter_key] < len(L) - 2:
        st[counter_key] += 1

if step_back:
    if st[counter_key] > 0:
        st[counter_key] -= 1

if reset:
    st[counter_key] = 0

if full:
    st[counter_key] = len(L)-2

if len(L):
    plane = L[st[counter_key]]
    point = points[st[counter_key]]
    pos = positions[st[counter_key]]



st["visualisation_counter"] = st[counter_key]
counter = st[counter_key]
# ---------- end counter ----------
pt_8 = Point(visualization.pos)  # disabled
mesh_6 = Mesh(visualization.mesh)  # disabled
item_5 = ListItem(List=pt_8, Index=number_slider_7, Wrap=True)  # disabled
counter_2 = CountThroughList(points=filter, start=start_2, stop=stop_2, step=step_2, step_back=back_2, reset=reset_2, full=full_2, interval=list_2)  # -> point, counter; inputs points: tree, start: Boolean, stop: Boolean, step_back: Boolean; disabled
# ---------- counter_2: Python ----------
from scriptcontext import sticky as st
from compas_ghpython import update_component


L = points
# store data in component
guid = str(ghenv.Component.InstanceGuid)
counter_key = "counter_" + guid
running_key = "running_" + guid

if counter_key not in st:
    st[counter_key] = 0

if running_key not in st:
    st[running_key] = False
    

if st[running_key]:
    if st[counter_key] < L.BranchCount - 1: #len(L) - 1:
        st[counter_key] += 1
        update_component(ghenv, interval)
    else:
        st[counter_key] = 0
        st[running_key] = False
    
    
if start:
    st[running_key] = True

if stop:
    st[running_key] = False

if step:
    if st[counter_key] < L.BranchCount - 1: #len(L) - 1:
        st[counter_key] += 1

if step_back:
    if st[counter_key] > 0:
        st[counter_key] -= 1

if reset:
    st[counter_key] = 0

if full:
    st[counter_key] = L.BranchCount - 1 #len(L)-1

if L.BranchCount:
    #point = points[st[counter_key]]
    point = points.Branch(st[counter_key])



st["visualisation_counter"] = st[counter_key]
counter = st[counter_key]
# ---------- end counter_2 ----------
preview = CustomPreview(
    Geometry=simplify.Curve,
    Material={diffuse=RGB(221, 160, 221), emission=RGB(66, 48, 66), shine=0.5, specular=RGB(255, 255, 255), transparency=0})
pt_9 = Point(counter.point)  # disabled
pt_10 = Point(item_5)  # disabled
dots_3 = DotDisplay(Point=pt_6, Colour=swatch_3, Size=number_slider_8)  # disabled
python_5 = GhPythonScript(counter=counter.counter, points=pt_7)  # -> pts; inputs points: list; disabled
# ---------- python_5: Python ----------
__author__ = "timda"
__version__ = "2023.06.27"

import rhinoscriptsyntax as rs
pts = points[:counter+1]
# ---------- end python_5 ----------
python_6 = GhPythonScript(pos=counter.pos, points=sectioning.network)  # -> positions; inputs pos: list; disabled
# ---------- python_6: Python ----------
__author__ = "timda"
__version__ = "2023.06.27"

import rhinoscriptsyntax as rs
from Rhino.Geometry import Point3d

positions = []
# do not use points, somehow shifted
for i in pos:
    # positions.append(points[i-1])
    x, y, z = points.node_coordinates(i)
    positions.append(Point3d(x, y, z))
# ---------- end python_6 ----------
pt_11 = Point(counter_2.point)  # disabled
python_7 = GhPythonScript(counter=counter_2.counter, points=filter)  # -> pts; inputs points: list; disabled; same code as python_5
python_8 = GhPythonScript(network=sectioning.network, pos=sectioning.pos_i, wall=brep_to_mesh.wall, envelope=envelope.envelope)  # -> assigned, reachable; inputs pos: list; disabled
# ---------- python_8: Python ----------
__author__ = "timda"
__version__ = "2023.08.19"

import rhinoscriptsyntax as rs
pos = pos[0]
assigned = pos.values()
assigned = [len(nodes) for nodes in assigned]

positions = list(pos.keys())
reachable = [0 for _ in positions]
for i, p in enumerate(pos):
    envelope.x, envelope.y, _ = network.node_coordinates(p)
    for face in wall.mesh.faces():
        x, y, z = wall.mesh.face_center(face)
        if envelope.point_inside(x, y, z):
            reachable[i] += 1
# ---------- end python_8 ----------
move = Move(Geometry=line_2, Motion=Y)  # -> Geometry, Transform; disabled
dots_4 = DotDisplay(Point=python_6, Colour=swatch_4, Size=number_slider_9)  # disabled
dots_5 = DotDisplay(Point=[python_5, python_6], Colour=swatch_5, Size=number_slider_9)  # disabled
avr = Average(Input=python_8.reachable)  # disabled
sort_3 = SortList(Keys=python_8.reachable, ValuesA=python_8.reachable)  # -> Keys, ValuesA; disabled
avr_2 = Average(Input=python_8.assigned)  # disabled
preview_2 = CustomPreview(Geometry=move.Geometry, Material=swatch_6)  # disabled
panel_10 = Panel([sort_3.ValuesA, avr])  # disabled
panel_11 = Panel([python_8.assigned, avr_2])  # disabled
visualization_2 = GhPythonScript(
    pos_i=sectioning.pos_i,
    last_i=sectioning.last_i,
    network=sectioning.network,
    map=sectioning.map,
    planner=sectioning.planner,
    envelope=envelope.envelope,
    index=number_slider_10,
    positions_list=sectioning.positions)  # -> points, ri, pos, vertices, nodes, mesh, poses, positions; inputs pos_i: list, last_i: list, index: Int32, positions_list: list; disabled
# ---------- visualization_2: Python ----------
__author__ = "timda"
__version__ = "2023.05.23"

import rhinoscriptsyntax as rs
from Rhino.Geometry import Point3d
from compas.artists import MeshArtist
from compas_ghpython.utilities import draw_network, draw_frame

points, edges = draw_network(network)

pos_i = pos_i[0]
last_i = last_i[0]
positions_list = positions_list[0]
pos = []
for i in pos_i.keys():
    [x, y, z] = network.node_attributes(i, ["x", "y", "z"])
    pos.append(Point3d(x, y, z))
#for i in last_i:
#    pos.append(points[i])

nodes = pos_i.values()[index]
vertices = []
positions = []
for node in nodes:
    [x, y, z] = planner.path_network.node_attributes(node, ["x", "y", "z"])
    vertices.append(Point3d(x, y, z))
    try:
        positions.append(positions_list[node])
    except:
        print("fail", node)

envelope.x = pos[index].X
envelope.y = pos[index].Y

#envelope.draw_mesh()
#artist = MeshArtist(envelope.mesh_out)
#mesh = artist.draw()
# ---------- end visualization_2 ----------
visualization_3 = GhPythonScript(
    pos_i=sectioning.pos_i,
    last_i=sectioning.last_i,
    network=sectioning.network,
    map=sectioning.map,
    planner=sectioning.planner,
    envelope=envelope.envelope,
    index=number_slider_11,
    positions_list=sectioning.positions)  # -> points, ri, pos, vertices, nodes, mesh, poses, positions; inputs pos_i: list, last_i: list, index: Int32, positions_list: list; disabled; same code as visualization_2
visualization_4 = GhPythonScript(
    pos_i=sectioning.pos_i,
    last_i=sectioning.last_i,
    network=sectioning.network,
    map=sectioning.map,
    planner=sectioning.planner,
    envelope=envelope.envelope,
    index=number_slider_12,
    positions_list=sectioning.positions)  # -> points, ri, pos, vertices, nodes, mesh, poses, positions; inputs pos_i: list, last_i: list, index: Int32, positions_list: list; disabled; same code as visualization_2
visualization_5 = GhPythonScript(
    pos_i=sectioning.pos_i,
    last_i=sectioning.last_i,
    network=sectioning.network,
    map=sectioning.map,
    planner=sectioning.planner,
    envelope=envelope.envelope,
    index=number_slider_13,
    positions_list=sectioning.positions)  # -> points, ri, pos, vertices, nodes, mesh, poses, positions; inputs pos_i: list, last_i: list, index: Int32, positions_list: list; disabled; same code as visualization_2
visualization_6 = GhPythonScript(
    pos_i=sectioning.pos_i,
    last_i=sectioning.last_i,
    network=sectioning.network,
    map=sectioning.map,
    planner=sectioning.planner,
    envelope=envelope.envelope,
    index=number_slider_14,
    positions_list=sectioning.positions)  # -> points, ri, pos, vertices, nodes, mesh, poses, positions; inputs pos_i: list, last_i: list, index: Int32, positions_list: list; disabled; same code as visualization_2
visualization_7 = GhPythonScript(
    pos_i=sectioning.pos_i,
    last_i=sectioning.last_i,
    network=sectioning.network,
    map=sectioning.map,
    planner=sectioning.planner,
    envelope=envelope.envelope,
    index=number_slider_15,
    positions_list=sectioning.positions)  # -> points, ri, pos, vertices, nodes, mesh, poses, positions; inputs pos_i: list, last_i: list, index: Int32, positions_list: list; disabled; same code as visualization_2
python_9 = GhPythonScript(pos=visualization_2.positions, points=sectioning.network)  # -> positions; inputs pos: list; disabled
# ---------- python_9: Python ----------
__author__ = "timda"
__version__ = "2023.06.27"

import rhinoscriptsyntax as rs
from Rhino.Geometry import Point3d

positions = []
# do not use points, somehow shifted
pos = pos[-1]
for i in pos:
    # positions.append(points[i-1])
    x, y, z = points.node_coordinates(i)
    positions.append(Point3d(x, y, z))
# ---------- end python_9 ----------
python_10 = GhPythonScript(pos=visualization_3.positions, points=sectioning.network)  # -> positions; inputs pos: list; disabled; same code as python_9
python_11 = GhPythonScript(pos=visualization_4.positions, points=sectioning.network)  # -> positions; inputs pos: list; disabled; same code as python_9
python_12 = GhPythonScript(pos=visualization_5.positions, points=sectioning.network)  # -> positions; inputs pos: list; disabled; same code as python_9
python_13 = GhPythonScript(pos=visualization_6.positions, points=sectioning.network)  # -> positions; inputs pos: list; disabled; same code as python_9
python_14 = GhPythonScript(pos=visualization_7.positions, points=sectioning.network)  # -> positions; inputs pos: list; disabled; same code as python_9
dots_6 = DotDisplay(Point=python_9, Colour=swatch_7, Size=number_slider_16)  # disabled
dots_7 = DotDisplay(Point=visualization_2.vertices, Colour=swatch_7, Size=number_slider_17)  # disabled
dots_8 = DotDisplay(Point=python_10, Colour=swatch_8, Size=number_slider_16)  # disabled
dots_9 = DotDisplay(Point=visualization_3.vertices, Colour=swatch_8, Size=number_slider_17)  # disabled
dots_10 = DotDisplay(Point=visualization_4.vertices, Colour=swatch_9, Size=number_slider_17)  # disabled
dots_11 = DotDisplay(Point=visualization_5.vertices, Colour=swatch_10, Size=number_slider_17)  # disabled
dots_12 = DotDisplay(Point=python_11, Colour=swatch_9, Size=number_slider_16)  # disabled
dots_13 = DotDisplay(Point=visualization_6.vertices, Colour=swatch_11, Size=number_slider_17)  # disabled
dots_14 = DotDisplay(Point=python_12, Colour=swatch_10, Size=number_slider_16)  # disabled
dots_15 = DotDisplay(Point=visualization_7.vertices, Colour=swatch_12, Size=number_slider_17)  # disabled
dots_16 = DotDisplay(Point=python_13, Colour=swatch_11, Size=number_slider_16)  # disabled
dots_17 = DotDisplay(Point=python_14, Colour=swatch_12, Size=number_slider_16)  # disabled
