# Grasshopper definition Method1_V1.0.ghx (Grasshopper 1.0.7)

mesh = Mesh(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)
python = GhPythonScript(mesh=mesh)  # -> heat, cold; inputs mesh: Mesh
# ---------- python: Python ----------
__author__ = "timda"
__version__ = "2023.06.27"

import rhinoscriptsyntax as rs

heat = []
cold = []

for vertice in mesh.Vertices:
    if vertice.X < 0.05:
        heat.append(vertice)
    elif vertice.X > 4.95:
        cold.append(vertice)
# ---------- end python ----------

mesh_2 = Mesh(mesh)
pt = Point(python.heat)
pt_2 = Point(python.cold)

line = Line()
c_script = CSharpScript(
    P=mesh_2,
    heatPoints=flatten(pt),
    coldPoints=flatten(pt_2),
    isoFix=line,
    Ratio_target=Slider(1, range=0..10),
    Max_iterations=Slider(3000, range=0..10000),
    Reference=["C:\USERS\TIMDA\APPDATA\ROAMING\GRASSHOPPER\LIBRARIES\Plankton.dll", "C:\USERS\TIMDA\APPDATA\ROAMING\GRASSHOPPER\LIBRARIES\Plankton.gha"])  # -> out, Mesh, Values, Gradient, Ratio, Ratio_achieved, iterations; inputs P: Mesh, heatPoints: list of Point3d, coldPoints: list of Point3d, isoFix: list of Polyline, Ratio_target: Double, Max_iterations: Int32
# ---------- c_script: C# usings ----------
using Plankton;
using PlanktonGh;
using System.Linq;
using System.Threading.Tasks;
# ---------- c_script: C# ----------
    /*
    This skript is based on a script by Daniel Piker 03/07/2020
    updated 27/07/2020 Link: https://discourse.mcneel.com/t/heat-method/105135/30
    Afterwards it´s changed by Masterstudent Jonas Michl @ BMW (01/04/2022 - 30/09/2022) to generate printing paths for WAAM
    */

    // Some global variables are defined and the mesh is converted to a triangle mesh
    double global_max = 0;
    double global_min = 10000;
    int iter = 0;
    P.Faces.ConvertQuadsToTriangles();
    pm = P.ToPlanktonMesh();
    int vc = pm.Vertices.Count;
    double[] conduction = new double[pm.Vertices.Count];

    // Compute average edge length
    double avg_edge = 0;
    for(int i = 0;i < pm.Halfedges.Count / 2;i++)
    {
      int start = pm.Halfedges[2 * i].StartVertex; // Start point
      int end = pm.Halfedges[(2 * i) + 1].StartVertex; // End point
      avg_edge += Math.Sqrt(pm.Vertices[start].ToPoint3d().DistanceToSquared(pm.Vertices[end].ToPoint3d())) / (0.5 * pm.Halfedges.Count);
    }

    // Initilisation ####################################################################################################
    { // Here is the initial process where all weights of the vertices are computed and boundarise vertices are detected.
      storedweights = new double[vc][];
      storedneighbours = new int[vc][];
      values = new double[vc];
      fix = new int[vc];
      equalize = new int[isoFix.Count][];

      // Boundary conditions ###########################################################################################
      for(int i = 0;i < vc;i++) // For all vertices
      {
        storedweights[i] = cotanWeights(pm, i); // Get weigths of vertex
        storedneighbours[i] = pm.Vertices.GetVertexNeighbours(i); // Get neighbour of vertex
        for(int j = 0;j < heatPoints.Count;j++) // Define hot points
        {
          if(pm.Vertices[i].ToPoint3d().DistanceToSquared(heatPoints[j]) < 0.5 * avg_edge * avg_edge) // Better use 0.5*average edge length
          {
            values[i] = 1; // Define hot Neumann BC (Boundary Conditions)
            fix[i] = 1;
          }
        }
        for(int j = 0;j < coldPoints.Count;j++) // Define cold points BC
        {
          if(pm.Vertices[i].ToPoint3d().DistanceToSquared(coldPoints[j]) < 0.5 * avg_edge * avg_edge) // Define cold Neumann BC
          {
            values[i] = -1; // Test with low temperature is -1 to get faster convergence
            fix[i] = 2;
          }
        }
      }

      for(int i = 0;i < isoFix.Count;i++) // Define isocontours
      {
        Polyline thisPoly = isoFix[i];
        int polyCount = thisPoly.Count;
        if(thisPoly[thisPoly.Count - 1].Equals(thisPoly[0])) polyCount--;//don't count first point twice for closed curves
        equalize[i] = new int[polyCount];
        for(int j = 0;j < polyCount;j++)
        {
          for(int k = 0;k < vc;k++)
          {
            if(pm.Vertices[k].ToPoint3d().DistanceToSquared(thisPoly[j]) < 0.5 * avg_edge * avg_edge)
            {
              equalize[i][j] = k;
              break;
            }
          }
        }
      }

      gradient = new Vector3d[vc];
      meshOut = P.DuplicateMesh();
      edgeGradient = null;
    }
    // Thermal Simulation ################################################################################
    { // Here the thermal simulation takes place to recieve a corse view of the temperature distribution
      // Afterwards this directionfield of the distribution is used
      {// Heat simulation (possible to iterate till no 0-values are left (because then the  and then a bit longer)
        for(int k = 0;k < Max_iterations;k++) // Heuristic defined 5000 iter
        {
          double[] newValues = new double[values.Length];
          Parallel.For(0, pm.Vertices.Count, // Parallelism is possible due to update sceme similiar to Jacobi
            i => {

            if(fix[i] == 0) // Node is not included to BC
            {
              int[] neighbours = storedneighbours[i]; // initialize variables
              double[] weights = storedweights[i];
              double newValue = 0;
              for(int j = 0;j < neighbours.Length;j++)
              {
                newValue += weights[j] * values[neighbours[j]]; // Compute new temperature values according to poisson equation
              }
              newValues[i] = newValue;
            }
            else newValues[i] = values[i]; // Keep boundary temperatures constant
            });

          for(int i = 0;i < equalize.Length;i++) // Compute the isocontours values
          {
            double avg = 0;
            for(int j = 0;j < equalize[i].Length;j++)avg += newValues[equalize[i][j]];
            avg /= equalize[i].Length;
            for(int j = 0;j < equalize[i].Length;j++) newValues[equalize[i][j]] = avg;
          }
          values = newValues; // Assign new values back to the old
        } //end


        double min = values.Min(); // Rerange temperature values
        double max = values.Max();
        double mult = 1.0 / (max - min);
        for(int i = 0;i < values.Length;i++) values[i] = mult * (values[i] - min);

        edgeGradient = null;
      }

      { // Compute edge gradient values ############################################################
        double avgGradientLength = 0;
        if(edgeGradient == null) // Compute initial edge gradients
        {
          gradient = gradients(pm, values); // Compute temperature gradients
          avgGradientLength = 0;
          for(int i = 0;i < gradient.Length;i++) // Compute average gradient
          {
            avgGradientLength += gradient[i].Length;
          }
          avgGradientLength /= gradient.Length;

          edgeGradient = new Vector3d[pm.Halfedges.Count / 2]; // Computation of the edge gradients
          for(int i = 0;i < pm.Halfedges.Count / 2;i++)
          {
            int start = pm.Halfedges[2 * i].StartVertex; // Start point
            int end = pm.Halfedges[(2 * i) + 1].StartVertex; // End point
            Vector3d sv = gradient[start];
            Vector3d ev = gradient[end];
            Vector3d thisEdgeGradient = sv + ev; // Calculation of the averaged normalised edge gradient
            thisEdgeGradient.Unitize();
            thisEdgeGradient *= avgGradientLength;
            edgeGradient[i] = thisEdgeGradient;
          }
        }

        double avg = 1;
        double avg_old = 0;
        double ratio = 1000;
        int k = 0;
        double avg_grad_new = avgGradientLength;
        // Poisson equation on temperature gradient ##########################################################################
        while(k < Max_iterations && ratio > 0.97 * Ratio_target || k < 0.1 * Max_iterations) // Applying Poisson equation on the Gradient values
          // other approach: iterate as long as the values are not changing much || (avg_old - avg) * (avg_old - avg) > 0.00001
        {
          k++;
          double[] heChange = new double[pm.Halfedges.Count];
          // Compute gradient on each edge
          Parallel.For(0, pm.Halfedges.Count / 2,
            i => {
            int start = pm.Halfedges[2 * i].StartVertex;
            int end = pm.Halfedges[(2 * i) + 1].StartVertex;
            Vector3d edgeVector = pm.Vertices[end].ToPoint3d() - pm.Vertices[start].ToPoint3d();
            double projected = edgeVector * edgeGradient[i];
            double currentDifference = values[end] - values[start];
            double change = currentDifference - projected;
            heChange[2 * i] = 1 * change;
            heChange[(2 * i) + 1] = -1 * change;
            });

          // Apply poisson equation on all vertices
          Parallel.For(0, pm.Vertices.Count,
            i => {
            {
              {
                double[] weights = storedweights[i];
                int[] halfedges = pm.Vertices.GetHalfedges(i);
                for(int j = 0;j < halfedges.Length;j++)
                {
                  values[i] += heChange[halfedges[j]] * weights[j];
                }
              }
            }
            });

          avg_old = avg;
          avg = 0;
          for(int i = 0; i < equalize.Length; i++) // Compute average gradient
          {
            for(int j = 0;j < equalize[i].Length;j++)avg += values[equalize[i][j]];
            avg /= equalize[i].Length;
            for(int j = 0;j < equalize[i].Length;j++) values[equalize[i][j]] = avg;
          }


          // Analyse of the global max and min of the gradient, it´s equivalent to the min and max distance of the isolines
          global_max = 0;
          global_min = 10000;
          gradient = gradients(pm, values);
          double gradient_length = 0;
          for(int i = 0;i < meshOut.Vertices.Count;i++) // Global min max gradient
          {
            gradient_length = gradient[i].Length;
            avg_grad_new += gradient_length / meshOut.Vertices.Count;
            if((gradient_length) < global_min)
            {
              global_min = gradient_length;
            }

            if(gradient_length > global_max)
            {
              global_max = gradient_length;
            }
          }
          ratio = global_max / global_min;
          avgGradientLength = avg_grad_new;
          avg_grad_new = 0;
          iter = k;
        }
      }
    }
    // End of iterative poisson
    Max_iterations = iter; // Output the real number of iterations

    // Compute output of the mesh values ##########################################################
    gradient = gradients(pm, values);
    for(int i = 0;i < meshOut.Vertices.Count;i++) // Compute output of the mesh values
    {
      meshOut.TextureCoordinates.SetTextureCoordinate(i, new Point2f(0, (float) (values[i])));
    }



    // Output####################################################################################
    {
      bool target_ratio = false;
      if(Ratio_target > Math.Sqrt(global_max / global_min))
      {
        target_ratio = true;
      }

      Mesh = meshOut;
      Values = values;
      Gradient = gradient;
      Ratio = Math.Sqrt(global_max / global_min);
      Ratio_achieved = target_ratio;
      iterations = Max_iterations;
    }
# ---------- c_script: C# additional code ----------
  PlanktonMesh pm;
  double[] values;
  double[][] storedweights;
  int[][] storedneighbours;
  Vector3d[] gradient;
  Vector3d[] edgeGradient;
  int[] fix;
  int[][] equalize;
  Mesh meshOut;

  // Compute gradients ##################################################################################
  static Vector3d[] gradients(PlanktonMesh P, double[] values)
  {
    Vector3d[] halfedgeGradients = new Vector3d[P.Halfedges.Count];
    for(int i = 0;i < P.Halfedges.Count / 2;i++)
    {
      int start = P.Halfedges[2 * i].StartVertex;
      int end = P.Halfedges[2 * i + 1].StartVertex;
      Vector3d v = P.Vertices[end].ToPoint3d() - P.Vertices[start].ToPoint3d();
      double lengthSquared = v.SquareLength;
      double diff = values[end] - values[start];
      Vector3d edgeGradient = v * (diff / lengthSquared);
      halfedgeGradients[2 * i] = halfedgeGradients[2 * i + 1] = edgeGradient;
    }
    Vector3d[] vertexGradients = new Vector3d[P.Vertices.Count];
    for(int i = 0;i < P.Vertices.Count;i++)
    {
      double[] weights = cotanWeights(P, i);
      Vector3d gradient = new Vector3d();
      int[] halfedges = P.Vertices.GetHalfedges(i);
      for(int j = 0;j < halfedges.Length;j++)
      {
        gradient += halfedgeGradients[halfedges[j]] * weights[j];
      }
      vertexGradients[i] = gradient;
    }
    return vertexGradients;
  }

  // Compute cotan weights for the finite difference method on a triangle mesh ################################
  static double[] cotanWeights(PlanktonMesh P, int i)
  {
    int[] Neighbours = P.Vertices.GetVertexNeighbours(i);
    Point3d Vertex = P.Vertices[i].ToPoint3d();
    int valence = P.Vertices.GetValence(i);
    Point3d[] NeighbourPts = new Point3d[valence];
    Vector3d[] Radial = new Vector3d[valence];
    Vector3d[] Around = new Vector3d[valence];
    double[] CotWeight = new double[valence];
    double WeightSum = 0;
    for (int j = 0; j < valence; j++)
    {
      NeighbourPts[j] = P.Vertices[Neighbours[j]].ToPoint3d();
      Radial[j] = NeighbourPts[j] - Vertex;
    }
    for (int j = 0; j < valence; j++)
    {
      Around[j] = NeighbourPts[(j + 1) % valence] - NeighbourPts[j];
    }
    int[] halfEdges = P.Vertices.GetHalfedges(i);
    for (int j = 0; j < Neighbours.Length; j++)
    {
      int previous = (j + valence - 1) % valence;
      int next = (j + 1) % valence;

      Vector3d Cross1 = Vector3d.CrossProduct(Radial[previous], Around[previous]);
      double Dot1 = Radial[previous] * Around[previous];
      double cwa = Math.Abs(Dot1 / Cross1.Length);

      Vector3d Cross2 = Vector3d.CrossProduct(Radial[next], Around[j]);
      double Dot2 = Radial[next] * Around[j];
      double cwb = Math.Abs(Dot2 / Cross2.Length);

      if(P.Halfedges[halfEdges[j]].AdjacentFace == -1){cwa = 0;}
      if(P.Halfedges[P.Halfedges.GetPairHalfedge(halfEdges[j])].AdjacentFace == -1){cwb = 0;}
      CotWeight[j] = cwa + cwb;
      WeightSum += CotWeight[j];
    }
    for (int j = 0; j < CotWeight.Length; j++) CotWeight[j] /= WeightSum;
    return CotWeight;
  }
# ---------- end c_script ----------

panel = Panel("Generate temperature field")
panel_2 = Panel("Generate Contour lines")
panel_3 = Panel("Analysis")

panel_4 = Panel("Analyse meshing")
medges = MeshEdges(Mesh=c_script.Mesh)  # -> NakedEdges, InteriorEdges, NonManifoldEdges

number_slider = Slider(49, range=0..300)
mesh_3 = Mesh(c_script.Mesh)
c_script_2 = CSharpScript(
    M=mesh_3,
    contourCount=number_slider,
    iterations=Slider(1, range=1..100),
    damping=Slider(0.9, range=0..1),
    smoothing_interval=Slider(1, range=1..10))  # -> out, Contours, Ratio; inputs M: Mesh, contourCount: Int32, iterations: Int32, damping: Double, smoothing_interval: Int32
# ---------- c_script_2: C# usings ----------
using System.Linq;
using System.Threading.Tasks;
# ---------- c_script_2: C# ----------
    // Initialize variables ##########################################################################
    List<Line>[] contours = new List<Line>[contourCount];
    List<Curve>[] curves = new List<Curve>[contourCount];
    List<Point3d>[] points = new List<Point3d>[contourCount];
    List<Vector3d>[] vectors = new List<Vector3d>[contourCount];
    double[] values = new double[M.Vertices.Count];
    for(int i = 0;i < M.Vertices.Count;i++) values[i] = M.TextureCoordinates[i].Y;
    double lower = values.Min();
    double upper = values.Max();
    double unit_stepsize = (upper - lower) / (contourCount + 1.0);
    double[] iso = new double[contourCount + 1];
    double[] iso_old = new double[contourCount + 1];
    for(int i = 0; i < contourCount; i++) iso[i] = lower + ((i + 1) * unit_stepsize); // Compute iso values for first iteration
    iso_old = iso;
    double[] stepsize_correction = new double[contourCount + 1];
    for(int i = 0; i <= contourCount; i++) stepsize_correction[i] = 1;
    double[] stepsize = new double[contourCount + 1];
    for(int i = 0; i < contourCount; i++) {stepsize[i] = unit_stepsize;} // Compute stepsize for first iteration

    //  Start iterative isoliones generation ###################################################
    for(int iter = 0; iter < iterations; iter++)
    {
      if(iter > 0)
      {
        for(int i = 0; i < contourCount; i++) // Clear all lists
        {
          vectors[i].Clear();
          contours[i].Clear();
          points[i].Clear();
        }
      }

      Parallel.For(0, contourCount, // Compute intersection point for all contour iso values
        j => {
        List<Line> lines = new List<Line>();
        List<Point3d> points_contour = new List<Point3d>();
        List<Vector3d> vecs = new List<Vector3d>();
        for(int i = 0;i < M.Faces.Count;i++) // Check all faces of the mesh if there is a intersection
        {
          int va = M.Faces[i].A;
          int vb = M.Faces[i].B;
          int vc = M.Faces[i].C;
          double a = M.TextureCoordinates[va].Y - iso[j];
          double b = M.TextureCoordinates[vb].Y - iso[j];
          double c = M.TextureCoordinates[vc].Y - iso[j];
          Point3d pa = M.Vertices.Point3dAt(va);
          Point3d pb = M.Vertices.Point3dAt(vb);
          Point3d pc = M.Vertices.Point3dAt(vc);

          List<Point3d> ends = new List<Point3d>();
          if(a < 0 != b < 0)
          {
            double wa = b / (b - a);
            double wb = 1 - wa;
            ends.Add(wa * pa + wb * pb);
          }
          if(a < 0 != c < 0)
          {
            double wa = c / (c - a);
            double wc = 1 - wa;
            ends.Add(wa * pa + wc * pc);
          }
          if(c < 0 != b < 0)
          {
            double wb = c / (c - b);
            double wc = 1 - wb;
            ends.Add(wb * pb + wc * pc);
          }
          if(ends.Count == 2) // if there is a intersection, the line is added to the contour
          {
            lines.Add(new Line(ends[0], ends[1]));
            points_contour.Add(ends[0]);
            points_contour.Add(ends[1]);
            Vector3d vec = new Vector3d((ends[0].X - ends[1].X), (ends[0].Y - ends[1].Y), (ends[0].Z - ends[1].Z));
            vecs.Add(vec);
          }
        }
        contours[j] = lines;
        points[j] = points_contour;
        vectors[j] = vecs;
        });

      // Compute changes in the iso values ###############################################################
      double normalize_factor = 0;
      Rhino.Geometry.Polyline poly;
      double[] distance = new double[contourCount + 1];
      // First the distance to the isoline above and below is computed to know how to change the iso values
      for(int i = 1; i < contourCount - 2; i++){

        poly = new Rhino.Geometry.Polyline(points[i]);
        distance[i] = 0;
        double dist2 = 0;
        for(int j = 0; j < points[i + 1].Count; j++) //distance to isoline above
        {
          distance[i] += Math.Sqrt(points[i + 1][j].DistanceToSquared(poly.ClosestPoint(points[i + 1][j])));
        }
        if(points[i + 1].Count > 0) // Check if isoline (i+1) exists
        {
          stepsize_correction[i] = distance[i] / (points[i + 1].Count);
        }
        poly = new Rhino.Geometry.Polyline(points[i + 1]);
        for(int j = 0; j < points[i].Count; j++) // distance from line below
        {
          dist2 += Math.Sqrt(points[i][j].DistanceToSquared(poly.ClosestPoint(points[i][j])));
        }
        if(points[i].Count > 0 && stepsize_correction[i] > dist2 / (points[i].Count)) // Always choose the smaller one
        {
          stepsize_correction[i] = dist2 / (points[i].Count);
          distance[i] = dist2;
        }
        stepsize_correction[i] = 1 / stepsize_correction[i];
        normalize_factor += stepsize_correction[i]; // Sum up normalize corrections factor
      }

      //For last row - spzial treetment
      distance[contourCount - 1] = 0;
      poly = new Rhino.Geometry.Polyline(points[contourCount - 1]);
      for(int j = 0; j < points[contourCount - 2].Count; j++)
      {
        distance[contourCount - 1] += Math.Sqrt(points[contourCount - 2][j].DistanceToSquared(poly.ClosestPoint(points[contourCount - 2][j]))); //Math.Sqrt
      }
      if(points[contourCount - 1].Count > 0)
      {
        stepsize_correction[contourCount - 1] = distance[contourCount - 1] / points[contourCount - 1].Count;
        stepsize_correction[contourCount - 1] = 1 / stepsize_correction[contourCount - 1];
        normalize_factor += stepsize_correction[contourCount - 1];
      }

      //For first row - spezial treetment
      distance[0] = 0;
      poly = new Rhino.Geometry.Polyline(points[1]);
      for(int j = 0; j < points[0].Count; j++)
      {
        distance[0] += Math.Sqrt(points[0][j].DistanceToSquared(poly.ClosestPoint(points[0][j]))); //Math.Sqrt
      }
      if(points[0].Count > 0)
      {
        stepsize_correction[0] = distance[0] / points[0].Count;
        stepsize_correction[0] = 1 / stepsize_correction[0];
        normalize_factor += stepsize_correction[0];
      }

      normalize_factor = normalize_factor / contourCount;


      for(int i = 0; i < contourCount; i++) // Keep correction value in boundaries
      {
        stepsize_correction[i] = stepsize_correction[i] / normalize_factor;
        if(stepsize_correction[i] > 1.5){stepsize_correction[i] = 1.5;}
        if(stepsize_correction[i] < 0.5){stepsize_correction[i] = 0.5;}
      }
      normalize_factor = normalize_factor / contourCount;

      double sum_steps = 0;

      // Compute correction factors ###########################################################
      for(int i = 0; i < contourCount; i++)
      {
        if(i == 0) // Compute first correction factor
        {
          stepsize[0] = stepsize[0] * stepsize_correction[0];
          iso[0] = lower + stepsize[0];
        }
        else // Compute the other correction factors
          // This process is highly unstable therefore it´s damped
        {
          stepsize_correction[i] = 0.5 * stepsize_correction[i] + 0.5 * stepsize_correction[i - 1];
          stepsize[i] = (1 - damping) * (stepsize[i] * stepsize_correction[i]) + damping * stepsize[i];
        }

        if(iso[i] > upper || iso[i] < lower) // If iso value goes out of range it´s being pushed back to the start value
        {
          iso[i] = lower + ((i + 1) * unit_stepsize);
        }
        sum_steps += stepsize[i];
      }

      // Compute new adapted iso values ######################################################
      double step_correction = unit_stepsize / (sum_steps / (contourCount - 1));

      for(int i = 1; i < contourCount; i++)
      {
        iso[i] = iso[i - 1] + stepsize[i] * step_correction;
      }

      if(iso[0] < lower || iso[0] > lower + unit_stepsize)
      {
        iso[0] = lower + 0.5 * unit_stepsize;
      }
      if(iso[contourCount - 1] > upper || iso[contourCount - 1] < upper - 0.5 * unit_stepsize)
      {
        iso[contourCount - 1] = upper - 0.5 * unit_stepsize;
      }
      iso_old = iso;

      // Depending on the smooting_interval a post smooting is done with a 2 point stencil
      if(iter % smoothing_interval == 0)
      {
        for(int i = 1; i < contourCount - 1 ; i++)
        {
          iso[i] = (iso_old[i + 1] + iso_old[i - 1]) / 2;
        }
      }
    }
    // End iteration ###########################################################################################
    // Analyse output ##########################################################################################
    for(int i = 0; i < contourCount; i++) // Difference of original iso values and adapted isovalues is computed for analysis
    {
      iso[i] = iso[i] - (lower + ((i + 1) * unit_stepsize));
    }
    // analyse = iso;

    double global_max = 0;
    double global_min = 10000;
    List<Point3d> gmax = new List<Point3d>();
    Parallel.For(1, contourCount,
      i => {
      /*
      - Compute minimal distance between all previous points (List) to the lines (List)
      - Local Extremas are the minimum and maximum of the minimal distance values
      - Global Extremas are the Extremas of the local extremas
      */
      double contour_max = 0;
      double contour_min = 10000;
      List<Point3d> max_points = new List<Point3d>();
      for (int j = 0; j < points[i].Count;j++) // Lopp over all points on a contour
      {
        double dist = 10000;
        List<Point3d> lmax_points = new List<Point3d>();
        for (int k = 0; k < points[i - 1].Count; k++) // Compute distance to all points below
        {
          if (dist > Math.Sqrt(points[i][j].DistanceToSquared(points[i - 1][k]))) // choose min as dist
          {
            dist = points[i][j].DistanceToSquared(points[i - 1][k]);
            dist = Math.Sqrt(dist);
            lmax_points.Clear();
            lmax_points.Add(points[i][j]);
            lmax_points.Add(points[i - 1][k]);
          }
        }

        if(contour_max < dist) // Check for Contour min/max
        {
          contour_max = dist;
          max_points.Clear();
          max_points = lmax_points;
        }
        if(contour_min > dist)
        {
          contour_min = dist;
        }
      }

      if(global_max < contour_max) // Check for Global min/max
      {
        global_max = contour_max;
        gmax.Clear();
        gmax = max_points;
      }
      if(global_min > contour_min)
      {
        global_min = contour_min;
      }
      });


    for(int i = 0; i < contourCount; i++)
    {
      List<Line > contour_lines = new List<Line>();
      contour_lines = contours[i];
    }

    // Output ####################################################################

    Ratio = global_max / global_min;
    DataTree<Line> contoursTree = new DataTree<Line>();
    for(int i = 0; i < contourCount;i++)
    {
      GH_Path path = new GH_Path(i);
      for (int j = 0; j < contours[i].Count;j++)
      {
        contoursTree.Add(contours[i][j], path);
      }
    }
    Contours = contoursTree;
# ---------- end c_script_2 ----------
line_2 = Line(c_script_2.Contours)

# ----
# Ratio of max and min gradient
# Analyse temperature  gradient field
panel_5 = Panel("Analyse temperature field")

mesh_4 = Mesh(c_script.Mesh)
num = Number(c_script.Values)
sort = SortList(Keys=num, ValuesA=num)  # -> Keys, ValuesA
number_slider_2 = Slider(0, range=0..1)
rev = ReverseList(List=sort.Keys)
item = ListItem(List=rev, Index=number_slider_2, Wrap=True)
item_2 = ListItem(List=sort.Keys, Index=number_slider_2, Wrap=True)
panel_6 = Panel([item, item_2])
gradient = Gradient(
    LowerLimit=item,
    UpperLimit=item_2,
    Parameter=num,
    stops=[0: RGB(248, 11, 57), 0: RGB(244, 180, 250), 0: RGB(102, 118, 54), 0.00106: RGB(234, 38, 0), 0.378: RGB(254, 244, 84), 0.692: RGB(173, 203, 249), 1: RGB(75, 107, 169)])
mcol = MeshColours(Mesh=mesh_4, Colours=gradient)

mesh_5 = Mesh(c_script.Mesh)
num_2 = Number(c_script.Gradient)
sort_2 = SortList(Keys=num_2, ValuesA=num_2)  # -> Keys, ValuesA
number_slider_3 = Slider(0, range=0..1)
rev_2 = ReverseList(List=sort_2.Keys)
item_3 = ListItem(List=rev_2, Index=number_slider_3, Wrap=True)
item_4 = ListItem(List=sort_2.Keys, Index=number_slider_3, Wrap=True)
gradient_2 = Gradient(
    LowerLimit=item_3,
    UpperLimit=item_4,
    Parameter=num_2,
    stops=[0: RGB(248, 11, 57), 0: RGB(244, 180, 250), 0: RGB(102, 118, 54), 0.00339: RGB(234, 38, 0), 0.495: RGB(254, 244, 84), 0.749: RGB(173, 203, 249), 1: RGB(75, 107, 169)])
division = Division(A=item_3, B=item_4)
panel_7 = Panel(division)
mcol_2 = MeshColours(Mesh=mesh_5, Colours=gradient_2)

c_script_3 = CSharpScript(M=mesh_3, contourCount=number_slider)  # -> out, Contours; inputs M: Mesh, contourCount: Int32
# ---------- c_script_3: C# ----------
      /*
    This skript is based on a script by Daniel Piker 03/07/2020
    updated 27/07/2020 Link: https://discourse.mcneel.com/t/heat-method/105135/30
    Afterwards it´s changed by Masterstudent Jonas Michl @ BMW (01/04/2022 - 30/09/2022) to generate printing paths for WAAM
    */
    // Inintialize variables ####################################################################
    List<Line> all = new List<Line>();
    List<Line>[] contours = new List<Line>[contourCount];
    double[] values = new double[M.Vertices.Count];
    for(int i = 0;i < M.Vertices.Count;i++) values[i] = M.TextureCoordinates[i].Y;
    double lower = values.Min();
    double upper = values.Max();
    double stepsize = (upper - lower) / (contourCount + 1.0);

    Parallel.For(0, contourCount, // Compute intersection point for all contour iso values
      j => {
      List<Line> lines = new List<Line>();
      List<Point3d> points_contour = new List<Point3d>();
      List<Vector3d> vecs = new List<Vector3d>();
      for(int i = 0;i < M.Faces.Count;i++) // Check all faces of the mesh if there is a intersection
      {
        int va = M.Faces[i].A;
        int vb = M.Faces[i].B;
        int vc = M.Faces[i].C;
        double a = M.TextureCoordinates[va].Y - iso[j];
        double b = M.TextureCoordinates[vb].Y - iso[j];
        double c = M.TextureCoordinates[vc].Y - iso[j];
        Point3d pa = M.Vertices.Point3dAt(va);
        Point3d pb = M.Vertices.Point3dAt(vb);
        Point3d pc = M.Vertices.Point3dAt(vc);

        List<Point3d> ends = new List<Point3d>();
        if(a < 0 != b < 0)
        {
          double wa = b / (b - a);
          double wb = 1 - wa;
          ends.Add(wa * pa + wb * pb);
        }
        if(a < 0 != c < 0)
        {
          double wa = c / (c - a);
          double wc = 1 - wa;
          ends.Add(wa * pa + wc * pc);
        }
        if(c < 0 != b < 0)
        {
          double wb = c / (c - b);
          double wc = 1 - wb;
          ends.Add(wb * pb + wc * pc);
        }
        if(ends.Count == 2) // if there is a intersection, the line is added to the contour
        {
          lines.Add(new Line(ends[0], ends[1]));
          points_contour.Add(ends[0]);
          points_contour.Add(ends[1]);
          Vector3d vec = new Vector3d((ends[0].X - ends[1].X), (ends[0].Y - ends[1].Y), (ends[0].Z - ends[1].Z));
          vecs.Add(vec);
        }
      }
      contours[j] = lines;
      points[j] = points_contour;
      vectors[j] = vecs;
      });


    // Generate output ###########################################################################################
    DataTree<Line> contoursTree = new DataTree<Line>();
    for(int i = 0; i < contourCount;i++)
    {
      GH_Path path = new GH_Path(i);
      for (int j = 0; j < contours[i].Count;j++)
      {
        contoursTree.Add(contours[i][j], path);
      }
    }

    Contours = contoursTree;
# ---------- end c_script_3 ----------
python_2 = GhPythonScript(tree=c_script_2.Contours)  # -> points, lines; inputs tree: tree of Line
# ---------- python_2: Python ----------
__author__ = "timda"
__version__ = "2023.06.28"

import rhinoscriptsyntax as rs
from ghpythonlib.treehelpers import list_to_tree

l_tree = []
p_tree = []
for i in range(tree.BranchCount):
    branchList = tree.Branch(i)
    points = []
    for line in branchList:
        start = line.PointAt(0.00)
        end = line.PointAt(1.00)
        if start not in points:
            points.append(start)
        if end not in points:
            points.append(end)
    lines = [line for line in branchList]
    p_tree.append(points)
    l_tree.append(branchList)

lines = list_to_tree(l_tree, source=[0,0])
points = list_to_tree(p_tree, source=[0,0])
# ---------- end python_2 ----------
python_3 = GhPythonScript(tree=c_script_2.Contours)  # -> points, pline; inputs tree: tree
# ---------- python_3: Python ----------
__author__ = "timda"
__version__ = "2023.06.27"

import rhinoscriptsyntax as rs

from Rhino.Geometry import PolylineCurve
points = []
for i in range(tree.BranchCount):
    points = []
    branchList = tree.Branch(i)
    #print(branchList[:10])
    for line in branchList:
        points.append(line.PointAt(0.0))
    points.append(line.PointAt(1.0))
    pline = PolylineCurve(points)
# ---------- end python_3 ----------
crv = Curve(python_3.pline)
pt_3 = Point(python_3.points)

list = ValueList({"20", "50", "100", "500", "1000", "5000"}, selected="20")
back = Button()
reset = Button()
start = Button()
stop = Button()
step = Button()
full = Button()

# ----
# Vector to sort along
number_slider_4 = Slider(0, range=-10..10)

vec = VectorXYZ(XComponent=number_slider_4, YComponent=Slider(0, range=-10..10), ZComponent=Slider(1, range=-10..10))  # -> Vector, Length
c_script_4 = CSharpScript(pts=python_2.points, vector=vec.Vector)  # -> out, sortPtsByY, sortPtsByZ, sortPtsAlongVector; inputs pts: list of Point3d, vector: Vector3d
# ---------- c_script_4: C# ----------
    //sort by Y
    var ptsArray = pts.ToArray();
    Array.Sort(ptsArray, SortPtByY());
    sortPtsByY = ptsArray;
    //sort by Z
    var ptsArray2 = pts.ToArray();
    Array.Sort(ptsArray2, SortPtByZ());
    sortPtsByZ = ptsArray2;
    //sort along vector
    var ptsArray3 = pts.ToArray();
    Array.Sort(ptsArray3, SortPtsAlongVector(vector));
    sortPtsAlongVector = ptsArray3;
# ---------- c_script_4: C# additional code ----------
  private class SortPtByY_Helper : IComparer
  {
    int IComparer.Compare(object a, object b)
    {
      double y1 = ((Point3d) a).Y;
      double y2 = ((Point3d) b).Y;
      if (y1 > y2)
        return 1;

      if (y1 < y2)
        return -1;
      else
        return 0;
    }
  }

  private class SortPtByZ_Helper : IComparer
  {
    int IComparer.Compare(object a, object b)
    {
      double z1 = ((Point3d) a).Z;
      double z2 = ((Point3d) b).Z;
      if (z1 > z2)
        return 1;

      if (z1 < z2)
        return -1;
      else
        return 0;
    }
  }

  private class SortPtsAlongVector_Helper : IComparer
  {
    private Vector3d Vector;

    public SortPtsAlongVector_Helper()
    {
      Vector = Vector3d.XAxis;
    }

    public SortPtsAlongVector_Helper(Vector3d vector0)
    {
      Vector = vector0;
      Vector.Unitize();
    }

    int IComparer.Compare(object a, object b)
    {
      int retval = 0;
      Vector3d vA = new Vector3d((Point3d) a);
      Vector3d vB = new Vector3d((Point3d) b);
      var vAprojectV = vA * Vector;
      var vBprojectV = vB * Vector;
      if (vAprojectV < vBprojectV)
      {
        retval = -1;
      }
      if (vAprojectV > vBprojectV)
      {
        retval = 1;
      }
      return retval;
    }
  }

  public static IComparer SortPtByY()
  {
    return (IComparer) new SortPtByY_Helper();
  }

  public static IComparer SortPtByZ()
  {
    return (IComparer) new SortPtByZ_Helper();
  }

  public static IComparer SortPtsAlongVector(Vector3d vector)
  {
    return (IComparer) new SortPtsAlongVector_Helper(vector);
  }
# ---------- end c_script_4 ----------
list_2 = ValueList({"Sort By Y": 0, "Sort By Z": 1, "Along Vector": 2}, selected="Sort By Z")
filter = StreamFilter(Gate=list_2, Stream0=c_script_4.sortPtsByY, Stream1=c_script_4.sortPtsByZ, Stream2=c_script_4.sortPtsAlongVector)
pline = PolyLine(Vertices=filter, Closed=False)  # -> flatten(Polyline)

vdis = VectorDisplay(Vector=vec.Vector)

counter = CountThroughList(points=filter, start=start, stop=stop, step=step, step_back=back, reset=reset, full=full, interval=list)  # -> point, counter; inputs points: tree, start: Boolean, stop: Boolean, step_back: Boolean
# ---------- counter: Python ----------
from scriptcontext import sticky as st
from compas_ghpython import update_component


L = points
# store data in component
guid = str(ghenv.Component.InstanceGuid)
counter_key = "counter_" + guid
running_key = "running_" + guid

if counter_key not in st:
    st[counter_key] = 0

if running_key not in st:
    st[running_key] = False
    

if st[running_key]:
    if st[counter_key] < L.BranchCount - 1: #len(L) - 1:
        st[counter_key] += 1
        update_component(ghenv, interval)
    else:
        st[counter_key] = 0
        st[running_key] = False
    
    
if start:
    st[running_key] = True

if stop:
    st[running_key] = False

if step:
    if st[counter_key] < L.BranchCount - 1: #len(L) - 1:
        st[counter_key] += 1

if step_back:
    if st[counter_key] > 0:
        st[counter_key] -= 1

if reset:
    st[counter_key] = 0

if full:
    st[counter_key] = L.BranchCount - 1 #len(L)-1

if L.BranchCount:
    #point = points[st[counter_key]]
    point = points.Branch(st[counter_key])



st["visualisation_counter"] = st[counter_key]
counter = st[counter_key]
# ---------- end counter ----------
crv_2 = Curve(counter.point)
python_4 = GhPythonScript(counter=counter.counter, points=filter)  # -> pts; inputs points: list
# ---------- python_4: Python ----------
__author__ = "timda"
__version__ = "2023.06.27"

import rhinoscriptsyntax as rs
pts = points[:counter+1]
# ---------- end python_4 ----------
python_5 = GhPythonScript(lines=pline)  # -> path; inputs lines: list of Curve
# ---------- python_5: Python ----------
__author__ = "timda"
__version__ = "2023.06.28"

import rhinoscriptsyntax as rs
from Rhino.Geometry import LineCurve
from Rhino.Geometry.Curve import JoinCurves

segments = [lines[0]]
for i, line in enumerate(lines):
    if i % 2 == 0:
        line.Reverse()
    if i == 0:
        continue
    connector = LineCurve(lines[i-1].PointAtEnd, line.PointAtStart)
    segments.append(connector)
    segments.append(line)
    # new_path = JoinCurves([path, connector], 0.00001, True)
path = JoinCurves(segments, 0.0001, True)
# ---------- end python_5 ----------
