# Grasshopper definition path_heat_method.ghx (Grasshopper 1.0.7)

# ---- group: DESIGN / Shape Initialization
number_slider = Slider(0, range=0..360)
number_slider_2 = Slider(2, range=0..10)
number_slider_3 = Slider(0, range=0..10)
number_slider_4 = Slider(0.05, range=0..0.1)
number_slider_5 = Slider(0, range=0..10)
number_slider_6 = Slider(5, range=0..10)
toggle = BooleanToggle(False)

# ---- group: DESIGN
create_wall = GhPythonScript(
    init=Button(),
    width=number_slider_6,
    height=number_slider_2,
    elsize=number_slider_4,
    x=number_slider_5,
    y=number_slider_3,
    rotation=number_slider,
    double_layer=toggle)  # -> wall
# ---------- create_wall: Python ----------
from add_on_am import Wall

import random
# create wall
wall = Wall(width, height, elsize, x, y, rotation)

print(wall.x_size, wall.z_size)
# ---------- end create_wall ----------

# ---- group: UNDULATION
number_slider_7 = Slider(0, range=0..6.2)
number_slider_8 = Slider(0.5, range=0..5)
number_slider_9 = Slider(0.4, range=0..10)
base_sine_crv = GhPythonScript(width=number_slider_6, a=number_slider_8, f=number_slider_9, ro=number_slider_7)  # -> c_curve, curve, L
# ---------- base_sine_crv: Python ----------
import Rhino.Geometry as rg
from Rhino.Collections import Point3dList
from compas.geometry import NurbsCurve 
import math

points = []
iterator = [i*0.1 for i in range(int(width/0.1 +1.999))]
for x in iterator:
    points.append(rg.Point3d(x, -a*math.sin(2.0 * math.pi * f*x + ro), 0))

points = Point3dList(points)
start_tangent = rg.Vector3d(iterator[0], a * 2.0 * math.pi * f * math.cos(2.0 * math.pi * f*iterator[0] + ro), 0)
end_tangent = rg.Vector3d(iterator[0], a * 2.0 * math.pi * f * math.cos(2.0 * math.pi * f*iterator[-1] + ro), 0)
curve = rg.Curve.CreateInterpolatedCurve(points, 3)


c_curve = NurbsCurve().from_interpolation(points)
L = curve.GetLength()
# ---------- end base_sine_crv ----------
undulate = GhPythonScript(
    wall=create_wall,
    up_amp=Slider(0.25, range=0..5),
    up_freq=Slider(0.8, range=0..10),
    up_phase=Slider(0, range=0..6.2),
    down_amp=number_slider_8,
    down_freq=number_slider_9,
    down_phase=number_slider_7)  # -> wall
# ---------- undulate: Python ----------
wall.undulate(up_amp, up_freq, up_phase ,down_amp, down_freq, down_phase)
# ---------- end undulate ----------

# ----
number_slider_10 = Slider(4119, range=0..4141)

reload = Button()
py = PythonScript(reload=reload)
# ---------- py: Python ----------
from compas_rhino.utilities.misc import get_tolerance
from compas_rhino.utilities.misc import unload_modules

from compas_ghpython import unload_modules

unload_modules("compas")
unload_modules("compas_fab")
unload_modules("roslibpy")
unload_modules("fabrication_control")
unload_modules("assembly_information_model")
unload_modules("am_information_model")
unload_modules("ur_fabrication_control")
unload_modules("workshop_aaec_revamp")
unload_modules("add_on_am")
unload_modules("mobile_part_based_am")
# ---------- end py ----------
py_2 = PythonScript()  # -> HERE, DATA
# ---------- py_2: Python ----------
import os

HERE = os.path.dirname(ghdoc.Path)
DATA = os.path.abspath(os.path.join(HERE, "..", "data"))

#print(HERE)
print(DATA)
# ---------- end py_2 ----------

list = ValueList({"weighted heat": 0, "distances start": 1, "distances end": 2}, selected="weighted heat")

# ---- group: VISUALIZATION
visualize = GhPythonScript(wall=undulate, show_mesh=Toggle(True), show_window=Toggle(True), delete_window=Toggle(True))  # -> rhmesh, vertices_window, vertices_support
# ---------- visualize: Python ----------
from compas_ghpython.artists import MeshArtist
import Rhino.Geometry as rg

rh_mesh = []
vertices_gate = []
vertices_all = []
disp_vectors = []
#
#if delete_window:
#    for vertex in wall.window_vertices:
#        wall.mesh.delete_vertex(vertex)
#        print("test")



if show_mesh:
    # Mesh Artist for visualization
    artist = MeshArtist(wall.mesh)
    rhmesh = artist.draw_mesh()

#
#if show_window:
    k = []
#    for vertex in wall.mesh.vertices():
#        gp = wall.mesh.vertex_attribute(vertex, name='window')
#        if gp: k.append(vertex)
#    
#    print k
#    if len(k): vertices_window = artist.draw_vertices(vertices=k)

for vertex in wall.mesh.vertices():
    if wall.mesh.vertex_attribute(vertex, name='z') < 0.025:
        k.append(vertex)
if len(k): vertices_support = artist.draw_vertices(vertices=k)
# ---------- end visualize ----------
swatch = ColourSwatch(SwatchColor=RGB(54, 45, 35))

# ----
pt = Point(visualize.vertices_window)
mcol = MeshColours(Mesh=visualize.rhmesh, Colours=swatch)

demesh = DeconstructMesh(Mesh=mcol)  # -> Vertices, Faces, Colours, Normals

# ----
# Path planner
path_type = ValueList({"Lowest Axis Path": 1, "Heat Method": 2}, selected="Heat Method")
orientation = ValueList({"X-axis": "x", "Y-axis": "y", "Z-axis": "z"}, selected="X-axis")
tool_path_planning = GhPythonScript(compute=Button(), path_type=path_type, orientation=orientation, mesh=visualize.rhmesh, L=base_sine_crv.L)  # -> planner, points, edges, heat, zero_crossings, v
# ---------- tool_path_planning: Python ----------
import compas
from compas_rhino.geometry import RhinoMesh
from Rhino.Geometry import Point3d
from add_on_am import SurfacePathPlanner
from compas_ghpython.utilities import draw_network, draw_frame
from compas.colors import Color

rmesh = RhinoMesh.from_guid(mesh)
planner = SurfacePathPlanner()
planner.set_quad_mesh_from_rhinomesh(rmesh)
planner.set_network_nodes()
#planner.set_color_map([
#    Color.from_rgb255(128,255,255),
#    Color.from_rgb255(255,255,0),
#    Color.from_rgb255(255,0,0)])
#planner.set_thickness_map([
#    0.008,
#    0.010,
#    0.012])
#center = Point3d(0, 0, 0)
#print(orientation)
#planner.map_reachability(reachabilitymap, center)


if path_type == 1:
    [network, n] = planner.lowest_axis_path(orientation)
elif path_type == 2:
    v, heat, zero_crossings, network = planner.heat_method(5.0, 2.0, L)
    #network = planner.network

#planner.calculate_fabrication_parameters()

points, edges = draw_network(network)   
#planes = []
#tool_planes = []
#cylinders = []
#colors = []
#for k in planner.network.path:
#    frame = planner.network.node_attribute(key=k, name='frame')
#    plane = draw_frame(frame)
#    planes.append(plane)

# print(planner.network.node_attributes(key=0))
# ---------- end tool_path_planning ----------
pt_2 = Point(tool_path_planning.points)
path = Curve(tool_path_planning.edges)

python = GhPythonScript(planner=tool_path_planning.planner, index=tool_path_planning.v)  # -> p; inputs index: list of Int32
# ---------- python: Python ----------
__author__ = "timda"
__version__ = "2023.06.01"

import rhinoscriptsyntax as rs
from compas_rhino.conversions import point_to_rhino
p = []
indices = list(range(4100, 4141))
for i in index:
    point = planner.mesh.vertex_coordinates(list(planner.mesh.vertices())[i])
    p.append(point_to_rhino(point))
# ---------- end python ----------
python_2 = GhPythonScript(
    heat_list=tool_path_planning.heat,
    zero_crossings=tool_path_planning.zero_crossings,
    index=list,
    weight_index=Slider(0, range=0..10))  # -> min_h, max_h, heat, zero_points; inputs heat_list: list, zero_crossings: list, index: Int32, weight_index: Int32
# ---------- python_2: Python ----------
__author__ = "timda"
__version__ = "2023.06.02"

import rhinoscriptsyntax as rs
from compas_rhino.conversions import point_to_rhino

heat = heat_list[index]

if index == 0:
    heat = heat[weight_index]


isolines = zero_crossings[weight_index]
zero_points = []
for p in isolines:
    zero_points.append(point_to_rhino(p))

max_h = max(heat)
min_h = min(heat)
# ---------- end python_2 ----------
pt_3 = Point(python_2.zero_points)
gradient = Gradient(
    LowerLimit=python_2.min_h,
    UpperLimit=python_2.max_h,
    Parameter=python_2.heat,
    stops=[0: RGB(203, 37, 215), 0: RGB(90, 100, 156), 0: RGB(234, 38, 0), 0: RGB(228, 231, 162), 0: RGB(116, 38, 103), 0.25: RGB(234, 126, 0), 0.5: RGB(254, 244, 84), 0.75: RGB(173, 203, 249), 1: RGB(75, 107, 169)])
mcol_2 = MeshColours(Mesh=visualize.rhmesh, Colours=gradient)
