# Grasshopper definition mesh_face_based.ghx (Grasshopper 1.0.7)

reload = Button()
py = PythonScript(reload=reload)
# ---------- py: Python ----------
from compas_rhino.utilities.misc import get_tolerance
from compas_rhino.utilities.misc import unload_modules

from compas_ghpython import unload_modules

unload_modules("compas")
unload_modules("compas_fab")
unload_modules("roslibpy")
unload_modules("fabrication_control")
unload_modules("assembly_information_model")
unload_modules("am_information_model")
unload_modules("ur_fabrication_control")
unload_modules("workshop_aaec_revamp")
unload_modules("add_on_am")
unload_modules("mobile_part_based_am")
# ---------- end py ----------
py_2 = PythonScript()  # -> HERE, DATA
# ---------- py_2: Python ----------
import os

HERE = os.path.dirname(ghdoc.Path)
DATA = os.path.abspath(os.path.join(HERE, "..", "data"))

#print(HERE)
print(DATA)
# ---------- end py_2 ----------

# ---- group: DESIGN / Shape Initialization
number_slider = Slider(0, range=0..360)
number_slider_2 = Slider(2, range=0..10)
number_slider_3 = Slider(0, range=0..10)
number_slider_4 = Slider(0.05, range=0..0.1)
number_slider_5 = Slider(0, range=0..10)
number_slider_6 = Slider(5, range=0..10)
toggle = BooleanToggle(False)

# ---- group: DESIGN
create_wall = GhPythonScript(
    init=Button(),
    width=number_slider_6,
    height=number_slider_2,
    elsize=number_slider_4,
    x=number_slider_5,
    y=number_slider_3,
    rotation=number_slider,
    double_layer=toggle)  # -> wall
# ---------- create_wall: Python ----------
from add_on_am import Wall

import random
# create wall
wall = Wall(width, height, elsize, x, y, rotation)

print(wall.x_size, wall.z_size)
# ---------- end create_wall ----------

# ---- group: UNDULATION
number_slider_7 = Slider(0, range=0..6.2)
number_slider_8 = Slider(0.5, range=0..5)
number_slider_9 = Slider(0.4, range=0..10)
base_sine_crv = GhPythonScript(width=number_slider_6, a=number_slider_8, f=number_slider_9, ro=number_slider_7)  # -> c_curve, curve
# ---------- base_sine_crv: Python ----------
import Rhino.Geometry as rg
from Rhino.Collections import Point3dList
from compas.geometry import NurbsCurve 
import math

points = []
iterator = [i*0.1 for i in range(int(width/0.1 +1.999))]
for x in iterator:
    points.append(rg.Point3d(x, -a*math.sin(2.0 * math.pi * f*x + ro), 0))

points = Point3dList(points)
start_tangent = rg.Vector3d(iterator[0], a * 2.0 * math.pi * f * math.cos(2.0 * math.pi * f*iterator[0] + ro), 0)
end_tangent = rg.Vector3d(iterator[0], a * 2.0 * math.pi * f * math.cos(2.0 * math.pi * f*iterator[-1] + ro), 0)
curve = rg.Curve.CreateInterpolatedCurve(points, 3)


c_curve = NurbsCurve().from_interpolation(points)
print(c_curve)
# ---------- end base_sine_crv ----------
undulate = GhPythonScript(
    wall=create_wall,
    up_amp=Slider(0.25, range=0..5),
    up_freq=Slider(0.8, range=0..10),
    up_phase=Slider(0, range=0..6.2),
    down_amp=number_slider_8,
    down_freq=number_slider_9,
    down_phase=number_slider_7)  # -> wall
# ---------- undulate: Python ----------
wall.undulate(up_amp, up_freq, up_phase ,down_amp, down_freq, down_phase)
# ---------- end undulate ----------

# ---- group: VISUALIZATION
visualize = GhPythonScript(wall=undulate, show_mesh=Toggle(True), show_window=Toggle(True), delete_window=Toggle(True))  # -> rhmesh, vertices_window, vertices_support
# ---------- visualize: Python ----------
from compas_ghpython.artists import MeshArtist
import Rhino.Geometry as rg

rh_mesh = []
vertices_gate = []
vertices_all = []
disp_vectors = []
#
#if delete_window:
#    for vertex in wall.window_vertices:
#        wall.mesh.delete_vertex(vertex)
#        print("test")



if show_mesh:
    # Mesh Artist for visualization
    artist = MeshArtist(wall.mesh)
    rhmesh = artist.draw_mesh()

#
#if show_window:
    k = []
#    for vertex in wall.mesh.vertices():
#        gp = wall.mesh.vertex_attribute(vertex, name='window')
#        if gp: k.append(vertex)
#    
#    print k
#    if len(k): vertices_window = artist.draw_vertices(vertices=k)

for vertex in wall.mesh.vertices():
    if wall.mesh.vertex_attribute(vertex, name='z') < 0.025:
        k.append(vertex)
if len(k): vertices_support = artist.draw_vertices(vertices=k)
# ---------- end visualize ----------
swatch = ColourSwatch(SwatchColor=RGB(54, 45, 35))

# ----
pt = Point(visualize.vertices_window)
mcol = MeshColours(Mesh=visualize.rhmesh, Colours=swatch)
curves_on_mesh = GhPythonScript(wall=undulate)  # -> crvs
# ---------- curves_on_mesh: Python ----------
__author__ = "timda"
__version__ = "2023.05.05"

import rhinoscriptsyntax as rs
from System.Collections.Generic import List
from Rhino.Geometry.Curve import ProjectToMesh, CreateControlPointCurve, CreateTweenCurvesWithSampling
from Rhino.Geometry import Point3d, Vector3d, LineCurve, Line, Curve, Mesh, BlendContinuity

crvs = []
for i in range(wall.x_size):
    x = i*wall.elsize
    crvs.append(Line(Point3d(x, 0, 0), Point3d(x, 0, wall.height)))
# ---------- end curves_on_mesh ----------
Y = UnitY(Factor=1)
projecttomesh = CSharpScript(Curve=curves_on_mesh, Mesh=visualize.rhmesh, Direction=Y)  # -> out, A; inputs Curve: Curve, Mesh: Mesh, Direction: Vector3d
# ---------- projecttomesh: C# usings ----------
using System.IO;
using System.Linq;
using System.Data;
using System.Drawing;
using System.Reflection;
using System.Windows.Forms;
using System.Xml;
using System.Xml.Linq;
using System.Runtime.InteropServices;

using Rhino.DocObjects;
using Rhino.Collections;
using GH_IO;
using GH_IO.Serialization;
# ---------- projecttomesh: C# ----------
    if (null != Curve && null != Mesh && Direction.IsValid)
    {
      var tol = RhinoDoc.ActiveDoc.ModelAbsoluteTolerance;
      A = Curve.ProjectToMesh(Curve, Mesh, Direction, tol);
    }
# ---------- end projecttomesh ----------
curves_on_mesh_2 = GhPythonScript(mesh=visualize.rhmesh, wall=undulate)  # -> crvs; inputs mesh: Mesh
# ---------- curves_on_mesh_2: Python ----------
__author__ = "timda"
__version__ = "2023.05.05"

import rhinoscriptsyntax as rs
from System.Collections.Generic import List
from Rhino.Geometry.Curve import ProjectToMesh, CreateControlPointCurve, CreateTweenCurvesWithSampling
from Rhino.Geometry import Point3d, Vector3d, LineCurve, Line, Curve, Mesh, BlendContinuity

def inter_lines(lines):
    cp = []
    for line in lines:
        cp.append(line.PointAtStart)
        cp.append(line.PointAtEnd)
    crv = CreateControlPointCurve(List[Point3d](cp))
    return crv

line = []
crvs = []
for i in range(wall.x_size):
    x = i*wall.elsize
    line = CreateControlPointCurve(List[Point3d]([Point3d(x, 0, 0), Point3d(x, 0, wall.height)]))
    segments = ProjectToMesh(line, mesh, Vector3d(0, 1, 0), 0.001)
    if len(segments) > 1:
        segments = [inter_lines(segments)]
    crvs.append(segments[0])
# ---------- end curves_on_mesh_2 ----------
python = GhPythonScript(mesh=visualize.rhmesh)  # -> edges, lines, line_p
# ---------- python: Python ----------
__author__ = "timda"
__version__ = "2023.05.07"

import rhinoscriptsyntax as rs
from add_on_am import SurfacePathPlanner
from compas_rhino.geometry import RhinoMesh
from System.Collections.Generic import List
from Rhino.Geometry.Curve import CreateControlPointCurve
from Rhino.Geometry import Point3d

from compas_ghpython.utilities import draw_network, draw_polylines

rmesh = RhinoMesh.from_guid(mesh)
planner = SurfacePathPlanner()
planner.set_quad_mesh_from_rhinomesh(rmesh)
planner.set_network_nodes()
[network, n, line_p] = planner.vertical_lines("x")
points, edges = draw_network(network) 
lines = []
for polyline in line_p:
    point = []
    for p in polyline:
        point.append(Point3d(p[0], p[1], p[2]))
    lines.append(CreateControlPointCurve(List[Point3d](point)))
# ---------- end python ----------
python_2 = GhPythonScript(crvs=projecttomesh.A)  # -> a; inputs crvs: tree of Curve
# ---------- python_2: Python ----------
__author__ = "timda"
__version__ = "2023.05.07"

import rhinoscriptsyntax as rs
from Rhino.Geometry.Curve import JoinCurves
a = []
for i in range(crvs.BranchCount):
    branchList = crvs.Branch(i)
    crv = JoinCurves(branchList, 0.1, True)[0]
    print(crv)
    a.append(crv)
# ---------- end python_2 ----------
item = ListItem(List=curves_on_mesh_2, Index=Slider(84, range=0..110), Wrap=True)
envelope = GhPythonScript(
    crvs=python_2,
    r_out=Slider(1.3, range=0..10),
    h_out=Slider(1, range=0..3),
    r_in=Slider(0.3, range=0..1),
    h_in=Slider(0.2, range=0..1),
    z_offset=Slider(0.2, range=0..1),
    base_crv=base_sine_crv.c_curve)  # -> mesh, points, crvs_in, crvs_out, envelope; inputs crvs: list of Curve
# ---------- envelope: Python ----------
from Rhino.Geometry.Intersect.Intersection import MeshPolyline
from add_on_am import Envelope
from compas.artists import MeshArtist
from compas_rhino.conversions import polyline_to_compas
import math

z = 0.5
c_crvs = []
for i, crv in enumerate(crvs):
    c_crvs.append(polyline_to_compas(crv.ToPolyline()))

envelope = Envelope(r_out, h_out, r_in, h_in, z_offset, 0, 0, z)

def intersections(intersection_mesh, curves):
    inter_points = []
    for curve in curves:
        inter = MeshPolyline(intersection_mesh, curve)
        if inter[1]:
            inter_points += inter[0]
    return inter_points

#c, max_in = envelope.iterate(c_crvs, base_crv)
#print(c, max_in)
#
## takes 3sek???
#i_in, i_out = envelope.crvs_inside(c_crvs, True, True)
#crvs_in = [[], []]
#crvs_out = []
#for i, crv in enumerate(crvs):
#    if i in i_in:
#        crvs_in[0].append(crv)
#    elif i in i_out:
#        crvs_out.append(crv)


i_out = range(len(c_crvs))
crvs_in = []

for k in range(5):
    if len(i_out)==0:
        break 
    crvs_in.append([])
    c, max_in = envelope.iterate([c_crvs[i] for i in i_out], base_crv)
    print(c, max_in)
    
    # takes 3sek???
    i_in, i_out = envelope.crvs_inside(c_crvs, True, True)
    crvs_out = []
    for i, crv in enumerate(crvs):
        if i in i_in:
            crvs_in[k].append(crv)
        elif i in i_out:
            crvs_out.append(crv)

envelope.draw_mesh()
artist = MeshArtist(envelope.mesh_out)
mesh = artist.draw()
# ---------- end envelope ----------
pt_2 = Point(envelope.points)
mesh = Mesh(envelope.mesh)
crv = Curve(envelope.crvs_out)
i = Slider(0, range=0..5)
max_ri = GhPythonScript(wall=undulate, envelope=envelope.envelope)  # -> points, ri, pos, vertices, mesh
# ---------- max_ri: Python ----------
__author__ = "timda"
__version__ = "2023.05.11"

import rhinoscriptsyntax as rs
from add_on_am import Map2d
from compas_ghpython.utilities import draw_network
from Rhino.Geometry import Point3d
from compas.artists import MeshArtist

map = Map2d(wall, 0.25)
network = map.create_network(envelope)
map.assign_reach(envelope)
points, edges = draw_network(network)
ri = {}
for node in map.network.nodes():
    ri[node] = map.network.node_attribute(node, "ri")

max_i = max(ri, key=ri.get)
pos = points[max_i]

vertices_i = map.network.node_attribute(max_i, "vertices")
vertices = []
for i in vertices_i:
    [x, y, z] = wall.mesh.vertex_coordinates(i)
    vertices.append(Point3d(x, y, z))

#pos = []
#for k in range(3):
#    max_i = max(ri, key=ri.get)
#    pos.append(points[max_i])
#    ri[max_i] = 0


envelope.x = pos.X
envelope.y = pos.Y
envelope.draw_mesh()
artist = MeshArtist(envelope.mesh_out)
mesh = artist.draw()
# ---------- end max_ri ----------
python_3 = GhPythonScript(list=envelope.crvs_in, i=i)  # -> out, item; inputs list: list, i: Int32
# ---------- python_3: Python ----------
__author__ = "timda"
__version__ = "2023.05.09"

import rhinoscriptsyntax as rs
item = list[i]
# ---------- end python_3 ----------
mesh_2 = Mesh(max_ri.mesh)
crv_2 = Curve(python_3.item)
pt_3 = Point(max_ri.points)
# Info
pt_4 = Point(max_ri.vertices)
pt_5 = Point(max_ri.pos)
panel = Panel(max_ri.ri)
