# Grasshopper definition sectioning_growth.ghx (Grasshopper 1.0.7)

envelope = GhPythonScript(
    r_out=Slider(1.374, range=0..10),
    h_out=Slider(0.72, range=0..3),
    r_in=Slider(0.5, range=0..1),
    h_in=Slider(0.36, range=0..1),
    z_offset=Slider(0, range=0..1))  # -> mesh, points, crvs_in, crvs_out, envelope; inputs crvs: list of Curve
# ---------- envelope: Python ----------
from Rhino.Geometry.Intersect.Intersection import MeshPolyline
from add_on_am import Envelope
from compas.artists import MeshArtist
from compas_rhino.conversions import polyline_to_compas
import math

z = 1.049
c_crvs = []
for i, crv in enumerate(crvs):
    c_crvs.append(polyline_to_compas(crv.ToPolyline()))

envelope = Envelope(r_out, h_out, r_in, h_in, z_offset, 0, 0, z)

def intersections(intersection_mesh, curves):
    inter_points = []
    for curve in curves:
        inter = MeshPolyline(intersection_mesh, curve)
        if inter[1]:
            inter_points += inter[0]
    return inter_points

#c, max_in = envelope.iterate(c_crvs, base_crv)
#print(c, max_in)
#
## takes 3sek???
#i_in, i_out = envelope.crvs_inside(c_crvs, True, True)
#crvs_in = [[], []]
#crvs_out = []
#for i, crv in enumerate(crvs):
#    if i in i_in:
#        crvs_in[0].append(crv)
#    elif i in i_out:
#        crvs_out.append(crv)


i_out = range(len(c_crvs))
crvs_in = []

for k in range(5):
    if len(i_out)==0:
        break 
    crvs_in.append([])
    c, max_in = envelope.iterate([c_crvs[i] for i in i_out], base_crv)
    print(c, max_in)
    
    # takes 3sek???
    i_in, i_out = envelope.crvs_inside(c_crvs, True, True)
    crvs_out = []
    for i, crv in enumerate(crvs):
        if i in i_in:
            crvs_in[k].append(crv)
        elif i in i_out:
            crvs_out.append(crv)

envelope.draw_mesh()
artist = MeshArtist(envelope.mesh_out)
mesh = artist.draw()
# ---------- end envelope ----------
crv = Curve(envelope.crvs_out)
pt = Point(envelope.points)
mesh = Mesh(envelope.mesh)

reload = Button()
py = PythonScript(reload=reload)
# ---------- py: Python ----------
from compas_rhino.utilities.misc import get_tolerance
from compas_rhino.utilities.misc import unload_modules

from compas_ghpython import unload_modules

unload_modules("compas")
unload_modules("compas_fab")
unload_modules("roslibpy")
unload_modules("fabrication_control")
unload_modules("assembly_information_model")
unload_modules("am_information_model")
unload_modules("ur_fabrication_control")
unload_modules("workshop_aaec_revamp")
unload_modules("add_on_am")
unload_modules("mobile_part_based_am")
# ---------- end py ----------
py_2 = PythonScript()  # -> HERE, DATA
# ---------- py_2: Python ----------
import os

HERE = os.path.dirname(ghdoc.Path)
DATA = os.path.abspath(os.path.join(HERE, "..", "data"))

#print(HERE)
print(DATA)
# ---------- end py_2 ----------

list = ValueList({"20", "50", "100", "500", "1000", "5000"}, selected="20")
back = Button()
reset = Button()
start = Button()
stop = Button()
step = Button()
full = Button()

number_slider = Slider(2, range=0..10)
number_slider_2 = Slider(5, range=0..10)

crvs = GhPythonScript(
    width=number_slider_2,
    height=number_slider,
    up_a=Slider(0.25, range=0..5),
    up_f=Slider(0.8, range=0..10),
    up_ro=Slider(0, range=0..6.2),
    down_a=Slider(0.5, range=0..5),
    down_f=Slider(0.4, range=0..10),
    down_ro=Slider(0, range=0..6.2))  # -> base, base_crv, top, top_crv
# ---------- crvs: Python ----------
__author__ = "timda"
__version__ = "2023.07.15"

import rhinoscriptsyntax as rs
import math
from Rhino.Geometry import Point3d, Vector3d, Curve
from Rhino.Collections import Point3dList

class CrvParams:
    def __init__(self, amp, freq, ro):
        self.amp = amp
        self.freq = freq
        self.ro = ro
    def crv(self, width, height):
        points = []
        iterator = [i*0.1 for i in range(int(width/0.1 +1.999))]
        for x in iterator:
            points.append(Point3d(x, -self.amp*math.sin(2.0 * math.pi * self.freq*x + self.ro), height))
        
        points = Point3dList(points)
        start_tangent = Vector3d(iterator[0], self.amp * 2.0 * math.pi * self.freq * math.cos(2.0 * math.pi * self.freq*iterator[0] + self.ro), 0)
        end_tangent = Vector3d(iterator[0], self.amp * 2.0 * math.pi * self.freq * math.cos(2.0 * math.pi * self.freq*iterator[-1] + self.ro), 0)
        self.curve = Curve.CreateInterpolatedCurve(points, 3)
        return self.curve


base = CrvParams(down_a, down_f, down_ro)
base_crv = base.crv(width, 0)
top = CrvParams(up_a, up_f, up_ro)
top_crv = top.crv(width, height)
# ---------- end crvs ----------

crv_2 = Curve(crvs.base_crv)
crv_3 = Curve(crvs.top_crv)
rulesrf = RuledSurface(CurveA=crv_2, CurveB=crv_3)

number_slider_3 = Slider(0.05, range=0..0.1)
brep = Brep(rulesrf)
brep_to_mesh = GhPythonScript(
    brep=brep,
    w=number_slider_2,
    h=number_slider,
    elsize=number_slider_3,
    max_size=number_slider_3,
    min_size=number_slider_3,
    base=crvs.base,
    top=crvs.top)  # -> rmesh, wall; inputs brep: Brep
# ---------- brep_to_mesh: Python ----------
__author__ = "timda"
__version__ = "2023.07.14"

import rhinoscriptsyntax as rs
from compas_ghpython.artists import MeshArtist
from add_on_am import NewWall

wall = NewWall(w, h, elsize)
wall.undulate(top, base)
mesh = wall.from_brep(brep, max_size, min_size)
mesh_art = MeshArtist(mesh)
rmesh = mesh_art.draw_mesh()
# ---------- end brep_to_mesh ----------
mcol = MeshColours(Mesh=brep_to_mesh.rmesh, Colours=ColourSwatch(SwatchColor=RGB(82, 82, 82)))

# ----
# Path planner
button = Button()
create_network_on_wall = GhPythonScript(compute=button, mesh=brep_to_mesh.rmesh)  # -> network, points
# ---------- create_network_on_wall: Python ----------
import compas
from compas_rhino.geometry import RhinoMesh
from Rhino.Geometry import Point3d
from add_on_am import SurfacePathPlanner
from compas_ghpython.utilities import draw_network, draw_frame
from compas.colors import Color

rmesh = RhinoMesh.from_guid(mesh)
wall_network = SurfacePathPlanner()
wall_network.set_quad_mesh_from_rhinomesh(rmesh)
wall_network.set_network_nodes()
network = wall_network.network

points, edges = draw_network(network)
# ---------- end create_network_on_wall ----------
pt_2 = Point(create_network_on_wall.points)

growth = GhPythonScript(
    wall_network=create_network_on_wall.network,
    wall=brep_to_mesh.wall,
    envelope=envelope.envelope,
    depth=Slider(150, range=0..1000))  # -> points, wall_network, positions, position_points; inputs depth: Int32
# ---------- growth: Python ----------
__author__ = "timda"
__version__ = "2023.07.15"

import rhinoscriptsyntax as rs
from add_on_am import GrowthPositioning
from compas_ghpython.utilities import draw_network
from Rhino.Geometry import Point3d

map = GrowthPositioning(wall, 0.3)
network = map.create_network(envelope)
nodes = map.segment(wall_network, envelope, max_depth=depth)
print(len(nodes.keys()))
position_points, edges = draw_network(network)

points = []
for node in nodes.keys():
    points.append(Point3d(*wall_network.node_coordinates(node)))
positions = [[] for _ in nodes.values()]
for i, pos in enumerate(nodes.values()):
    for p in pos:
        positions[i].append(Point3d(*network.node_coordinates(p)))
        
position_points = positions[0]
# ---------- end growth ----------
pt_3 = Point(growth.position_points)

counter = CountThroughList(
    points=growth.points,
    positions=growth.positions,
    start=start,
    stop=stop,
    step=step,
    step_back=back,
    reset=reset,
    full=full,
    interval=list)  # -> plane, point, pos, counter; inputs points: list, planes: list, positions: list, start: Boolean, stop: Boolean, step_back: Boolean
# ---------- counter: Python ----------
from scriptcontext import sticky as st
from compas_ghpython import update_component


L = points
# store data in component
guid = str(ghenv.Component.InstanceGuid)
counter_key = "counter_" + guid
running_key = "running_" + guid

if counter_key not in st:
    st[counter_key] = 0

if running_key not in st:
    st[running_key] = False
    

if st[running_key]:
    if st[counter_key] < len(L) - 2:
        st[counter_key] += 1
        update_component(ghenv, interval)
    else:
        st[counter_key] = 0
        st[running_key] = False
    
    
if start:
    st[running_key] = True

if stop:
    st[running_key] = False

if step:
    if st[counter_key] < len(L) - 2:
        st[counter_key] += 1

if step_back:
    if st[counter_key] > 0:
        st[counter_key] -= 1

if reset:
    st[counter_key] = 0

if full:
    st[counter_key] = len(L)-2

if len(L):
    #plane = L[st[counter_key]]
    point = points[st[counter_key]]
    pos = positions[st[counter_key]]



st["visualisation_counter"] = st[counter_key]
counter = st[counter_key]
# ---------- end counter ----------
pln = Plane(counter.plane)
pt_4 = Point(counter.pos)
python = GhPythonScript(counter=counter.counter, points=growth.points)  # -> pts; inputs points: list
# ---------- python: Python ----------
__author__ = "timda"
__version__ = "2023.06.27"

import rhinoscriptsyntax as rs
pts = points[:counter+1]
# ---------- end python ----------
dots = DotDisplay(Point=python, Colour=ColourSwatch(SwatchColor=RGB(0, 81, 255)), Size=Slider(0.01, range=0..0.1))

python_2 = GhPythonScript(pt=pt_4, env=envelope.envelope)  # -> envelope; inputs pt: Point3d
# ---------- python_2: Python ----------
__author__ = "timda"
__version__ = "2023.07.15"

import rhinoscriptsyntax as rs
env.x = pt.X
env.y = pt.Y

from compas.artists import MeshArtist
env.draw_mesh()
envartist = MeshArtist(env.mesh_out)
envelope = envartist.draw()
# ---------- end python_2 ----------
mesh_2 = Mesh(python_2)
