# Grasshopper definition 25dgeometries.gh (Grasshopper 1.0.7)

reload = Button()
py = PythonScript(reload=reload)
# ---------- py: Python ----------
from compas_rhino.utilities.misc import get_tolerance
from compas_rhino.utilities.misc import unload_modules

from compas_ghpython import unload_modules

unload_modules("compas")
unload_modules("compas_fab")
unload_modules("roslibpy")
unload_modules("fabrication_control")
unload_modules("assembly_information_model")
unload_modules("am_information_model")
unload_modules("ur_fabrication_control")
unload_modules("workshop_aaec_revamp")
unload_modules("add_on_am")
unload_modules("mobile_part_based_am")
# ---------- end py ----------
py_2 = PythonScript()  # -> HERE, DATA
# ---------- py_2: Python ----------
import os

HERE = os.path.dirname(ghdoc.Path)
DATA = os.path.abspath(os.path.join(HERE, "..", "data"))

#print(HERE)
print(DATA)
# ---------- end py_2 ----------

Z = UnitZ(Factor=0.8)
number_slider = Slider(2, range=0..10)

number_slider_2 = Slider(0, range=0..6.2)
number_slider_3 = Slider(0, range=0..6.2)
number_slider_4 = Slider(0.25, range=0..5)
number_slider_5 = Slider(0.8, range=0..10)
number_slider_6 = Slider(0.5, range=0..5)
number_slider_7 = Slider(0.4, range=0..10)
number_slider_8 = Slider(2, range=0..10)
number_slider_9 = Slider(5, range=0..10)

crvs = GhPythonScript(
    width=number_slider_9,
    height=number_slider_8,
    up_a=number_slider_6,
    up_f=number_slider_7,
    up_ro=number_slider_3,
    down_a=number_slider_6,
    down_f=number_slider_7,
    down_ro=number_slider_3)  # -> base, base_crv, top, top_crv
# ---------- crvs: Python ----------
__author__ = "timda"
__version__ = "2023.07.15"

import rhinoscriptsyntax as rs
import math
from Rhino.Geometry import Point3d, Vector3d, Curve
from Rhino.Collections import Point3dList

class CrvParams:
    def __init__(self, amp, freq, ro):
        self.amp = amp
        self.freq = freq
        self.ro = ro
    def crv(self, width, height):
        points = []
        iterator = [i*0.1 for i in range(int(width/0.1 +1.999))]
        for x in iterator:
            points.append(Point3d(x, -self.amp*math.sin(2.0 * math.pi * self.freq*x + self.ro), height))
        
        points = Point3dList(points)
        start_tangent = Vector3d(iterator[0], self.amp * 2.0 * math.pi * self.freq * math.cos(2.0 * math.pi * self.freq*iterator[0] + self.ro), 0)
        end_tangent = Vector3d(iterator[0], self.amp * 2.0 * math.pi * self.freq * math.cos(2.0 * math.pi * self.freq*iterator[-1] + self.ro), 0)
        self.curve = Curve.CreateInterpolatedCurve(points, 3)
        return self.curve


base = CrvParams(down_a, down_f, down_ro)
base_crv = base.crv(width, 0)
top = CrvParams(up_a, up_f, up_ro)
top_crv = top.crv(width, height)
# ---------- end crvs ----------

crv = Curve(crvs.base_crv)
crv_2 = Curve(crvs.top_crv)
rulesrf = RuledSurface(CurveA=crv, CurveB=crv_2)

number_slider_10 = Slider(0.05, range=0..0.1)
brep = Brep(rulesrf)
brep_to_mesh = GhPythonScript(
    brep=brep,
    w=number_slider_9,
    h=number_slider_8,
    elsize=number_slider_10,
    max_size=number_slider_10,
    min_size=number_slider_10,
    base=crvs.base,
    top=crvs.top)  # -> rmesh, wall; inputs brep: Brep
# ---------- brep_to_mesh: Python ----------
__author__ = "timda"
__version__ = "2023.07.14"

import rhinoscriptsyntax as rs
from compas_ghpython.artists import MeshArtist
from add_on_am import NewWall

wall = NewWall(w, h, elsize)
wall.undulate(top, base)
mesh = wall.from_brep(brep, max_size, min_size)
mesh_art = MeshArtist(mesh)
rmesh = mesh_art.draw_mesh()
# ---------- end brep_to_mesh ----------
mcol = MeshColours(Mesh=brep_to_mesh.rmesh, Colours=ColourSwatch(SwatchColor=RGB(82, 82, 82)))

envelope = GhPythonScript(
    wall=mcol,
    r_out=Slider(1.7, range=0..10),
    h_out=Slider(0.72, range=0..3),
    r_in=Slider(0.4, range=0..1),
    h_in=Slider(1.32, range=0..2),
    z_offset=Slider(-0.7, range=-1..1))  # -> envelope, wall; inputs wall: Mesh
# ---------- envelope: Python ----------
import Rhino.Geometry as rg
import Rhino as rc

#class Envelope:
#    def __init__(self, r_out, h_out, r_in, h_in, z_offset):
#        self.reach = self.create_sphere_cylinder(r_out, h_out)
#        self.deadzone = self.create_sphere_cylinder(r_in, h_in)
#        self.deadzone.Translate(0, 0, z_offset)
#        self.envelope = rg.Mesh()
#        self.envelope.Append([self.reach, self.deadzone])
#        self.envelope.Translate(1, 0, 0)
#    
#    def create_sphere_cylinder(self, r, h):
#        sphere = rg.Sphere(rg.Point3d(0, 0, 0,), r)
#        sph_cyl = rg.Mesh.CreateFromSphere(sphere, 16, 32)
#        
#        to_delete = []
#        sph_cyl.FaceNormals.ComputeFaceNormals()
#        for i, normal in enumerate(sph_cyl.FaceNormals):
#            if normal.Z > 0:
#                to_delete.append(i)
#        top_sphere = sph_cyl.Faces.ExtractFaces(to_delete)
#        top_sphere.Translate(0, 0, h)
#        
#        cylinder = rg.Cylinder(rg.Circle(rg.Point3d(0, 0, 0), r), h)
#        cylinder = rg.Mesh.CreateFromCylinder(cylinder, 10, 16, False, False)
#        
#        sph_cyl.Append([cylinder, top_sphere])
#        return sph_cyl
#
#e = Envelope(r_out, h_out, r_in, h_in, z_offset)
#meshes = []
#meshes.append(wall)
#meshes.append(e.envelope)
#intersections = rg.Intersect.Intersection.MeshMesh(meshes, 1.0e-10, False, False, None, None, None)
#
#reach = e.reach
#deadzone = e.deadzone
#envelope = e.envelope


class Envelope:
    def __init__(self, wall, r_out, h_out, r_in, h_in, z_offset, z):
        self.mesh = wall
        self.r_out = r_out
        self.r_in = r_in
        self.h_out = h_out
        self.h_in = h_in
        self.z_offset = z_offset
        self.x = 0
        self.y = 0
        self.z = z
        
    def get_intersection(self, x=0, y=0, z=0, p=None):
        if p != None:
            self.x = p.X
            self.y = p.Y
            self.z = p.Z
        inside = []
        for i, vertex in enumerate(self.mesh.Vertices):
            condition1 = [vertex.Z > self.h_out+self.z, vertex.Z < self.z]
            condition2 = {
            "cylinder": (vertex.X-self.x)**2 + (vertex.Y-self.y)**2 < self.r_out**2,
            "upper circle": (vertex.X-self.x)**2 + (vertex.Y-self.y)**2 + (vertex.Z-self.h_out-self.z)**2 < self.r_out**2,
            "lower circle": (vertex.X-self.x)**2 + (vertex.Y-self.y)**2 + (vertex.Z-self.z)**2 < self.r_out**2
            }
            outside_condition = ((not (condition1[0] or condition1[1])) and condition2["cylinder"]) or (condition1[0] and condition2["upper circle"]) or (condition1[1] and condition2["lower circle"])
            
            condition1 = [vertex.Z-self.z_offset > self.h_in+self.z, vertex.Z-self.z_offset < self.z]
            condition2 = {
            "cylinder": (vertex.X-self.x)**2 + (vertex.Y-self.y)**2 > self.r_in**2,
            "upper circle": (vertex.X-self.x)**2 + (vertex.Y-self.y)**2 + (vertex.Z-(self.h_in+self.z_offset)-self.z)**2 > self.r_in**2,
            "lower circle": (vertex.X-self.x)**2 + (vertex.Y-self.y)**2 + (vertex.Z-self.z_offset-self.z)**2 > self.r_in**2
            }
            # inside_condition = ((not (condition1[0] or condition1[1])) and condition2["cylinder"]) or (condition1[0] and condition2["upper circle"]) or (condition1[1] and condition2["lower circle"])
            if not (condition1[0] or condition1[1]):
                inside_condition = condition2["cylinder"]
            elif condition1[0]:
                inside_condition = condition2["upper circle"]
            elif condition1[1]:
                inside_condition = condition2["lower circle"]
            else:
                inside_condition = False
            
            if inside_condition and outside_condition:
                inside += wall.Vertices.GetVertexFaces(i)
        return self.mesh.DuplicateMesh().Faces.ExtractFaces(inside)
        
    def create_mesh(self):
        reach = self.create_sphere_cylinder(self.r_out, self.h_out)
        deadzone = self.create_sphere_cylinder(self.r_in, self.h_in)
        deadzone.Translate(0, 0, self.z_offset)
        e = rg.Mesh()
        e.Append([reach, deadzone])
        e.Translate(self.x, self.y, self.z)
        return e
    
    def create_sphere_cylinder(self, r, h):
        sphere = rg.Sphere(rg.Point3d(0, 0, 0), r)
        sph_cyl = rg.Mesh.CreateFromSphere(sphere, 16, 32)
        
        to_delete = []
        sph_cyl.FaceNormals.ComputeFaceNormals()
        for i, normal in enumerate(sph_cyl.FaceNormals):
            if normal.Z > 0:
                to_delete.append(i)
        top_sphere = sph_cyl.Faces.ExtractFaces(to_delete)
        top_sphere.Translate(0, 0, h)
        
        cylinder = rg.Cylinder(rg.Circle(rg.Point3d(0, 0, 0), r), h)
        cylinder = rg.Mesh.CreateFromCylinder(cylinder, 10, 16, False, False)
        
        sph_cyl.Append([cylinder, top_sphere])
        return sph_cyl
        
envelope = Envelope(wall, r_out, h_out, r_in, h_in, z_offset, 1.15)
in_mesh = envelope.get_intersection(1.1, r_in, 0)
# ---------- end envelope ----------
seperation = GhPythonScript(crv=crv, z=Slider(1.2, range=0..10), envelope=envelope.envelope, wall=brep_to_mesh.wall, switch_sides=Toggle(True))  # -> total_mesh, meshes, meshes_envelope, points, p_dist, int_p; inputs crv: Curve
# ---------- seperation: Python ----------
import Rhino.Geometry as rg
import math
from Rhino.Geometry import Brep, Intersect


whole_mesh = rg.Mesh()
meshes = []
meshes_envelope = [] # rg.Mesh()
if 0 < z < envelope.r_out:
    dist_bottom = math.sqrt((envelope.r_out)**2 - (z)**2 - envelope.r_in**2)
elif z < 0:
    dist_bottom = math.sqrt((envelope.r_out)**2 - envelope.r_in**2)
else:
    dist_bottom = 0
    
if wall.height-envelope.h_out-envelope.r_out < z < wall.height-envelope.h_out:
    dist_top = math.sqrt((envelope.r_out)**2 - (z+envelope.h_out-wall.height)**2 - envelope.r_in**2)
elif z > wall.height-envelope.h_out:
    dist_top = math.sqrt((envelope.r_out)**2 - envelope.r_in**2)
else:
    dist_top = 0

dist = min([dist_top, dist_bottom])


crv.Translate(0, 0, z)

# divide the wall with points that are equally spaced, the first point must not be at zero but at distance dist from 0
temp = crv.Split(crv.ClosestPoint(crv.DivideEquidistant(dist)[1])[1])[1]
points_t = temp.DivideEquidistant(dist*2)
points = points_t
if crv.PointAtEnd.DistanceTo(points_t[-1]) > dist:
    points = [point for point in points_t]
    points.append(crv.PointAtEnd)

p_dist = points_t

for i, point in enumerate(points):
    normal = crv.TangentAt(crv.ClosestPoint(point)[1])
    if switch_sides:
        curvature = crv.CurvatureAt(crv.ClosestPoint(point)[1]).Y
        crv_sign = curvature/abs(curvature)
    else:
        crv_sign = 1.0
    normal.Rotate(crv_sign*math.pi/2, rg.Vector3d(0, 0, 1.0))
    normal.Unitize()
    
    point += (envelope.r_in*normal)
    points[i] = point
    mesh = envelope.get_intersection(p=point)
    if mesh != None:
        meshes.append(envelope.get_intersection(p=point))
        whole_mesh.Append(envelope.get_intersection(p=point))
    meshes_envelope.append(envelope.create_mesh())

overlap = whole_mesh.Faces.ExtractDuplicateFaces()


# checking each face that appears twice for its second closest point and then removing it from the mesh that is associated with that point
# the points are the robots positions
for i, face in enumerate(overlap.Faces):
    center = overlap.Faces.GetFaceCenter(i)
    distance = []
    for point in points:
        distance.append(center.DistanceTo(point))
    for d in sorted(set(distance))[1:]:
        i_mesh_to_delete_from = distance.index(d)
        duplicate_face = meshes[i_mesh_to_delete_from].ClosestMeshPoint(center,0.05)
        if duplicate_face:
            i_face_to_delete = duplicate_face.FaceIndex
            meshes[i_mesh_to_delete_from].Faces.DeleteFaces([i_face_to_delete])

total_mesh = rg.Mesh()
total_mesh.Append(meshes)

#
#points = []
#whole_mesh = rg.Mesh()
#meshes_envelope = rg.Mesh()
#dist = math.sqrt((envelope.r_out)**2 - (z+envelope.h_out-wall.height)**2 - envelope.r_in**2)
#crv.Translate(0, 0, z)
#k = crv.LengthParameter(dist)[1]
#t = k
#while t < crv.LengthParameter(crv.GetLength())[1]+k:
#    normal = crv.TangentAt(t)
#    if switch_sides:
#        curvature = crv.CurvatureAt(t).Y
#        crv_sign = curvature/abs(curvature)
#    else:
#        crv_sign = 1.0
#    normal.Rotate(crv_sign*math.pi/2, rg.Vector3d(0, 0, 1.0))
#    normal.Unitize()
#    point = crv.PointAt(t)
#    
#    point += (envelope.r_in*normal)
#    points.append(point)
#    mesh = envelope.get_intersection(p=point)
#    if mesh != None:
#        whole_mesh.Append(envelope.get_intersection(p=point))
#    meshes_envelope.Append(envelope.create_mesh())
#    t_old = t
#    t += 2*k


#top_edges = []
#for mesh in meshes:
#    edges = mesh.GetNakedEdges()[0].BreakAtAngles(math.pi/2)
#    for i, edge in enumerate(edges):
#        edge = edge.ToPolylineCurve()
#        if edge.PointAtStart.Z == wall.height and edge.PointAtEnd.Z == wall.height:
#            top_edges.append(edge)
#
#for edge in enumerate(top_edges[1:]):
#    split = 

crv.Translate(0, 0, -z)
crv_top = crv.Duplicate()
crv_top.Translate(0, 0, wall.height)
int_p = []
for mesh in meshes_envelope:
    b = Brep.CreateFromMesh(mesh, True)
    intersect = Intersect.Intersection.CurveBrep(crv, b, 0.001)[2]
    for p in intersect:
        int_p.append(p)
    
    intersect = Intersect.Intersection.CurveBrep(crv_top, b, 0.001)[2]
    for p in intersect:
        int_p.append(p)
# ---------- end seperation ----------
mesh = Mesh(seperation.total_mesh)
mesh_2 = Mesh(seperation.meshes_envelope)
pt = Point(seperation.points)

mesh_3 = Mesh(seperation.meshes)
pt_2 = Point(seperation.p_dist)
move = Move(Geometry=pt_2, Motion=Z)  # -> Geometry, Transform
pt_3 = Point(seperation.int_p)
item = ListItem(List=mesh_3, Index=number_slider, Wrap=True)
item_2 = ListItem(List=pt, Index=number_slider, Wrap=True)
mcol_2 = MeshColours(Mesh=item, Colours=ColourSwatch(SwatchColor=RGB(255, 0, 0)))
