# Grasshopper definition segmentation_path_finding.ghx (Grasshopper 1.0.7)

# ---- group: DESIGN / Shape Initialization
number_slider = Slider(0, range=0..360)
number_slider_2 = Slider(2, range=0..10)
number_slider_3 = Slider(0, range=0..10)
number_slider_4 = Slider(0.05, range=0..0.1)
number_slider_5 = Slider(0, range=0..10)
number_slider_6 = Slider(5, range=0..10)
toggle = BooleanToggle(False)

# ---- group: DESIGN
create_wall = GhPythonScript(
    init=Button(),
    width=number_slider_6,
    height=number_slider_2,
    elsize=number_slider_4,
    x=number_slider_5,
    y=number_slider_3,
    rotation=number_slider,
    double_layer=toggle)  # -> wall
# ---------- create_wall: Python ----------
from add_on_am import Wall

import random
# create wall
wall = Wall(width, height, elsize, x, y, rotation)

print(wall.x_size, wall.z_size)
# ---------- end create_wall ----------

# ---- group: UNDULATION
number_slider_7 = Slider(0, range=0..6.2)
number_slider_8 = Slider(0.5, range=0..5)
number_slider_9 = Slider(0.4, range=0..10)
base_sine_crv = GhPythonScript(width=number_slider_6, a=number_slider_8, f=number_slider_9, ro=number_slider_7)  # -> c_curve, curve
# ---------- base_sine_crv: Python ----------
import Rhino.Geometry as rg
from Rhino.Collections import Point3dList
from compas.geometry import NurbsCurve 
import math

points = []
iterator = [i*0.1 for i in range(int(width/0.1 +1.999))]
for x in iterator:
    points.append(rg.Point3d(x, -a*math.sin(2.0 * math.pi * f*x + ro), 0))

points = Point3dList(points)
start_tangent = rg.Vector3d(iterator[0], a * 2.0 * math.pi * f * math.cos(2.0 * math.pi * f*iterator[0] + ro), 0)
end_tangent = rg.Vector3d(iterator[0], a * 2.0 * math.pi * f * math.cos(2.0 * math.pi * f*iterator[-1] + ro), 0)
curve = rg.Curve.CreateInterpolatedCurve(points, 3)


c_curve = NurbsCurve().from_interpolation(points)
print(c_curve)
# ---------- end base_sine_crv ----------
undulate = GhPythonScript(
    wall=create_wall,
    up_amp=Slider(0.25, range=0..5),
    up_freq=Slider(0.8, range=0..10),
    up_phase=Slider(0, range=0..6.2),
    down_amp=number_slider_8,
    down_freq=number_slider_9,
    down_phase=number_slider_7)  # -> wall
# ---------- undulate: Python ----------
wall.undulate(up_amp, up_freq, up_phase ,down_amp, down_freq, down_phase)
# ---------- end undulate ----------

# ----
envelope = GhPythonScript(
    r_out=Slider(1.3, range=0..10),
    h_out=Slider(0.72, range=0..3),
    r_in=Slider(0.55, range=0..1),
    h_in=Slider(0.3, range=0..1),
    z_offset=Slider(0, range=0..1),
    base_crv=base_sine_crv.c_curve)  # -> mesh, points, crvs_in, crvs_out, envelope; inputs crvs: list of Curve
# ---------- envelope: Python ----------
from Rhino.Geometry.Intersect.Intersection import MeshPolyline
from add_on_am import Envelope
from compas.artists import MeshArtist
from compas_rhino.conversions import polyline_to_compas
import math

z = 1.049
c_crvs = []
for i, crv in enumerate(crvs):
    c_crvs.append(polyline_to_compas(crv.ToPolyline()))

envelope = Envelope(r_out, h_out, r_in, h_in, z_offset, 0, 0, z)

def intersections(intersection_mesh, curves):
    inter_points = []
    for curve in curves:
        inter = MeshPolyline(intersection_mesh, curve)
        if inter[1]:
            inter_points += inter[0]
    return inter_points

#c, max_in = envelope.iterate(c_crvs, base_crv)
#print(c, max_in)
#
## takes 3sek???
#i_in, i_out = envelope.crvs_inside(c_crvs, True, True)
#crvs_in = [[], []]
#crvs_out = []
#for i, crv in enumerate(crvs):
#    if i in i_in:
#        crvs_in[0].append(crv)
#    elif i in i_out:
#        crvs_out.append(crv)


i_out = range(len(c_crvs))
crvs_in = []

for k in range(5):
    if len(i_out)==0:
        break 
    crvs_in.append([])
    c, max_in = envelope.iterate([c_crvs[i] for i in i_out], base_crv)
    print(c, max_in)
    
    # takes 3sek???
    i_in, i_out = envelope.crvs_inside(c_crvs, True, True)
    crvs_out = []
    for i, crv in enumerate(crvs):
        if i in i_in:
            crvs_in[k].append(crv)
        elif i in i_out:
            crvs_out.append(crv)

envelope.draw_mesh()
artist = MeshArtist(envelope.mesh_out)
mesh = artist.draw()
# ---------- end envelope ----------
crv = Curve(envelope.crvs_out)
pt = Point(envelope.points)
mesh = Mesh(envelope.mesh)

reload = Button()
py = PythonScript(reload=reload)
# ---------- py: Python ----------
from compas_rhino.utilities.misc import get_tolerance
from compas_rhino.utilities.misc import unload_modules

from compas_ghpython import unload_modules

unload_modules("compas")
unload_modules("compas_fab")
unload_modules("roslibpy")
unload_modules("fabrication_control")
unload_modules("assembly_information_model")
unload_modules("am_information_model")
unload_modules("ur_fabrication_control")
unload_modules("workshop_aaec_revamp")
unload_modules("add_on_am")
unload_modules("mobile_part_based_am")
# ---------- end py ----------
py_2 = PythonScript()  # -> HERE, DATA
# ---------- py_2: Python ----------
import os

HERE = os.path.dirname(ghdoc.Path)
DATA = os.path.abspath(os.path.join(HERE, "..", "data"))

#print(HERE)
print(DATA)
# ---------- end py_2 ----------

# ----
# Path planner
path_type = ValueList({"Lowest Axis Path": 1, "Lowest Axis Path Combined": 2, "Lowest Axis Path Priority": 3, "Lowest Axis Path Adjusted": 4, "Centroid Path": 5, "Boundary Path": 6, "Corners Path": 7, "Random Path Adjusted": 8, "Lowest Neighbors Path": 9}, selected="Lowest Axis Path")
orientation = ValueList({"X-axis": "x", "Y-axis": "y", "Z-axis": "z"}, selected="X-axis")

# ---- group: VISUALIZATION
visualize = GhPythonScript(wall=undulate, show_mesh=Toggle(True), show_window=Toggle(True), delete_window=Toggle(True))  # -> rhmesh, vertices_window, vertices_support, wall
# ---------- visualize: Python ----------
from compas_ghpython.artists import MeshArtist
import Rhino.Geometry as rg

rh_mesh = []
vertices_gate = []
vertices_all = []
disp_vectors = []
#
#if delete_window:
#    for vertex in wall.window_vertices:
#        wall.mesh.delete_vertex(vertex)
#        print("test")



if show_mesh:
    # Mesh Artist for visualization
    artist = MeshArtist(wall.mesh)
    rhmesh = artist.draw_mesh()

#
#if show_window:
    k = []
#    for vertex in wall.mesh.vertices():
#        gp = wall.mesh.vertex_attribute(vertex, name='window')
#        if gp: k.append(vertex)
#    
#    print k
#    if len(k): vertices_window = artist.draw_vertices(vertices=k)

for vertex in wall.mesh.vertices():
    if wall.mesh.vertex_attribute(vertex, name='z') < 0.025:
        k.append(vertex)
if len(k): vertices_support = artist.draw_vertices(vertices=k)
# ---------- end visualize ----------
swatch = ColourSwatch(SwatchColor=RGB(82, 82, 82))

# ----
tool_path_planning = GhPythonScript(compute=Button(), path_type=path_type, orientation=orientation, mesh=visualize.rhmesh)  # -> planner, points, edges, n; inputs center: Point3d
# ---------- tool_path_planning: Python ----------
import compas
from compas_rhino.geometry import RhinoMesh
from Rhino.Geometry import Point3d
from add_on_am import SurfacePathPlanner
from compas_ghpython.utilities import draw_network, draw_frame
from compas.colors import Color

rmesh = RhinoMesh.from_guid(mesh)
planner = SurfacePathPlanner()
planner.set_quad_mesh_from_rhinomesh(rmesh)
planner.set_network_nodes()
#planner.set_color_map([
#    Color.from_rgb255(128,255,255),
#    Color.from_rgb255(255,255,0),
#    Color.from_rgb255(255,0,0)])
#planner.set_thickness_map([
#    0.008,
#    0.010,
#    0.012])
#center = Point3d(0, 0, 0)
#print(orientation)
#planner.map_reachability(reachabilitymap, center)


if path_type == 1:
    [network, n] = planner.lowest_axis_path(orientation)

#planner.calculate_fabrication_parameters()

points, edges = draw_network(network)   
#planes = []
#tool_planes = []
#cylinders = []
#colors = []
#for k in planner.network.path:
#    frame = planner.network.node_attribute(key=k, name='frame')
#    plane = draw_frame(frame)
#    planes.append(plane)

# print(planner.network.node_attributes(key=0))
# ---------- end tool_path_planning ----------
pt_2 = Point(tool_path_planning.points)
panel = Panel(tool_path_planning.n)

line = Line(tool_path_planning.edges)

pt_3 = Point(visualize.vertices_window)
mcol = MeshColours(Mesh=visualize.rhmesh, Colours=swatch)

# ----
# Path planner
path_type_2 = ValueList({"Lowest Axis Path": 1, "Lowest Axis Path Combined": 2, "Lowest Axis Path Priority": 3, "Lowest Axis Path Adjusted": 4, "Centroid Path": 5, "Boundary Path": 6, "Corners Path": 7, "Random Path Adjusted": 8, "Lowest Neighbors Path": 9}, selected="Lowest Axis Path")
orientation_2 = ValueList({"X-axis": "x", "Y-axis": "y", "Z-axis": "z"}, selected="Z-axis")
tool_path_planning_2 = GhPythonScript(
    compute=Button(),
    path_type=path_type_2,
    orientation=orientation_2,
    min_ri=Slider(50, range=0..100),
    wall=visualize.wall,
    envelope=envelope.envelope)  # -> planner, points, edges, n, pos
# ---------- tool_path_planning_2: Python ----------
import compas
from compas_rhino.geometry import RhinoMesh
from Rhino.Geometry import Point3d
from add_on_am import SurfacePathPlanner_two
from compas_ghpython.utilities import draw_network, draw_frame
from compas.colors import Color

planner = SurfacePathPlanner_two(wall, 0.3, envelope)
planner.set_network_nodes()
planner.create_pos_network()

[network, position] = planner.section_path(min_ri=min_ri)

points, edges = draw_network(network)
print(position)

# check if positions is list
if isinstance(position, list):
    pos = []
    for node in position:
        [x, y, z] = planner.pos_network.node_coordinates(node)
        pos.append(Point3d(x, y, z))
else:
    [x, y, z] = planner.pos_network.node_coordinates(position)
    pos = Point3d(x, y, z)
# ---------- end tool_path_planning_2 ----------
line_2 = Line(tool_path_planning_2.edges)
pt_4 = Point(tool_path_planning_2.points)
panel_2 = Panel(tool_path_planning_2.n)

dots = DotDisplay(Point=tool_path_planning_2.pos, Colour=ColourSwatch(SwatchColor=RGB(255, 0, 0)), Size=Slider(0.02, range=0..0.1))
preview = CustomPreview(
    Geometry=line_2,
    Material={diffuse=RGB(221, 160, 221), emission=RGB(66, 48, 66), shine=0.5, specular=RGB(255, 255, 255), transparency=0})

sectioning = GhPythonScript(wall=undulate, envelope=envelope.envelope, planner=tool_path_planning.planner)  # -> network, map, pos_i, last_i, positions_list
# ---------- sectioning: Python ----------
__author__ = "timda"
__version__ = "2023.05.11"

import rhinoscriptsyntax as rs
from add_on_am import Map2d_optimized

map = Map2d_optimized(wall, 0.3)
network = map.create_network(envelope)
pos_i, last_i, positions_list = map.pos_by_path(planner, envelope, reachability_map)

pos_i = [pos_i]
last_i = [last_i]
# ---------- end sectioning ----------
number_slider_10 = Slider(5, range=0..10)

visualization = GhPythonScript(
    pos_i=sectioning.pos_i,
    last_i=sectioning.last_i,
    network=sectioning.network,
    map=sectioning.map,
    planner=tool_path_planning.planner,
    envelope=envelope.envelope,
    index=number_slider_10,
    positions_list=sectioning.positions_list)  # -> points, ri, pos, vertices, mesh, poses, positions; inputs pos_i: list, last_i: list, index: Int32, positions_list: list
# ---------- visualization: Python ----------
__author__ = "timda"
__version__ = "2023.05.23"

import rhinoscriptsyntax as rs
from Rhino.Geometry import Point3d
from compas.artists import MeshArtist
from compas_ghpython.utilities import draw_network, draw_frame

points, edges = draw_network(network)

pos_i = pos_i[0]
last_i = last_i[0]

pos = []
for i in pos_i.keys():
    pos.append(points[i])
#for i in last_i:
#    pos.append(points[i])

frames = map.poses(pos_i.values()[index], planner, pos[index])
poses = []
for frame in frames:
    poses.append(draw_frame(frame))

vertices = []
positions = []
for node in pos_i.values()[index]:
    [x, y, z] = planner.network.node_attributes(node, ["x", "y", "z"])
    vertices.append(Point3d(x, y, z))
    positions.append(positions_list[node])

envelope.x = pos[index].X
envelope.y = pos[index].Y

#envelope.draw_mesh()
#artist = MeshArtist(envelope.mesh_out)
#mesh = artist.draw()
# ---------- end visualization ----------

pt_5 = Point(visualization.points)
panel_3 = Panel(visualization.ri)
pt_6 = Point(visualization.vertices)
pt_7 = Point(visualization.pos)
mesh_2 = Mesh(visualization.mesh)
item = ListItem(List=pt_7, Index=number_slider_10, Wrap=True)

pt_8 = Point(item)
