# Grasshopper definition stability_analysis_karamba.ghx (Grasshopper 1.0.7)
# plug-ins: Karamba3D

# ----
# Wall
number_slider = Slider(0.93, range=0..1)
crvs = GhPythonScript(
    width=Slider(5, range=0..10),
    height=Slider(2, range=0..10),
    up_a=Slider(0.1, range=0.1..0.3),
    up_f=Slider(1.15, range=0.6..1.2),
    up_ro=number_slider,
    down_a=Slider(0.49, range=0.3..0.6),
    down_f=Slider(0.59, range=0.4..0.6),
    down_ro=Slider(0.73, range=0..1))  # -> base, base_crv, top, top_crv
# ---------- crvs: Python ----------
__author__ = "timda"
__version__ = "2023.07.15"

import rhinoscriptsyntax as rs
import math
from Rhino.Geometry import Point3d, Vector3d, Curve
from Rhino.Collections import Point3dList

class CrvParams:
    def __init__(self, amp, freq, ro):
        self.amp = amp
        self.freq = freq
        self.ro = ro*math.pi
    def crv(self, width, height):
        points = []
        iterator = [i*0.1 for i in range(int(width/0.1 +1.999))]
        for x in iterator:
            points.append(Point3d(x, -self.amp*math.sin(2.0 * math.pi * self.freq*x + self.ro), height))
        
        points = Point3dList(points)
        start_tangent = Vector3d(iterator[0], self.amp * 2.0 * math.pi * self.freq * math.cos(2.0 * math.pi * self.freq*iterator[0] + self.ro), 0)
        end_tangent = Vector3d(iterator[0], self.amp * 2.0 * math.pi * self.freq * math.cos(2.0 * math.pi * self.freq*iterator[-1] + self.ro), 0)
        self.curve = Curve.CreateInterpolatedCurve(points, 3)
        return self.curve


base = CrvParams(down_a, down_f, down_ro)
base_crv = base.crv(width, 0)
top = CrvParams(up_a, up_f, up_ro)
top_crv = top.crv(width, height)
# ---------- end crvs ----------
crv = Curve(crvs.base_crv)
crv_2 = Curve(crvs.top_crv)
rulesrf = RuledSurface(CurveA=crv, CurveB=crv_2)

matselect = MaterialSelectionKaramba3D(menu=[dropdown(7), dropdown(6)])
cross_section = CrossSectionKaramba3D(FamilyNameOfCrossSection="DefaultCroSec", Material=matselect, Height_cm=10, mode="Shell - Const")

number_slider_2 = Slider(0.1, range=0..0.1)

# ----
# Assamble
divlength = DivideLength(Curve=crv_2, Length=number_slider_2)  # -> Points, Tangents, Parameters
divlength_2 = DivideLength(Curve=crv, Length=number_slider_2)  # -> Points, Tangents, Parameters
supp = SupportKaramba3D(PosInd=divlength_2.Points, menu=[buttons(on, on, on, off, off, off)])

neg = Negative(Value=number_slider_2)
Z = UnitZ(Factor=neg)
loads = LoadsKaramba3D(ForceVector=Z, Local=False, PosInd=divlength.Points, LCase="0", mode="Point")

mesh_breps = MeshBrepsKaramba3D(
    Brep=rulesrf,
    InclusionPoints=[divlength.Points, divlength_2.Points],
    MeshResolution=number_slider_2,
    EdgeRefinementFactor=0.67,
    PointReduction=False,
    SmoothingStepSize=0,
    SmoothingIterations=5)  # -> Mesh, Info
meshtoshell = MeshToShellKaramba3D(Mesh=mesh_breps.Mesh, LimitDistance_m=0.005)  # -> Element, Points, Info

assemble = AssembleModelKaramba3D(Elem=meshtoshell.Element, Support=supp, Load=loads, CrossSection=cross_section, LimitDistance_m=0.005)  # -> Model, Info, Mass_kg, CenterOfGravity, LoadCaseNames
modelview = ModelViewKaramba3D(Model=assemble.Model, ResultFactors=1, ResultCase=-1)  # -> Model, DeformedMesh, DeformedAxes, DeformedModel

analyzethii = AnalyzeThIIKaramba3D(Model=assemble.Model, LoadCase="0", RTolerance=1e-07, MaxIterations=50, NoTensionalNII=True)  # -> CalculatedModel, MaximumDisplacement_cm, ResultingForceOfGravity_kN, ElasticEnergyChange_kNm
bmodes = BucklingModesKaramba3D(Model=analyzethii.CalculatedModel, FromIndex=1, NumberOfModes=3, MaximumNumberOfIterations=300, Epsilon=1e-07)  # -> ModelWithBucklingModesAsLoadCaseResults, BucklingLoadFactors
panel = Panel(bmodes.BucklingLoadFactors)

# ----
# Eigenmodes
emodes = EigenModesKaramba3D(Model=assemble.Model, FromIndex=1, NumberOfModes=3, MaximumNumberOfIterations=300, Epsilon=1e-07)  # -> ModelWithEigenModesAsLoadCaseResults, Eigenvalues

# ----
# Output
modelview_2 = ModelViewKaramba3D(Model=bmodes.ModelWithBucklingModesAsLoadCaseResults, ResultFactors=1, ResultCase=-1)  # -> Model, DeformedMesh, DeformedAxes, DeformedModel
disassemble = DisassembleModelKaramba3D(Model=bmodes.ModelWithBucklingModesAsLoadCaseResults)  # -> Model, Point, Beam, Shell, Support, Load, Line, Mesh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
preview = CustomPreview(Geometry=modelview_2.DeformedMesh, Material=ColourSwatch(SwatchColor=RGB(194, 194, 194)))
disassemble_2 = DisassembleElementKaramba3D(Element=disassemble.Shell)  # -> Element, ElementIdentifier, AxisOfElement, CrossSection, Joint, Material, LocalCoordinateSystem, ElementIsActive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

# ----
# Imperfection for Kiwi3D!
python = GhPythonScript(mesh=modelview.DeformedMesh, mesh_def=modelview_2.DeformedMesh)  # -> points; inputs mesh: Mesh, mesh_def: Mesh
# ---------- python: Python ----------
__author__ = "timda"
__version__ = "2023.08.18"

import rhinoscriptsyntax as rs

points = []
vertices = list(mesh.Vertices)
for i, v in enumerate(vertices):
    if v.Z >= 1.975:
        
        points.append(list(mesh_def.Vertices)[i])
points = sorted(points , key=lambda k: k.X)
points = points[:-1]
# ---------- end python ----------
intcrv = Interpolate(Vertices=python, Degree=3, Periodic=False, KnotStyle=1)  # -> Curve, Length, Domain
vec2pt = Vector2Pt(PointA=divlength.Points, PointB=python, Unitize=False)  # -> Vector, Length
rulesrf_2 = RuledSurface(CurveA=crv, CurveB=intcrv.Curve)
python_2 = GhPythonScript(v=vec2pt.Vector, length=vec2pt.Length)  # -> max_l, min_l, avg_l; inputs v: list of Vector3d, length: list
# ---------- python_2: Python ----------
__author__ = "timda"
__version__ = "2023.08.18"

import rhinoscriptsyntax as rs

max_l = max(length)
min_l = min(length)
avg_l = sum(length)/len(length)

print(max_l)
print(length)
#
#max_v = v[length.index(max_l)]
#min_v = v[length.index(min_l)]
#avg_v = v[length.index(avg_l)]
# ---------- end python_2 ----------
brep = Brep(rulesrf_2)
preview_2 = CustomPreview(Geometry=brep, Material=ColourSwatch(SwatchColor=RGBA(255, 0, 0, 150)))
panel_2 = Panel([python_2.max_l, python_2.min_l, python_2.avg_l])
panel_3 = Panel("""0.07083
0.001144
0.03827""")
brep_10 = Brep(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)
panel_4 = Panel("""0.035415
0.000572
0.019135""")
brep_5 = Brep(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)
panel_5 = Panel("""0.007083
0.000114
0.003827""")
brep_1 = Brep(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)
