# Grasshopper definition stability_analysis_kiwi.ghx (Grasshopper 1.0.7)
# plug-ins: Kiwi3d

panel = Panel("""0.07083
0.001144
0.03827""")
brep_10 = Brep(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)
panel_2 = Panel("""0.035415
0.000572
0.019135""")
brep = Brep(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)
brep_5 = Brep(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)
panel_3 = Panel("""0.007083
0.000114
0.003827""")
brep_1 = Brep(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)
brep_2 = Brep(brep)
wires = BrepWireframe(Brep=brep_2, Density=-1)
item = ListItem(List=wires, Index=0, Wrap=True)
item_2 = ListItem(List=wires, Index=2, Wrap=True)
multiplication = Multiplication(A=Slider(1, range=0..1000), B=Slider(1000, range=0..10000))
visopt = VisualizeOptions(
    ScaleCrossSections=1,
    ScaleSupports=Slider(0.2, range=-0.5..0.5),
    ScaleLoads=Slider(0.0005, range=0..0.001),
    ScaleCouplingPoints=1,
    ScaleConnectingPoints=1,
    ScaleRefinedControlPoints=1,
    ColourBeam=RGB(211, 211, 211),
    ColourCable=RGB(255, 255, 255),
    ColourSupports=RGB(232, 65, 119),
    ColourLoads=RGB(232, 65, 119),
    ColourConnects=RGB(255, 255, 255),
    ColourRefinedPatches=RGB(139, 0, 0),
    ColourSliding=RGB(135, 16, 55))

number_slider = Slider(11, range=0..100)
series = Series(Start=Slider(0, range=0..1000), Step=Slider(2, range=0..5), Count=number_slider)
series_2 = Series(Start=0, Step=1, Count=number_slider)
panel_4 = Panel(series)
ldc = LoadDisplCurve(TimeStepList=series_2, ValueList=series)
list = ValueList({"Displacements": 1, "Stresses": 2, "SupportForces": 3}, selected="Displacements")
nonlina = NonLinearAnalysis(
    Name="Non_Linear_0",
    Iterations=Slider(100, range=0..1000),
    EquilibriumAccurancy=0.001,
    OutputSetting=list,
    GlobalLDCurve=ldc,
    AdaptiveForceControl=Slider(3, range=0..10),
    OutputFrequency=1)

list_2 = ValueList({"STEEL": 1, "WOOD": 2, "GFRP": 3, "ETFE (Membrane)": 4, "CONCRETE": 5, "ALUMINIUM": 6}, selected="CONCRETE")
matdef = MaterialDefaults(Type=list_2, IsNmm2=False, IskNcm2=False, IskNm2=True, mUnit=1)  # -> Material, YoungsModulus, AlphaT, Nue, Density, Strength
srfref = SurfaceRefinement(PDeg=3, QDeg=5, ElementRefU=1, ElementRefV=5, IsKnotApproxElementSize=False, IsKnotSubdivision=True)
list_3 = ValueList({"DEAD": 1, "SNOW": 2, "PRES": 3, "PRES_FL": 4, "MOMENT": 5}, selected="DEAD")
supcrv = SupportCurve(Crv=item, DispX=True, DispY=True, DispZ=True, Rot=False)
shell = ShellElement(Brep=brep_2, Material=matdef.Material, Thickness=0.1, Refinement=srfref, HingeCoupling=False)
crvload = CurveLoad(Crv=item_2, Loadtype=list_3, Direction=Vector(0, 0, -1), Value=multiplication, LoadCase=2)
amodel = AnalysisModel(
    Analysis=nonlina,
    StructuralElements=shell,
    Supports=supcrv,
    Loads=crvload,
    Visualizer=visopt,
    IntersectionTolerance=0.001,
    IsCarat=True,
    IsKratos=False,
    PenaltyFac=10000000,
    ShowCouplingIDs=False,
    ShowEdgeIDs=False,
    ShowGeo=False,
    ShowPatchIDs=False,
    ShowPrePro=True,
    ShowRef=False)

lina = LinearAnalysis(Name="Linear", OutputSetting=list)

demodel = DeconstructModel(Model=amodel)  # -> StructuralElements, RefinedGeometries, GaussPoints, InputText
preview = CustomPreview(Geometry=demodel.RefinedGeometries, Material=ColourSwatch(SwatchColor=RGB(191, 191, 191)))

panel_5 = Panel("C:\Users\timda\Documents\Uni-Programming\revamp\workspace\add_on_am\nlin_analysis")
run_analysis = IGASolver(AnalysisModel=amodel, Path=panel_5, Run=Button(), antiFreeze=False, showWindow=True)  # -> ResultModel, ErrorReport
defmod = DeformedModel(
    Model=run_analysis.ResultModel,
    LoadCase=Slider(10, range=0..20),
    ScaleFactor=Slider(1, range=-10..10),
    FlyingNodeLimit=100000)  # -> Model, Geo, DeformedStructuralElements

preview_2 = CustomPreview(Geometry=defmod.Geo, Material=ColourSwatch(SwatchColor=RGBA(255, 0, 0, 150)))
mesh = MeshBrep(
    Brep=defmod.Geo,
    Settings={GridMaxCount=0, GridMinCount=16, JaggedSeams=False, MaxEdgeLength=0, MinEdgeLength=0.0001, MinTolerance=0, Refine=True, RefineAngle=0, RelativeTolerance=0.65, SimplePlanes=True, Tolerance=0})
demesh = DeconstructMesh(Mesh=mesh)  # -> Vertices, Faces, Colours, Normals
pt = Point(<point referenced from the Rhino model>)
mesh_2 = MeshBrep(
    Brep=brep_2,
    Settings={GridMaxCount=0, GridMinCount=16, JaggedSeams=False, MaxEdgeLength=0, MinEdgeLength=0.0001, MinTolerance=0, Refine=True, RefineAngle=0, RelativeTolerance=0.65, SimplePlanes=True, Tolerance=0})
demesh_2 = DeconstructMesh(Mesh=mesh_2)  # -> Vertices, Faces, Colours, Normals
item_3 = ListItem(List=demesh.Vertices, Index=Slider(2689, range=0..10000), Wrap=True)
python = GhPythonScript(V=demesh_2.Vertices)  # -> a; inputs V: list of Point3d
# ---------- python: Python ----------
__author__ = "timda"
__version__ = "2023.08.13"

import rhinoscriptsyntax as rs

for vertex in V:
    if vertex.X > 4.97 and vertex.Z > 1.97:
        print(vertex, V.index(vertex))
# ---------- end python ----------
swatch = ColourSwatch(SwatchColor=RGB(0, 54, 214))
item_4 = ListItem(List=demesh_2.Vertices, Index=Slider(424, range=0..966), Wrap=True)
dots = DotDisplay(Point=[item_4, pt], Colour=swatch, Size=Slider(0.02, range=0..0.1))
vec2pt = Vector2Pt(PointA=item_4, PointB=pt, Unitize=False)  # -> Vector, Length
vdisex = VectorDisplayEx(Point=item_4, Vector=vec2pt.Vector, Colour=swatch, Width=Slider(10, range=0..10))
