# Grasshopper definition wall.ghx (Grasshopper 1.0.7)
# plug-ins: Karamba3D

reload = Button()
py = PythonScript(reload=reload)
# ---------- py: Python ----------
from compas_rhino.utilities.misc import get_tolerance
from compas_rhino.utilities.misc import unload_modules

from compas_ghpython import unload_modules

unload_modules("compas")
unload_modules("compas_fab")
unload_modules("roslibpy")
unload_modules("fabrication_control")
unload_modules("assembly_information_model")
unload_modules("am_information_model")
unload_modules("ur_fabrication_control")
unload_modules("workshop_aaec_revamp")
unload_modules("add_on_am")
# ---------- end py ----------
py_2 = PythonScript()  # -> HERE, DATA
# ---------- py_2: Python ----------
import os

HERE = os.path.dirname(ghdoc.Path)
DATA = os.path.abspath(os.path.join(HERE, "..", "data"))

#print(HERE)
print(DATA)
# ---------- end py_2 ----------

# ---- group: DESIGN / Shape Initialization
number_slider = Slider(0, range=0..360)
number_slider_2 = Slider(2, range=0..10)
number_slider_3 = Slider(0, range=0..10)
number_slider_4 = Slider(4, range=0..10)
number_slider_5 = Slider(0.05, range=0..0.1)
number_slider_6 = Slider(0, range=0..10)
toggle = BooleanToggle(False)

# ---- group: DESIGN
create_wall = GhPythonScript(
    init=Button(),
    width=number_slider_4,
    height=number_slider_2,
    elsize=number_slider_5,
    x=number_slider_6,
    y=number_slider_3,
    rotation=number_slider,
    double_layer=toggle)  # -> wall
# ---------- create_wall: Python ----------
from add_on_am import Wall

import random
# create wall
wall = Wall(width, height, elsize, x, y, rotation)

print(wall.x_size, wall.z_size)
# ---------- end create_wall ----------

# ----
number_slider_7 = Slider(1, range=0..10)
number_slider_8 = Slider(3, range=0..10)
number_slider_9 = Slider(100, range=0..100)  # disabled
python = GhPythonScript()  # -> out, a
# ---------- python: Python ----------
print(x(a))
# ---------- end python ----------
create_window = GhPythonScript(
    wall=create_wall,
    left=number_slider_7,
    right=number_slider_8,
    top=Slider(1.8, range=0..5),
    bottom=Slider(0.6, range=0..5))  # -> out, wall
# ---------- create_window: Python ----------
if left < right < wall.width and bottom < top < wall.height:
    wall.window((left, top), (right, bottom))
# ---------- end create_window ----------

# ---- group: UNDULATION
undulate = GhPythonScript(
    wall=create_window.wall,
    up_amp=Slider(0.019, range=0..0.1),
    up_freq=Slider(3, range=0..10),
    up_phase=Slider(0, range=0..6.2),
    down_amp=Slider(0.587, range=0..1),
    down_freq=Slider(0.5, range=0..10),
    down_phase=Slider(0, range=0..6.2))  # -> wall
# ---------- undulate: Python ----------
wall.undulate(up_amp, up_freq, up_phase ,down_amp, down_freq, down_phase)
# ---------- end undulate ----------

# ----
list = ValueList({"N1": 0, "N2": 1}, selected="N2")  # disabled
python_2 = GhPythonScript(select=list)  # -> norm_n, red, green, blue; inputs n1: list, n2: list; disabled
# ---------- python_2: Python ----------
if select:
    n = n1
elif not select:
    n = n2

max_n = max(n) # 1
min_n = min(n) # -1
# n=0
norm_n = []
red = []
green = [0 for _ in n]
blue = []
for force in n:
    if force >= 0:
        norm_force = 255*force/max_n
        red.append(255)
        blue.append(0)
    elif force < 0:
        norm_force = 255*force/min_n
        red.append(0)
        blue.append(255)
    norm_n.append(norm_force)
print(len(red), len(blue), len(green))
# ---------- end python_2 ----------

# ---- group: VISUALIZATION
visualize = GhPythonScript(wall=undulate, show_mesh=Toggle(True), show_window=Toggle(True), delete_window=Toggle(True))  # -> rhmesh, vertices_window, vertices_support
# ---------- visualize: Python ----------
from compas_ghpython.artists import MeshArtist
import Rhino.Geometry as rg

rh_mesh = []
vertices_gate = []
vertices_all = []
disp_vectors = []

if delete_window:
    for vertex in wall.window_vertices:
        wall.mesh.delete_vertex(vertex)
        print("test")



if show_mesh:
    # Mesh Artist for visualization
    artist = MeshArtist(wall.mesh)
    rhmesh = artist.draw_mesh()


if show_window:
    k = []
    for vertex in wall.mesh.vertices():
        gp = wall.mesh.vertex_attribute(vertex, name='window')
        if gp: k.append(vertex)
    
    print k
    if len(k): vertices_window = artist.draw_vertices(vertices=k)

for vertex in wall.mesh.vertices():
    if wall.mesh.vertex_attribute(vertex, name='z') < 0.025:
        k.append(vertex)
if len(k): vertices_support = artist.draw_vertices(vertices=k)
# ---------- end visualize ----------
swatch = ColourSwatch(SwatchColor=RGB(54, 45, 35))

# ----
# Forces
number_slider_10 = Slider(10, range=0..10)
cross_section = CrossSectionKaramba3D(
    FamilyNameOfCrossSection="DefaultCroSec",
    Height_cm=number_slider_10,
    ReinforcementAreas_cm2_m=[0, 0, 0, 0],
    ReinforcementConcreteCovers_cm=[3.5, 4.5, -4.5, -3.5],
    PrincipalReinforcementDirection_deg=0,
    mode="Shell RC Standard - Const.")
pt = Point(visualize.vertices_support)
loads = LoadsKaramba3D(Vector=Vector(0, 0, -1), LCase="0", mode="Gravity")
supp = SupportKaramba3D(PosInd=pt, menu=[buttons(on, on, on, off, off, off)])
meshtoshell = MeshToShellKaramba3D(Mesh=visualize.rhmesh, Identifier="Mesh", CrossSection=cross_section, LimitDistance_m=0.005)  # -> Element, Points, Info
assemble = AssembleModelKaramba3D(Elem=meshtoshell.Element, Support=supp, Load=loads, LimitDistance_m=0.005)  # -> Model, Info, Mass_kg, CenterOfGravity, LoadCaseNames
analyze = AnalyzeKaramba3D(Model=assemble.Model)  # -> CalculatedModel, MaximumDisplacement_cm, ResultingForceOfGravity_kN, ElasticEnergyChange_kNm
s_forces = ShellForcesKaramba3D(AnalyzedModel=analyze.CalculatedModel, mode="Local")  # -> AnalyzedModel, Nxx_kN_m, Nyy_kN_m, Nxy_kN_m, Mxx_kNm_m, Myy_kNm_m, Mxy_kNm_m, Vx_kN_m, Vy_kN_m

modelview = ModelViewKaramba3D(Model=analyze.CalculatedModel, ResultFactors=number_slider_9, ResultCase=-1)  # -> Model, DeformedMesh, DeformedAxes, DeformedModel; disabled
mesh = Mesh(modelview.DeformedMesh)  # disabled
shellview = ShellViewKaramba3D(Model=modelview.Model, IndexOfLayer=0)  # -> Model, MeshesOfRenderedShells, LegendColors, LegendTags; disabled
panel = Panel(shellview.LegendTags)  # disabled
disassemble = DisassembleModelKaramba3D(Model=s_forces.AnalyzedModel)  # -> Model, Point, Beam, Shell, Support, Load, Line, Mesh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; disabled
mesh_2 = Mesh(shellview.MeshesOfRenderedShells)  # disabled
number_slider_11 = Slider(255, range=0..1000)  # disabled
demesh = DeconstructMesh(Mesh=mesh_2)  # -> Vertices, Faces, Colours, Normals; disabled
panel_2 = Panel(shellview.LegendColors)  # disabled
rgb = ColourRGB(Alpha=number_slider_11, Red=python_2.red, Green=python_2.green, Blue=python_2.blue)  # disabled
demesh_2 = DeconstructMesh(Mesh=disassemble.Mesh)  # -> Vertices, graft(Faces), Colours, Normals; disabled
panel_3 = Panel(demesh.Colours)  # disabled
python_3 = GhPythonScript(colors=demesh.Colours)  # -> red, green, blue; inputs colors: list; disabled
# ---------- python_3: Python ----------
red = []
green = [0 for _ in colors]
blue = []
for color in colors:
    if color[0] == 255:
        red.append(0)
        blue.append(255)
    elif color[2] == 255:
        red.append(255)
        blue.append(0)
    else:
        print(error)
        red.append(255)
        blue.append(255)
# ---------- end python_3 ----------
number_slider_12 = Slider(255, range=0..1000)  # disabled
conmesh = ConstructMesh(Vertices=demesh_2.Vertices, Faces=demesh_2.Faces)  # disabled
rgb_2 = ColourRGB(Alpha=number_slider_12, Red=python_3.red, Green=python_3.green, Blue=python_3.blue)  # disabled
pt_2 = Point(visualize.vertices_window)
mcol = MeshColours(Mesh=conmesh, Colours=graft(rgb))  # disabled
mcol_2 = MeshColours(Mesh=visualize.rhmesh, Colours=swatch)
mcol_3 = MeshColours(Mesh=mesh_2, Colours=rgb_2)  # disabled
list_2 = ValueList({"nx", "ny", "nxy"}, selected="nx")
python_4 = GhPythonScript(wall=undulate, nx=s_forces.Nxx_kN_m, ny=s_forces.Nyy_kN_m, nxy=s_forces.Nxy_kN_m, force=list_2, show_forces=Toggle(True))  # -> faces_tension, faces_compression; inputs nx: list, ny: list, nxy: list
# ---------- python_4: Python ----------
from compas_ghpython.artists import MeshArtist
from compas.colors import Color
import Rhino.Geometry as rg
red = Color(1, 0, 0)
blue = Color(0, 0, 1)

force_dict = {
"nx": nx,
"ny": ny,
"nxy": nxy,
}
print(force, force_dict[force])
wall.zones(force_dict[force])
if show_forces:
    artist = MeshArtist(wall.mesh)
    tension = []
    compression = []
    for face in wall.mesh.faces():
        gp = wall.mesh.face_attribute(face, name="tension")
        if gp: tension.append(face)
        else: compression.append(face)
    if len(tension): faces_tension = artist.draw_faces(faces=tension, color=red, join_faces=True)
    if len(compression): faces_compression = artist.draw_faces(faces=compression, color=blue, join_faces=True)
# ---------- end python_4 ----------
# red = x
# green = y
# blue = z
modelview_2 = ModelViewKaramba3D(Model=s_forces.AnalyzedModel, ResultFactors=1, ResultCase=-1)  # -> Model, DeformedMesh, DeformedAxes, DeformedModel
mcol_4 = MeshColours(Mesh=python_4.faces_tension, Colours=ColourSwatch(SwatchColor=RGB(255, 0, 0)))
mcol_5 = MeshColours(Mesh=python_4.faces_compression, Colours=ColourSwatch(SwatchColor=RGB(0, 115, 255)))

# ----
# FABRICATION
list_3 = ValueList({"1:10": 0.1, "1:5": 0.2}, selected="1:10")
div_len = GhPythonScript(scalefactor=list_3)  # -> out, max_layer_height, avg_layer_height, min_layer_height
# ---------- div_len: Python ----------
max_layer_height = 0.0065 / scalefactor
avg_layer_height = 0.0045 / scalefactor
min_layer_height = 0.0030 / scalefactor
print (avg_layer_height)
# ---------- end div_len ----------
print_path_generation = GhPythonScript(
    max_layer_height=div_len.max_layer_height,
    avg_layer_height=div_len.avg_layer_height,
    min_layer_height=div_len.min_layer_height,
    angle_constraint="25",
    wall=undulate,
    rhmesh=visualize.rhmesh,
    blend_layers="25")  # -> out, pts_gate_left, pts_wall_left, pts_gate_right, pts_wall_right, test_lines, crvs_region_center, crvs_region_top, crvs_bottom, crvs_region_bottom; inputs blend_layers: Int32
# ---------- print_path_generation: Python ----------
import Rhino.Geometry as rg
import ghpythonlib.components as ghcomp
import math


class BlendFunction():
    def __init__(self, func_type, count, blend_layers=0):
        self.count = count
        self.blend_layers = int(min(blend_layers, count/2))
        self.func_type = func_type
        self.blend_type = {
            "linear" : self.blend_linear,
            "cosine" : self.blend_cosine
        }
    
    def get_value(self, value):
        return self.blend_type[self.func_type](value)
    
    def blend_cosine(self, value):
        if self.blend_layers != 0:
            if value <= self.blend_layers:
                step = (math.pi/self.blend_layers)*value
            elif value >= self.count-self.blend_layers:
                step = math.pi + (math.pi/self.blend_layers)*(value-(self.count-self.blend_layers))
            else:
                step = math.pi
        else:
            step = (2*math.pi/self.blend_layers)*value
        blendfactor = (math.cos(math.pi+step)+1)/2
        return blendfactor

    def blend_linear(self, value):
        blendfactor = (1/self.count)*value
        return blendfactor

def generate_crvs(planes_left, planes_right, region="middle", dir="left", angle=0):
    base_tangent = rg.Vector3d(1,0,0)
    mult = 1
    if dir == "right":
        mult = -1

    tangent_start_min = mult*base_tangent
    tangent_end_min = tangent_start_min.Clone()
    
    if region=="middle":
        b_func = BlendFunction("linear", len(planes_left), blend_layers)
        tangent_start_min.Rotate(math.radians(mult*15), rg.Vector3d.YAxis)
        tangent_end_min.Rotate(math.radians(-mult*15), rg.Vector3d.YAxis)
    elif region=="top":
        b_func = BlendFunction("linear", len(planes_left), blend_layers)
        tangent_start_min.Rotate(math.radians(-mult*angle_constraint), rg.Vector3d.YAxis)
    elif region == "bottom":
        tangent_start_min.Rotate(math.radians(mult*angle), rg.Vector3d.YAxis)
        tangent_end_min.Rotate(math.radians(mult*angle), rg.Vector3d.YAxis)
        
    crvs = []
    
    for i in range(len(planes_left)):
        plane_left = planes_left[i]
        plane_right = planes_right[i]
        
        vertices = [plane_left.Origin, plane_right.Origin]
        
        normal = mult*plane_left.XAxis
        i_normal = mult*plane_right.XAxis
        
        if region=="middle":
            factor = b_func.get_value(i)
            if i<len(planes_left)/3:
                factor = factor*3
                tangent_start = factor*tangent_start_min + (1-factor)*mult*base_tangent
                tangent_end = factor*tangent_end_min + (1-factor)*mult*base_tangent
            else:
                factor = (factor-(1/3))*3/2
                tangent_start = factor*normal + (1-factor)*tangent_start_min
                tangent_end = factor*i_normal + (1-factor)*tangent_end_min
        
        elif region=="bottom":
            tangent_start = tangent_start_min
            tangent_end = tangent_end_min
        else:
            factor = b_func.get_value(i)
            tangent_start = factor*normal + (1-factor)*tangent_start_min
            tangent_end = mult*plane_right.XAxis
        
        c, c_len, c_domain = ghcomp.Interpolatet(vertices, tangent_start, tangent_end, knotstyle=0)
        crvs.append(c)

    return crvs


def straight_lines(crv, a=0, b=0, layer_height=0.045, type="ellipse"):
    start_z = crv.PointAtStart.Z
    end_z = crv.PointAtEnd.Z
    x = [0]
    z = [0]
    distances = [0]
    i = 0
    z_i = 0
    while z_i < abs(end_z-start_z):
        z_i += layer_height
        if type=="ellipse":
            x_i = a*math.sqrt(abs(1-(pow((z_i-b)/b,2))))
        else:
            x_i = 0
        x.append(x_i)
        z.append(z_i)
        distances.append(math.sqrt(pow(x_i-x[i],2)+pow(z_i-z[i],2)))
        i += 1
    l = sum(distances)+0.25
    parameters = []
    parameter = 0
    for distance in distances:
        parameter += distance/l
        parameters.append(parameter)
    return parameters

def intersect(crv, intersection_crvs):
    intersections = []
    cut_crvs = []
    for intersection_crv in intersection_crvs:
        events = rg.Intersect.Intersection.CurveCurve(crv, intersection_crv, 0.01, 0.01)
        for event in events:
            intersections.append(event.PointA.X-crv.PointAtStart.X)
    if len(intersections) == 1:
        left_crv = crv.LengthParameter(intersections[0])[1]
        if left_crv < 0.005:
            return []
        return [crv.Split(left_crv)[0]]
    elif len(intersections) == 0:
        return [crv]
    intersections.sort(reverse=True)
    
    if len(intersections) % 2 !=0:
        intersections = [0] + intersections
    else:
        right_crv = crv.LengthParameter(intersections[0])[1]
        cut_crvs.append(crv.Split(right_crv)[1])
    left_crv = crv.LengthParameter(intersections[-1])[1]
    for i in range(1, len(intersections)-2, 2):
        if abs(intersections[i] - intersections[i+1]) > 0.05:
            parameter_l = crv.LengthParameter(intersections[i])[1]
            cut_crv = crv.Split(parameter_l)[0]
            parameter_r = crv.LengthParameter(intersections[i+1])[1]
            cut_crvs.append(cut_crv.Split(parameter_r)[1])
        else:
            pass
    cut_crvs.append(crv.Split(left_crv)[0])
    return cut_crvs[::-1]

def intersect_top(crv, intersection_crvs):
    intersections = []
    cut_crvs = []
    for intersection_crv in intersection_crvs:
        events = rg.Intersect.Intersection.CurveCurve(crv, intersection_crv, 0.1, 0.1)
        for event in events:
            intersections.append(event.PointA.X-crv.PointAtStart.X)
    intersections.sort(reverse=True)
    
    for i in range(0, len(intersections)-1, 2):
        if abs(intersections[i] - intersections[i+1]) > 0.05:
            parameter_r = crv.LengthParameter(intersections[i])[1]
            cut_crv = crv.Split(parameter_r)[0]
            parameter_l = crv.LengthParameter(intersections[i+1])[1]
            cut_crvs.append(cut_crv.Split(parameter_l)[1])
        else:
            pass
    return cut_crvs[::-1]


test = False
rib_line_left = []
rib_line_right = []
x_min = wall.width
z_min = wall.height
x_max = 0
z_max = 0
for vertex in wall.mesh.vertices():
    x = wall.mesh.vertex_attribute(vertex, name="x")
    z = wall.mesh.vertex_attribute(vertex, name="z")
    if x <= x_min and z <= z_min:
        x_min = x
        z_min = z
        start_left = vertex
    if x <= x_min and z >= z_max:
        x_min = x
        z_max = z
        end_left = vertex
    if x >= x_max and z <= z_min:
        x_max = x
        z_min = z
        start_right = vertex
    if x <= x_max and z >= z_max:
        x_max = x
        z_max = z
        end_right = vertex

print(start_left, end_left, start_right, end_right)

edges = ghcomp.MeshEdges(rhmesh)
print(edges)



crvs_region_bottom = []
crvs_bottom = []

tsl = crv_wall_left.DivideByLength(avg_layer_height/math.cos(25), True)
tsr = crv_wall_right.DivideByLength(avg_layer_height/math.cos(25), True)
planes_wall_left_bottom = [crv_wall_left.PerpendicularFrameAt(t)[1] for t in tsl[:len(tsr)]]
planes_wall_right_bottom = [crv_wall_right.PerpendicularFrameAt(t)[1] for t in tsr[:len(tsl)]]

crvs_bottom = generate_crvs(planes_wall_left_bottom, planes_wall_right_bottom, region="bottom", angle=0)

crvs_borders_bottom = []

for i in range(4):
    crvs_borders_bottom += [crv_gate_left[i], crv_gate_right[i]]


window_two_left = crv_gate_left[1].Split(crv_gate_left[1].NormalizedLengthParameter(0.5)[1])[0]
line_two_left = rg.Line(rg.Point3d(wall.windows[1].x-wall.windows[1].a, 0, wall.windows[1].z), rg.Point3d(wall.windows[0].x+wall.windows[0].a, 0, wall.windows[0].z))
#crvs_borders_bottom.append(ghcomp.JoinCurves(curves=[window_two_left, line_two_left], preserve=False))
window_two_right = crv_gate_right[1].Split(crv_gate_right[1].NormalizedLengthParameter(0.5)[1])[0]
line_two_right = rg.Line(rg.Point3d(wall.windows[1].x+wall.windows[1].a, 0, wall.windows[1].z), rg.Point3d(wall.windows[2].x-wall.windows[2].a, 0, wall.windows[2].z))
#crvs_borders_bottom.append(ghcomp.JoinCurves(curves=[window_two_right, line_two_right], preserve=False))

#crvs_borders_bottom.append(crv_gate_left[2].Split(crv_gate_left[2].NormalizedLengthParameter(0.501)[1])[0])
#crvs_borders_bottom.append(crv_gate_right[2].Split(crv_gate_right[2].NormalizedLengthParameter(0.501)[1])[0])

window_four_left = crv_gate_left[3].Split(crv_gate_left[3].NormalizedLengthParameter(0.5)[1])[0]
line_four_left = rg.Line(rg.Point3d(wall.windows[3].x-wall.windows[3].a, 0, wall.windows[3].z), rg.Point3d(wall.windows[2].x+wall.windows[2].a, 0, wall.windows[2].z+0.01))
#crvs_borders_bottom.append(ghcomp.JoinCurves(curves=[window_four_left, line_four_left], preserve=False))
window_four_right = crv_gate_right[3].Split(crv_gate_right[3].NormalizedLengthParameter(0.6)[1])[0]
line_four_right = rg.LineCurve(window_four_right.PointAtEnd, rg.Point3d(wall.width, 0, wall.windows[3].z+0.6))
#crvs_borders_bottom.append(ghcomp.JoinCurves(curves=[window_four_right, line_four_right], preserve=False))


planes = []
for crv_bottom in crvs_bottom:
    planes += intersect(crv_bottom, crvs_borders_bottom)

intersection_crvs = []
for i in range(len(rib_line_left)):
    intersection_crvs.append(rib_line_left[i])
    intersection_crvs.append(rib_line_right[i])

for crv in planes:
    intersections = []
    for intersection_crv in intersection_crvs:
        events = rg.Intersect.Intersection.CurveCurve(crv, intersection_crv, 0.01, 0.01)
        for event in events:
            intersections.append(event.PointA)
    if intersections:
        crvs_region_bottom.append(crv.Split(crv.ClosestPoint(intersections[0])[1])[0])
        if len(intersections) > 2:
            for i in range(1, len(intersections)-1, 2):
                if crv.ClosestPoint(intersections[i+1])[1] != 0.0:
                    crv_to_split = crv.Split(crv.ClosestPoint(intersections[i+1])[1])[0]
                if crv.ClosestPoint(intersections[i])[1] != 0.0:
                    crvs_region_bottom.append(crv_to_split.Split(crv.ClosestPoint(intersections[i])[1])[1])
        last_crv = crv.Split(crv.ClosestPoint(intersections[-1])[1])
        if last_crv:
            crvs_region_bottom.append(last_crv[1])
    else:
        crvs_region_bottom.append(crv)


bottom_height = min(crv_wall_left.PointAtEnd.Z, crv_wall_right.PointAtEnd.Z)


# center part
crvs_region_center = []
top_border = []

line = [rg.LineCurve(rg.Point3d(-0.9, crv_gate_left[0].PointAtEnd.Y, bottom_height+avg_layer_height), rg.Point3d(-0.9, crv_gate_left[0].PointAtEnd.Y, crv_gate_left[0].PointAtEnd.Z))]
for crv in crv_gate_left:
    point = crv.PointAtEnd
    line.append(rg.LineCurve(rg.Point3d(point.X, point.Y, bottom_height+avg_layer_height*0.5), point))
line.append(rg.LineCurve(rg.Point3d(wall.width-0.9, crv_gate_left[-1].PointAtEnd.Y, bottom_height+avg_layer_height), rg.Point3d(wall.width-0.9, crv_gate_left[-1].PointAtEnd.Y, crv_gate_left[-1].PointAtEnd.Z)))

intersections = [crv_wall_left]
for i in range(4):
    intersections += [crv_gate_left[i], crv_gate_right[i]]
intersections.append(crv_wall_top.Split(1.6)[1])

for i in range(len(line)-1):
    tsl = line[i].DivideByLength(avg_layer_height, True)[:-3]
    tsr = line[i+1].DivideByLength(avg_layer_height, True)[:-3]
    planes_wall_left_centre = [line[i].PerpendicularFrameAt(t)[1] for t in tsl[:len(tsr)]]
    planes_wall_right_centre = [line[i+1].PerpendicularFrameAt(t)[1] for t in tsr[:len(tsl)]]
    
    for crv in  generate_crvs(planes_wall_left_centre, planes_wall_right_centre, region="bottom", angle=0):
        crvs_region_center += intersect_top(crv, intersections)
    top_border.append(crvs_region_center[-1])


wall_left = crv_wall_left
line_one_right = rg.LineCurve(rg.Point3d(wall.windows[0].x-wall.windows[0].a+0.2, 0, wall.windows[0].z+0.23), rg.Point3d(-0.5, 0, wall.windows[0].z+0.82))
events = rg.Intersect.Intersection.CurveCurve(wall_left, line_one_right, 0.1, 0.1)
for event in events:
    intersection = event.PointA
line_one_right = line_one_right.Split(line_one_right.ClosestPoint(intersection)[1])[0]
events = rg.Intersect.Intersection.CurveCurve(crv_gate_left[0], line_one_right, 0.1, 0.1)
for event in events:
    intersection = event.PointA
line_one_right = line_one_right.Split(line_one_right.ClosestPoint(intersection)[1])[1]


def intersect_angled(crvs, intersections, negative_slope=True):
    cut_crvs = []
    if not negative_slope:
        intersections = intersections[::-1]
    for crv in crvs:
        event_r = rg.Intersect.Intersection.CurveCurve(crv, intersections[1], 0.1, 0.1)
        event_l = rg.Intersect.Intersection.CurveCurve(crv, intersections[0], 0.1, 0.1)
        if event_r and event_l:
            for event in event_r:
                inter_r = crv.ClosestPoint(event.PointA)[1]
            for event in event_l:
                inter_l = crv.ClosestPoint(event.PointA)[1]
            if inter_r >= 1.0:
                cut_crvs.append(crv.Split(inter_l)[1])
            elif inter_l <= 0.0:
                cut_crvs.append(crv.Split(inter_r)[0])
            elif inter_r > inter_l:
                cut_crvs.append(crv.Split(inter_r)[0].Split(inter_l)[1])
    return cut_crvs


# top part
region_top = []
top_borders = []

# first left
line_in = rg.LineCurve(crv_gate_left[0].PointAtEnd, rg.Point3d(crv_gate_left[0].PointAtEnd.X-math.tan(30*math.pi/180), crv_gate_left[0].PointAtEnd.Y, crv_gate_left[0].PointAtEnd.Z-1))
line_out = rg.LineCurve(rg.Point3d(line_in.PointAtStart.X-1, line_in.PointAtStart.Y, line_in.PointAtStart.Z+math.tan(30*math.pi/180)), rg.Point3d(line_in.PointAtEnd.X-1, line_in.PointAtEnd.Y, line_in.PointAtEnd.Z+math.tan(30*math.pi/180)))
tsl = line_out.DivideByLength(avg_layer_height, True)[:14]
tsr = line_in.DivideByLength(avg_layer_height, True)
planes_left = [line_out.PerpendicularFrameAt(t)[1] for t in tsl[:len(tsr)]]
planes_right = [line_in.PerpendicularFrameAt(t)[1] for t in tsr[:len(tsl)]]
intersections = [crv_wall_top]
intersections.append(ghcomp.JoinCurves(curves=[top_border[0], crv_gate_left[0].Split(crv_gate_left[0].ClosestPoint(top_border[0].PointAtEnd)[1])[1]], preserve=False))

region_top.append(intersect_angled(generate_crvs(planes_left, planes_right, region="bottom", angle=30)[::-1], intersections, True))
top_borders.append(ghcomp.JoinCurves(curves=[rg.LineCurve(crv_gate_top[0].PointAtStart, region_top[-1][-1].PointAtStart), crv_wall_top.Split(crv_wall_top.ClosestPoint(crv_gate_top[0].PointAtEnd)[1])[0].Split(crv_wall_top.ClosestPoint(region_top[-1][-1].PointAtStart)[1])[1]], preserve=False))


# first right
line_in = rg.LineCurve(crv_gate_right[0].PointAtEnd, rg.Point3d(crv_gate_right[0].PointAtEnd.X+1.25*math.tan(30*math.pi/180), crv_gate_right[0].PointAtEnd.Y, crv_gate_right[0].PointAtEnd.Z-1.25))
line_out = rg.LineCurve(rg.Point3d(line_in.PointAtStart.X+1, line_in.PointAtStart.Y, line_in.PointAtStart.Z+math.tan(30*math.pi/180)), rg.Point3d(line_in.PointAtEnd.X+1, line_in.PointAtEnd.Y, line_in.PointAtEnd.Z+math.tan(30*math.pi/180)))
tsl = line_out.DivideByLength(avg_layer_height, True)[:]
tsr = line_in.DivideByLength(avg_layer_height, True)
planes_right = [line_out.PerpendicularFrameAt(t)[1] for t in tsl[:len(tsr)]]
planes_left = [line_in.PerpendicularFrameAt(t)[1] for t in tsr[:len(tsl)]]

events = rg.Intersect.Intersection.CurveCurve(crv_wall_top, rib_line[0], 0.01, 0.01)
for event in events:
    intersection = event.PointA

intersections = [ghcomp.JoinCurves(curves=[crv_wall_top.Split(crv_wall_top.ClosestPoint(intersection)[1])[0], rib_line[0].Split(rib_line[0].ClosestPoint(intersection)[1])[0]], preserve=False)]
intersections.append(ghcomp.JoinCurves(curves=[top_border[1], crv_gate_right[0].Split(crv_gate_right[0].ClosestPoint(top_border[1].PointAtStart)[1])[1]], preserve=False))

region_top.append(intersect_angled(generate_crvs(planes_left, planes_right, region="bottom", angle=-30)[::-1], intersections, False))
top_borders.append(ghcomp.JoinCurves(curves=[rg.LineCurve(crv_gate_top[0].PointAtStart, region_top[-1][-1].PointAtEnd), crv_wall_top.Split(crv_wall_top.ClosestPoint(region_top[-1][-1].PointAtEnd)[1])[0].Split(crv_wall_top.ClosestPoint(crv_gate_top[0].PointAtEnd)[1])[1]], preserve=False))


# second left
line_in = rg.LineCurve(crv_gate_left[1].PointAtEnd, rg.Point3d(crv_gate_left[1].PointAtEnd.X-math.tan(30*math.pi/180), crv_gate_left[1].PointAtEnd.Y, crv_gate_left[1].PointAtEnd.Z-1))
line_out = rg.LineCurve(rg.Point3d(line_in.PointAtStart.X-1, line_in.PointAtStart.Y, line_in.PointAtStart.Z+math.tan(30*math.pi/180)), rg.Point3d(line_in.PointAtEnd.X-1, line_in.PointAtEnd.Y, line_in.PointAtEnd.Z+math.tan(30*math.pi/180)))
tsl = line_out.DivideByLength(avg_layer_height, True)[:]
tsr = line_in.DivideByLength(avg_layer_height, True)
planes_left = [line_out.PerpendicularFrameAt(t)[1] for t in tsl[:len(tsr)]]
planes_right = [line_in.PerpendicularFrameAt(t)[1] for t in tsr[:len(tsl)]]
intersections = [ghcomp.JoinCurves(curves=[crv_wall_top.Split(crv_wall_top.ClosestPoint(intersection)[1])[1], rib_line[0].Split(rib_line[0].ClosestPoint(intersection)[1])[0]], preserve=False)]
intersections.append(ghcomp.JoinCurves(curves=[top_border[1], crv_gate_left[1].Split(crv_gate_left[1].ClosestPoint(top_border[1].PointAtEnd)[1])[1]], preserve=False))

region_top.append(intersect_angled(generate_crvs(planes_left, planes_right, region="bottom", angle=30)[::-1], intersections, True))
top_borders.append(ghcomp.JoinCurves(curves=[rg.LineCurve(crv_gate_top[1].PointAtStart, region_top[-1][-1].PointAtStart), crv_wall_top.Split(crv_wall_top.ClosestPoint(crv_gate_top[1].PointAtEnd)[1])[0].Split(crv_wall_top.ClosestPoint(region_top[-1][-1].PointAtStart)[1])[1]], preserve=False))


# second right
line_in = rg.LineCurve(crv_gate_right[1].PointAtEnd, rg.Point3d(crv_gate_right[1].PointAtEnd.X+1.25*math.tan(30*math.pi/180), crv_gate_right[1].PointAtEnd.Y, crv_gate_right[1].PointAtEnd.Z-1.25))
line_out = rg.LineCurve(rg.Point3d(line_in.PointAtStart.X+1, line_in.PointAtStart.Y, line_in.PointAtStart.Z+math.tan(30*math.pi/180)), rg.Point3d(line_in.PointAtEnd.X+1, line_in.PointAtEnd.Y, line_in.PointAtEnd.Z+math.tan(30*math.pi/180)))
tsl = line_out.DivideByLength(avg_layer_height, True)[:]
tsr = line_in.DivideByLength(avg_layer_height, True)
planes_right = [line_out.PerpendicularFrameAt(t)[1] for t in tsl[:len(tsr)]]
planes_left = [line_in.PerpendicularFrameAt(t)[1] for t in tsr[:len(tsl)]]

events = rg.Intersect.Intersection.CurveCurve(crv_wall_top, rib_line[1], 0.01, 0.01)
for event in events:
    intersection = event.PointA

intersections = [ghcomp.JoinCurves(curves=[crv_wall_top.Split(crv_wall_top.ClosestPoint(intersection)[1])[0], rib_line[1].Split(rib_line[1].ClosestPoint(intersection)[1])[0]], preserve=False)]
intersections.append(ghcomp.JoinCurves(curves=[top_border[2], crv_gate_right[1].Split(crv_gate_right[1].ClosestPoint(top_border[2].PointAtStart)[1])[1]], preserve=False))

region_top.append(intersect_angled(generate_crvs(planes_left, planes_right, region="bottom", angle=-30)[::-1], intersections, False))
top_borders.append(ghcomp.JoinCurves(curves=[rg.LineCurve(crv_gate_top[1].PointAtStart, region_top[-1][-1].PointAtEnd), crv_wall_top.Split(crv_wall_top.ClosestPoint(region_top[-1][-1].PointAtEnd)[1])[0].Split(crv_wall_top.ClosestPoint(crv_gate_top[1].PointAtEnd)[1])[1]], preserve=False))


# third left
line_in = rg.LineCurve(crv_gate_left[2].PointAtEnd, rg.Point3d(crv_gate_left[2].PointAtEnd.X-math.tan(30*math.pi/180), crv_gate_left[2].PointAtEnd.Y, crv_gate_left[2].PointAtEnd.Z-1))
line_out = rg.LineCurve(rg.Point3d(line_in.PointAtStart.X-1, line_in.PointAtStart.Y, line_in.PointAtStart.Z+math.tan(30*math.pi/180)), rg.Point3d(line_in.PointAtEnd.X-1, line_in.PointAtEnd.Y, line_in.PointAtEnd.Z+math.tan(30*math.pi/180)))
tsl = line_out.DivideByLength(avg_layer_height, True)[:]
tsr = line_in.DivideByLength(avg_layer_height, True)
planes_left = [line_out.PerpendicularFrameAt(t)[1] for t in tsl[:len(tsr)]]
planes_right = [line_in.PerpendicularFrameAt(t)[1] for t in tsr[:len(tsl)]]
intersections = [ghcomp.JoinCurves(curves=[crv_wall_top.Split(crv_wall_top.ClosestPoint(intersection)[1])[1], rib_line[1].Split(rib_line[1].ClosestPoint(intersection)[1])[0]], preserve=False)]
intersections.append(ghcomp.JoinCurves(curves=[top_border[2], crv_gate_left[2].Split(crv_gate_left[2].ClosestPoint(top_border[2].PointAtEnd)[1])[1]], preserve=False))

region_top.append(intersect_angled(generate_crvs(planes_left, planes_right, region="bottom", angle=30)[::-1], intersections, True))
top_borders.append(ghcomp.JoinCurves(curves=[rg.LineCurve(crv_gate_top[2].PointAtStart, region_top[-1][-1].PointAtStart), crv_wall_top.Split(crv_wall_top.ClosestPoint(crv_gate_top[2].PointAtEnd)[1])[0].Split(crv_wall_top.ClosestPoint(region_top[-1][-1].PointAtStart)[1])[1]], preserve=False))


# third right
line_in = rg.LineCurve(crv_gate_right[2].PointAtEnd, rg.Point3d(crv_gate_right[2].PointAtEnd.X+1.25*math.tan(30*math.pi/180), crv_gate_right[2].PointAtEnd.Y, crv_gate_right[2].PointAtEnd.Z-1.25))
line_out = rg.LineCurve(rg.Point3d(line_in.PointAtStart.X+1, line_in.PointAtStart.Y, line_in.PointAtStart.Z+math.tan(30*math.pi/180)), rg.Point3d(line_in.PointAtEnd.X+1, line_in.PointAtEnd.Y, line_in.PointAtEnd.Z+math.tan(30*math.pi/180)))
tsl = line_out.DivideByLength(avg_layer_height, True)[:]
tsr = line_in.DivideByLength(avg_layer_height, True)
planes_right = [line_out.PerpendicularFrameAt(t)[1] for t in tsl[:len(tsr)]]
planes_left = [line_in.PerpendicularFrameAt(t)[1] for t in tsr[:len(tsl)]]

events = rg.Intersect.Intersection.CurveCurve(crv_wall_top, rib_line[2], 0.01, 0.01)
for event in events:
    intersection = event.PointA

intersections = [ghcomp.JoinCurves(curves=[crv_wall_top.Split(crv_wall_top.ClosestPoint(intersection)[1])[0], rib_line[2].Split(rib_line[2].ClosestPoint(intersection)[1])[0]], preserve=False)]
intersections.append(ghcomp.JoinCurves(curves=[top_border[3], crv_gate_right[2].Split(crv_gate_right[2].ClosestPoint(top_border[3].PointAtStart)[1])[1]], preserve=False))

region_top.append(intersect_angled(generate_crvs(planes_left, planes_right, region="bottom", angle=-30)[::-1], intersections, False))
top_borders.append(ghcomp.JoinCurves(curves=[rg.LineCurve(crv_gate_top[2].PointAtStart, region_top[-1][-1].PointAtEnd), crv_wall_top.Split(crv_wall_top.ClosestPoint(region_top[-1][-1].PointAtEnd)[1])[0].Split(crv_wall_top.ClosestPoint(crv_gate_top[2].PointAtEnd)[1])[1]], preserve=False))


# third left
line_in = rg.LineCurve(crv_gate_left[3].PointAtEnd, rg.Point3d(crv_gate_left[3].PointAtEnd.X-math.tan(30*math.pi/180), crv_gate_left[3].PointAtEnd.Y, crv_gate_left[3].PointAtEnd.Z-1))
line_out = rg.LineCurve(rg.Point3d(line_in.PointAtStart.X-1, line_in.PointAtStart.Y, line_in.PointAtStart.Z+math.tan(30*math.pi/180)), rg.Point3d(line_in.PointAtEnd.X-1, line_in.PointAtEnd.Y, line_in.PointAtEnd.Z+math.tan(30*math.pi/180)))
tsl = line_out.DivideByLength(avg_layer_height, True)[:]
tsr = line_in.DivideByLength(avg_layer_height, True)
planes_left = [line_out.PerpendicularFrameAt(t)[1] for t in tsl[:len(tsr)]]
planes_right = [line_in.PerpendicularFrameAt(t)[1] for t in tsr[:len(tsl)]]
intersections = [ghcomp.JoinCurves(curves=[crv_wall_top.Split(crv_wall_top.ClosestPoint(intersection)[1])[1], rib_line[2].Split(rib_line[2].ClosestPoint(intersection)[1])[0]], preserve=False)]
intersections.append(ghcomp.JoinCurves(curves=[top_border[3], crv_gate_left[3].Split(crv_gate_left[3].ClosestPoint(top_border[3].PointAtEnd)[1])[1]], preserve=False))

region_top.append(intersect_angled(generate_crvs(planes_left, planes_right, region="bottom", angle=30)[::-1], intersections, True))
top_borders.append(ghcomp.JoinCurves(curves=[rg.LineCurve(crv_gate_top[3].PointAtStart, region_top[-1][-1].PointAtStart), crv_wall_top.Split(crv_wall_top.ClosestPoint(crv_gate_top[3].PointAtEnd)[1])[0].Split(crv_wall_top.ClosestPoint(region_top[-1][-1].PointAtStart)[1])[1]], preserve=False))


# third right
line_in = rg.LineCurve(crv_gate_right[3].PointAtEnd, rg.Point3d(crv_gate_right[3].PointAtEnd.X+1.25*math.tan(30*math.pi/180), crv_gate_right[3].PointAtEnd.Y, crv_gate_right[3].PointAtEnd.Z-1.25))
line_out = rg.LineCurve(rg.Point3d(line_in.PointAtStart.X+1, line_in.PointAtStart.Y, line_in.PointAtStart.Z+math.tan(30*math.pi/180)), rg.Point3d(line_in.PointAtEnd.X+1, line_in.PointAtEnd.Y, line_in.PointAtEnd.Z+math.tan(30*math.pi/180)))
tsl = line_out.DivideByLength(avg_layer_height, True)[:]
tsr = line_in.DivideByLength(avg_layer_height, True)
planes_right = [line_out.PerpendicularFrameAt(t)[1] for t in tsl[:len(tsr)]]
planes_left = [line_in.PerpendicularFrameAt(t)[1] for t in tsr[:len(tsl)]]


intersections = [crv_wall_top]
intersections.append(ghcomp.JoinCurves(curves=[top_border[4], crv_gate_right[3].Split(crv_gate_right[3].ClosestPoint(top_border[4].PointAtStart)[1])[1]], preserve=False))

region_top.append(intersect_angled(generate_crvs(planes_left, planes_right, region="bottom", angle=-30)[::-1], intersections, False))
top_borders.append(ghcomp.JoinCurves(curves=[rg.LineCurve(crv_gate_top[3].PointAtStart, region_top[-1][-1].PointAtEnd), crv_wall_top.Split(crv_wall_top.ClosestPoint(region_top[-1][-1].PointAtEnd)[1])[0].Split(crv_wall_top.ClosestPoint(crv_gate_top[3].PointAtEnd)[1])[1]], preserve=False))


crv_wall_left_top = rg.LineCurve(crv_wall_left.PointAtStart, rg.Point3d(crv_wall_left.PointAtStart.X, 0, wall.height))
crv_wall_right_top = rg.LineCurve(crv_wall_right.PointAtStart, rg.Point3d(crv_wall_right.PointAtStart.X, 0, wall.height))

tsl = crv_wall_left_top.DivideByLength(avg_layer_height, True)
tsr = crv_wall_right_top.DivideByLength(avg_layer_height, True)
planes_wall_left_bottom = [crv_wall_left_top.PerpendicularFrameAt(t)[1] for t in tsl[:len(tsr)]]
planes_wall_right_bottom = [crv_wall_right_top.PerpendicularFrameAt(t)[1] for t in tsr[:len(tsl)]]

crvs_top = generate_crvs(planes_wall_left_bottom, planes_wall_right_bottom, region="bottom")

crvs_triangle_top = []
for crv_top in crvs_top:
    crvs_triangle_top += intersect_top(crv_top, top_borders)

crvs_region_top = []
triangles = []
for i in range(0, 8, 2):
    crvs_region_top += region_top[i] + region_top[i+1]
    for crv in crvs_triangle_top:
        if i == 6 and rib_line[(i//2)-1].PointAtEnd.X < crv.PointAtEnd.X:
            triangles.append(crv)
        elif i == 0 and crv.PointAtEnd.X < rib_line[i//2].PointAtEnd.X:
            triangles.append(crv)
        elif rib_line[(i//2)-1].PointAtEnd.X < crv.PointAtEnd.X < rib_line[i//2].PointAtEnd.X:
            triangles.append(crv)
crvs_region_top += triangles

crvs_bottom = []
for i in range(8):
    for crv in crvs_region_bottom + crvs_region_center:
        if i == 0 and crv.PointAtEnd.Z < wall.windows[1].z-wall.windows[1].b:
            crvs_bottom.append(crv)
        elif i == 1 and crv.PointAtEnd.Z < wall.windows[0].z-wall.windows[0].b and crv.PointAtEnd.X < wall.windows[1].x:
            crvs_bottom.append(crv)
        elif i == 2 and crv.PointAtEnd.Z < wall.windows[2].z-wall.windows[2].b and wall.windows[1].x < crv.PointAtEnd.X < wall.windows[3].x:
            crvs_bottom.append(crv)
        elif i == 3 and crv.PointAtEnd.Z >= wall.windows[0].z-wall.windows[0].b and crv.PointAtEnd.X < wall.windows[0].x:
            crvs_bottom.append(crv)
        elif i == 4 and crv.PointAtEnd.Z >= wall.windows[0].z-wall.windows[0].b and wall.windows[0].x < crv.PointAtEnd.X < wall.windows[1].x:
            crvs_bottom.append(crv)
        elif i == 5 and crv.PointAtEnd.Z >= wall.windows[2].z-wall.windows[2].b and wall.windows[1].x < crv.PointAtEnd.X < wall.windows[2].x:
            crvs_bottom.append(crv)
        elif i == 6 and crv.PointAtEnd.Z >= wall.windows[2].z-wall.windows[2].b and wall.windows[2].x < crv.PointAtEnd.X < wall.windows[3].x:
            crvs_bottom.append(crv)
        elif i == 7 and crv.PointAtEnd.Z >= wall.windows[3].z-wall.windows[3].b and wall.windows[3].x < crv.PointAtEnd.X:
            crvs_bottom.append(crv)
# ---------- end print_path_generation ----------
crv = Curve(print_path_generation.test_lines)
Y = UnitY(Factor=1)
pt_3 = Point(print_path_generation.pts_gate_left)
pt_4 = Point(print_path_generation.pts_gate_right)
pt_5 = Point(print_path_generation.pts_wall_right)
pt_6 = Point(print_path_generation.pts_wall_left)
crv_2 = Curve(print_path_generation.crvs_region_center)
crv_3 = Curve(print_path_generation.crvs_bottom)
crv_4 = Curve(print_path_generation.crvs_region_bottom)
crv_5 = Curve(print_path_generation.crvs_region_top)
projecttomesh = CSharpScript(Curve=[crv_5, crv_3], Direction=Y)  # -> out, A; inputs Curve: Curve, Mesh: Mesh, Direction: Vector3d
# ---------- projecttomesh: C# usings ----------
using System.IO;
using System.Linq;
using System.Data;
using System.Drawing;
using System.Reflection;
using System.Windows.Forms;
using System.Xml;
using System.Xml.Linq;
using System.Runtime.InteropServices;

using Rhino.DocObjects;
using Rhino.Collections;
using GH_IO;
using GH_IO.Serialization;
# ---------- projecttomesh: C# ----------
    if (null != Curve && null != Mesh && Direction.IsValid)
    {
      var tol = RhinoDoc.ActiveDoc.ModelAbsoluteTolerance;
      A = Curve.ProjectToMesh(Curve, Mesh, Direction, tol);
    }
# ---------- end projecttomesh ----------

medges = MeshEdges(Mesh=visualize.rhmesh)  # -> NakedEdges, InteriorEdges, NonManifoldEdges
addition = Addition(A=number_slider_6, B=number_slider_4)
edges = GhPythonScript(
    edges=medges.NakedEdges,
    wall_left=number_slider_6,
    wall_right=addition,
    window_left=number_slider_7,
    window_right=number_slider_8)  # -> left, right, win_left, win_right; inputs edges: list of Curve
# ---------- edges: Python ----------
import Rhino.Geometry as rg
import ghpythonlib.components as ghcomp
import math

#ghcomp.JoinCurves(curves=[], preserve=False)
left = []
right = []
win_left = []
win_right = []
for edge in edges:
    if edge.PointAtStart.X == edge.PointAtEnd.X:
        if edge.PointAtStart.X == wall_left:
            left.append(edge)
        if edge.PointAtStart.X == wall_right:
            right.append(edge)
        if edge.PointAtStart.X == window_left:
            win_left.append(edge)
        if edge.PointAtStart.X == window_right:
            win_right.append(edge)


left = ghcomp.JoinCurves(curves=left, preserve=False)
right = ghcomp.JoinCurves(curves=right, preserve=False)
win_left = ghcomp.JoinCurves(curves=win_left, preserve=False)
win_right = ghcomp.JoinCurves(curves=win_right, preserve=False)
# ---------- end edges ----------
list_4 = ValueList({"1:10": 0.1, "1:5": 0.2}, selected="1:10")
div_len_2 = GhPythonScript(scalefactor=list_4)  # -> out, max_layer_height, avg_layer_height, min_layer_height; same code as div_len
print_path_generation_2 = GhPythonScript(
    max_layer_height=div_len_2.max_layer_height,
    avg_layer_height=div_len_2.avg_layer_height,
    min_layer_height=div_len_2.min_layer_height,
    angle_constraint="25",
    wall=undulate,
    rhmesh=visualize.rhmesh,
    wall_left=edges.left,
    wall_right=edges.right,
    win_left=edges.win_left,
    win_right=edges.win_right,
    blend_layers="25")  # -> crvs, planes; inputs wall_left: Curve, wall_right: Curve, win_left: Curve, win_right: Curve, blend_layers: Int32
# ---------- print_path_generation_2: Python ----------
import Rhino.Geometry as rg
import ghpythonlib.components as ghcomp
import math


def tangents(region, dir, angle, start, end):
    if region == "bottom":
        start.Rotate(math.radians(dir*angle), rg.Vector3d.YAxis)
        end.Rotate(math.radians(dir*angle), rg.Vector3d.YAxis)
    return start, end


def generate_planes(wall_left, wall_right):
    tsl = wall_left.DivideByLength(avg_layer_height, True)
    tsr = wall_right.DivideByLength(avg_layer_height, True)
    ts = tsl if len(tsl)<=len(tsr) else tsr
    left = [wall_left.PerpendicularFrameAt(t)[1] for t in tsl[:len(ts)]]
    right = [wall_right.PerpendicularFrameAt(t)[1] for t in tsr[:len(ts)]]
    return left, right


def generate_crvs(wall_left, wall_right, region="bottom", l_to_r=True, angle=0):
    # curve left to right
    if l_to_r:
        dir = 1
    else:
        dir = -1
        
    base_tangent = rg.Vector3d(dir,0,0)
    
    # generate planes on each border in given distance
    planes_left, planes_right = generate_planes(wall_left, wall_right)
    
    # start and end tangents for straight curves
    tangent_start, tangent_end = tangents(region, dir, angle , base_tangent.Clone(), base_tangent.Clone())
    
    # interpolate between left and right planes
    crvs = []
    for i, plane_left in enumerate(planes_left):
        plane_right = planes_right[i]
        
        vertices = [plane_left.Origin, plane_right.Origin]
        
        c, c_len, c_domain = ghcomp.Interpolatet(vertices, tangent_start, tangent_end, knotstyle=0)
        crvs.append(c)

    return crvs


def split_borders(left, right, win_left, win_right):
    left_bottom, left_temp = left.Split(left.ClosestPoint(win_left.PointAtStart)[1])
    right_bottom, right_temp = right.Split(right.ClosestPoint(win_right.PointAtStart)[1])
    left_centre, left_top = left_temp.Split(left_temp.ClosestPoint(win_left.PointAtEnd)[1])
    right_centre, right_top = right_temp.Split(right_temp.ClosestPoint(win_right.PointAtEnd)[1])
    return [left_bottom, right_bottom], [left_centre, right_centre], [left_top, right_top]


bottom, centre, top = split_borders(wall_left, wall_right, win_left, win_right)

crvs_wall_bottom = generate_crvs(bottom[0], bottom[1], region="bottom", angle=0)
crvs_left = generate_crvs(centre[0], win_left, region="bottom", angle=0)
crvs_right = generate_crvs(win_right, centre[1], region="bottom", angle=0)
crvs_wall_top = generate_crvs(top[0], top[1], region="bottom", angle=0)


crvs = crvs_wall_bottom + crvs_left + crvs_right + crvs_wall_top
# ---------- end print_path_generation_2 ----------
